# Grasshopper definition selva_example_0_1_0.gh (Grasshopper 1.0.8)
# plug-ins: Selva

enable = BooleanToggle(True)
copy_up = BooleanToggle(False)
types = ValueList({"Sphere": 0, "Cylinder": 1, "Box": 2}, selected="Box")
radius = Slider(15, range=10..20)
heigth = Slider(15, range=10..20)
width = Slider(15, range=10..20)
ui_bridge = UIBridge(
    Enable=enable,
    Schema="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",
    SessionId="LtjSknEb",
    Values="{\"94193105-5909-40ea-8eaa-1fdeff65bb9b\":15,\"997ae855-b1aa-4ed5-a357-49cfeb950e3a\":\"Box\",\"43a7ba4b-b9bc-49b2-9725-4f17fcd12448\":15,\"9384d7f9-d7f4-40b7-b199-777e95c9d1dc\":false,\"03e0d624-3978-4583-8508-da129c41dc87\":15}")

copy_up_2 = GetBoolean(copy_up, AtLeast=1, AtMost=1, FalseValue="False", TreeAccess=False, TrueValue="True")
radius_2 = GetNumber(radius, AtLeast=1, AtMost=1, Maximum=1.797693135e+308, Minimum=-1.797693135e+308, TreeAccess=False)
heigth_2 = GetNumber(heigth, AtLeast=1, AtMost=1, Maximum=1.797693135e+308, Minimum=-1.797693135e+308, TreeAccess=False)
width_2 = GetNumber(width, AtLeast=1, AtMost=1, Maximum=1.797693135e+308, Minimum=-1.797693135e+308, TreeAccess=False)
types_2 = GetValueList(
    types,
    AtLeast=1,
    AtMost=1,
    Immediate=True,
    StoredItems="""[
  {
    "name": "Sphere",
    "expression": "0"
  },
  {
    "name": "Cylinder",
    "expression": "1"
  },
  {
    "name": "Box",
    "expression": "2"
  }
]""",
    TreeAccess=False)

copy_upddd = GetBoolean(copy_up, AtLeast=1, AtMost=1, FalseValue="False", TreeAccess=False, TrueValue="True")
file = ContextBake(Content=ui_bridge)
cylinder = Cylinder(Base=PlaneXY(0, 0, 0), Radius=radius_2, Length=heigth_2)
sphere = Sphere(Base=PlaneXY(0, 0, 0), Radius=radius_2)
center_box = CenterBox(Base=PlaneXY(0, 0, 0), X=radius_2, Y=heigth_2, Z=width_2)
cap_holes = CapHoles(Brep=cylinder)
stream_filter = StreamFilter(Gate=types_2, Stream0=sphere, Stream1=cap_holes, Stream2=center_box)
bounding_box = BoundingBox(Content=stream_filter, Plane=PlaneXY(0, 0, 0))  # -> Box, Box_2
deconstruct_box = DeconstructBox(Box=bounding_box.Box)  # -> Plane, X, Y, Z
unit_z = UnitZ(Factor=deconstruct_box.Z)
move = Move(Geometry=stream_filter, Motion=unit_z)  # -> Geometry, Transform
merge = Merge(Data1=stream_filter, Data2=move.Geometry)  # -> flatten(Result)
stream_filter_2 = StreamFilter(Gate=copy_up_2, Stream0=stream_filter, Stream1=merge)
three_material = ThreeMaterial(Color=RGB(255, 255, 255), Metalness=0, Roughness=0.5, Opacity=1, Transparent=False)
display = Display(Geo=stream_filter_2, TMaterial=three_material)
area = Area(Geometry=stream_filter_2, UseTasks=True)  # -> Area, Centroid
geometry_to_file = GeometryToFile(Geometry=stream_filter_2, FileNames="Test", FileEnding=".3dm")
context_bake = ContextBake(DisplayOuput=display)
file_2 = ContextBake(FileOutput=geometry_to_file)
area_2 = ContextPrint(Text=area.Area)
