# Grasshopper definition bench-solve-transport.gh (Grasshopper 1.0.9)
# plug-ins: Selva

# ---- group: Inputs
# bench-solve-transport
# Blue: inputs to change.   Green: outputs (charts, results, values passed on).   Named parameters mark each group's inputs and outputs.
# SOLVE BENCH
# For developers. Each input changes one part of the graph, so the solve bench can split a re-solve into Grasshopper time, encoding, transport and the browser. See plans/research/solve-transport-bench.md.
# INPUTS
# Upstream work holds every solve that reaches it. Mesh size and Context size are megabytes on the wire, roughly. Shape moves only the first Shape scope panels.
upstream_work_default = Slider(0.5, range=0..10)
shape_default = Slider(0.5, range=0..1)
mesh_size_default = Slider(5, range=1..60)
branches_default = Slider(4, range=1..32)
shape_scope_default = Slider(1, range=1..32)
context_size_default = Slider(5, range=0..50)
files_default = BooleanToggle(False)
upstream_work = GetNumber(upstream_work_default, AtLeast=1, AtMost=1, Maximum=10, Minimum=0, Prompt="Upstream work", TreeAccess=False)
shape = GetNumber(shape_default, AtLeast=1, AtMost=1, Maximum=1, Minimum=0, Prompt="Shape", TreeAccess=False)
mesh_size = GetInteger(mesh_size_default, AtLeast=1, AtMost=1, Maximum=60, Minimum=1, Prompt="Mesh size", TreeAccess=False)
branches = GetInteger(branches_default, AtLeast=1, AtMost=1, Maximum=32, Minimum=1, Prompt="Branches", TreeAccess=False)
shape_scope = GetInteger(shape_scope_default, AtLeast=1, AtMost=1, Maximum=32, Minimum=1, Prompt="Shape scope", TreeAccess=False)
context_size = GetInteger(context_size_default, AtLeast=1, AtMost=1, Maximum=50, Minimum=0, Prompt="Context size", TreeAccess=False)
colour = GetColor(ColourSwatch(SwatchColor=RGB(58, 123, 213)), AtLeast=1, AtMost=1, Immediate=True, Prompt="Colour", TreeAccess=False)
files = GetBoolean(files_default, AtLeast=1, AtMost=1, FalseValue="False", Prompt="Files", TreeAccess=False, TrueValue="True")

# ---- group: UI Bridge / Inputs
toggle = BooleanToggle(False)

# ---- group: UI Bridge
uibridge = UIBridge(Enable=toggle, Schema="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")  # -> Schema, URL

# ---- group: UI Bridge / Outputs
c_bake = ContextBake(Content=uibridge.Schema)

# ---- group: Upstream work
# UPSTREAM WORK
# A fixed wait every panel depends on. A warm document skips it when only something below changes; a cold one pays it. Source: SolveBench.Upstream.script.cs.
upstream_work_2 = UpstreamWork(upstream_work)
upstream_work_3 = CSharpScript(Seconds=upstream_work_2)  # -> out, Base
# ---------- upstream_work_3: C# ----------
// Grasshopper Script Instance
using System;

using Grasshopper.Kernel;

public class Script_Instance : GH_ScriptInstance
{
    // Stands in for an expensive step at the top of a real definition: everything geometric hangs
    // off Base, so a warm solve of anything below skips this wait and a cold one pays it. Sleep, not
    // a busy loop, so a bench run doesn't load every core.
    private void RunScript(object Seconds, ref object Base)
    {
        double seconds = 0;
        GH_Convert.ToDouble(Seconds, out seconds, GH_Conversion.Both);
        System.Threading.Thread.Sleep((int)Math.Round(Math.Max(0, seconds) * 1000));
        Base = 1.0;
    }
}
# ---------- end upstream_work_3 ----------

# ---- group: Context / Inputs
ground_color = GroundColor(ColourSwatch(SwatchColor=RGB(150, 150, 145)))

# ---- group: Context
# CONTEXT
# A ground slab that reads only its own size, so it ships byte-identical on every other change. Source: SolveBench.Context.script.cs.
context_size_2 = ContextSize(context_size)
context = CSharpScript(Size=context_size_2)  # -> out, Context
# ---------- context: C# ----------
// Grasshopper Script Instance
using System;

using Rhino.Geometry;

using Grasshopper.Kernel;

public class Script_Instance : GH_ScriptInstance
{
    // Keep equal to the panels script's constant: both convert megabytes on the wire to faces.
    const double WireBytesPerFace = 2.9;

    // A ground slab in front of the panels that reads no input but its own size, so it reaches the
    // browser byte-identical on every solve: the case a whole-item dedupe would skip. Size 0 still
    // gives one quad, because an empty Display warns on every solve.
    private void RunScript(object Size, ref object Context)
    {
        double megabytes = 0;
        GH_Convert.ToDouble(Size, out megabytes, GH_Conversion.Both);
        var side = Math.Max(1, (int)Math.Ceiling(Math.Sqrt(Math.Max(0, megabytes) * 1e6 / WireBytesPerFace)));

        var mesh = new Mesh();
        var rng = new Random(7);
        for (var v = 0; v <= side; v++)
            for (var u = 0; u <= side; u++)
            {
                double x = (double)u / side, y = (double)v / side;
                mesh.Vertices.Add(-0.5 + x * 12, -2.5 + y * 2, -0.3 + (rng.NextDouble() - 0.5) * 0.01);
            }
        for (var v = 0; v < side; v++)
            for (var u = 0; u < side; u++)
            {
                var a = v * (side + 1) + u;
                mesh.Faces.AddFace(a, a + 1, a + side + 2, a + side + 1);
            }
        mesh.Normals.ComputeNormals();
        Context = mesh;
    }
}
# ---------- end context ----------
ground = ThreeMaterial(Color=ground_color, Roughness=0.9)
context_display = Display(Geo=context.Context, Name="Ground", Layer="Bench/Context", Material=ground)

# ---- group: Upstream work / Outputs
upstream_work_base = UpstreamWorkBase(upstream_work_3.Base)

# ---- group: Context / Outputs
c_bake_2 = ContextBake(Context=context_display)

# ---- group: Panels
# PANELS
# One wavy panel per branch, each its own Display branch. Colour changes only the material. Faces is a result that ships almost nothing. Source: SolveBench.Panels.script.cs.
upstream_work_base_2 = UpstreamWorkBase(upstream_work_base)
shape_2 = Shape(shape)
mesh_size_2 = MeshSize(mesh_size)
branches_2 = Branches(branches)
shape_scope_2 = ShapeScope(shape_scope)
colour_2 = Colour(colour)
panels = CSharpScript(Base=upstream_work_base_2, Shape=shape_2, MeshSize=mesh_size_2, Branches=branches_2, Scope=shape_scope_2)  # -> out, Panels, Faces
# ---------- panels: C# ----------
// Grasshopper Script Instance
using System;
using System.Collections.Generic;

using Rhino.Geometry;

using Grasshopper;
using Grasshopper.Kernel;
using Grasshopper.Kernel.Data;

public class Script_Instance : GH_ScriptInstance
{
    // Wire bytes per quad face: the length of the Display goo's ToComputeJson (SLVA, base64), which
    // measured 2.8 for these panels and 3.2 for the context slab. Re-measure when the display encoding
    // changes, or Mesh size stops meaning megabytes.
    const double WireBytesPerFace = 2.9;

    // One wavy panel per branch, so each lands in its own Display branch. Only the first Scope
    // panels read Shape; the rest keep a fixed phase and stay byte-identical when Shape moves.
    // The jitter is seeded per panel and vertex: a perfectly regular grid deflates to almost
    // nothing, which would make Mesh size meaningless.
    private void RunScript(object Base, object Shape, object MeshSize, object Branches, object Scope,
        ref object Panels, ref object Faces)
    {
        double baseScale = 1, shape = 0.5, megabytes = 5;
        int branches = 4, scope = 1;
        GH_Convert.ToDouble(Base, out baseScale, GH_Conversion.Both);
        GH_Convert.ToDouble(Shape, out shape, GH_Conversion.Both);
        GH_Convert.ToDouble(MeshSize, out megabytes, GH_Conversion.Both);
        GH_Convert.ToInt32(Branches, out branches, GH_Conversion.Both);
        GH_Convert.ToInt32(Scope, out scope, GH_Conversion.Both);
        branches = Math.Max(1, branches);

        var facesPerPanel = megabytes * 1e6 / WireBytesPerFace / branches;
        var side = Math.Max(2, (int)Math.Ceiling(Math.Sqrt(facesPerPanel)));

        var tree = new DataTree<Mesh>();
        long faces = 0;
        for (var i = 0; i < branches; i++)
        {
            var phase = i < scope ? shape : 0.5;
            var mesh = Panel(i, side, phase, baseScale);
            faces += mesh.Faces.Count;
            tree.Add(mesh, new GH_Path(i));
        }
        Panels = tree;
        Faces = faces;
    }

    static Mesh Panel(int index, int side, double phase, double scale)
    {
        var mesh = new Mesh();
        var rng = new Random(1000 + index);
        for (var v = 0; v <= side; v++)
            for (var u = 0; u <= side; u++)
            {
                double x = (double)u / side, y = (double)v / side;
                var z = 0.12 * Math.Sin(2 * Math.PI * (2 * x + phase)) * Math.Cos(3 * Math.PI * y)
                    + (rng.NextDouble() - 0.5) * 0.004;
                mesh.Vertices.Add((index * 1.2 + x) * scale, y * scale, z * scale);
            }
        for (var v = 0; v < side; v++)
            for (var u = 0; u < side; u++)
            {
                var a = v * (side + 1) + u;
                mesh.Faces.AddFace(a, a + 1, a + side + 2, a + side + 1);
            }
        mesh.Normals.ComputeNormals();
        return mesh;
    }
}
# ---------- end panels ----------
panel_finish = ThreeMaterial(Color=colour_2, Roughness=0.5)
panel_display = Display(Geo=panels.Panels, Name="Panel", Layer="Bench/Panels", Material=panel_finish)

# ---- group: Panels / Outputs
panels_panels = PanelsPanels(panels.Panels)
c_bake_3 = ContextBake(Panels=panel_display)
c_print = ContextPrint(Faces=panels.Faces)

# ---- group: Files
# FILES
# A 3DM of the panels on every solve while Files is on; off, a 3DM of one point, so the output never goes empty.
panels_panels_2 = PanelsPanels(panels_panels)
files_2 = Files(files)
placeholder = ConstructPoint(XCoordinate=0, YCoordinate=0, ZCoordinate=0)
model_geometry = StreamFilter(Gate=files_2, Stream0=placeholder, Stream1=flatten(panels_panels_2))
model = GeometryToFile(Geometry=model_geometry, LayerNames="Panels", FileNames="solve-bench", FileEnding=".3dm")

# ---- group: Files / Outputs
c_bake_4 = ContextBake(Model3DM=model)
