# Grasshopper definition dynamic-value-list.ghx (Grasshopper 1.0.8)
# plug-ins: Selva

# ---- group: convergent
count = Slider(3, range=1..5)
count_2 = GetNumber(count, AtLeast=1, AtMost=1, Maximum=5, Minimum=1, TreeAccess=False)
convergent = CSharpScript(count=count_2)  # -> out, pairs; inputs count: Double
# ---------- convergent: C# ----------
// Grasshopper Script Instance
#region Usings
using System;
using System.Linq;
using System.Collections;
using System.Collections.Generic;
using System.Drawing;

using Rhino;
using Rhino.Geometry;

using Grasshopper;
using Grasshopper.Kernel;
using Grasshopper.Kernel.Data;
using Grasshopper.Kernel.Types;
#endregion

/// Convergent scenario: the option set is driven by count, independently of the
/// current selection. Shrinking count below the selected index invalidates the
/// selection once; re-picking then settles. Reaches a fixed point, unlike the
/// oscillation generator.
public class Script_Instance : GH_ScriptInstance
{
    private void RunScript(double count, ref object pairs)
    {
        var n = Math.Max(1, (int) Math.Round(count));
        var result = new List<string>();
        for (var i = 1; i <= n; i++)
        {
            result.Add(string.Format("\"Item {0}\" = {1}", i, i));
        }

        pairs = result;
    }
}
# ---------- end convergent ----------
dvlconvergent = GetDynamicValueList(
    AtLeast=1,
    AtMost=1,
    Immediate=True,
    ListAccess=False,
    SelectedValues="""[
  "Item 2"
]""",
    StoredItems="""[
  {
    "name": "Item 1",
    "expression": "1"
  },
  {
    "name": "Item 2",
    "expression": "2"
  },
  {
    "name": "Item 3",
    "expression": "3"
  }
]""",
    TreeAccess=False)
set_dynvl = SetDynamicValueList(Options=convergent.pairs)

# ----
c_script = CSharpScript()  # -> Out, A

# ---- group: oscillate (disabled - enable only for the stall test)
dvloscillate = GetDynamicValueList(
    AtLeast=1,
    AtMost=1,
    Immediate=True,
    ListAccess=False,
    SelectedValues="""[
  "X"
]""",
    StoredItems="""[
  {
    "name": "X",
    "expression": "X"
  },
  {
    "name": "Y",
    "expression": "Y"
  },
  {
    "name": "Z",
    "expression": "Z"
  }
]""",
    TreeAccess=False)
oscillate = CSharpScript(selected=dvloscillate)  # -> out, pairs; inputs selected: String; disabled
# ---------- oscillate: C# ----------
// Grasshopper Script Instance
#region Usings
using System;
using System.Linq;
using System.Collections;
using System.Collections.Generic;
using System.Drawing;

using Rhino;
using Rhino.Geometry;

using Grasshopper;
using Grasshopper.Kernel;
using Grasshopper.Kernel.Data;
using Grasshopper.Kernel.Types;
#endregion

/// Oscillation trigger. Emits every option EXCEPT the one currently selected, so
/// any selection deletes itself from the next option set and the UI must re-pick
/// forever. This component ships DISABLED — enable it only to exercise the
/// stall detector, which must cap the loop and surface a warning.
public class Script_Instance : GH_ScriptInstance
{
    private void RunScript(string selected, ref object pairs)
    {
        var all = new[] { "X", "Y", "Z" };

        // Match on the option NAME: the selected value arrives as the resolved
        // expression once a pick round-trips, and as the raw name before that.
        var survivors = all
            .Where(name => !string.Equals(name, selected, StringComparison.Ordinal))
            .Select(name => string.Format("\"{0}\" = {1}", name, name))
            .ToList();

        pairs = survivors;
    }
}
# ---------- end oscillate ----------
set_dynvl_2 = SetDynamicValueList(Options=oscillate.pairs)

# ----
# Dynamic Value List fixture
# 
# 
# 
# steady      - options fixed; one pick = one solve, then quiet.
# 
# convergent  - options follow `count`; shrink it below the
# 
#               selection to force exactly one re-pick.
# 
# oscillate   - DISABLED. Enable the 'oscillate' script to emit
# 
#               all options except the selected one; the stall
# 
#               detector must cap this and warn.
# 
# 
# 
# consumer throws on an empty selection - a regression that
# 
# dispatches empty turns this fixture red.
toggle = BooleanToggle(False)

# ---- group: steady
dvlselect = GetDynamicValueList(
    AtLeast=1,
    AtMost=1,
    Immediate=True,
    ListAccess=False,
    SelectedValues="""[
  "2"
]""",
    StoredItems="""[
  {
    "name": "A",
    "expression": "1"
  },
  {
    "name": "B",
    "expression": "2"
  },
  {
    "name": "C",
    "expression": "3"
  }
]""",
    TreeAccess=False)
steady = CSharpScript()  # -> out, pairs
# ---------- steady: C# ----------
// Grasshopper Script Instance
#region Usings
using System;
using System.Linq;
using System.Collections;
using System.Collections.Generic;
using System.Drawing;

using Rhino;
using Rhino.Geometry;

using Grasshopper;
using Grasshopper.Kernel;
using Grasshopper.Kernel.Data;
using Grasshopper.Kernel.Types;
#endregion

/// Steady scenario: options never depend on the selection, so picking a value
/// must produce exactly one solve and then quiet.
public class Script_Instance : GH_ScriptInstance
{
    private void RunScript(ref object pairs)
    {
        pairs = new List<string> { "\"A\" = 1", "\"B\" = 2", "\"C\" = 3" };
    }
}
# ---------- end steady ----------
consumer = CSharpScript(selected=dvlselect)  # -> out, result; inputs selected: String
# ---------- consumer: C# ----------
// Grasshopper Script Instance
#region Usings
using System;
using System.Linq;
using System.Collections;
using System.Collections.Generic;
using System.Drawing;

using Rhino;
using Rhino.Geometry;

using Grasshopper;
using Grasshopper.Kernel;
using Grasshopper.Kernel.Data;
using Grasshopper.Kernel.Types;
#endregion

/// Load-bearing consumer for the "never dispatch an empty selection" invariant.
/// Throws on a null/empty selection instead of degrading quietly, so a regression
/// that dispatches empty turns the fixture red rather than passing unnoticed.
public class Script_Instance : GH_ScriptInstance
{
    private void RunScript(string selected, ref object result)
    {
        if (string.IsNullOrEmpty(selected))
        {
            throw new InvalidOperationException(
                "Empty selection dispatched to a Dynamic Value List consumer.");
        }

        result = "ok: " + selected;
    }
}
# ---------- end consumer ----------
set_dynvl_3 = SetDynamicValueList(Options=steady.pairs)

# ----
ui_bridge = UIBridge(Enable=toggle, Schema="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")  # -> Schema, URL
context_bake = ContextBake(Content=ui_bridge.Schema)
bake_convergent = ContextBake(ConvergentOptions=set_dynvl)
bake_oscillate = ContextBake(OscillateOptions=set_dynvl_2)
bake_steady = ContextBake(SteadyOptions=set_dynvl_3)
