# Grasshopper definition stress-every-input-and-output.gh (Grasshopper 1.0.9)
# plug-ins: Selva Canopy, Selva

# ---- group: Basic inputs / Inputs
# stress every input and output
# Blue: inputs to change.   Green: outputs (charts, results, values passed on).   Named parameters mark each group's inputs and outputs.
# STRESS: EVERY INPUT AND OUTPUT
# For developers. One of each input widget, visibility rules, a dynamic value list, every output kind (text, numbers, 3D, charts, files, a folder of files), progress steps, and remarks, warnings and errors on demand. The Echo output shows exactly what the definition received.
panel = Panel("x*2")
advanced_default = Slider(3, range=0..10)
number_default = Slider(42.5, range=0..100)
integer_default = Slider(5, range=1..20)
boolean_default = BooleanToggle(False)
text_default = Panel("Hello, Selva")
text_default_2 = TextDefault(text_default, AtLeast=1, AtMost=1, TreeAccess=False)
x_2 = X2(panel)
x_20_0_1 = X2001("x/20+0.1")
number = GetNumber(number_default, AtLeast=1, AtMost=1, Maximum=100, Minimum=0, Prompt="Number", TreeAccess=False)
integer = GetInteger(integer_default, AtLeast=1, AtMost=1, Maximum=20, Minimum=1, Prompt="Integer", TreeAccess=False)
boolean = GetBoolean(boolean_default, AtLeast=1, AtMost=1, FalseValue="False", Prompt="Boolean", TreeAccess=False, TrueValue="True")
advanced = GetNumber(advanced_default, AtLeast=1, AtMost=1, Maximum=10, Minimum=0, Prompt="Advanced", TreeAccess=False)

# ---- group: Choices / Inputs
dropdown_options = ValueList({"Alpha", "Beta", "Gamma"}, selected="Alpha")
segmented_options = ValueList({"S", "M", "L", "XL"}, selected="M")
tiles_options = ValueList({"Red", "Green", "Blue"}, selected="Blue")
gamma_note_default = Panel("Only shown for Gamma")
gamma_note_default_2 = GammaNoteDefault(gamma_note_default, AtLeast=1, AtMost=1, TreeAccess=False)
dropdown = GetValueList(
    dropdown_options,
    AtLeast=1,
    AtMost=1,
    Immediate=True,
    ListAccess=False,
    Prompt="Dropdown",
    StoredItems="""[
  {
    "name": "Alpha",
    "expression": "Alpha"
  },
  {
    "name": "Beta",
    "expression": "Beta"
  },
  {
    "name": "Gamma",
    "expression": "Gamma"
  }
]""",
    TreeAccess=False)
segmented = GetValueList(
    segmented_options,
    AtLeast=1,
    AtMost=1,
    Immediate=True,
    ListAccess=False,
    Prompt="Segmented",
    StoredItems="""[
  {
    "name": "S",
    "expression": "S"
  },
  {
    "name": "M",
    "expression": "M"
  },
  {
    "name": "L",
    "expression": "L"
  },
  {
    "name": "XL",
    "expression": "XL"
  }
]""",
    TreeAccess=False)
tiles = GetValueList(
    tiles_options,
    AtLeast=1,
    AtMost=1,
    Immediate=True,
    ListAccess=False,
    Prompt="Tiles",
    StoredItems="""[
  {
    "name": "Red",
    "expression": "Red"
  },
  {
    "name": "Green",
    "expression": "Green"
  },
  {
    "name": "Blue",
    "expression": "Blue"
  }
]""",
    TreeAccess=False)

# ---- group: Media and messages / Inputs
raise_options = ValueList({"Nothing", "Remark", "Warning", "Error"}, selected="Nothing")
colour_get_color = ColourGetColor(
    ColourSwatch(SwatchColor=RGB(230, 120, 40)),
    AtLeast=1,
    AtMost=1,
    Immediate=True,
    Prompt="Select a color",
    TreeAccess=False)
raise = GetValueList(
    raise_options,
    AtLeast=1,
    AtMost=1,
    Immediate=True,
    ListAccess=False,
    Prompt="Raise",
    StoredItems="""[
  {
    "name": "Nothing",
    "expression": "Nothing"
  },
  {
    "name": "Remark",
    "expression": "Remark"
  },
  {
    "name": "Warning",
    "expression": "Warning"
  },
  {
    "name": "Error",
    "expression": "Error"
  }
]""",
    TreeAccess=False)

# ---- group: Other / Inputs
toggle = BooleanToggle(False)

# ---- group: Other
uibridge = UIBridge(Enable=toggle, Schema="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")  # -> Schema, URL

# ---- group: Other / Outputs
c_bake = ContextBake(Content=uibridge.Schema)

# ---- group: Media and messages
# MEDIA
# Colour tints the box; an image becomes its texture; a file's name and size are echoed.
file = GetFile(AtLeast=1, AtMost=1, Immediate=True, Prompt="Select a file to import", TreeAccess=False)
image = GetImage(AtLeast=1, AtMost=1, Immediate=True, Prompt="Select an image", TreeAccess=False)
colour = GetColor(colour_get_color, AtLeast=1, AtMost=1, Immediate=True, Prompt="Colour", TreeAccess=False)
raise_name = Text(raise)

# ---- group: Choices
# CHOICES
# Three value-list styles and a dynamic list whose options come from Integer.
dynamic = GetDynamicValueList(AtLeast=1, AtMost=1, Immediate=True, ListAccess=False, Prompt="Dynamic", StoredItems="[]", TreeAccess=False)
dropdown_name = Text(dropdown)
segmented_name = Text(segmented)
tiles_name = Text(tiles)

# ---- group: Basic inputs
# BASIC INPUTS
# Number, integer, boolean and text.
text = GetString(text_default_2, AtLeast=1, AtMost=1, Prompt="Text", TreeAccess=False)
double = Evaluate(E=x_2, x=number)
box_half_height = Evaluate(E=x_20_0_1, x=number)

# ---- group: Choices / Outputs
gamma_note = GetString(gamma_note_default_2, AtLeast=1, AtMost=1, Prompt="Gamma note", TreeAccess=False)
dropdown_name_2 = DropdownName(dropdown_name)
segmented_name_2 = SegmentedName(segmented_name)
tiles_name_2 = TilesName(tiles_name)

# ---- group: Media and messages / Outputs
raise_name_2 = RaiseName(raise_name)

# ---- group: Basic inputs / Outputs
box_half_height_2 = BoxHalfHeight(box_half_height)
double_2 = Double(double)

# ---- group: Dynamic options
# DYNAMIC OPTIONS
# Integer sets how many options the Dynamic list offers.
option_numbers = Series(Start=1, Step=1, Count=integer)
option_pairs = Format(Format="\"Option {0}\" = {0}", Culture=127, Data0=option_numbers)
dynamic_options = SetDynamicValueList(Options=option_pairs)

# ---- group: Echo / Inputs
sentence = Panel("Selva wraps long outputs without breaking the layout. ")
sentence_2 = Sentence(sentence)

# ---- group: 3D
# 3D
# A box per Integer, coloured by Colour and textured with Image when one is given.
box_half_height_3 = BoxHalfHeight(box_half_height_2)
box_x = Series(Start=0, Step=1.5, Count=integer)
box_centres = ConstructPoint(XCoordinate=box_x, YCoordinate=0, ZCoordinate=0.5)
boxes = CenterBox(Base=box_centres, X=0.5, Y=0.5, Z=box_half_height_3)
box_meshes = MeshBox(Base=boxes, XCount=1, YCount=1, ZCount=1)
box_material = ThreeMaterial(Color=colour, Roughness=0.4, Texture=image)
boxes_2 = Display(Geo=box_meshes, Name="Boxes", Layer="Kitchen sink", Material=box_material)

# ---- group: Charts / Inputs
bar_labels = Panel("""Alpha
Beta
Gamma""")
bar_values = Panel("""3
7
5""")
sin_x_y_10 = SinXY10("sin(x*y/10)")
bar_labels_2 = BarLabels(bar_labels)
bar_values_2 = BarValues(bar_values)

# ---- group: Messages / Inputs
raise_index_options = Panel("""Nothing
Remark
Warning
Error""")
raise_index_options_2 = RaiseIndexOptions(raise_index_options)

# ---- group: Messages
# MESSAGES
# Raise picks a level. An error blocks every output from reaching the page.
raise_name_3 = RaiseName(raise_name_2)
raise_index = MemberIndex(Set=raise_index_options_2, Member=raise_name_3)  # -> Index, Count
remark = Equality(FirstNumber=raise_index.Index, SecondNumber=1)  # -> Equality, Inequality
warning = Equality(FirstNumber=raise_index.Index, SecondNumber=2)  # -> Equality, Inequality
error = Equality(FirstNumber=raise_index.Index, SecondNumber=3)  # -> Equality, Inequality
remark_2 = Message(Condition=remark.Inequality, Message="A test remark raised from the Raise input.", Level=0, Notify=1)
warning_2 = Message(Condition=warning.Inequality, Message="A test warning raised from the Raise input.", Level=1, Notify=1)
error_2 = Message(Condition=error.Inequality, Message="A test error raised from the Raise input.", Level=2, Notify=1)

# ---- group: Echo
# ECHO
# Every value as the definition received it, one line each, plus a long text to test wrapping.
segmented_name_3 = SegmentedName(segmented_name_2)
dropdown_name_3 = DropdownName(dropdown_name_2)
tiles_name_3 = TilesName(tiles_name_2)
double_3 = Double(double_2)
echo = Format(
    Format="""number = {0}
integer = {1}
boolean = {2}
text = {3}
advanced = {4}
dropdown = {5}
segmented = {6}
tiles = {7}
dynamic = {8}
colour = {9}
file = {10}""",
    Culture=127,
    Data0=number,
    Data1=integer,
    Data2=boolean,
    Data3=text,
    Data4=advanced,
    Data5=dropdown_name_3,
    Data6=segmented_name_3,
    Data7=tiles_name_3,
    Data8=dynamic,
    Data9=colour,
    Data10=file)
long_text = RepeatData(Data=sentence_2, Length=40)
paragraph = TextJoin(Text=long_text)

# ---- group: Dynamic options / Outputs
c_bake_2 = ContextBake(DynamicOptions=dynamic_options)

# ---- group: Charts
# CHARTS
# A bar chart, a scatter and a histogram from the same numbers.
t = Range(Domain=Domain(0, 6.283), Steps=60)
samples = Random(Range=Domain(0, 1), Number=400, Seed=integer)
wave = Evaluate(E=sin_x_y_10, x=t, y=number)
histogram = QuickChart(Data=samples, Kind=0, Title="400 random samples")
bars = Bar(X=bar_labels_2, Y=bar_values_2, Name="Choices", Orientation=0)
bar_figure = Figure(Traces=bars, ExportFormat="png")
wave_chart = QuickChart(Data=wave, Kind=0, Title="sin(t × Number / 10)")

# ---- group: 3D / Outputs
box_meshes_2 = BoxMeshes(box_meshes)
c_bake_3 = ContextBake(Scene=boxes_2)

# ---- group: Charts / Outputs
c_bake_4 = ContextBake(Histogram=histogram)
c_bake_5 = ContextBake(Wave=wave_chart)
t_2 = T(t)
wave_2 = Wave(wave)
c_bake_6 = ContextBake(Bars=bar_figure)

# ---- group: Echo / Outputs
c_print = ContextPrint(Number2=double_3)
c_print_2 = ContextPrint(LongText=paragraph)
c_print_3 = ContextPrint(Echo=echo)
echo_2 = Echo(echo)

# ---- group: Files / Inputs
csv_header = Panel("t,value")
parts = Panel("""a
b
c""")
csv_header_2 = CSVHeader(csv_header)
parts_2 = Parts(parts)

# ---- group: Files
# FILES
# CSV, JSON, a PDF, a 3DM, and three files in nested folders: each output kind the download path handles.
box_meshes_3 = BoxMeshes(box_meshes_2)
echo_3 = Echo(echo_2)
t_3 = T(t_2)
wave_3 = Wave(wave_2)
_3dm = GeometryToFile(Geometry=box_meshes_3, LayerNames="Boxes", FileNames="boxes", FileEnding=".3dm")
json = Format(Format="{{\"number\": {0}, \"integer\": {1}, \"text\": \"{2}\"}}", Culture=127, Data0=number, Data1=integer, Data2=text)
text_spot = ConstructPoint(XCoordinate=0, YCoordinate=0, ZCoordinate=0)
body_spot = ConstructPoint(XCoordinate=0, YCoordinate=-20, ZCoordinate=0)
csv_rows = Format(Format="{0},{1:0.0000}", Culture=127, Data0=t_3, Data1=wave_3)
json_file = CreateFile(Data=json, Name="values", Extension=".json", IsBase64=False)
heading = DrawText(Text=text, Position=text_spot, Rotation=0, Padding=1, Radius=0)
body = DrawText(Text=echo_3, Position=body_spot, Rotation=0, Padding=1, Radius=0)
bundle_names = Format(Format="part-{0}", Culture=127, Data0=parts_2)
csv_lines = Merge(Data1=csv_header_2, Data2=csv_rows)
csv = CreateFile(Data=flatten(csv_lines), Name="wave", Extension=".csv", IsBase64=False)
bundle = CreateFile(Data=bundle_names, Name=bundle_names, Extension=".txt", IsBase64=False, SubFolder="Bundle::Parts")
report_page = Page(Drawings=[heading, body], Title="Kitchen sink report", KeepTogether=False, Arrange=0, Spacing=5)
report = Document(Pages=report_page, Title="Kitchen sink", Culture="en-US")
pdf = RenderPDF(Document=report, Name="report", AutoFit=False)

# ---- group: Files / Outputs
c_bake_7 = ContextBake(FolderOfFiles=bundle)
c_bake_8 = ContextBake(JSON=json_file)
c_bake_9 = ContextBake(PDF=pdf)
c_bake_10 = ContextBake(CSV=csv)
c_bake_11 = ContextBake(_3DM=_3dm)
