# Grasshopper definition ui-bridge-minimal.ghx (Grasshopper 1.0.8)
# plug-ins: Selva

int_slider = Slider(0, range=0..20)
string = Panel("Test String")
ui_bridge = UIBridge(
    Enable=Toggle(True),
    Schema="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",
    Values="{\"1a0660dd-fff4-4da1-b46e-b7e2b693d855\":0,\"530cc167-9f8b-411a-984f-bae30b1e7e2c\":false,\"cbfee256-cbdc-4c46-9435-a35b71c4ce7e\":\"Test String\",\"b7369f6c-7e36-4b4a-a38b-e466b7dbefee\":0}")  # -> Schema, URL
brep = Brep(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)
brep_2 = Brep(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)
geometry = Geometry([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, Point(22.23214333, -28.82275009, 0)])
c_bake = ContextBake(Content=ui_bridge.Schema)
geometry_to_file = GeometryToFile(Geometry=brep, FileNames="MainBrep", FileEnding=".3dm", SubFolder="Main::MainBrep")
geometry_to_file_2 = GeometryToFile(Geometry=brep_2, FileNames="SecondBrep", FileEnding=".3dm", SubFolder="Main::ROOT")
display = Display(Geo=geometry)
get_number = GetNumber(Slider(0, range=0..20), AtLeast=1, AtMost=1, Maximum=1.797693135e+308, Minimum=-1.797693135e+308, TreeAccess=False)
get_integer = GetInteger(int_slider, AtLeast=1, AtMost=1, Maximum=2147483647, Minimum=-2147483648, TreeAccess=False)
get_boolean = GetBoolean(Toggle(False), AtLeast=1, AtMost=1, FalseValue="False", TreeAccess=False, TrueValue="True")
get_string = GetString(string, AtLeast=1, AtMost=1, TreeAccess=False)
file_path = FilePath("C:\Users\felix\Desktop\")
context_bake = ContextBake(RealBool=get_boolean)
context_print = ContextPrint(Number=get_number)
context_print_2 = ContextPrint(Text=get_boolean)
context_print_3 = ContextPrint(Text=get_string)
context_print_4 = ContextPrint(Text=get_integer)
context_bake_2 = ContextBake(Content=display)
bake_files = BakeFiles(Files=[geometry_to_file_2, geometry_to_file], BasePath=file_path, Bake=Button())  # -> Paths, Status
context_bake_3 = ContextBake(Content=[geometry_to_file, geometry_to_file_2])
