# Grasshopper definition block-massing-studio.gh (Grasshopper 1.0.9)
# plug-ins: Selva Canopy, Selva

# ---- group: Massing / Inputs
# MASSING
# Plate shape, height and the podium. Twist and Taper only shape a Tower.
typology = ValueList({"Tower", "Slab", "L-Block", "U-Block", "Courtyard"}, selected="Tower")
length = Slider(40, range=20..120)
depth = Slider(34, range=14..90)
wing_depth = Slider(14, range=10..24)
storeys = Slider(24, range=3..40)
floor_height = Slider(3.3, range=2.8..4.2)
twist = Slider(35, range=0..90)
taper = Slider(12, range=0..40)
podium = BooleanToggle(True)
podium_storeys = Slider(2, range=1..4)
podium_overhang = Slider(6, range=0..14)
podium_overhang_2 = GetNumber(podium_overhang, AtLeast=1, AtMost=1, Maximum=1.797693135e+308, Minimum=-1.797693135e+308, TreeAccess=False)
podium_storeys_2 = GetInteger(podium_storeys, AtLeast=1, AtMost=1, Maximum=2147483647, Minimum=-2147483648, TreeAccess=False)
typology_2 = GetValueList(
    typology,
    AtLeast=1,
    AtMost=1,
    Immediate=True,
    ListAccess=False,
    StoredItems="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",
    TreeAccess=False)
length_2 = GetNumber(length, AtLeast=1, AtMost=1, Maximum=1.797693135e+308, Minimum=-1.797693135e+308, TreeAccess=False)
depth_2 = GetNumber(depth, AtLeast=1, AtMost=1, Maximum=1.797693135e+308, Minimum=-1.797693135e+308, TreeAccess=False)
wing_depth_2 = GetNumber(wing_depth, AtLeast=1, AtMost=1, Maximum=1.797693135e+308, Minimum=-1.797693135e+308, TreeAccess=False)
storeys_2 = GetInteger(storeys, AtLeast=1, AtMost=1, Maximum=2147483647, Minimum=-2147483648, TreeAccess=False)
floor_height_2 = GetNumber(floor_height, AtLeast=1, AtMost=1, Maximum=1.797693135e+308, Minimum=-1.797693135e+308, TreeAccess=False)
twist_2 = GetNumber(twist, AtLeast=1, AtMost=1, Maximum=1.797693135e+308, Minimum=-1.797693135e+308, TreeAccess=False)
taper_2 = GetNumber(taper, AtLeast=1, AtMost=1, Maximum=1.797693135e+308, Minimum=-1.797693135e+308, TreeAccess=False)
podium_2 = GetBoolean(podium, AtLeast=1, AtMost=1, FalseValue="False", TreeAccess=False, TrueValue="True")

# ---- group: Facade and roof / Inputs
# FACADE AND ROOF
# The facade system draws fins, mullions, punched windows or balconies; the roof is flat, planted or covered in solar panels.
facade_system = ValueList({"Curtain Wall", "Vertical Fins", "Punched Windows", "Balconies"}, selected="Balconies")
bay_width = Slider(3.2, range=2..6)
fin_depth = Slider(0.7, range=0.2..1.4)
window_ratio = Slider(0.5, range=0.25..0.8)
balcony_depth = Slider(1.8, range=1..3)
roof = ValueList({"Flat", "Green Roof", "Solar Array"}, selected="Solar Array")
panel_tilt = Slider(20, range=5..35)
facade_system_2 = GetValueList(
    facade_system,
    AtLeast=1,
    AtMost=1,
    Immediate=True,
    ListAccess=False,
    StoredItems="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",
    TreeAccess=False)
window_ratio_2 = GetNumber(window_ratio, AtLeast=1, AtMost=1, Maximum=1.797693135e+308, Minimum=-1.797693135e+308, TreeAccess=False)
balcony_depth_2 = GetNumber(balcony_depth, AtLeast=1, AtMost=1, Maximum=1.797693135e+308, Minimum=-1.797693135e+308, TreeAccess=False)
bay_width_2 = GetNumber(bay_width, AtLeast=1, AtMost=1, Maximum=1.797693135e+308, Minimum=-1.797693135e+308, TreeAccess=False)
fin_depth_2 = GetNumber(fin_depth, AtLeast=1, AtMost=1, Maximum=1.797693135e+308, Minimum=-1.797693135e+308, TreeAccess=False)
roof_2 = GetValueList(
    roof,
    AtLeast=1,
    AtMost=1,
    Immediate=True,
    ListAccess=False,
    StoredItems="""[
  {
    "name": "Flat",
    "expression": "Flat"
  },
  {
    "name": "Green Roof",
    "expression": "Green Roof"
  },
  {
    "name": "Solar Array",
    "expression": "Solar Array"
  }
]""",
    TreeAccess=False)
panel_tilt_2 = GetNumber(panel_tilt, AtLeast=1, AtMost=1, Maximum=1.797693135e+308, Minimum=-1.797693135e+308, TreeAccess=False)

# ---- group: Site / Inputs
# SITE
# Plot size and height limit drive FAR, coverage and the zoning check. Lit Windows is the share of panes that glow in the Night look.
city_context = BooleanToggle(True)
street_trees = BooleanToggle(True)
plot_width = Slider(130, range=60..200)
plot_depth = Slider(110, range=60..200)
height_limit = Slider(95, range=20..150)
lit_windows = Slider(38, range=0..80)
city_context_2 = GetBoolean(city_context, AtLeast=1, AtMost=1, FalseValue="False", TreeAccess=False, TrueValue="True")
street_trees_2 = GetBoolean(street_trees, AtLeast=1, AtMost=1, FalseValue="False", TreeAccess=False, TrueValue="True")
plot_width_2 = GetNumber(plot_width, AtLeast=1, AtMost=1, Maximum=1.797693135e+308, Minimum=-1.797693135e+308, TreeAccess=False)
plot_depth_2 = GetNumber(plot_depth, AtLeast=1, AtMost=1, Maximum=1.797693135e+308, Minimum=-1.797693135e+308, TreeAccess=False)
height_limit_2 = GetNumber(height_limit, AtLeast=1, AtMost=1, Maximum=1.797693135e+308, Minimum=-1.797693135e+308, TreeAccess=False)
lit_windows_2 = GetNumber(lit_windows, AtLeast=1, AtMost=1, Maximum=1.797693135e+308, Minimum=-1.797693135e+308, TreeAccess=False)

# ---- group: Selva / Inputs
# block-massing-studio
# Blue: inputs to change.   Green: outputs (charts, results, values passed on).   Named parameters mark each group's inputs and outputs.
toggle = BooleanToggle(True)

# ---- group: Materials / Inputs
cladding_index_options = Panel("""Corten
Brick
Limestone
Slate
Charcoal
Timber""")
cladding = ValueList({"Corten", "Brick", "Limestone", "Slate", "Charcoal", "Timber"}, selected="Timber")
glass_tint_index_options = Panel("""Clear
Bronze
Sage""")
glass_tint = ValueList({"Clear", "Bronze", "Sage"}, selected="Clear")
paving_index_options = Panel("""Concrete paving
Granite setts
Gravel
Travertine""")
paving_options = ValueList({"Concrete paving", "Granite setts", "Gravel", "Travertine"}, selected="Concrete paving")
glass_tint_index_options_2 = GlassTintIndexOptions(glass_tint_index_options)
cladding_index_options_2 = CladdingIndexOptions(cladding_index_options)
paving_index_options_2 = PavingIndexOptions(paving_index_options)
cladding_2 = GetValueList(
    cladding,
    AtLeast=1,
    AtMost=1,
    Immediate=True,
    ListAccess=False,
    StoredItems="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",
    TreeAccess=False)
glass_tint_2 = GetValueList(
    glass_tint,
    AtLeast=1,
    AtMost=1,
    Immediate=True,
    ListAccess=False,
    StoredItems="""[
  {
    "name": "Clear",
    "expression": "Clear"
  },
  {
    "name": "Bronze",
    "expression": "Bronze"
  },
  {
    "name": "Sage",
    "expression": "Sage"
  }
]""",
    TreeAccess=False)
paving = GetValueList(
    paving_options,
    AtLeast=1,
    AtMost=1,
    Immediate=True,
    ListAccess=False,
    Prompt="Paving",
    StoredItems="""[
  {
    "name": "Concrete paving",
    "expression": "Concrete paving"
  },
  {
    "name": "Granite setts",
    "expression": "Granite setts"
  },
  {
    "name": "Gravel",
    "expression": "Gravel"
  },
  {
    "name": "Travertine",
    "expression": "Travertine"
  }
]""",
    TreeAccess=False)
tints_data_1 = TintsData1(ColourSwatch(SwatchColor=RGB(232, 240, 242)))
tints_data_2 = TintsData2(ColourSwatch(SwatchColor=RGB(214, 186, 150)))
tints_data_3 = TintsData3(ColourSwatch(SwatchColor=RGB(196, 220, 204)))
street_color = StreetColor(ColourSwatch(SwatchColor=RGB(70, 72, 74)))

# ---- group: Selva
# SELVA
# The UI Bridge serves the form; its Enable toggle starts it.
ui_bridge = UIBridge(
    Enable=toggle,
    Schema="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",
    SelvaLinks="[{\"origin\":\"https://selvajs.com\",\"definitionGuid\":\"bbdcd377-718a-4637-b474-24b9ee25b65f\",\"versionId\":\"9b3a4280-bd97-44ac-ab24-7f150238263e\",\"versionNumber\":5}]",
    Values="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")  # -> Schema, URL

# ---- group: Selva / Outputs
c_bake = ContextBake(Content=ui_bridge.Schema)

# ---- group: Materials
# MATERIALS
# Material Presets carry real-size finishes: oak grain, brick bond, honed limestone, cleft slate, granite setts. A choice picks one with Member Index and List Item. The glass takes its tint as colour over the Glass preset.
asphalt_base = MaterialPreset(Preset=8)
street = ThreeMaterial(Color=street_color, Roughness=0.95, Base=asphalt_base)
concrete_paving = MaterialPreset(Preset=32)
granite_setts = MaterialPreset(Preset=33)
travertine = MaterialPreset(Preset=27)
gravel = MaterialPreset(Preset=34)
paving_name = Text(paving)
glass_tint_name = Text(glass_tint_2)
tints = Merge(Data1=tints_data_1, Data2=tints_data_2, Data3=tints_data_3)
glass_tint_index = MemberIndex(Set=glass_tint_index_options_2, Member=glass_tint_name)  # -> Index, Count
paving_finishes = Merge(Data1=concrete_paving, Data2=granite_setts, Data3=gravel, Data4=travertine)
paving_index = MemberIndex(Set=paving_index_options_2, Member=paving_name)  # -> Index, Count
corten = MaterialPreset(Preset=15)
brick = MaterialPreset(Preset=13)
limestone = MaterialPreset(Preset=26)
slate = MaterialPreset(Preset=30)
charcoal = MaterialPreset(Preset=6)
timber = MaterialPreset(Preset=23)
cladding_name = Text(cladding_2)
glass = MaterialPreset(Preset=9)
glass_tint_3 = ListItem(List=tints, Index=glass_tint_index.Index, Wrap=True)
paving_finish = ListItem(List=paving_finishes, Index=paving_index.Index, Wrap=True)
frame_coating = MaterialPreset(Preset=6)
floor_plates = MaterialPreset(Preset=8)
cladding_finishes = Merge(Data1=corten, Data2=brick, Data3=limestone, Data4=slate, Data5=charcoal, Data6=timber)
cladding_index = MemberIndex(Set=cladding_index_options_2, Member=cladding_name)  # -> Index, Count
frames = ThreeMaterial(Color=RGB(42, 46, 50), Metalness=0.6, Roughness=0.4, Base=frame_coating)
lit_windows_3 = ThreeMaterial(Color=RGB(255, 214, 160), Metalness=0, Roughness=0.3)
planting = ThreeMaterial(Color=RGB(92, 132, 84), Metalness=0, Roughness=0.85)
glazing = ThreeMaterial(Color=glass_tint_3, Base=glass)
city_blocks = MaterialPreset(Preset=14)
cladding_finish = ListItem(List=cladding_finishes, Index=cladding_index.Index, Wrap=True)

# ---- group: Materials / Outputs
paving_finish_2 = PavingFinish(paving_finish)
cladding_finish_2 = CladdingFinish(cladding_finish)
floor_plates_2 = FloorPlates(floor_plates)
lit_windows_4 = LitWindows(lit_windows_3)
city_blocks_2 = CityBlocks(city_blocks)
glazing_2 = Glazing(glazing)
planting_2 = Planting(planting)
frames_2 = Frames(frames)
street_2 = Street(street)

# ---- group: Building geometry
# BUILDING
# One script draws every part as a mesh in metres, scaled to the document's units. Each part leaves on its own output so it takes its own material.
c_script = CSharpScript(
    Typology=typology_2,
    Length=length_2,
    Depth=depth_2,
    WingDepth=wing_depth_2,
    Storeys=storeys_2,
    FloorHeight=floor_height_2,
    Twist=twist_2,
    Taper=taper_2,
    PodiumOn=podium_2,
    PodiumStoreys=podium_storeys_2,
    PodiumOverhang=podium_overhang_2,
    FacadeSystem=facade_system_2,
    Bay=bay_width_2,
    FinDepth=fin_depth_2,
    WindowRatio=window_ratio_2,
    BalconyDepth=balcony_depth_2,
    Roof=roof_2,
    PanelTilt=panel_tilt_2,
    ContextOn=city_context_2,
    Trees=street_trees_2,
    PlotWidth=plot_width_2,
    PlotDepth=plot_depth_2,
    HeightLimit=height_limit_2,
    LitWindows=lit_windows_2)  # -> out, Slabs, Clad, Glazing, LitGlazing, Frames, Planting, Massing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
# ---------- c_script: C# ----------
// Grasshopper Script Instance
using System;
using System.Linq;
using System.Collections.Generic;
using System.Drawing;

using Rhino;
using Rhino.Geometry;

using Grasshopper;
using Grasshopper.Kernel;
using Grasshopper.Kernel.Data;
using Grasshopper.Kernel.Types;

public class Script_Instance : GH_ScriptInstance
{
    // A building on a plot, in metres. Plates are loops of outward-facing edges plus rectangles for the
    // floor faces: a courtyard is two loops, so its inner wall faces the court. Outer loops run
    // anticlockwise, inner loops clockwise, so "outward" is always to the right of an edge.
    const double SlabDepth = 0.34;
    const double PodiumFloorHeight = 4.6;
    const double ParapetHeight = 1.1;    // above the roof finish
    const double ParapetWidth = 0.3;
    const double PlotSetback = 3;        // clear strip kept between the building and the road
    const double GlassSetback = 0.03;   // fins, mullions and bands are rooted this far behind the glass
    static readonly Vector3d Z = Vector3d.ZAxis;

    private void RunScript(
		object Typology, object Length, object Depth, object WingDepth, object Storeys, object FloorHeight,
		object Twist, object Taper, object PodiumOn, object PodiumStoreys, object PodiumOverhang,
		object FacadeSystem, object Bay, object FinDepth, object WindowRatio, object BalconyDepth,
		object Roof, object PanelTilt, object ContextOn, object Trees, object PlotWidth, object PlotDepth, object HeightLimit, object LitWindows,
		ref object Slabs, ref object Clad, ref object Glazing, ref object LitGlazing, ref object Frames, ref object Planting, ref object Massing, ref object Ground, ref object Street,
		ref object PodiumLevels, ref object PodiumAreas, ref object TowerLevels, ref object TowerAreas,
		ref object BuildingHeight, ref object Gfa, ref object Far, ref object Coverage, ref object FacadeArea, ref object Units, ref object Zoning)
    {
        // ---- Inputs, clamped to values the geometry can survive -------------------------------------
        string type = Txt(Typology, "Tower"), system = Txt(FacadeSystem, "Vertical Fins"), roof = Txt(Roof, "Green Roof");

        bool tower = type == "Tower";
        double fh = Math.Max(Num(FloorHeight, 3.3), SlabDepth + 1.8);
        int n = Math.Max(1, (int)Math.Round(Num(Storeys, 22)));     // 0 storeys would stack a roof slab on the podium's
        double twist = Num(Twist, 25) * Math.PI / 180;
        double taper = Clamp(Num(Taper, 12) / 100.0, -1, 0.9);       // 100 % would shrink the top floor to a point
        bool podium = Bool(PodiumOn, true), context = Bool(ContextOn, true), trees = Bool(Trees, true);
        int pn = podium ? Math.Max(0, (int)Math.Round(Num(PodiumStoreys, 2))) : 0;
        double plotW = Math.Max(1, Num(PlotWidth, 130)), plotD = Math.Max(1, Num(PlotDepth, 110)), limit = Num(HeightLimit, 90);

        double L = Math.Max(4, Num(Length, 40)), D = Math.Max(4, Num(Depth, 34));
        double overhang = Math.Max(0, Num(PodiumOverhang, 6));

        // Everything the building covers on plan, podium and twisting plates included. The building is drawn
        // at the size asked for even when that is wider than the plot: the streets and neighbours move out
        // of its way, and the zoning text reports the overrun.
        double reachX = L / 2, reachY = D / 2;
        if (tower)
            for (int k = 0; k < n; k++)
            {
                double t = n > 1 ? k / (double)(n - 1) : 0, s = 1 - taper * t;
                double c = Math.Abs(Math.Cos(twist * t)), sn = Math.Abs(Math.Sin(twist * t));
                reachX = Math.Max(reachX, s * (L * c + D * sn) / 2); reachY = Math.Max(reachY, s * (L * sn + D * c) / 2);
            }
        if (pn > 0) { reachX = Math.Max(reachX, L / 2 + overhang); reachY = Math.Max(reachY, D / 2 + overhang); }
        double overPlot = Math.Max(2 * reachX - plotW, 2 * reachY - plotD);
        double w = Math.Min(Math.Max(Num(WingDepth, 14), 1), MaxWing(type, L, D));
        double bay = Math.Max(0.8, Num(Bay, 3.2)), fin = Math.Max(0, Num(FinDepth, 0.7));
        double ratio = Clamp(Num(WindowRatio, 0.5), 0.05, 0.95), bal = Math.Max(0.3, Num(BalconyDepth, 1.8));
        double tilt = Clamp(Num(PanelTilt, 20), 0, 60) * Math.PI / 180;
        double litShare = Clamp(Num(LitWindows, 38) / 100, 0, 1);

        var slabs = new Mesh(); var clad = new Mesh(); var glass = new Mesh(); var lit = new Mesh(); var frames = new Mesh();
        var green = new Mesh(); var massing = new Mesh(); var ground = new Mesh(); var street = new Mesh();
        // Floor area per storey for the chart, podium and tower apart so each gets its own colour.
        var podiumLevels = new List<int>(); var podiumAreas = new List<double>();
        var towerLevels = new List<int>(); var towerAreas = new List<double>();

        // ---- Plate ---------------------------------------------------------------------------------
        var loops = new List<List<Point3d>>();
        var rects = new List<double[]>();
        BuildPlate(type, L, D, w, loops, rects);
        double plateArea = rects.Sum(RectArea);
        double perimeter = loops.Sum(Perimeter);

        // ---- Podium --------------------------------------------------------------------------------
        double z = 0, gfa = 0, facade = 0;
        int level = 0;    // counts podium and tower storeys together, so the lit pattern never repeats
        double[] podiumBox = { -L / 2 - overhang, -D / 2 - overhang, L / 2 + overhang, D / 2 + overhang };
        var podiumLoops = new List<List<Point3d>> { RectLoop(podiumBox) };
        var podiumRects = new List<double[]> { podiumBox };
        if (pn > 0)
        {
            for (int k = 0; k < pn; k++, level++)
            {
                Slab(slabs, clad, podiumLoops, podiumRects, z, Transform.Identity, Transform.Identity, true);
                Storey(podiumLoops, Transform.Identity, z, PodiumFloorHeight, 6, "Curtain Wall", 0, 0, 0, level, litShare, true, slabs, clad, glass, lit, frames);
                Core(frames, podiumRects, z, PodiumFloorHeight, Transform.Identity);
                podiumLevels.Add(level); podiumAreas.Add(Math.Round(RectArea(podiumBox)));
                z += PodiumFloorHeight;
            }
            // The podium's roof is the tower's first floor. It only gets a guard when there is a terrace to guard;
            // with a small overhang the parapet would run into the tower's own facade.
            bool terrace = overhang >= 1.0;
            Slab(slabs, clad, podiumLoops, podiumRects, z, Transform.Identity, Transform.Identity, !terrace);
            if (terrace) Parapet(clad, podiumLoops, Transform.Identity, z);
            gfa += RectArea(podiumBox) * pn;
            facade += Perimeter(podiumLoops[0]) * PodiumFloorHeight * pn;
        }

        // ---- Storeys -------------------------------------------------------------------------------
        // A twisting or tapering tower changes plate from storey to storey, so nothing may hang down over a slab edge.
        bool stacked = !tower || (Math.Abs(twist) < 1e-9 && Math.Abs(taper) < 1e-9);
        Transform xf = Transform.Identity, below = Transform.Identity;
        double maxScale = 1;
        for (int k = 0; k < n; k++, level++)
        {
            double t = n > 1 ? k / (double)(n - 1) : 0;
            double s = 1;
            below = xf;
            xf = Transform.Identity;
            if (tower)
            {
                s = 1 - taper * t;
                xf = Transform.Rotation(twist * t, Z, Point3d.Origin) * Transform.Scale(Point3d.Origin, s);
            }
            if (k == 0) below = xf;
            maxScale = Math.Max(maxScale, s);
            // The podium's roof is the first floor: a second slab there would fight it.
            // Each slab is lofted from the plate below to its own, so it closes the twist instead of leaving a gap.
            if (k > 0 || pn == 0) Slab(slabs, clad, loops, rects, z, below, xf, true);
            Storey(loops, xf, z, fh, bay, system, fin, ratio, bal, level, litShare, stacked, slabs, clad, glass, lit, frames);
            Core(frames, rects, z, fh, xf);
            gfa += plateArea * s * s;
            towerLevels.Add(level); towerAreas.Add(Math.Round(plateArea * s * s));
            facade += perimeter * s * fh;
            z += fh;
        }
        // Roof slab without edge faces: the parapet's outer face covers that strip and would fight it.
        Slab(slabs, clad, loops, rects, z, xf, xf, false);
        Parapet(clad, loops, xf, z);

        // ---- Roof ----------------------------------------------------------------------------------
        double finish = z + SlabDepth;
        for (int ri = 0; ri < rects.Count; ri++)
        {
            var r = rects[ri];
            if (roof == "Green Roof")
            {
                double gz = finish + 0.02;
                Quad(green, P(r[0], r[1], gz, xf), P(r[2], r[1], gz, xf), P(r[2], r[3], gz, xf), P(r[0], r[3], gz, xf));
                var rnd = new Random(7 + ri);
                // Shrub mounds, kept 2 m in from the edge so the largest stays clear of the parapet.
                for (double x = r[0] + 2; x <= r[2] - 2; x += 3.4)
                    for (double y = r[1] + 2; y <= r[3] - 2; y += 3.4)
                    {
                        double size = 0.7 + rnd.NextDouble() * 0.7;
                        if (rnd.NextDouble() > 0.45) Ball(green, P(x, y, gz, xf), size, 0.6);
                    }
            }
            else if (roof == "Solar Array")
            {
                const double panelW = 1.9, panelL = 1.7, lift = 0.3, thick = 0.05, leg = 0.06;
                double run = panelL * Math.Cos(tilt), rise = panelL * Math.Sin(tilt);
                // Whole panels only, a metre clear of the parapet.
                for (double y = r[1] + 1.5; y + run <= r[3] - 1; y += 3.2)
                    for (double x = r[0] + 1; x + panelW <= r[2] - 1; x += 2.1)
                    {
                        Point3d a = P(x, y, finish + lift, xf), b = P(x + panelW, y, finish + lift, xf);
                        var across = P(x, y + run, finish + lift + rise, xf) - a;
                        Prism(frames, a, b, across, -Z * thick);
                        // The glass sits a hair above the frame and inside its edge, so the two never share a plane.
                        var inX = (b - a) / panelW * 0.03; var inY = across / panelL * 0.03; var eps = Z * 0.005;
                        Quad(glass, a + inX + inY + eps, b - inX + inY + eps, b - inX + across - inY + eps, a + inX + across - inY + eps);
                        foreach (double lx in new[] { x + 0.1, x + panelW - 0.1 - leg })
                        {
                            Post(frames, lx, y + 0.1, finish, lift - thick, leg, xf);
                            Post(frames, lx, y + run - 0.1 - leg, finish, lift + rise * (run - 0.1 - leg) / run - thick, leg, xf);
                        }
                    }
            }
        }

        // ---- Site ----------------------------------------------------------------------------------
        double hw = plotW / 2, hd = plotD / 2;
        Quad(ground, new Point3d(-hw, -hd, 0.02), new Point3d(hw, -hd, 0.02), new Point3d(hw, hd, 0.02), new Point3d(-hw, hd, 0.02));
        if (trees)
        {
            // Everywhere the building can reach on plan: the podium, or a twisted, flaring plate.
            double[] keepOut = pn > 0 ? (double[])podiumBox.Clone() : new[] { -L / 2, -D / 2, L / 2, D / 2 };
            if (tower && (Math.Abs(twist) > 1e-6 || maxScale > 1))
            {
                double reach = Math.Sqrt(L * L + D * D) / 2 * maxScale;
                keepOut = new[] { Math.Min(keepOut[0], -reach), Math.Min(keepOut[1], -reach), Math.Max(keepOut[2], reach), Math.Max(keepOut[3], reach) };
            }
            var rnd = new Random(11);
            var spots = new List<Point3d>();
            for (double x = -hw + 5; x <= hw - 5; x += 11)
                foreach (double y in new[] { -hd + 4, hd - 4 }) spots.Add(new Point3d(x, y, 0));
            for (double y = -hd + 15; y <= hd - 15; y += 11)
                foreach (double x in new[] { -hw + 4, hw - 4 }) spots.Add(new Point3d(x, y, 0));
            // A lawn strip under each row of trees, open in the middle for the way in.
            const double lawn = 5, door = 6;
            foreach (double side in new[] { -1.0, 1.0 })
            {
                foreach (double half in new[] { -1.0, 1.0 })
                {
                    double[] alongX = { Math.Min(half * door, half * (hw - 2)), side * (hd - 4) - lawn / 2, Math.Max(half * door, half * (hw - 2)), side * (hd - 4) + lawn / 2 };
                    double[] alongY = { side * (hw - 4) - lawn / 2, Math.Min(half * door, half * (hd - 8)), side * (hw - 4) + lawn / 2, Math.Max(half * door, half * (hd - 8)) };
                    foreach (var strip in new[] { alongX, alongY })
                    {
                        if (strip[2] - strip[0] < 1 || strip[3] - strip[1] < 1) continue;
                        if (strip[2] > keepOut[0] && strip[0] < keepOut[2] && strip[3] > keepOut[1] && strip[1] < keepOut[3]) continue;
                        Quad(green, new Point3d(strip[0], strip[1], 0.05), new Point3d(strip[2], strip[1], 0.05), new Point3d(strip[2], strip[3], 0.05), new Point3d(strip[0], strip[3], 0.05));
                    }
                }
            }
            foreach (var at in spots)
            {
                double r = 3 + rnd.NextDouble() * 1.4;    // drawn before the test, so a skipped tree doesn't resize the rest
                double clear = r + 1;
                if (at.X > keepOut[0] - clear && at.X < keepOut[2] + clear && at.Y > keepOut[1] - clear && at.Y < keepOut[3] + clear) continue;
                Tree(green, frames, at, r);
            }
        }
        if (context)
        {
            // Only the near side of each neighbouring block is shown: the viewer frames everything it is given,
            // so whole blocks would shrink the building to a dot.
            const double road = 16, band = 44, kerb = 0.15, setback = 3;
            // The road starts at the plot edge, or past a building that overruns it. Only this block's hw and hd
            // move: the plot itself, drawn above, keeps its size.
            hw = Math.Max(hw, reachX + PlotSetback); hd = Math.Max(hd, reachY + PlotSetback);
            double ex = hw + road + band, ey = hd + road + band;
            Quad(street, new Point3d(-ex, -ey, -0.05), new Point3d(ex, -ey, -0.05), new Point3d(ex, ey, -0.05), new Point3d(-ex, ey, -0.05));
            var rnd = new Random(23);
            for (int gx = -1; gx <= 1; gx++)
                for (int gy = -1; gy <= 1; gy++)
                {
                    if (gx == 0 && gy == 0) continue;
                    double x0 = gx < 0 ? -ex : gx > 0 ? hw + road : -hw, x1 = gx < 0 ? -hw - road : gx > 0 ? ex : hw;
                    double y0 = gy < 0 ? -ey : gy > 0 ? hd + road : -hd, y1 = gy < 0 ? -hd - road : gy > 0 ? ey : hd;
                    Prism(massing, new Point3d(x0, y0, -0.05), new Point3d(x1, y0, -0.05), new Vector3d(0, y1 - y0, 0), Z * (kerb + 0.05));

                    // Buildings in a row along the pad's long side, each a little narrower and lower than the next.
                    bool alongX = x1 - x0 >= y1 - y0;
                    double run = (alongX ? x1 - x0 : y1 - y0) - 2 * setback, deep = (alongX ? y1 - y0 : x1 - x0) - 2 * setback;
                    int count = Math.Max(1, (int)Math.Round(run / 30));
                    double pitch = run / count;
                    for (int b = 0; b < count; b++)
                    {
                        double len = pitch - 4 - rnd.NextDouble() * 4, wid = deep * (0.62 + rnd.NextDouble() * 0.38);
                        double bh = 9 + Math.Pow(rnd.NextDouble(), 2) * 24;
                        double u = setback + b * pitch + (pitch - len) / 2;
                        // Pushed towards the site, so the street has a wall.
                        bool nearLow = alongX ? gy > 0 : gx > 0;
                        double off = nearLow ? setback : deep + setback - wid;
                        Point3d corner = alongX ? new Point3d(x0 + u, y0 + off, kerb) : new Point3d(x0 + off, y0 + u, kerb);
                        Vector3d along = alongX ? new Vector3d(len, 0, 0) : new Vector3d(0, len, 0);
                        Vector3d across = alongX ? new Vector3d(0, wid, 0) : new Vector3d(wid, 0, 0);
                        Prism(massing, corner, corner + along, across, Z * bh);
                    }
                }
        }

        // Metres above whatever the document uses: 84 in a millimetre file is a model, and the viewer's
        // real-size finishes would draw a brick bigger than the building.
        var doc = RhinoDoc.ActiveDoc;
        double toDoc = doc == null ? 1 : RhinoMath.UnitScale(UnitSystem.Meters, doc.ModelUnitSystem);
        foreach (var m in new[] { slabs, clad, glass, lit, frames, green, massing, ground, street })
        {
            if (Math.Abs(toDoc - 1) > 1e-12) m.Scale(toDoc);
            m.Normals.ComputeNormals();
        }

        // ---- Outputs -------------------------------------------------------------------------------
        double plot = plotW * plotD, height = finish + ParapetHeight;
        double spare = limit - height;
        double footprintArea = pn > 0 ? RectArea(podiumBox) : plateArea;

        Slabs = OrNone(slabs); Clad = OrNone(clad); Glazing = OrNone(glass); LitGlazing = OrNone(lit); Frames = OrNone(frames);
        Planting = OrNone(green); Massing = OrNone(massing); Ground = ground; Street = OrNone(street);
        PodiumLevels = podiumLevels; PodiumAreas = podiumAreas; TowerLevels = towerLevels; TowerAreas = towerAreas;
        BuildingHeight = Math.Round(height, 1);
        Gfa = Math.Round(gfa);
        Far = Math.Round(gfa / plot, 2);
        Coverage = Math.Round(footprintArea / plot * 100, 1);
        FacadeArea = Math.Round(facade);
        Units = Math.Floor(gfa * 0.8 / 78);
        Zoning = (spare >= 0 ? string.Format("Within the limit, {0:0.0} m spare", spare) : string.Format("Over the limit by {0:0.0} m", -spare))
            + (overPlot > 1e-6 ? string.Format(". Footprint overruns the plot by {0:0.0} m", overPlot) : "");
    }

    // ================================================================================================
    // Plate

    static void BuildPlate(string type, double L, double D, double w, List<List<Point3d>> loops, List<double[]> rects)
    {
        if (type == "L-Block")
        {
            loops.Add(Pts(0, 0, L, 0, L, w, w, w, w, D, 0, D));
            rects.Add(new[] { 0, 0, L, w }); rects.Add(new[] { 0, w, w, D });
        }
        else if (type == "U-Block")
        {
            loops.Add(Pts(0, 0, L, 0, L, D, L - w, D, L - w, w, w, w, w, D, 0, D));
            rects.Add(new[] { 0, 0, L, w }); rects.Add(new[] { 0, w, w, D }); rects.Add(new[] { L - w, w, L, D });
        }
        else if (type == "Courtyard")
        {
            loops.Add(Pts(0, 0, L, 0, L, D, 0, D));
            loops.Add(Pts(w, w, w, D - w, L - w, D - w, L - w, w));
            rects.Add(new[] { 0, 0, L, w }); rects.Add(new[] { 0, D - w, L, D }); rects.Add(new[] { 0, w, w, D - w }); rects.Add(new[] { L - w, w, L, D - w });
        }
        else
        {
            loops.Add(Pts(0, 0, L, 0, L, D, 0, D));
            rects.Add(new[] { 0, 0, L, D });
        }
        var shift = new Vector3d(-L / 2, -D / 2, 0);
        foreach (var loop in loops) for (int i = 0; i < loop.Count; i++) loop[i] += shift;
        foreach (var r in rects) { r[0] -= L / 2; r[2] -= L / 2; r[1] -= D / 2; r[3] -= D / 2; }
    }

    // The deepest wing that still leaves the shape its name: a court at least 6 m across, a leg at least 4 m long.
    static double MaxWing(string type, double L, double D)
    {
        double max = type == "Courtyard" ? (Math.Min(L, D) - 6) / 2
            : type == "U-Block" ? Math.Min((L - 6) / 2, D - 4)
            : Math.Min(L, D) - 4;
        return Math.Max(1, max);
    }

    static List<Point3d> RectLoop(double[] r) { return Pts(r[0], r[1], r[2], r[1], r[2], r[3], r[0], r[3]); }
    static double RectArea(double[] r) { return (r[2] - r[0]) * (r[3] - r[1]); }

    // A reflex corner of the building: the loop turns right there, since outward is to the right.
    static bool IsConcave(Point3d prev, Point3d at, Point3d next)
    {
        Vector3d a = at - prev, b = next - at;
        return a.X * b.Y - a.Y * b.X < -1e-9;
    }

    // ================================================================================================
    // Storeys

    // stacked: the storey below has the same plate, so mullions and fins can run down over the slab edge and
    // read as continuous lines. On a twisting tower they stop at the slab instead of hanging off it.
    static void Storey(List<List<Point3d>> loops, Transform xf, double z, double fh, double bay, string system, double fin, double ratio, double bal,
        int level, double litShare, bool stacked, Mesh slabs, Mesh clad, Mesh glass, Mesh lit, Mesh frames)
    {
        for (int l = 0; l < loops.Count; l++)
        {
            var loop = loops[l];
            int count = loop.Count;
            for (int e = 0; e < count; e++)
            {
                Point3d a0 = loop[e], b0 = loop[(e + 1) % count];
                bool concaveStart = IsConcave(loop[(e + count - 1) % count], a0, b0);
                bool concaveEnd = IsConcave(a0, b0, loop[(e + 2) % count]);
                // Counted on the untransformed plate, so bays and fins stack in lines up a tapered tower.
                int bays = Math.Max(1, (int)Math.Round(a0.DistanceTo(b0) / bay));
                int edgeId = l * 1000 + e;

                // Starts above the slab: the slab's edge shares this plane, and the two would fight.
                Point3d a = Flat(a0, xf, z + SlabDepth), b = Flat(b0, xf, z + SlabDepth);
                var along = (b - a) / bays;
                var dir = U(along);
                var nrm = Outward(a, b);
                var up = Z * (fh - SlabDepth);
                var storey = stacked ? Z * fh : up;
                // Rooted just behind the glass, so a back face never shares its plane.
                var sink = -nrm * GlassSetback;
                var root = stacked ? sink - Z * SlabDepth : sink;

                if (system == "Vertical Fins")
                {
                    // One sill band per edge. At an outside corner one band runs on past the corner to close it
                    // and the next starts behind it; at an inside corner the band stops short of its neighbour.
                    const double depth = 0.15;
                    double reach = depth - GlassSetback;
                    Point3d bs = a + dir * (concaveStart ? 0 : GlassSetback) + sink;
                    Point3d be = b + dir * (concaveEnd ? -reach : reach) + sink;
                    if ((be - bs) * dir > 0.05) Prism(clad, bs, be, nrm * depth, Z * 0.7);
                }

                for (int i = 0; i < bays; i++)
                {
                    var p = a + along * i; var q = p + along;
                    var pane = Pane(edgeId, i, level, litShare, glass, lit);
                    // Corner pieces at an inside corner would run straight into the neighbouring wall.
                    bool atConcaveStart = i == 0 && concaveStart;
                    bool atConcaveEnd = i == bays - 1 && concaveEnd;

                    if (system == "Punched Windows")
                    {
                        double f = Math.Sqrt(ratio);
                        var u = along * (1 - f) / 2; var v = up * (1 - f) * 0.55; var v2 = up * (1 - f) * 0.45;
                        Point3d p0 = p + u + v, p1 = q - u + v, p2 = q - u + up - v2, p3 = p + u + up - v2;
                        Quad(clad, p, q, p1, p0); Quad(clad, p3, p2, q + up, p + up);
                        Quad(clad, p, p0, p3, p + up); Quad(clad, p1, q, q + up, p2);
                        var inset = -nrm * 0.28;
                        Quad(clad, p0, p1, p1 + inset, p0 + inset); Quad(clad, p3 + inset, p2 + inset, p2, p3);
                        Quad(clad, p0 + inset, p3 + inset, p3, p0); Quad(clad, p1, p2, p2 + inset, p1 + inset);
                        Quad(pane, p0 + inset, p1 + inset, p2 + inset, p3 + inset);
                        continue;
                    }

                    bool balconyHere = system == "Balconies" && (i + level) % 2 == 0 && !atConcaveStart && !atConcaveEnd;
                    if (balconyHere) BalconyDoor(pane, frames, p, q, up, dir, nrm);
                    else Quad(pane, p, q, q + up, p + up);
                    // At an outside corner the first post belongs to both faces: it sits wholly on this edge,
                    // flush with the face before it, instead of straddling the corner and poking out sideways.
                    bool atConvexStart = i == 0 && !concaveStart;
                    if (system == "Curtain Wall")
                    {
                        const double depth = 0.23, half = 0.04;
                        if (atConvexStart)
                            // A square corner post standing proud of both faces by the same amount.
                            Prism(frames, p - dir * (depth - GlassSetback) + root, p + dir * GlassSetback + root, nrm * depth, storey);
                        else if (!atConcaveStart)
                            Prism(frames, p - dir * half + root, p + dir * half + root, nrm * depth, storey);
                    }
                    else if (system == "Vertical Fins")
                    {
                        if (fin < 0.01) continue;
                        const double thick = 0.14;
                        if (atConvexStart)
                            Prism(clad, p - dir * GlassSetback + root, p + dir * (thick - GlassSetback) + root, nrm * (fin + GlassSetback), storey);
                        else if (!atConcaveStart)
                            Prism(clad, p - dir * (thick / 2) + root, p + dir * (thick / 2) + root, nrm * (fin + GlassSetback), storey);
                        var mid = p + along / 2;
                        Prism(clad, mid - dir * 0.05 + root, mid + dir * 0.05 + root, nrm * (fin * 0.6 + GlassSetback), storey);
                    }
                    else if (balconyHere)
                    {
                        var gap = dir * 0.1;
                        var plate = nrm * bal;
                        var plateDepth = Z * 0.18;
                        Prism(clad, p + gap + sink - plateDepth, q - gap + sink - plateDepth, plate - sink, plateDepth);
                        // Rails are thin solids set just inside the plate's edge, so they have a proper inside face.
                        // The front runs past the corners by half its width and the sides stop short of it,
                        // so the three pieces meet without overlapping.
                        const double inset = 0.03, paneW = 0.02, cap = 0.05, railH = 1.1;
                        Point3d s0 = p + gap + dir * inset, s1 = q - gap - dir * inset;
                        Point3d f0 = s0 + nrm * (bal - inset), f1 = s1 + nrm * (bal - inset);
                        foreach (var piece in new[] { new { w = paneW, h = railH, z = 0.0, m = glass }, new { w = cap, h = cap, z = railH, m = frames } })
                        {
                            var lift = Z * piece.z;
                            Bar(piece.m, f0 - dir * (piece.w / 2) + lift, f1 + dir * (piece.w / 2) + lift, piece.w, piece.h);
                            Bar(piece.m, s0 + lift, f0 - nrm * (piece.w / 2) + lift, piece.w, piece.h);
                            Bar(piece.m, f1 - nrm * (piece.w / 2) + lift, s1 + lift, piece.w, piece.h);
                        }
                    }
                }
            }
        }
    }

    // A glazed door in the middle of a balcony bay, with fixed glass either side and above it. The door leaf sits
    // a few centimetres back from the glass line, and its frame is deep enough to hide that step.
    static void BalconyDoor(Mesh pane, Mesh frames, Point3d p, Point3d q, Vector3d up, Vector3d dir, Vector3d nrm)
    {
        const double fw = 0.06, recess = 0.04, proud = 0.03;
        double dw = Math.Min(1.0, p.DistanceTo(q) - 0.4), dh = Math.Min(2.3, up.Length - 0.3);
        if (dw < 0.6 || dh < 1.8) { Quad(pane, p, q, q + up, p + up); return; }    // too tight for a door

        var mid = p + (q - p) / 2;
        Point3d d0 = mid - dir * (dw / 2), d1 = mid + dir * (dw / 2);
        var head = Z * dh;

        // Fixed glass left, right and above the opening.
        Quad(pane, p, d0, d0 + up, p + up);
        Quad(pane, d1, q, q + up, d1 + up);
        Quad(pane, d0 + head, d1 + head, d1 + up, d0 + up);

        // Frame: two jambs up to the underside of the head, then the head across both.
        var back = -nrm * (recess + 0.02);
        var depth = nrm * (recess + 0.02 + proud);
        var jamb = Z * (dh - fw / 2);
        Prism(frames, d0 - dir * (fw / 2) + back, d0 + dir * (fw / 2) + back, depth, jamb);
        Prism(frames, d1 - dir * (fw / 2) + back, d1 + dir * (fw / 2) + back, depth, jamb);
        Prism(frames, d0 - dir * (fw / 2) + back + jamb, d1 + dir * (fw / 2) + back + jamb, depth, Z * fw);

        // Door leaf, set back between the jambs.
        var leaf = -nrm * recess;
        Point3d l0 = d0 + dir * (fw / 2) + leaf, l1 = d1 - dir * (fw / 2) + leaf;
        Quad(pane, l0, l1, l1 + jamb, l0 + jamb);

        // Handle near the opening side.
        var grip = l1 - dir * 0.12 + Z * 0.95;
        Prism(frames, grip - dir * 0.015, grip + dir * 0.015, nrm * 0.06, Z * 0.2);
    }

    // Scattered but stable, so a window doesn't flicker on and off between solves.
    static Mesh Pane(int e, int i, int k, double litShare, Mesh glass, Mesh lit)
    {
        // Wrapping is the point of the hash; the script compiler checks overflow, so say so.
        int hash = unchecked((e * 73856093) ^ (i * 19349663) ^ (k * 83492791));
        return ((hash >> 8) & 1023) / 1023.0 < litShare ? lit : glass;
    }

    // The edge band goes to its own mesh: clad in the facade finish, it ties the storeys together under any system.
    // Underside on the plate below (where that storey's glass ends), top on this storey's plate (where its
    // glass starts). On a twisting tower the edge is a ruled band between the two, so no gap opens at a corner.
    static void Slab(Mesh m, Mesh edge, List<List<Point3d>> loops, List<double[]> rects, double z, Transform below, Transform xf, bool edges)
    {
        double t = SlabDepth;
        foreach (var r in rects)
        {
            Quad(m, P(r[0], r[1], z + t, xf), P(r[2], r[1], z + t, xf), P(r[2], r[3], z + t, xf), P(r[0], r[3], z + t, xf));
            Quad(m, P(r[0], r[3], z, below), P(r[2], r[3], z, below), P(r[2], r[1], z, below), P(r[0], r[1], z, below));
        }
        if (!edges) return;
        foreach (var loop in loops)
            for (int i = 0; i < loop.Count; i++)
            {
                Point3d a = loop[i], b = loop[(i + 1) % loop.Count];
                Point3d a0 = Flat(a, below, z), b0 = Flat(b, below, z), a1 = Flat(a, xf, z + t), b1 = Flat(b, xf, z + t);
                // Twisted, so the band isn't flat: two triangles instead of one warped quad.
                Tri(edge, a0, b0, b1); Tri(edge, a0, b1, a1);
            }
    }

    // Upstand around a roof: the outer face runs from the slab's underside, the inner face from the roof finish.
    static void Parapet(Mesh m, List<List<Point3d>> loops, Transform xf, double z)
    {
        var rise = Z * (SlabDepth + ParapetHeight);
        var finish = Z * SlabDepth;
        foreach (var loop in loops)
        {
            var outer = loop.Select(p => Flat(p, xf, z)).ToList();
            var inner = Inset(outer, ParapetWidth);
            for (int i = 0; i < outer.Count; i++)
            {
                int j = (i + 1) % outer.Count;
                Quad(m, outer[i], outer[j], outer[j] + rise, outer[i] + rise);
                Quad(m, inner[j] + finish, inner[i] + finish, inner[i] + rise, inner[j] + rise);
                Quad(m, outer[i] + rise, outer[j] + rise, inner[j] + rise, inner[i] + rise);
            }
        }
    }

    // A walled interior behind a perimeter zone, so the glazing shows rooms instead of the far facade.
    static void Core(Mesh m, List<double[]> rects, double z, double fh, Transform xf)
    {
        foreach (var r in rects)
        {
            double w = r[2] - r[0], d = r[3] - r[1], inset = Math.Min(6, Math.Min(w, d) * 0.35);
            double x0 = r[0] + inset, y0 = r[1] + inset, x1 = r[2] - inset, y1 = r[3] - inset;
            double lo = z + SlabDepth, hi = z + fh;
            Quad(m, P(x0, y0, lo, xf), P(x1, y0, lo, xf), P(x1, y0, hi, xf), P(x0, y0, hi, xf));
            Quad(m, P(x1, y0, lo, xf), P(x1, y1, lo, xf), P(x1, y1, hi, xf), P(x1, y0, hi, xf));
            Quad(m, P(x1, y1, lo, xf), P(x0, y1, lo, xf), P(x0, y1, hi, xf), P(x1, y1, hi, xf));
            Quad(m, P(x0, y1, lo, xf), P(x0, y0, lo, xf), P(x0, y0, hi, xf), P(x0, y1, hi, xf));
        }
    }

    // Moves each corner along its mitre, so a ring's corners meet instead of overlapping.
    static List<Point3d> Inset(List<Point3d> ring, double d)
    {
        var inner = new List<Point3d>();
        for (int i = 0; i < ring.Count; i++)
        {
            var before = Outward(ring[(i + ring.Count - 1) % ring.Count], ring[i]);
            var after = Outward(ring[i], ring[(i + 1) % ring.Count]);
            inner.Add(ring[i] - (before + after) * (d / (1 + before * after)));
        }
        return inner;
    }

    // ================================================================================================
    // Small pieces

    static void Tree(Mesh green, Mesh frames, Point3d at, double r)
    {
        var d = 0.14;
        Prism(frames, at + new Vector3d(-d, -d, 0), at + new Vector3d(d, -d, 0), new Vector3d(0, 2 * d, 0), Z * (r * 1.2));
        Ball(green, at + Z * (r * 1.7), r, 1);
    }

    // A square post standing on plan point (x, y), following the plate's rotation.
    static void Post(Mesh m, double x, double y, double z, double h, double size, Transform xf)
    {
        if (h <= 0.01) return;
        Point3d a = P(x, y, z, xf), b = P(x + size, y, z, xf);
        Prism(m, a, b, P(x, y + size, z, xf) - a, Z * h);
    }

    // A UV ball with shared vertices, so it shades smooth while everything else stays faceted.
    // squash < 1 flattens it into a mound.
    static void Ball(Mesh m, Point3d c, double r, double squash)
    {
        const int seg = 10, rings = 6;
        if (!(r > 0) || !c.IsValid) return;
        int top = m.Vertices.Count;
        m.Vertices.Add(c + Z * (r * squash));
        for (int j = 1; j < rings; j++)
        {
            double phi = Math.PI * j / rings, rr = Math.Sin(phi) * r, zz = Math.Cos(phi) * r * squash;
            for (int i = 0; i < seg; i++)
            {
                double th = 2 * Math.PI * i / seg;
                m.Vertices.Add(new Point3d(c.X + rr * Math.Cos(th), c.Y + rr * Math.Sin(th), c.Z + zz));
            }
        }
        int bottom = m.Vertices.Count;
        m.Vertices.Add(c - Z * (r * squash));
        Func<int, int, int> V = (j, i) => top + 1 + (j - 1) * seg + (i % seg);
        for (int i = 0; i < seg; i++)
        {
            m.Faces.AddFace(top, V(1, i), V(1, i + 1));
            for (int j = 1; j < rings - 1; j++) m.Faces.AddFace(V(j, i), V(j + 1, i), V(j + 1, i + 1), V(j, i + 1));
            m.Faces.AddFace(bottom, V(rings - 1, i + 1), V(rings - 1, i));
        }
    }

    // A Display reads an empty list as a switched-off part; a null item, or an empty mesh, warns on the page.
    static List<Mesh> OrNone(Mesh m) { return m.Faces.Count > 0 ? new List<Mesh> { m } : new List<Mesh>(); }

    // ================================================================================================
    // Mesh primitives

    static void Quad(Mesh m, Point3d a, Point3d b, Point3d c, Point3d d)
    {
        int i = m.Vertices.Count;
        m.Vertices.Add(a); m.Vertices.Add(b); m.Vertices.Add(c); m.Vertices.Add(d);
        m.Faces.AddFace(i, i + 1, i + 2, i + 3);
    }

    static void Tri(Mesh m, Point3d a, Point3d b, Point3d c)
    {
        int i = m.Vertices.Count;
        m.Vertices.Add(a); m.Vertices.Add(b); m.Vertices.Add(c);
        m.Faces.AddFace(i, i + 1, i + 2);
    }

    static void Prism(Mesh m, Point3d a, Point3d b, Vector3d across, Vector3d up)
    {
        // Keeps faces pointing out whichever side of a -> b the prism grows on.
        if (Vector3d.CrossProduct(b - a, up) * across > 0) { var swap = a; a = b; b = swap; }
        Point3d c = b + across, d = a + across;
        Quad(m, a, b, b + up, a + up); Quad(m, b, c, c + up, b + up);
        Quad(m, c, d, d + up, c + up); Quad(m, d, a, a + up, d + up);
        Quad(m, a + up, b + up, c + up, d + up); Quad(m, d, c, b, a);
    }

    // A horizontal bar standing on the line a -> b, centred across it.
    static void Bar(Mesh m, Point3d a, Point3d b, double width, double height)
    {
        var along = b - a;
        if (along.Length < 1e-6) return;
        var s = Vector3d.CrossProduct(Z, U(along)) * width;
        Prism(m, a - s / 2, b - s / 2, s, Z * height);
    }

    static Vector3d U(Vector3d v) { v.Unitize(); return v; }

    static Vector3d Outward(Point3d a, Point3d b)
    {
        var v = b - a; v.Unitize();
        return new Vector3d(v.Y, -v.X, 0);
    }

    static double Perimeter(List<Point3d> loop)
    {
        double sum = 0;
        for (int i = 0; i < loop.Count; i++) sum += loop[i].DistanceTo(loop[(i + 1) % loop.Count]);
        return sum;
    }

    // Plan point through the plate's twist and taper, then set to height z (the scale must not touch heights).
    static Point3d P(double x, double y, double z, Transform xf) { return Flat(new Point3d(x, y, 0), xf, z); }
    static Point3d Flat(Point3d p, Transform xf, double z) { p.Z = 0; p.Transform(xf); p.Z = z; return p; }

    static List<Point3d> Pts(params double[] xy)
    {
        var list = new List<Point3d>();
        for (int i = 0; i < xy.Length; i += 2) list.Add(new Point3d(xy[i], xy[i + 1], 0));
        return list;
    }

    static double Clamp(double v, double lo, double hi) { return v < lo ? lo : v > hi ? hi : v; }
    static string Txt(object o, string fallback) { return o == null ? fallback : o.ToString().Trim().Trim('"'); }
    static double Num(object o, double fallback) { double v; return o != null && GH_Convert.ToDouble(o, out v, GH_Conversion.Both) && !double.IsNaN(v) ? v : fallback; }
    static bool Bool(object o, bool fallback) { bool v; return o != null && GH_Convert.ToBoolean(o, out v, GH_Conversion.Both) ? v : fallback; }
}
# ---------- end c_script ----------

# ---- group: Building geometry / Outputs
c_buildingheight = CSharpBuildingHeight(c_script.BuildingHeight)
c_podiumlevels = CSharpPodiumLevels(c_script.PodiumLevels)
c_podiumareas = CSharpPodiumAreas(c_script.PodiumAreas)
c_towerlevels = CSharpTowerLevels(c_script.TowerLevels)
c_towerareas = CSharpTowerAreas(c_script.TowerAreas)
c_facadearea = CSharpFacadeArea(c_script.FacadeArea)
c_litglazing = CSharpLitGlazing(c_script.LitGlazing)
c_coverage = CSharpCoverage(c_script.Coverage)
c_planting = CSharpPlanting(c_script.Planting)
c_massing = CSharpMassing(c_script.Massing)
c_ground = CSharpGround(c_script.Ground)
c_glazing = CSharpGlazing(c_script.Glazing)
c_frames = CSharpFrames(c_script.Frames)
c_zoning = CSharpZoning(c_script.Zoning)
c_street = CSharpStreet(c_script.Street)
c_slabs = CSharpSlabs(c_script.Slabs)
c_units = CSharpUnits(c_script.Units)
c_clad = CSharpClad(c_script.Clad)
c_gfa = CSharpGfa(c_script.Gfa)
c_far = CSharpFar(c_script.Far)

# ---- group: 3D view
# 3D VIEW
# One Display per part, each on its own layer, so the scene outliner can hide the context or the glass.
floor_plates_3 = FloorPlates(floor_plates_2)
lit_windows_5 = LitWindows(lit_windows_4)
c_glazing_2 = CSharpGlazing(c_glazing)
glazing_3 = Glazing(glazing_2)
c_frames_2 = CSharpFrames(c_frames)
frames_3 = Frames(frames_2)
c_ground_2 = CSharpGround(c_ground)
paving_finish_3 = PavingFinish(paving_finish_2)
c_street_2 = CSharpStreet(c_street)
street_3 = Street(street_2)
c_slabs_2 = CSharpSlabs(c_slabs)
c_clad_2 = CSharpClad(c_clad)
cladding_finish_3 = CladdingFinish(cladding_finish_2)
c_litglazing_2 = CSharpLitGlazing(c_litglazing)
c_planting_2 = CSharpPlanting(c_planting)
planting_3 = Planting(planting_2)
c_massing_2 = CSharpMassing(c_massing)
city_blocks_3 = CityBlocks(city_blocks_2)
lit_windows_6 = EmissiveMaterial(Color=RGB(255, 196, 128), Strength=1.8, Base=lit_windows_5)
floor_plates_4 = Display(Geo=c_slabs_2, Name="Floor plates", Layer="Building/Floor plates", Material=floor_plates_3)
cladding_3 = Display(Geo=c_clad_2, Name="Cladding", Layer="Building/Cladding", Material=cladding_finish_3)
lit_windows_7 = Display(Geo=c_litglazing_2, Name="Lit windows", Layer="Building/Lit windows", Material=lit_windows_6)
glazing_4 = Display(Geo=c_glazing_2, Name="Glazing", Layer="Building/Glazing", Material=glazing_3)
frames_4 = Display(Geo=c_frames_2, Name="Frames", Layer="Building/Frames", Material=frames_3)
planting_4 = Display(Geo=c_planting_2, Name="Planting", Layer="Landscape/Planting", Material=planting_3)
city_blocks_4 = Display(Geo=c_massing_2, Name="City blocks", Layer="Context/City blocks", Material=city_blocks_3)
plot = Display(Geo=c_ground_2, Name="Plot", Layer="Landscape/Plot", Material=paving_finish_3)
street_4 = Display(Geo=c_street_2, Name="Street", Layer="Context/Street", Material=street_3)
codisplay = CombineDisplay(WebDisplay=flatten([floor_plates_4, cladding_3, glazing_4, lit_windows_7, frames_4, planting_4, city_blocks_4, plot, street_4]))

# ---- group: Chart / Inputs
podium_bars_color = PodiumBarsColor(ColourSwatch(SwatchColor=RGB(150, 132, 112)))
tower_bars_color = TowerBarsColor(ColourSwatch(SwatchColor=RGB(84, 120, 140)))

# ---- group: Chart
# FLOOR AREA CHART
# Selva Canopy bar traces, one per part, so the podium reads apart from the tower. A twisting or tapering tower shows here as shrinking floors.
c_podiumlevels_2 = CSharpPodiumLevels(c_podiumlevels)
c_podiumareas_2 = CSharpPodiumAreas(c_podiumareas)
c_towerlevels_2 = CSharpTowerLevels(c_towerlevels)
c_towerareas_2 = CSharpTowerAreas(c_towerareas)
layout = Layout(Title="Floor area by storey", XAxis="Floor area (m²)", YAxis="Storey", Width=0, Height=0)
podium_bars = Bar(X=c_podiumlevels_2, Y=c_podiumareas_2, Name="Podium", Orientation=1, Color=podium_bars_color)
tower_bars = Bar(X=c_towerlevels_2, Y=c_towerareas_2, Name="Tower", Orientation=1, Color=tower_bars_color)
floor_area_chart = Figure(Traces=[podium_bars, tower_bars], Layout=layout, ExportFormat="png")

# ---- group: Metrics
# METRICS
# One Context Print per figure; the label is the print's input name.
c_buildingheight_2 = CSharpBuildingHeight(c_buildingheight)
c_gfa_2 = CSharpGfa(c_gfa)
c_far_2 = CSharpFar(c_far)
c_units_2 = CSharpUnits(c_units)
c_zoning_2 = CSharpZoning(c_zoning)
c_coverage_2 = CSharpCoverage(c_coverage)
c_facadearea_2 = CSharpFacadeArea(c_facadearea)

# ---- group: Metrics / Outputs
c_print = ContextPrint(SiteCoverage=c_coverage_2)
c_print_2 = ContextPrint(FacadeAreaM2=c_facadearea_2)
c_print_3 = ContextPrint(HeightM=c_buildingheight_2)
c_print_4 = ContextPrint(GFAM2=c_gfa_2)
c_print_5 = ContextPrint(Text=c_far_2)
c_print_6 = ContextPrint(Homes=c_units_2)
c_print_7 = ContextPrint(Zoning=c_zoning_2)

# ---- group: Chart / Outputs
c_bake_2 = ContextBake(FloorAreas=floor_area_chart)

# ---- group: 3D view / Outputs
c_bake_3 = ContextBake(Content=codisplay)
