# Grasshopper definition block_massing_studio.gh (Grasshopper 1.0.9)
# plug-ins: Selva

typology = ValueList({"Tower", "Slab", "L-Block", "U-Block", "Courtyard"}, selected="Tower")
length = Slider(40, range=20..120)
depth = Slider(34, range=14..90)
wing_depth = Slider(14, range=10..24)
storeys = Slider(24, range=3..40)
floor_height = Slider(3.3, range=2.8..4.2)
twist = Slider(35, range=0..90)
taper = Slider(12, range=0..40)
podium = BooleanToggle(True)
podium_storeys = Slider(2, range=1..4)
podium_overhang = Slider(6, range=0..14)
facade_system = ValueList({"Curtain Wall", "Vertical Fins", "Punched Windows", "Balconies"}, selected="Punched Windows")
bay_width = Slider(3.2, range=2..6)
fin_depth = Slider(0.7, range=0.2..1.4)
window_ratio = Slider(0.5, range=0.25..0.8)
balcony_depth = Slider(1.8, range=1..3)
cladding = ValueList({"Corten", "Brick", "Limestone", "Charcoal", "Timber"}, selected="Brick")
glass_tint = ValueList({"Clear", "Bronze", "Sage"}, selected="Clear")
roof = ValueList({"Flat", "Green Roof", "Solar Array"}, selected="Green Roof")
panel_tilt = Slider(20, range=5..35)
city_context = BooleanToggle(True)
street_trees = BooleanToggle(True)
plot_width = Slider(130, range=60..200)
plot_depth = Slider(110, range=60..200)
height_limit = Slider(95, range=20..150)
lit_windows = Slider(38, range=0..80)
ui_bridge = UIBridge(
    Enable=Toggle(True),
    Schema="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",
    SelvaLinks="[{\"origin\":\"https://selvajs.com\",\"definitionGuid\":\"bbdcd377-718a-4637-b474-24b9ee25b65f\",\"versionId\":\"9b3a4280-bd97-44ac-ab24-7f150238263e\",\"versionNumber\":5}]",
    Values="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")  # -> Schema, URL
typology_2 = GetValueList(
    typology,
    AtLeast=1,
    AtMost=1,
    Immediate=True,
    ListAccess=False,
    StoredItems="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",
    TreeAccess=False)
length_2 = GetNumber(length, AtLeast=1, AtMost=1, Maximum=1.797693135e+308, Minimum=-1.797693135e+308, TreeAccess=False)
depth_2 = GetNumber(depth, AtLeast=1, AtMost=1, Maximum=1.797693135e+308, Minimum=-1.797693135e+308, TreeAccess=False)
wing_depth_2 = GetNumber(wing_depth, AtLeast=1, AtMost=1, Maximum=1.797693135e+308, Minimum=-1.797693135e+308, TreeAccess=False)
storeys_2 = GetInteger(storeys, AtLeast=1, AtMost=1, Maximum=2147483647, Minimum=-2147483648, TreeAccess=False)
floor_height_2 = GetNumber(floor_height, AtLeast=1, AtMost=1, Maximum=1.797693135e+308, Minimum=-1.797693135e+308, TreeAccess=False)
twist_2 = GetNumber(twist, AtLeast=1, AtMost=1, Maximum=1.797693135e+308, Minimum=-1.797693135e+308, TreeAccess=False)
taper_2 = GetNumber(taper, AtLeast=1, AtMost=1, Maximum=1.797693135e+308, Minimum=-1.797693135e+308, TreeAccess=False)
podium_2 = GetBoolean(podium, AtLeast=1, AtMost=1, FalseValue="False", TreeAccess=False, TrueValue="True")
podium_storeys_2 = GetInteger(podium_storeys, AtLeast=1, AtMost=1, Maximum=2147483647, Minimum=-2147483648, TreeAccess=False)
podium_overhang_2 = GetNumber(podium_overhang, AtLeast=1, AtMost=1, Maximum=1.797693135e+308, Minimum=-1.797693135e+308, TreeAccess=False)
facade_system_2 = GetValueList(
    facade_system,
    AtLeast=1,
    AtMost=1,
    Immediate=True,
    ListAccess=False,
    StoredItems="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",
    TreeAccess=False)
bay_width_2 = GetNumber(bay_width, AtLeast=1, AtMost=1, Maximum=1.797693135e+308, Minimum=-1.797693135e+308, TreeAccess=False)
fin_depth_2 = GetNumber(fin_depth, AtLeast=1, AtMost=1, Maximum=1.797693135e+308, Minimum=-1.797693135e+308, TreeAccess=False)
window_ratio_2 = GetNumber(window_ratio, AtLeast=1, AtMost=1, Maximum=1.797693135e+308, Minimum=-1.797693135e+308, TreeAccess=False)
balcony_depth_2 = GetNumber(balcony_depth, AtLeast=1, AtMost=1, Maximum=1.797693135e+308, Minimum=-1.797693135e+308, TreeAccess=False)
cladding_2 = GetValueList(
    cladding,
    AtLeast=1,
    AtMost=1,
    Immediate=True,
    ListAccess=False,
    StoredItems="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",
    TreeAccess=False)
glass_tint_2 = GetValueList(
    glass_tint,
    AtLeast=1,
    AtMost=1,
    Immediate=True,
    ListAccess=False,
    StoredItems="""[
  {
    "name": "Clear",
    "expression": "Clear"
  },
  {
    "name": "Bronze",
    "expression": "Bronze"
  },
  {
    "name": "Sage",
    "expression": "Sage"
  }
]""",
    TreeAccess=False)
roof_2 = GetValueList(
    roof,
    AtLeast=1,
    AtMost=1,
    Immediate=True,
    ListAccess=False,
    StoredItems="""[
  {
    "name": "Flat",
    "expression": "Flat"
  },
  {
    "name": "Green Roof",
    "expression": "Green Roof"
  },
  {
    "name": "Solar Array",
    "expression": "Solar Array"
  }
]""",
    TreeAccess=False)
panel_tilt_2 = GetNumber(panel_tilt, AtLeast=1, AtMost=1, Maximum=1.797693135e+308, Minimum=-1.797693135e+308, TreeAccess=False)
city_context_2 = GetBoolean(city_context, AtLeast=1, AtMost=1, FalseValue="False", TreeAccess=False, TrueValue="True")
street_trees_2 = GetBoolean(street_trees, AtLeast=1, AtMost=1, FalseValue="False", TreeAccess=False, TrueValue="True")
plot_width_2 = GetNumber(plot_width, AtLeast=1, AtMost=1, Maximum=1.797693135e+308, Minimum=-1.797693135e+308, TreeAccess=False)
plot_depth_2 = GetNumber(plot_depth, AtLeast=1, AtMost=1, Maximum=1.797693135e+308, Minimum=-1.797693135e+308, TreeAccess=False)
height_limit_2 = GetNumber(height_limit, AtLeast=1, AtMost=1, Maximum=1.797693135e+308, Minimum=-1.797693135e+308, TreeAccess=False)
lit_windows_2 = GetNumber(lit_windows, AtLeast=1, AtMost=1, Maximum=1.797693135e+308, Minimum=-1.797693135e+308, TreeAccess=False)
c_bake = ContextBake(Content=ui_bridge.Schema)
c_script = CSharpScript(
    Typology=typology_2,
    Length=length_2,
    Depth=depth_2,
    WingDepth=wing_depth_2,
    Storeys=storeys_2,
    FloorHeight=floor_height_2,
    Twist=twist_2,
    Taper=taper_2,
    PodiumOn=podium_2,
    PodiumStoreys=podium_storeys_2,
    PodiumOverhang=podium_overhang_2,
    FacadeSystem=facade_system_2,
    Bay=bay_width_2,
    FinDepth=fin_depth_2,
    WindowRatio=window_ratio_2,
    BalconyDepth=balcony_depth_2,
    Cladding=cladding_2,
    GlassTint=glass_tint_2,
    Roof=roof_2,
    PanelTilt=panel_tilt_2,
    ContextOn=city_context_2,
    Trees=street_trees_2,
    PlotWidth=plot_width_2,
    PlotDepth=plot_depth_2,
    HeightLimit=height_limit_2,
    LitWindows=lit_windows_2)  # -> out, Slabs, Clad, Glazing, LitGlazing, Frames, Planting, Massing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
# ---------- c_script: C# ----------
// Grasshopper Script Instance
using System;
using System.Linq;
using System.Collections;
using System.Collections.Generic;
using System.Drawing;

using Rhino;
using Rhino.Geometry;

using Grasshopper;
using Grasshopper.Kernel;
using Grasshopper.Kernel.Data;
using Grasshopper.Kernel.Types;

public class Script_Instance : GH_ScriptInstance
{
    // A building on a plot, in metres. Plates are loops of outward-facing edges plus rectangles for the
    // floor faces: a courtyard is two loops, so its inner wall faces the court.
    const double SlabDepth = 0.34;

    private void RunScript(
		object Typology, object Length, object Depth, object WingDepth, object Storeys, object FloorHeight,
		object Twist, object Taper, object PodiumOn, object PodiumStoreys, object PodiumOverhang,
		object FacadeSystem, object Bay, object FinDepth, object WindowRatio, object BalconyDepth, object Cladding, object GlassTint,
		object Roof, object PanelTilt, object ContextOn, object Trees, object PlotWidth, object PlotDepth, object HeightLimit, object LitWindows,
		ref object Slabs, ref object Clad, ref object Glazing, ref object LitGlazing, ref object Frames, ref object Planting, ref object Massing, ref object Ground,
		ref object CladCol, ref object CladPreset, ref object GlassCol,
		ref object BuildingHeight, ref object Gfa, ref object Far, ref object Coverage, ref object FacadeArea, ref object Units, ref object Zoning)
    {
        Diag = null;
        string type = Txt(Typology, "Tower"), system = Txt(FacadeSystem, "Vertical Fins"), roof = Txt(Roof, "Green Roof"), tint = Txt(GlassTint, "Clear");
        double L = Num(Length, 40), D = Num(Depth, 34), w = Math.Min(Num(WingDepth, 14), Math.Min(L, D) / 2.2), fh = Num(FloorHeight, 3.3);
        int n = (int)Num(Storeys, 22);
        double twist = Num(Twist, 25) * Math.PI / 180, taper = Num(Taper, 12) / 100.0;
        bool podium = Bool(PodiumOn, true), context = Bool(ContextOn, true), trees = Bool(Trees, true);
        int pn = podium ? (int)Num(PodiumStoreys, 2) : 0;
        double overhang = Num(PodiumOverhang, 6), bay = Num(Bay, 3.2), fin = Num(FinDepth, 0.7), ratio = Num(WindowRatio, 0.5), bal = Num(BalconyDepth, 1.8);
        double tilt = Num(PanelTilt, 20) * Math.PI / 180, plotW = Num(PlotWidth, 130), plotD = Num(PlotDepth, 110), limit = Num(HeightLimit, 90);
        const double podiumFh = 4.6;

        var slabs = new Mesh(); var clad = new Mesh(); var glass = new Mesh(); var lit = new Mesh(); var frames = new Mesh();
        double litShare = Num(LitWindows, 38) / 100;
        var green = new Mesh(); var massing = new Mesh(); var ground = new Mesh();

        // Plate
        var loops = new List<List<Point3d>>();
        var rects = new List<double[]>();
        if (type == "L-Block")
        {
            loops.Add(Pts(0, 0, L, 0, L, w, w, w, w, D, 0, D));
            rects.Add(new[] { 0, 0, L, w }); rects.Add(new[] { 0, w, w, D });
        }
        else if (type == "U-Block")
        {
            loops.Add(Pts(0, 0, L, 0, L, D, L - w, D, L - w, w, w, w, w, D, 0, D));
            rects.Add(new[] { 0, 0, L, w }); rects.Add(new[] { 0, w, w, D }); rects.Add(new[] { L - w, w, L, D });
        }
        else if (type == "Courtyard")
        {
            loops.Add(Pts(0, 0, L, 0, L, D, 0, D));
            loops.Add(Pts(w, w, w, D - w, L - w, D - w, L - w, w));
            rects.Add(new[] { 0, 0, L, w }); rects.Add(new[] { 0, D - w, L, D }); rects.Add(new[] { 0, w, w, D - w }); rects.Add(new[] { L - w, w, L, D - w });
        }
        else
        {
            loops.Add(Pts(0, 0, L, 0, L, D, 0, D));
            rects.Add(new[] { 0, 0, L, D });
        }
        foreach (var loop in loops) for (int i = 0; i < loop.Count; i++) loop[i] += new Vector3d(-L / 2, -D / 2, 0);
        foreach (var r in rects) { r[0] -= L / 2; r[2] -= L / 2; r[1] -= D / 2; r[3] -= D / 2; }
        double plateArea = rects.Sum(r => (r[2] - r[0]) * (r[3] - r[1]));
        double perimeter = loops.Sum(Perimeter);

        // Podium
        double z0 = 0, gfa = 0;
        var maxBox = new[] { -L / 2 - overhang, -D / 2 - overhang, L / 2 + overhang, D / 2 + overhang };
        if (pn > 0)
        {
            var loop = Pts(maxBox[0], maxBox[1], maxBox[2], maxBox[1], maxBox[2], maxBox[3], maxBox[0], maxBox[3]);
            for (int k = 0; k < pn; k++)
            {
                Slab(slabs, new List<List<Point3d>> { loop }, new List<double[]> { maxBox }, z0, Transform.Identity);
                Storey(new List<List<Point3d>> { loop }, Transform.Identity, z0, podiumFh, 6, "Curtain Wall", 0, 0, 0, k, slabs, clad, glass, lit, 0.5, frames);
                Core(slabs, new List<double[]> { maxBox }, z0, podiumFh, Transform.Identity);
                z0 += podiumFh;
            }
            Slab(slabs, new List<List<Point3d>> { loop }, new List<double[]> { maxBox }, z0, Transform.Identity);
            gfa += (maxBox[2] - maxBox[0]) * (maxBox[3] - maxBox[1]) * pn;
        }

        // Storeys
        bool tower = type == "Tower";
        var center = Point3d.Origin;
        Transform top = Transform.Identity;
        double facade = 0;
        for (int k = 0; k < n; k++)
        {
            double t = n > 1 ? k / (double)(n - 1) : 0;
            var xf = Transform.Identity;
            double s = 1;
            if (tower)
            {
                s = 1 - taper * t;
                xf = Transform.Rotation(twist * t, Vector3d.ZAxis, center) * Transform.Scale(center, s);
            }
            // The podium's roof is the first floor: a second slab there would fight it.
            if (k > 0 || pn == 0) Slab(slabs, loops, rects, z0, xf);
            Storey(loops, xf, z0, fh, bay, system, fin, ratio, bal, k, slabs, clad, glass, lit, litShare, frames);
            Core(slabs, rects, z0, fh, xf);
            gfa += plateArea * s * s;
            facade += perimeter * s * fh;
            z0 += fh;
            top = xf;
        }
        Slab(slabs, loops, rects, z0, top);

        // Parapet
        foreach (var loop in loops)
        {
            var outerRing = loop.Select(p => { var q = p; q.Transform(top); q.Z = z0; return q; }).ToList();
            var innerRing = Inset(outerRing, 0.3);
            var rise = new Vector3d(0, 0, 1.1);
            for (int i = 0; i < outerRing.Count; i++)
            {
                int j = (i + 1) % outerRing.Count;
                Quad(frames, outerRing[i], outerRing[j], outerRing[j] + rise, outerRing[i] + rise);
                Quad(frames, innerRing[j], innerRing[i], innerRing[i] + rise, innerRing[j] + rise);
                Quad(frames, outerRing[i] + rise, outerRing[j] + rise, innerRing[j] + rise, innerRing[i] + rise);
            }
        }

        // Roof
        foreach (var r in rects)
        {
            if (roof == "Green Roof")
            {
                Quad(green, P(r[0], r[1], z0 + SlabDepth + 0.02, top), P(r[2], r[1], z0 + SlabDepth + 0.02, top), P(r[2], r[3], z0 + SlabDepth + 0.02, top), P(r[0], r[3], z0 + SlabDepth + 0.02, top));
                var rnd = new Random(7);
                for (double x = r[0] + 2; x < r[2] - 1; x += 3.4)
                    for (double y = r[1] + 2; y < r[3] - 1; y += 3.4)
                        if (rnd.NextDouble() > 0.55) green.Append(Blob(P(x, y, z0 + 0.5, top), 0.7 + rnd.NextDouble() * 0.7));
            }
            else if (roof == "Solar Array")
            {
                for (double y = r[1] + 1.5; y < r[3] - 2.4; y += 3.2)
                    for (double x = r[0] + 1; x < r[2] - 1; x += 2.1)
                    {
                        var a = P(x, y, z0 + 0.5, top); var b = P(x + 1.9, y, z0 + 0.5, top);
                        var back = P(x, y + 1.7 * Math.Cos(tilt), z0 + 0.5 + 1.7 * Math.Sin(tilt), top);
                        Prism(glass, a, b, back - a, new Vector3d(0, 0, 0.06));
                        Prism(frames, a, b, back - a, new Vector3d(0, 0, -0.06));
                    }
            }
        }

        // Site
        double hw = plotW / 2, hd = plotD / 2;
        Quad(ground, new Point3d(-hw, -hd, 0.02), new Point3d(hw, -hd, 0.02), new Point3d(hw, hd, 0.02), new Point3d(-hw, hd, 0.02));
        if (trees)
        {
            var rnd = new Random(11);
            for (double x = -hw + 5; x <= hw - 5; x += 11)
                foreach (double y in new[] { -hd + 4, hd - 4 })
                    Tree(green, frames, new Point3d(x, y, 0), 3 + rnd.NextDouble() * 1.4);
            for (double y = -hd + 15; y <= hd - 15; y += 11)
                foreach (double x in new[] { -hw + 4, hw - 4 })
                    Tree(green, frames, new Point3d(x, y, 0), 3 + rnd.NextDouble() * 1.4);
        }
        if (context)
        {
            double road = 16, pitchX = plotW + road, pitchY = plotD + road, reach = 1.5;
            Quad(ground, new Point3d(-pitchX * reach, -pitchY * reach, -0.05), new Point3d(pitchX * reach, -pitchY * reach, -0.05), new Point3d(pitchX * reach, pitchY * reach, -0.05), new Point3d(-pitchX * reach, pitchY * reach, -0.05));
            var rnd = new Random(23);
            for (int gx = -1; gx <= 1; gx++)
                for (int gy = -1; gy <= 1; gy++)
                {
                    if (gx == 0 && gy == 0) continue;
                    double cx = gx * pitchX, cy = gy * pitchY;
                    for (int b = 0; b < 3; b++)
                    {
                        double bw = plotW * (0.18 + rnd.NextDouble() * 0.11), bd = plotD * (0.3 + rnd.NextDouble() * 0.5);
                        double bx = cx + (b - 1) * plotW * 0.32, by = cy + (rnd.NextDouble() - 0.5) * plotD * 0.2;
                        double bh = 8 + Math.Pow(rnd.NextDouble(), 2) * 22;
                        Prism(massing, new Point3d(bx - bw / 2, by - bd / 2, 0), new Point3d(bx + bw / 2, by - bd / 2, 0), new Vector3d(0, bd, 0), new Vector3d(0, 0, bh));
                    }
                }
        }

        // Metres above whatever the document uses: 84 in a millimetre file is a model, and the viewer's
        // real-size finishes would draw a brick bigger than the building.
        var doc = RhinoDoc.ActiveDoc;
        double toDoc = doc == null ? 1 : RhinoMath.UnitScale(UnitSystem.Meters, doc.ModelUnitSystem);
        foreach (var m in new[] { slabs, clad, glass, lit, frames, green, massing, ground })
        {
            m.Scale(toDoc);
            m.Normals.ComputeNormals();
        }

        double plot = plotW * plotD, height = z0 + 1.1;
        double spare = limit - height;
        double footprintArea = pn > 0 ? (maxBox[2] - maxBox[0]) * (maxBox[3] - maxBox[1]) : plateArea;

        Slabs = OrNull(slabs); Clad = OrNull(clad); Glazing = OrNull(glass); LitGlazing = OrNull(lit); Frames = OrNull(frames); Planting = OrNull(green); Massing = OrNull(massing); Ground = ground;
        CladCol = CladColour(Txt(Cladding, "Corten"));
        string cladName = Txt(Cladding, "Corten");
        CladPreset = cladName == "Brick" ? 13 : cladName == "Timber" ? 7 : cladName == "Corten" ? 15 : 14;
        GlassCol = tint == "Bronze" ? Color.FromArgb(150, 118, 86) : tint == "Sage" ? Color.FromArgb(120, 150, 134) : Color.FromArgb(168, 196, 214);
        BuildingHeight = Math.Round(height, 1);
        Gfa = Math.Round(gfa);
        Far = Math.Round(gfa / plot, 2);
        Coverage = Math.Round(footprintArea / plot * 100, 1);
        FacadeArea = Math.Round(facade);
        Units = Math.Floor(gfa * 0.8 / 78);
        Zoning = spare >= 0 ? string.Format("Within the limit, {0:0.0} m spare", spare) : string.Format("Over the limit by {0:0.0} m", -spare);
        if (Diag != null) Zoning = Diag;
    }

    // An empty mesh reads as failed geometry; nothing at all reads as a switched-off option.
    static Mesh OrNull(Mesh m) { return m.Faces.Count > 0 ? m : null; }

    static Color CladColour(string name)
    {
        switch (name)
        {
            case "Brick": return Color.FromArgb(158, 76, 56);
            case "Limestone": return Color.FromArgb(224, 214, 192);
            case "Charcoal": return Color.FromArgb(52, 54, 58);
            case "Timber": return Color.FromArgb(178, 130, 84);
            default: return Color.FromArgb(150, 78, 44);
        }
    }

    // Scattered but stable, so a window doesn't flicker on and off between solves.
    static Mesh Pane(int e, int i, int k, double litShare, Mesh glass, Mesh lit)
    {
        int hash = (e * 73856093) ^ (i * 19349663) ^ (k * 83492791);
        return ((hash >> 8) & 1023) / 1023.0 < litShare ? lit : glass;
    }

    static void Storey(List<List<Point3d>> loops, Transform xf, double z, double fh, double bay, string system, double fin, double ratio, double bal, int k,
        Mesh slabs, Mesh clad, Mesh glass, Mesh lit, double litShare, Mesh frames)
    {
        foreach (var loop in loops)
            for (int e = 0; e < loop.Count; e++)
            {
                Point3d a = loop[e], b = loop[(e + 1) % loop.Count];
                // Starts above the slab: the slab's edge shares this plane, and the two would fight.
                a.Transform(xf); b.Transform(xf); a.Z = z + SlabDepth; b.Z = z + SlabDepth;
                double len = a.DistanceTo(b);
                int bays = Math.Max(1, (int)Math.Round(len / bay));
                var along = (b - a) / bays;
                var nrm = Outward(a, b);
                var up = new Vector3d(0, 0, fh - SlabDepth);
                var storey = new Vector3d(0, 0, fh);
                // Rooted just behind the glass, so a back face never shares its plane.
                var root = -nrm * 0.03 - new Vector3d(0, 0, SlabDepth);
                var sink = -nrm * 0.03;
                for (int i = 0; i < bays; i++)
                {
                    var p = a + along * i; var q = p + along;
                    if (system == "Punched Windows")
                    {
                        double f = Math.Sqrt(ratio);
                        var u = along * (1 - f) / 2; var v = up * (1 - f) * 0.55; var v2 = up * (1 - f) * 0.45;
                        Point3d p0 = p + u + v, p1 = q - u + v, p2 = q - u + up - v2, p3 = p + u + up - v2;
                        Quad(clad, p, q, p1, p0); Quad(clad, p3, p2, q + up, p + up);
                        Quad(clad, p, p0, p3, p + up); Quad(clad, p1, q, q + up, p2);
                        var inset = -nrm * 0.28;
                        Quad(clad, p0, p1, p1 + inset, p0 + inset); Quad(clad, p3 + inset, p2 + inset, p2, p3);
                        Quad(clad, p0 + inset, p3 + inset, p3, p0); Quad(clad, p1, p2, p2 + inset, p1 + inset);
                        Quad(Pane(e, i, k, litShare, glass, lit), p0 + inset, p1 + inset, p2 + inset, p3 + inset);
                        continue;
                    }
                    Quad(Pane(e, i, k, litShare, glass, lit), p, q, q + up, p + up);
                    if (system == "Curtain Wall")
                    {
                        Prism(frames, p - U(along) * 0.04 + root, p + U(along) * 0.04 + root, nrm * 0.23, storey);
                    }
                    else if (system == "Vertical Fins")
                    {
                        var dir = U(along);
                        Prism(clad, p - dir * 0.07 + root, p + dir * 0.07 + root, nrm * (fin + 0.03), storey);
                        Prism(clad, p + along / 2 - dir * 0.05 + root, p + along / 2 + dir * 0.05 + root, nrm * (fin * 0.6 + 0.03), storey);
                        Prism(clad, p + sink, q + sink, nrm * 0.15, new Vector3d(0, 0, 0.7));
                    }
                    else if (system == "Balconies" && (i + k) % 2 == 0)
                    {
                        var dir = U(along) * 0.1;
                        var plate = nrm * bal;
                        var plateDepth = new Vector3d(0, 0, 0.18);
                        Prism(slabs, p + dir + sink - plateDepth, q - dir + sink - plateDepth, plate - sink, plateDepth);
                        var rail = new Vector3d(0, 0, 1.25);
                        Point3d r0 = p + dir + plate, r1 = q - dir + plate;
                        Quad(glass, r0, r1, r1 + rail, r0 + rail);
                        Quad(glass, p + dir, r0, r0 + rail, p + dir + rail);
                        Quad(glass, r1, q - dir, q - dir + rail, r1 + rail);
                    }
                }
            }
    }

    static void Slab(Mesh m, List<List<Point3d>> loops, List<double[]> rects, double z, Transform xf)
    {
        double t = SlabDepth;
        foreach (var r in rects)
        {
            Quad(m, P(r[0], r[1], z + t, xf), P(r[2], r[1], z + t, xf), P(r[2], r[3], z + t, xf), P(r[0], r[3], z + t, xf));
            Quad(m, P(r[0], r[3], z, xf), P(r[2], r[3], z, xf), P(r[2], r[1], z, xf), P(r[0], r[1], z, xf));
        }
        foreach (var loop in loops)
            for (int i = 0; i < loop.Count; i++)
            {
                Point3d a = loop[i], b = loop[(i + 1) % loop.Count];
                a.Transform(xf); b.Transform(xf);
                a.Z = z; b.Z = z;
                var rise = Vector3d.ZAxis * t;
                Quad(m, a, b, b + rise, a + rise);
            }
    }

    // A walled interior behind a perimeter zone, so the glazing shows rooms instead of the far facade.
    static void Core(Mesh m, List<double[]> rects, double z, double fh, Transform xf)
    {
        foreach (var r in rects)
        {
            double w = r[2] - r[0], d = r[3] - r[1], inset = Math.Min(6, Math.Min(w, d) * 0.35);
            double x0 = r[0] + inset, y0 = r[1] + inset, x1 = r[2] - inset, y1 = r[3] - inset;
            double lo = z + SlabDepth, hi = z + fh;
            Quad(m, P(x0, y0, lo, xf), P(x1, y0, lo, xf), P(x1, y0, hi, xf), P(x0, y0, hi, xf));
            Quad(m, P(x1, y0, lo, xf), P(x1, y1, lo, xf), P(x1, y1, hi, xf), P(x1, y0, hi, xf));
            Quad(m, P(x1, y1, lo, xf), P(x0, y1, lo, xf), P(x0, y1, hi, xf), P(x1, y1, hi, xf));
            Quad(m, P(x0, y1, lo, xf), P(x0, y0, lo, xf), P(x0, y0, hi, xf), P(x0, y1, hi, xf));
        }
    }

    // Moves each corner along its mitre, so a ring's corners meet instead of overlapping.
    static List<Point3d> Inset(List<Point3d> ring, double d)
    {
        var inner = new List<Point3d>();
        for (int i = 0; i < ring.Count; i++)
        {
            var before = Outward(ring[(i + ring.Count - 1) % ring.Count], ring[i]);
            var after = Outward(ring[i], ring[(i + 1) % ring.Count]);
            inner.Add(ring[i] - (before + after) * (d / (1 + before * after)));
        }
        return inner;
    }

    static void Tree(Mesh green, Mesh frames, Point3d at, double r)
    {
        var d = 0.14;
        Prism(frames, at + new Vector3d(-d, -d, 0), at + new Vector3d(d, -d, 0), new Vector3d(0, 2 * d, 0), new Vector3d(0, 0, r * 1.2));
        green.Append(Blob(at + new Vector3d(0, 0, r * 1.7), r));
    }

    static string Diag;
    static Mesh Blob(Point3d at, double r)
    {
        var s = new Sphere(at, r);
        if (!s.IsValid) { if (Diag == null) Diag = string.Format("DIAG at={0} atValid={1} r={2} rhino={3}", at, at.IsValid, r, RhinoApp.Version); return new Mesh(); }
        return Mesh.CreateFromSphere(s, 10, 8);
    }

    static void Quad(Mesh m, Point3d a, Point3d b, Point3d c, Point3d d)
    {
        int i = m.Vertices.Count;
        m.Vertices.Add(a); m.Vertices.Add(b); m.Vertices.Add(c); m.Vertices.Add(d);
        m.Faces.AddFace(i, i + 1, i + 2, i + 3);
    }

    static void Prism(Mesh m, Point3d a, Point3d b, Vector3d across, Vector3d up)
    {
        // Keeps faces pointing out whichever side of a -> b the prism grows on.
        if (Vector3d.CrossProduct(b - a, up) * across > 0) { var swap = a; a = b; b = swap; }
        Point3d c = b + across, d = a + across;
        Quad(m, a, b, b + up, a + up); Quad(m, b, c, c + up, b + up);
        Quad(m, c, d, d + up, c + up); Quad(m, d, a, a + up, d + up);
        Quad(m, a + up, b + up, c + up, d + up); Quad(m, d, c, b, a);
    }

    static Vector3d U(Vector3d v) { v.Unitize(); return v; }

    static Vector3d Outward(Point3d a, Point3d b)
    {
        var v = b - a; v.Unitize();
        return new Vector3d(v.Y, -v.X, 0);
    }

    static double Perimeter(List<Point3d> loop)
    {
        double sum = 0;
        for (int i = 0; i < loop.Count; i++) sum += loop[i].DistanceTo(loop[(i + 1) % loop.Count]);
        return sum;
    }

    static Point3d P(double x, double y, double z, Transform xf)
    {
        var p = new Point3d(x, y, 0);
        p.Transform(xf);
        p.Z = z;
        return p;
    }

    static List<Point3d> Pts(params double[] xy)
    {
        var list = new List<Point3d>();
        for (int i = 0; i < xy.Length; i += 2) list.Add(new Point3d(xy[i], xy[i + 1], 0));
        return list;
    }

    static string Txt(object o, string fallback) { return o == null ? fallback : o.ToString().Trim('"'); }
    static double Num(object o, double fallback) { double v; return o != null && GH_Convert.ToDouble(o, out v, GH_Conversion.Both) ? v : fallback; }
    static bool Bool(object o, bool fallback) { bool v; return o != null && GH_Convert.ToBoolean(o, out v, GH_Conversion.Both) ? v : fallback; }
    static Color Col(object o, Color fallback) { Color v = fallback; return o != null && GH_Convert.ToColor(o, out v, GH_Conversion.Both) ? v : fallback; }
}
# ---------- end c_script ----------
glazing = ThreeMaterial(Color=c_script.GlassCol, Metalness=0.2, Roughness=0.4, Opacity=0.45, Transparent=True)
frames = ThreeMaterial(Color=RGB(42, 46, 50), Metalness=0.6, Roughness=0.4)
mpre = MaterialPreset(Preset=8)
mpre_2 = MaterialPreset(Preset=c_script.CladPreset)
lit_windows_3 = ThreeMaterial(Color=RGB(255, 214, 160), Metalness=0, Roughness=0.3)
planting = ThreeMaterial(Color=RGB(92, 132, 84), Metalness=0, Roughness=0.85)
mpre_3 = MaterialPreset(Preset=14)
mpre_4 = MaterialPreset(Preset=8)
lit_windows_4 = EmissiveMaterial(Color=RGB(255, 196, 128), Strength=1.8, Base=lit_windows_3)
floor_plates = ThreeMaterial(Color=RGB(226, 222, 214), Base=mpre)
cladding_3 = ThreeMaterial(Color=c_script.CladCol, Base=mpre_2)
ground = ThreeMaterial(Base=mpre_4)
city = ThreeMaterial(Color=RGB(236, 233, 226), Base=mpre_3)
c_print = ContextPrint(SiteCoverage=c_script.Coverage)
c_print_2 = ContextPrint(FacadeAreaM2=c_script.FacadeArea)
c_print_3 = ContextPrint(HeightM=c_script.BuildingHeight)
c_print_4 = ContextPrint(GFAM2=c_script.Gfa)
c_print_5 = ContextPrint(Homes=c_script.Units)
c_print_6 = ContextPrint(Zoning=c_script.Zoning)
c_print_7 = ContextPrint(Text=c_script.Far)
D = Display(Geo=c_script.Slabs, Name="Floor plates", Layer="Building/Structure", Material=floor_plates)
D_2 = Display(Geo=c_script.Clad, Name="Cladding", Layer="Building/Facade", Material=cladding_3)
D_3 = Display(Geo=c_script.Glazing, Name="Glazing", Layer="Building/Glazing", Material=glazing)
D_4 = Display(Geo=c_script.LitGlazing, Name="Lit windows", Layer="Building/Glazing", Material=lit_windows_4)
D_5 = Display(Geo=c_script.Frames, Name="Frames", Layer="Building/Frames", Material=frames)
D_6 = Display(Geo=c_script.Planting, Name="Planting", Layer="Site/Planting", Material=planting)
D_7 = Display(Geo=c_script.Massing, Name="City", Layer="Site/City context", Material=city)
D_8 = Display(Geo=c_script.Ground, Name="Ground", Layer="Site/Ground", Material=ground)
codisplay = CombineDisplay(WebDisplay=[D, D_2, D_3, D_4, D_5, D_6, D_7, D_8])
c_bake_2 = ContextBake(Content=codisplay)
