# Grasshopper definition canopy-example.gh (Grasshopper 1.0.8)
# plug-ins: Selva Canopy, Selva

series = Series(Start=0, Step=1, Count=10)
ui_bridge = UIBridge(Enable=Toggle(True), Schema="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")
jitter = Jitter(List=series, Jitter=1, Seed=2)  # -> Values, Indices
c_bake = ContextBake(Content=ui_bridge)
layout = Layout(Width=0, Height=0)
scatter_2d = Scatter2D(X=series, Y=jitter.Values, Mode=1, Size=8)
figure = Figure(Traces=scatter_2d, Layout=layout, ExportFormat="png")
context_bake = ContextBake(Content=figure)
