# Grasshopper definition dependent-forms-tutorial.gh (Grasshopper 1.0.9)
# plug-ins: Selva

# ---- group: 1. Set Dynamic Value List / Inputs
# dependent-forms-tutorial
# Blue: inputs to change.   Green: outputs (charts, results, values passed on).   Named parameters mark each group's inputs and outputs.
# DEPENDENT FORMS TUTORIAL
# Three ways to fill a dropdown (a Get Dynamic Value List) from Grasshopper.
# Each one is wired into the dropdown AND into a Context Bake.
# Turn on the UI Bridge at the bottom to open the form.
pizza_size_default = Slider(30, range=20..50)
pizza_size = GetInteger(pizza_size_default, AtLeast=1, AtMost=1, Maximum=50, Minimum=20, Prompt="Pizza size", TreeAccess=False)

# ---- group: 2. Repeat / Inputs
guests_default = Slider(3, range=1..6)
topping_list = Panel("""Margherita
Mushroom
Salami
Pineapple""")
guests = GetInteger(guests_default, AtLeast=1, AtMost=1, Maximum=6, Minimum=1, Prompt="Guests", TreeAccess=False)
topping_list_2 = ToppingList(topping_list)

# ---- group: 3. Options Table / Inputs
menu = Panel("""Pizza, Size, Amount
Margherita, Small,20
Margherita, Large,40
Salami, Large,30
Salami, Family,30
Mushroom, Large,20""")
menu_2 = Menu(menu)

# ---- group: UI Bridge / Inputs
toggle = BooleanToggle(False)

# ---- group: UI Bridge
uibridge = UIBridge(Enable=toggle, Schema="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")  # -> Schema, URL

# ---- group: UI Bridge / Outputs
c_bake = ContextBake(Content=uibridge.Schema)

# ---- group: 1. Set Dynamic Value List
# 1. SET DYNAMIC VALUE LIST
# A list whose choices you calculate: a bigger pizza can be cut into more slices.
# Wire it into Slices AND into a Context Bake.
# Try: change Pizza size in the form, then open Slices again.
panel = Panel("Floor(x/10)")
how_many_choices = Evaluate(E=panel, x=pizza_size)
slice_counts = Series(Start=2, Step=2, Count=how_many_choices)
choices_as_text = Format(Format="\"{0} slices\" = {0}", Culture=127, Data0=slice_counts)
slice_choices = SetDynamicValueList(Options=choices_as_text)
slices = GetDynamicValueList(
    slice_choices,
    AtLeast=1,
    AtMost=1,
    Immediate=True,
    ListAccess=False,
    StoredItems="""[
  {
    "name": "2 slices",
    "expression": "2"
  },
  {
    "name": "4 slices",
    "expression": "4"
  },
  {
    "name": "6 slices",
    "expression": "6"
  }
]""",
    TreeAccess=False)
cut_text = Concatenate(FragmentA=pizza_size, FragmentB=" cm pizza, slices: ", FragmentC=slices)

# ---- group: 2. Repeat
# 2. REPEAT
# Asks the same question once per guest.
# Wire: guest names into Keys, the topping list into Options, Repeat into Topping AND a Context Bake.
# Try: change Guests in the form.
guest_numbers = Series(Start=1, Step=1, Count=guests)
guest_names = Format(Format="Guest {0}", Culture=127, Data0=guest_numbers)
once_per_guest = Repeat(Keys=guest_names, Options=topping_list_2)
topping = GetDynamicValueList(
    once_per_guest,
    AtLeast=1,
    AtMost=1,
    Immediate=True,
    ListAccess=False,
    StoredItems="""[
  {
    "name": "Margherita",
    "expression": "Margherita"
  },
  {
    "name": "Mushroom",
    "expression": "Mushroom"
  },
  {
    "name": "Salami",
    "expression": "Salami"
  },
  {
    "name": "Pineapple",
    "expression": "Pineapple"
  }
]""",
    TreeAccess=False)
guest_line = Concatenate(FragmentA=guest_names, FragmentB=": ", FragmentC=topping)
all_guests = TextJoin(Text=guest_line)

# ---- group: 2. Repeat / Outputs
c_print = ContextPrint(ToppingsOrdered=all_guests)
c_bake_2 = ContextBake(OncePerGuest=once_per_guest)

# ---- group: 1. Set Dynamic Value List / Outputs
c_bake_3 = ContextBake(SliceChoices=slice_choices)
c_print_2 = ContextPrint(Cut=cut_text)

# ---- group: 3. Options Table
# 3. OPTIONS TABLE
# A table of what goes together: each line is one pizza you can order.
# Wire Options Table into Pizza AND into a Context Bake, then Pizza into Size.
# Try: pick Mushroom in the form. Size only offers Large.
menu_table = OptionsTable(Table=menu_2)
pizza = GetDynamicValueList(
    menu_table,
    AtLeast=1,
    AtMost=1,
    Immediate=True,
    ListAccess=False,
    StoredItems="""[
  {
    "name": "Margherita",
    "expression": "Margherita"
  },
  {
    "name": "Salami",
    "expression": "Salami"
  },
  {
    "name": "Mushroom",
    "expression": "Mushroom"
  }
]""",
    TreeAccess=False)
size = GetDynamicValueList(
    pizza,
    AtLeast=1,
    AtMost=1,
    Immediate=True,
    ListAccess=False,
    StoredItems="""[
  {
    "name": "Small",
    "expression": "Small"
  },
  {
    "name": "Large",
    "expression": "Large"
  }
]""",
    TreeAccess=False)

# ----
amount = GetDynamicValueList(
    size,
    AtLeast=1,
    AtMost=1,
    Immediate=True,
    ListAccess=False,
    StoredItems="""[
  {
    "name": "20",
    "expression": "20"
  }
]""",
    TreeAccess=False)

# ---- group: 3. Options Table (continued)
order_text = Concatenate(FragmentA=amount, FragmentB=" ", FragmentC=pizza)

# ---- group: 3. Options Table / Outputs
c_bake_4 = ContextBake(MenuTable=menu_table)
c_print_3 = ContextPrint(Order=order_text)
