# Grasshopper definition display_example.gh (Grasshopper 1.0.8)
# plug-ins: Selva

circle = Circle(Plane=PlaneXY(0, 0, 0), Radius=Slider(20, range=0..100))
curve = Curve(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)
point = Point([Point(-24.81440315, 27.54677694, 0), Point(-61.21052281, 3.536972272, 0), Point(-8.636114168, -6.617801712, 0)])
line = Line(Line((150.8310954, 21.07625768, 0), (60.37936822, 21.07625768, 0)))
curve_2 = Curve(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)
brep = Brep(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)
three_material = ThreeMaterial(Color=ColourSwatch(SwatchColor=RGB(153, 83, 83)), Metalness=0, Roughness=0.5, Opacity=1, Transparent=False)
merge = Merge(Data1=point, Data2=curve_2, Data3=line, Data4=curve, Data5=brep, Data6=circle)
ui_bridge = UIBridge(Enable=Toggle(True), Schema="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")  # -> Schema, URL
display = Display(Geo=merge, TMaterial=three_material)
c_bake = ContextBake(Content=ui_bridge.Schema)
context_bake = ContextBake(WebDisplay=display)
