# Grasshopper definition dynamic_value_list.gh (Grasshopper 1.0.8)
# plug-ins: Selva

driver_values = ValueList({"Small room": 3.0, "Standard room": 3.5, "Large room": 4.5, "Open plan": 6.0, "Garage span": 7.0}, selected="Open plan")
driver_values_2 = GetValueList(
    driver_values,
    AtLeast=1,
    AtMost=1,
    Immediate=True,
    ListAccess=False,
    StoredItems="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",
    TreeAccess=False)
get_dynamic_value_list = GetDynamicValueList(AtLeast=1, AtMost=1, Immediate=True, ListAccess=False, StoredItems="[]", TreeAccess=False)
c_script = CSharpScript(driver=driver_values_2)  # -> output
# ---------- c_script: C# ----------
// Grasshopper Script Instance
#region Usings
using System;
using System.Linq;
using System.Collections;
using System.Collections.Generic;
using System.Drawing;

using Rhino;
using Rhino.Geometry;

using Grasshopper;
using Grasshopper.Kernel;
using Grasshopper.Kernel.Data;
using Grasshopper.Kernel.Types;
#endregion

public class Script_Instance : GH_ScriptInstance
{
    private void RunScript(object driver, ref object output)
    {
        // ---- INPUT ----
        // Wire your required clear span (in metres) into 'x'. 'y' is left free
        // (use it later for a load class, spacing, etc. if you want).
        double span;
        if (!TryGetDouble(driver, out span) || span <= 0)
        {
            output = new List<string> { "input = invalid (wire a positive span in metres into x)" };
            return;
        }

        // ---- OPTION CATALOG ----
        // (member description, max economical span in m for a typical domestic floor).
        // INDICATIVE values only - replace with your own verified data / load case.
        var catalog = new List<(string Name, double MaxSpan)>
        {
            ("Timber C24 47x145 @ 400mm", 2.70),
            ("Timber C24 47x170 @ 400mm", 3.20),
            ("Timber C24 47x195 @ 400mm", 3.70),
            ("Timber C24 47x220 @ 400mm", 4.20),
            ("Timber C24 47x245 @ 400mm", 4.70),
            ("I-Joist 240mm @ 400mm",     5.00),
            ("I-Joist 300mm @ 400mm",     6.00),
            ("Glulam GL24h 90x270",       6.50),
            ("LVL 45x300",                7.00),
            ("Steel UB 178x102x19",       7.50),
            ("Steel UB 203x133x25",       9.00),
            ("Steel UB 254x146x31",      10.50),
        };

        const int maxOptions = 10;

        // ---- LOGIC: keep members that span it, smallest (most economical) first ----
        var options = catalog
            .Where(o => o.MaxSpan >= span)
            .OrderBy(o => o.MaxSpan)
            .Take(maxOptions)
            .Select(o => $"{o.Name} = {o.MaxSpan:0.00} m")
            .ToList();

        if (options.Count == 0)
            options.Add($"no catalogued member spans {span:0.00} m = add support / increase depth");

        Print($"span = {span:0.00} m  ->  {options.Count} option(s)");
        output = options;   // outputs a list, one option per item
    }

    // Robust number parsing - also accepts Swiss comma decimals (e.g. "3,5").
    private static bool TryGetDouble(object o, out double value)
    {
        value = 0;
        if (o == null) return false;
        if (o is double d) { value = d; return true; }
        if (o is int i)    { value = i; return true; }
        string s = o.ToString().Trim().Replace(",", ".");
        return double.TryParse(s, System.Globalization.NumberStyles.Any,
            System.Globalization.CultureInfo.InvariantCulture, out value);
    }
}
# ---------- end c_script ----------
ui_bridge = UIBridge(
    Enable=Toggle(True),
    Schema="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",
    Values="{\"195233d0-1b39-4cb9-a8b7-dfe8dd676c5a\":\"6.0\",\"cf79452c-a051-4849-8ab7-461e90fa072c\":\"6.00 m\"}")  # -> Schema, URL
set_dynamic_value_list = SetDynamicValueList(Options=c_script)
c_bake = ContextBake(Content=ui_bridge.Schema)
context_print = ContextPrint(ValueListOutput=get_dynamic_value_list)
context_bake = ContextBake(Content=set_dynamic_value_list)
