# Grasshopper definition file-example.gh (Grasshopper 1.0.8)
# plug-ins: Selva

ui_bridge = UIBridge(Enable=Toggle(True), Schema="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")  # -> Schema, URL
context_bake = ContextBake(Content=ui_bridge.Schema)

brep = Brep(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)
brep_2 = Brep(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)
merge = Merge(Data1=brep, Data2=brep_2)
panel = Panel("""Surface
Solid""")
merge_2 = Merge(Data1=ColourSwatch(SwatchColor=RGB(255, 255, 255)), Data2=ColourSwatch(SwatchColor=RGB(255, 0, 0)))

geometry_to_file = GeometryToFile(
    Geometry=merge,
    LayerNames=panel,
    LayerColors=merge_2,
    FileNames="Export::Single_File",
    FileEnding=".3dm",
    SubFolder="Export::Single_File",
    Metadata="File=Main")

data = Data(geometry_to_file)

brep_3 = Brep(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)
brep_4 = Brep(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)
panel_2 = Panel("""File_1
File_2""")
merge_3 = Merge(Data1=brep_3, Data2=brep_4)
panel_3 = Panel("""Surface
Solid""")
merge_4 = Merge(Data1=ColourSwatch(SwatchColor=RGB(255, 255, 255)), Data2=ColourSwatch(SwatchColor=RGB(255, 0, 0)))

geometry_to_file_2 = GeometryToFile(
    Geometry=graft(merge_3),
    LayerNames=graft(panel_3),
    LayerColors=graft(merge_4),
    FileNames=graft(panel_2),
    FileEnding=".3dm",
    SubFolder="Export::MultiFile",
    Metadata="File=Main")

data_2 = Data(geometry_to_file_2)

brep_5 = Brep(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)
brep_6 = Brep(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)
model_object = ModelObject(Geometry=brep_5)  # -> Object, Geometry, Name, Layer, Visibility, Display, Drafting, Render
model_object_2 = ModelObject(Geometry=brep_6)  # -> Object, Geometry, Name, Layer, Visibility, Display, Drafting, Render
model_block_definition = ModelBlockDefinition(Objects=model_object.Object, Name="Surface")  # -> BlockDefinition, Objects, Name
model_block_definition_2 = ModelBlockDefinition(Objects=model_object_2.Object, Name="Solid")  # -> BlockDefinition, Objects, Name
model_block_definition_3 = ModelBlockDefinition(Objects=[model_block_definition_2.BlockDefinition, model_block_definition.BlockDefinition], Name="Assembly")  # -> BlockDefinition, Objects, Name

block_to_file = BlockToFile(
    Block=model_block_definition_3.BlockDefinition,
    FileName="Block_To_File",
    SubFolder="Export::Block",
    Metadata="File=Main")

data_3 = Data(block_to_file)

panel_4 = Panel("""Material,Quantity,Price
Portland Cement,500,42500
Steel Rebar,250,112500
Concrete Mix,1200,144000
Drywall Sheets,3500,29750
Electrical Wire,5000,2250
Copper Pipes,800,10200
Interior Paint,1000,35000
Structural Beams,150,72000
Safety Barriers,200,25000
Lumber 2x4,10000,8500
Roofing Shingles,8000,20000
HVAC Units,45,126000
Insulation,2000,1900
Vinyl Flooring,4500,18900
Aluminum Framing,600,11100
Concrete Blocks,5000,10500
Aluminum Windows,280,77000
Excavation Sand,2000,44000
Gravel Base,1500,42750
LED Lighting,600,39000""")

create_file = CreateFile(Data=panel_4, Name="Material_Table", Extension=".csv", IsBase64=False, SubFolder="Export::CSV", Metadata="File=Main")

data_4 = Data(create_file)

data_5 = Data(data_2)
data_6 = Data(data_4)
data_7 = Data(data)
data_8 = Data(data_3)
merge_5 = Merge(Data1=data_7, Data2=data_5, Data3=data_8, Data4=data_6)  # -> flatten(Result)
file_data = FileData(merge_5)

# ----
# Bake files to local
file_data_2 = FileData(file_data)
file_path = FilePath()  # disabled
button = Button()  # disabled
bake_files = BakeFiles(Files=file_data_2, BasePath=file_path, Bake=button)  # -> Paths, Status; disabled

context_bake_2 = ContextBake(Content=file_data)

get_file = GetFile(AtLeast=1, AtMost=1, Immediate=True, Prompt="Select a file to import", TreeAccess=False)
brep_7 = Brep(get_file)

display = Display(Geo=brep_7)

context_bake_3 = ContextBake(WebDisplay=display)
