# Grasshopper definition kitchen-run.gh (Grasshopper 1.0.9)
# plug-ins: Selva Canopy, Selva

# ---- group: Unit height / Inputs
# kitchen-run
# Blue: inputs to change.   Green: outputs (charts, results, values passed on).   Named parameters mark each group's inputs and outputs.
# KITCHEN RUN
# A kitchen configurator on Selva's three dependent-form components. Repeat: the layout decides which cabinets exist, and each gets its own front and handle. Options Table: two small tables list what goes together, fronts and handles per style, and the colours and worktops that suit each other. Set Dynamic Value List: the unit heights that fit under the ceiling. Grasshopper checks every pick in the solve, so every change is one solve.
unit_heights_made = Panel("""500
700
900
1100""")
ceiling_height_default = Slider(2500, range=2300..2800)
ceiling_height = GetInteger(ceiling_height_default, AtLeast=1, AtMost=1, Maximum=2800, Minimum=2300, Prompt="Ceiling height", TreeAccess=False)
unit_heights_made_2 = UnitHeightsMade(unit_heights_made)

# ---- group: UI Bridge / Inputs
toggle = BooleanToggle(False)

# ---- group: Kitchen / Inputs
# KITCHEN
# Layout changes the cabinets, so the form waits for its solve. Style only narrows lists. Metal is the finish of the handles, the tap and the pendants.
layout_options = ValueList({"Straight", "L-shaped", "Island"}, selected="Island")
style_options = ValueList({"Shaker", "Slab", "Handleless"}, selected="Shaker")
metal_options = ValueList({"Brass", "Steel", "Black"}, selected="Brass")
wall_units_default = BooleanToggle(True)
lights_on_default = BooleanToggle(True)
layout = GetValueList(
    layout_options,
    AtLeast=1,
    AtMost=1,
    Immediate=True,
    ListAccess=False,
    Prompt="Layout",
    StoredItems="""[
  {
    "name": "Straight",
    "expression": "Straight"
  },
  {
    "name": "L-shaped",
    "expression": "L-shaped"
  },
  {
    "name": "Island",
    "expression": "Island"
  }
]""",
    TreeAccess=False)
style = GetValueList(
    style_options,
    AtLeast=1,
    AtMost=1,
    Immediate=True,
    ListAccess=False,
    Prompt="Style",
    StoredItems="""[
  {
    "name": "Shaker",
    "expression": "Shaker"
  },
  {
    "name": "Slab",
    "expression": "Slab"
  },
  {
    "name": "Handleless",
    "expression": "Handleless"
  }
]""",
    TreeAccess=False)
metal = GetValueList(
    metal_options,
    AtLeast=1,
    AtMost=1,
    Immediate=True,
    ListAccess=False,
    Prompt="Metal",
    StoredItems="""[
  {
    "name": "Brass",
    "expression": "Brass"
  },
  {
    "name": "Steel",
    "expression": "Steel"
  },
  {
    "name": "Black",
    "expression": "Black"
  }
]""",
    TreeAccess=False)
wall_units = GetBoolean(wall_units_default, AtLeast=1, AtMost=1, FalseValue="False", Prompt="Wall units", TreeAccess=False, TrueValue="True")
lights_on = GetBoolean(lights_on_default, AtLeast=1, AtMost=1, FalseValue="False", Prompt="Lights on", TreeAccess=False, TrueValue="True")

# ---- group: UI Bridge
uibridge = UIBridge(Enable=toggle, Schema="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")  # -> Schema, URL

# ---- group: UI Bridge / Outputs
c_bake = ContextBake(Content=uibridge.Schema)

# ---- group: Unit height
# UNIT HEIGHT
# Set Dynamic Value List sends options computed in the solve: the wall unit heights that fit under the ceiling, 150 mm clear. Its output goes into Unit height and into a Context Bake. Lower the ceiling and a height that no longer fits falls back to the first one, in the same solve.
panel = Panel("x + 1600 <= y")
fits_under_the_ceiling = Evaluate(E=panel, x=unit_heights_made_2, y=ceiling_height)
heights_that_fit = CullPattern(List=unit_heights_made_2, CullPattern=fits_under_the_ceiling)
height_options = Format(Format="\"{0} mm\" = {0}", Culture=127, Data0=heights_that_fit)
unit_height_options = SetDynamicValueList(Options=height_options)
unit_height = GetDynamicValueList(
    unit_height_options,
    AtLeast=1,
    AtMost=1,
    Immediate=True,
    ListAccess=False,
    SelectedValues="""[
  "700"
]""",
    StoredItems="""[
  {
    "name": "500 mm",
    "expression": "500"
  },
  {
    "name": "700 mm",
    "expression": "700"
  },
  {
    "name": "900 mm",
    "expression": "900"
  }
]""",
    TreeAccess=False)

# ---- group: Unit height / Outputs
c_bake_2 = ContextBake(UnitHeightOptions=unit_height_options)

# ---- group: Cabinets / Inputs
cabinet_keys_straight = Panel("""back/sink
back/prep
back/hob
back/larder""")
cabinet_keys_l_shaped = Panel("""back/sink
back/prep
back/hob
side/crockery
side/pans
side/larder""")
cabinet_keys_island = Panel("""back/sink
back/prep
back/hob
back/larder
island/cutlery
island/pans
island/end""")
layout_index_options = Panel("""Straight
L-shaped
Island""")
cabinet_labels_straight = Panel("""Sink
Prep
Hob
Larder""")
cabinet_labels_l_shaped = Panel("""Sink
Prep
Hob
Crockery
Pans
Larder""")
cabinet_labels_island = Panel("""Sink
Prep
Hob
Larder
Cutlery
Pans
Open end""")
cabinet_walls_straight = Panel("""Back wall
Back wall
Back wall
Back wall""")
cabinet_walls_l_shaped = Panel("""Back wall
Back wall
Back wall
Side wall
Side wall
Side wall""")
cabinet_walls_island = Panel("""Back wall
Back wall
Back wall
Back wall
Island
Island
Island""")
cabinet_labels_l_shaped_2 = CabinetLabelsLShaped(cabinet_labels_l_shaped)
cabinet_walls_l_shaped_2 = CabinetWallsLShaped(cabinet_walls_l_shaped)
cabinet_labels_straight_2 = CabinetLabelsStraight(cabinet_labels_straight)
cabinet_keys_l_shaped_2 = CabinetKeysLShaped(cabinet_keys_l_shaped)
cabinet_walls_straight_2 = CabinetWallsStraight(cabinet_walls_straight)
cabinet_keys_straight_2 = CabinetKeysStraight(cabinet_keys_straight)
cabinet_labels_island_2 = CabinetLabelsIsland(cabinet_labels_island)
layout_index_options_2 = LayoutIndexOptions(layout_index_options)
cabinet_walls_island_2 = CabinetWallsIsland(cabinet_walls_island)
cabinet_keys_island_2 = CabinetKeysIsland(cabinet_keys_island)

# ---- group: Cabinets
# CABINETS
# Repeat's output wired into a Get Dynamic Value List shows that input once per row. Each row has a key, and a pick is stored by key, so it stays with its cabinet when the layout changes.
layout_2 = Layout(layout)
layout_name = Text(layout_2)
layout_index = MemberIndex(Set=layout_index_options_2, Member=layout_name)  # -> Index, Count
cabinet_keys = StreamFilter(Gate=layout_index.Index, Stream0=cabinet_keys_straight_2, Stream1=cabinet_keys_l_shaped_2, Stream2=cabinet_keys_island_2)
cabinet_labels = StreamFilter(
    Gate=layout_index.Index,
    Stream0=cabinet_labels_straight_2,
    Stream1=cabinet_labels_l_shaped_2,
    Stream2=cabinet_labels_island_2)
cabinet_walls = StreamFilter(
    Gate=layout_index.Index,
    Stream0=cabinet_walls_straight_2,
    Stream1=cabinet_walls_l_shaped_2,
    Stream2=cabinet_walls_island_2)
cabinets = Repeat(Keys=cabinet_keys, Labels=cabinet_labels, Section=cabinet_walls)

# ---- group: Colour and worktop / Inputs
colours_and_worktops = Panel("""Style, Colour, Worktop
Shaker, Sage, Oak
Shaker, Sage, Marble
Shaker, Navy, Marble
Shaker, Navy, Oak
Shaker, Navy, Terrazzo
Shaker, Cream, Walnut
Shaker, Cream, Oak
Shaker, Cream, Slate
Slab, White, Oak
Slab, White, Concrete
Slab, White, Slate
Slab, Clay, Travertine
Slab, Clay, Oak
Slab, Forest, Walnut
Slab, Forest, Marble
Handleless, Graphite, Concrete
Handleless, Graphite, Marble
Handleless, Graphite, Walnut
Handleless, White, Slate
Handleless, White, Concrete
Handleless, Sand, Travertine
Handleless, Sand, Slate""")
colours_and_worktops_2 = ColoursAndWorktops(colours_and_worktops)

# ---- group: Colour and worktop
# COLOUR AND WORKTOP
# The same wiring without Repeat: each style comes in three colours, and each colour offers the worktops that suit it. Nobody can pick a pair that was never meant to meet.
style_2 = Style(style)
palette = OptionsTable(Table=colours_and_worktops_2, By=style_2)
colour = GetDynamicValueList(
    palette,
    AtLeast=1,
    AtMost=1,
    Immediate=True,
    ListAccess=False,
    StoredItems="""[
  {
    "name": "Sage",
    "expression": "Sage"
  },
  {
    "name": "Navy",
    "expression": "Navy"
  },
  {
    "name": "Cream",
    "expression": "Cream"
  }
]""",
    TreeAccess=False)
worktop = GetDynamicValueList(
    colour,
    AtLeast=1,
    AtMost=1,
    Immediate=True,
    ListAccess=False,
    StoredItems="""[
  {
    "name": "Oak",
    "expression": "Oak"
  },
  {
    "name": "Marble",
    "expression": "Marble"
  }
]""",
    TreeAccess=False)

# ---- group: Cabinets / Outputs
cabinet_labels_2 = CabinetLabels(cabinet_labels)
c_bake_3 = ContextBake(Cabinets=cabinets)
cabinet_walls_2 = CabinetWalls(cabinet_walls)
cabinet_keys_2 = CabinetKeys(cabinet_keys)

# ---- group: Colour and worktop / Outputs
c_bake_4 = ContextBake(Palette=palette)

# ---- group: Fronts and handles / Inputs
fronts_and_handles = Panel("""Style, Fronts, Handles
Shaker, Shaker door, Knob
Shaker, Shaker door, Bar
Shaker, Shaker door, Edge pull
Shaker, Shaker drawers, Cup pull
Shaker, Shaker drawers, Knob
Shaker, Shaker drawers, Bar
Shaker, Glazed door, Knob
Shaker, Glazed door, Bar
Shaker, Glazed door, Edge pull
Shaker, Open shelves, None
Slab, Slab door, Bar
Slab, Slab door, Knob
Slab, Slab door, Edge pull
Slab, Slab drawers, Bar
Slab, Slab drawers, Knob
Slab, Slab drawers, Edge pull
Slab, Open shelves, None
Handleless, Push door, None
Handleless, Push drawers, None
Handleless, Open shelves, None""")
fronts_and_handles_2 = FrontsAndHandles(fronts_and_handles)

# ---- group: Fronts and handles
# FRONTS AND HANDLES
# One line per combination that exists. Style goes into By: it narrows the table and keeps its own options. The output goes into Fronts, and Fronts into Handles: each reads the column named like it and offers what is left. Repeat shows both once per cabinet, and each cabinet narrows on its own. Delete Options Table and swap Fronts and Handles for Value Lists, and the kitchen still solves.
style_3 = Style(style)
cabinet_options = OptionsTable(Table=fronts_and_handles_2, By=style_3)
fronts = GetDynamicValueList(
    [cabinet_options, cabinets],
    AtLeast=1,
    AtMost=1,
    Immediate=True,
    ListAccess=False,
    SelectedValues="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",
    StoredItems="""[
  {
    "name": "Shaker door",
    "expression": "Shaker door"
  },
  {
    "name": "Shaker drawers",
    "expression": "Shaker drawers"
  },
  {
    "name": "Glazed door",
    "expression": "Glazed door"
  },
  {
    "name": "Open shelves",
    "expression": "Open shelves"
  }
]""",
    TreeAccess=False)
handles = GetDynamicValueList(
    [fronts, cabinets],
    AtLeast=1,
    AtMost=1,
    Immediate=True,
    ListAccess=False,
    SelectedValues="""[
  "{\"back/sink\":\"Knob\",\"back/prep\":\"Cup pull\",\"back/hob\":\"Cup pull\",\"back/larder\":\"Knob\",\"side/crockery\":\"Knob\",\"side/pans\":\"Cup pull\",\"side/larder\":\"Knob\",\"island/cutlery\":\"Cup pull\",\"island/pans\":\"Knob\",\"island/end\":\"None\"}"
]""",
    StoredItems="""[
  {
    "name": "Knob",
    "expression": "Knob"
  },
  {
    "name": "Bar",
    "expression": "Bar"
  },
  {
    "name": "Edge pull",
    "expression": "Edge pull"
  }
]""",
    TreeAccess=False)

# ---- group: Materials / Inputs
sage = ColourSwatch(SwatchColor=RGB(118, 140, 110))
navy = ColourSwatch(SwatchColor=RGB(38, 52, 78))
cream = ColourSwatch(SwatchColor=RGB(238, 230, 212))
white = ColourSwatch(SwatchColor=RGB(244, 243, 239))
clay = ColourSwatch(SwatchColor=RGB(176, 104, 76))
forest = ColourSwatch(SwatchColor=RGB(46, 74, 60))
graphite = ColourSwatch(SwatchColor=RGB(58, 60, 64))
sand = ColourSwatch(SwatchColor=RGB(198, 180, 150))
colour_index_options = Panel("""Sage
Navy
Cream
White
Clay
Forest
Graphite
Sand""")
worktop_preset_table = Panel("""23
12
29
31
30
8
27""")
worktop_index_options = Panel("""Oak
Walnut
Marble
Terrazzo
Slate
Concrete
Travertine""")
metal_preset_table = Panel("""10
1
18""")
metal_index_options = Panel("""Brass
Steel
Black""")
worktop_index_options_2 = WorktopIndexOptions(worktop_index_options)
worktop_preset_table_2 = WorktopPresetTable(worktop_preset_table)
colour_index_options_2 = ColourIndexOptions(colour_index_options)
metal_index_options_2 = MetalIndexOptions(metal_index_options)
metal_preset_table_2 = MetalPresetTable(metal_preset_table)
graphite_2 = Graphite(graphite)
sage_2 = Sage(sage)
navy_2 = Navy(navy)
cream_2 = Cream(cream)
white_2 = White(white)
clay_2 = Clay(clay)
forest_2 = Forest(forest)
sand_2 = Sand(sand)

# ---- group: Materials
# MATERIALS
# Each pick's index takes its row from a small table: a colour for the fronts, a preset for the worktop and for the metal.
colour_name = Text(colour)
worktop_name = Text(worktop)
metal_2 = Metal(metal)
metal_name = Text(metal_2)
front_colours = Merge(Data1=sage_2, Data2=navy_2, Data3=cream_2, Data4=white_2, Data5=clay_2, Data6=forest_2, Data7=graphite_2, Data8=sand_2)
worktop_index = MemberIndex(Set=worktop_index_options_2, Member=worktop_name)  # -> Index, Count
metal_index = MemberIndex(Set=metal_index_options_2, Member=metal_name)  # -> Index, Count
colour_index = MemberIndex(Set=colour_index_options_2, Member=colour_name)  # -> Index, Count
front_colour = ListItem(List=front_colours, Index=colour_index.Index, Wrap=True)
worktop_preset = ListItem(List=worktop_preset_table_2, Index=worktop_index.Index, Wrap=True)
metal_preset = ListItem(List=metal_preset_table_2, Index=metal_index.Index, Wrap=True)
fronts_2 = ThreeMaterial(Color=front_colour, Metalness=0, Roughness=0.45)
worktop_2 = MaterialPreset(Preset=worktop_preset)
metal_3 = MaterialPreset(Preset=metal_preset)

# ---- group: Materials / Outputs
worktop_3 = Worktop(worktop_2)
fronts_3 = Fronts(fronts_2)
metal_4 = Metal(metal_3)

# ---- group: Fronts and handles / Outputs
c_bake_5 = ContextBake(CabinetOptions=cabinet_options)

# ---- group: Kitchen script
# KITCHEN SCRIPT
# Builds the room and one cabinet per row from the resolved picks: carcass, fronts, pulls, sink, hob, hood, wall units or a shelf, the island's stools and pendants. It also prices every row. Source: Kitchen.script.cs beside the generator.
cabinet_keys_3 = CabinetKeys(cabinet_keys_2)
cabinet_labels_3 = CabinetLabels(cabinet_labels_2)
ceiling_height_2 = CeilingHeight(ceiling_height)
cabinet_walls_3 = CabinetWalls(cabinet_walls_2)
wall_units_2 = WallUnits(wall_units)
lights_on_2 = LightsOn(lights_on)
kitchen = CSharpScript(
    Keys=cabinet_keys_3,
    Labels=cabinet_labels_3,
    Sections=cabinet_walls_3,
    Fronts=fronts,
    Handles=handles,
    WorktopName=worktop,
    WallUnits=wall_units_2,
    LightsOn=lights_on_2,
    UnitHeight=unit_height,
    Ceiling=ceiling_height_2)  # -> out, Carcass, Panels, Glass, Metal, Steel, Dark, Top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; inputs Keys: list, Labels: list, Sections: list, Fronts: list, Handles: list
# ---------- kitchen: C# ----------
// Grasshopper Script Instance
using System;
using System.Collections.Generic;
using System.Globalization;

using Rhino.Geometry;

using Grasshopper.Kernel;

public class Script_Instance : GH_ScriptInstance
{
    // A kitchen in millimetres. Each row of the Repeat is one cabinet: Keys, Labels, Sections, Fronts
    // and Handles arrive in row order, the picks already resolved, so row i of each list is cabinet i.
    // The back wall runs along +X from the origin with its fronts to -Y, the side wall turns along -Y
    // at its right-hand end, and the island stands in front of the back run. The room's two walls are
    // behind and to the right, so the default camera, which looks in from -X, -Y, sees every front.
    private void RunScript(List<object> Keys, List<object> Labels, List<object> Sections, List<object> Fronts, List<object> Handles,
        object WorktopName, object WallUnits, object LightsOn, object UnitHeight, object Ceiling,
        ref object Carcass, ref object Panels, ref object Glass, ref object Metal, ref object Steel, ref object Dark, ref object Top,
        ref object Splash, ref object Glow, ref object Walls, ref object Floor, ref object GlowStrength, ref object Lumens,
        ref object Lines, ref object Csv, ref object PartNames, ref object PartEur, ref object Total, ref object TopMetres)
    {
        var parts = new Parts();
        bool wallUnits = Truthy(WallUnits), lightsOn = Truthy(LightsOn);
        string worktop = Txt(WorktopName);
        // Wall units and tall cabinets end at the same height.
        double TallZ = WallZ0 + Num(UnitHeight, 700), Room = Num(Ceiling, 2500);

        var length = new Dictionary<string, double>();
        for (int i = 0; i < Keys.Count; i++)
        {
            string section = Txt(At(Sections, i));
            length[section] = (length.TryGetValue(section, out var l) ? l : 0) + WidthOf(Txt(Keys[i]));
        }
        double backLength = length.TryGetValue("Back wall", out var back) ? back : 0;
        bool hasSide = length.ContainsKey("Side wall");
        double islandLength = length.TryGetValue("Island", out var island) ? island : 0;

        var run = new Dictionary<string, double>();
        var low = new Dictionary<string, double>();
        double sinkAt = -1;
        var lines = new List<string>();
        var csv = new List<string> { "Cabinet,Wall,Width (mm),Front,Handle,EUR" };
        double carcassEur = 0, frontEur = 0, handleEur = 0, wallEur = 0, applianceEur = 0;

        for (int i = 0; i < Keys.Count; i++)
        {
            string key = Txt(Keys[i]), label = Txt(At(Labels, i)), section = Txt(At(Sections, i));
            string front = Txt(At(Fronts, i)), handle = Txt(At(Handles, i));
            bool tall = key.EndsWith("larder"), sink = key.EndsWith("sink"), hob = key.EndsWith("hob");
            bool open = front == "Open shelves", shelves = open || front == "Glazed door";
            double w = WidthOf(key);
            double u0 = run.TryGetValue(section, out var used) ? used : 0;
            run[section] = u0 + w;
            var wall = Wall(section, backLength, islandLength);

            var cabinet = new Cabinet(wall, u0, w, 0, tall ? TallZ : CarcassZ, 0, plinth: true);
            cabinet.Carcass(parts, shelves, top: !sink);
            int pulls = cabinet.Fronts(front, handle, parts);

            double rowCarcass = tall ? 420 : open ? 150 : 190 * w / 600;
            double rowFront = FrontEur(front) * w / 600 * (tall ? 2 : 1);
            double rowHandle = HandleEur(handle) * pulls;
            double rowWall = 0;

            if (!tall)
            {
                low[section] = u0 + w;
                if (sink)
                {
                    SinkAndTap(cabinet, w, parts);
                    sinkAt = u0;
                    applianceEur += 380;
                }

                if (hob)
                {
                    parts.Dark.Add(cabinet.Box(110, w - 110, 70, 490, TopZ, TopZ + 6));
                    foreach (var (du, dv, r) in new[] { (-140.0, 170.0, 95.0), (140.0, 170.0, 75.0), (-140.0, 390.0, 75.0), (140.0, 390.0, 95.0) })
                    {
                        parts.Steel.Add(Cyl(cabinet.At(w / 2 + du, dv, TopZ + 6), Vector3d.ZAxis, r, 1));
                    }
                    applianceEur += 520;
                }

                if (key == "back/prep") parts.Glass.Add(Cyl(cabinet.At(w / 2, 430, TopZ), Vector3d.ZAxis, 45, 230));

                if (section != "Island")
                {
                    if (hob)
                    {
                        parts.Steel.Add(cabinet.Box(0, w, Depth - 480, Depth, WallZ0, WallZ0 + 60));
                        parts.Steel.Add(cabinet.Box(w / 2 - 140, w / 2 + 140, Depth - 300, Depth, WallZ0 + 60, TallZ));
                        parts.Glow.Add(cabinet.Box(w / 2 - 160, w / 2 + 160, Depth - 300, Depth - 260, WallZ0 - 6, WallZ0));
                        applianceEur += 340;
                    }
                    else if (wallUnits)
                    {
                        var unit = new Cabinet(wall, u0, w, WallZ0, TallZ, Depth - WallDepth, plinth: false);
                        unit.Carcass(parts, shelves, top: true);
                        int unitPulls = unit.Fronts(WallFront(front), handle == "Cup pull" ? "Knob" : handle, parts);
                        parts.Glow.Add(unit.Box(20, w - 20, 40, 60, WallZ0 - 6, WallZ0));
                        rowWall = 150 * w / 600 + FrontEur(WallFront(front)) * w / 600 * 0.8 + HandleEur(handle) * unitPulls;
                    }
                    else
                    {
                        parts.Top.Add(cabinet.Box(0, w, Depth - 250, Depth, WallZ0, WallZ0 + 30));
                        parts.Glow.Add(cabinet.Box(20, w - 20, Depth - 70, Depth - 50, WallZ0 - 6, WallZ0));
                    }
                }
            }

            carcassEur += rowCarcass;
            frontEur += rowFront;
            handleEur += rowHandle;
            wallEur += rowWall;
            double rowEur = Math.Round(rowCarcass + rowFront + rowHandle + rowWall);
            lines.Add(string.Format(CultureInfo.InvariantCulture, "{0} · {1}: {2} / {3} · EUR {4:0}", label, section, front, handle, rowEur));
            csv.Add(string.Format(CultureInfo.InvariantCulture, "{0},{1},{2:0},{3},{4},{5:0}", label, section, w, front, handle, rowEur));
        }

        var backWall = Wall("Back wall", backLength, islandLength);
        double backLow = low.TryGetValue("Back wall", out var bl) ? bl : 0;
        double topMetres = backLow / 1000;

        // The side wall leaves the corner between the two runs: a blind cabinet under the worktop.
        if (hasSide)
        {
            var corner = new Cabinet(backWall, backLength, Depth, 0, CarcassZ, 0, plinth: true);
            corner.Carcass(parts, shelves: false, top: true);
            if (wallUnits)
            {
                var filler = new Cabinet(backWall, backLength, Depth, WallZ0, TallZ, Depth - WallDepth, plinth: false);
                filler.Carcass(parts, shelves: false, top: true);
                parts.Panels.Add(filler.Box(Gap / 2, Depth - WallDepth - Gap / 2, -Board, 0, WallZ0 + Gap, TallZ - Gap));
            }
            else
            {
                parts.Top.Add(corner.Box(0, Depth, Depth - 250, Depth, WallZ0, WallZ0 + 30));
            }

            double sideLow = low.TryGetValue("Side wall", out var sl) ? sl : 0;
            var side = new Cabinet(Wall("Side wall", backLength, islandLength), 0, sideLow, 0, CarcassZ, 0, plinth: false);
            parts.Splash.Add(side.Box(-Depth, sideLow, Depth - 10, Depth, TopZ, WallZ0));
            parts.Top.Add(side.Slab(0, sideLow, -20, Depth, CarcassZ, TopZ, null));
            topMetres += (Depth + sideLow) / 1000;
            carcassEur += 160;
        }

        var backRun = new Cabinet(backWall, 0, backLow, 0, CarcassZ, 0, plinth: false);
        parts.Splash.Add(backRun.Box(0, backLow + (hasSide ? Depth : 0), Depth - 10, Depth, TopZ, WallZ0));
        // One slab per run, so its grain runs the length of the run: Selva lays wood along each part.
        parts.Top.Add(backRun.Slab(0, backLow + (hasSide ? Depth : 0), -20, Depth, CarcassZ, TopZ,
            sinkAt < 0 ? ((double, double, double, double)?)null : (sinkAt + SinkInset, sinkAt + WidthOf("back/sink") - SinkInset, SinkFront, SinkBack)));

        if (islandLength > 0)
        {
            // One slab over the island, 300 mm past its back for the stools.
            var slab = new Cabinet(Wall("Island", backLength, islandLength), 0, islandLength, 0, CarcassZ, 0, plinth: false);
            parts.Top.Add(slab.Slab(-20, islandLength + 20, -20, IslandTop, CarcassZ, TopZ, null));
            topMetres += islandLength / 1000 * 1.5;
            for (int s = 0; s < 3; s++)
            {
                double u = islandLength * (2 * s + 1) / 6;
                parts.Dark.Add(Cyl(slab.At(u, IslandTop + 80, 0), Vector3d.ZAxis, 180, 15));
                parts.Dark.Add(Cyl(slab.At(u, IslandTop + 80, 0), Vector3d.ZAxis, 22, 640));
                parts.Dark.Add(Cyl(slab.At(u, IslandTop + 80, 640), Vector3d.ZAxis, 175, 45));
                parts.Metal.Add(Cyl(slab.At(u, 440, 1650), Vector3d.ZAxis, 120, 150));
                parts.Glow.Add(Cyl(slab.At(u, 440, 1640), Vector3d.ZAxis, 100, 10));
                parts.Dark.Add(Cyl(slab.At(u, 440, 1800), Vector3d.ZAxis, 4, Room - 1800));
            }
        }

        // The room is only as big as the kitchen needs: the viewer frames everything it is given.
        double wallX = backLength + (hasSide ? Depth : 0);
        double sideLength = length.TryGetValue("Side wall", out var sideRun) ? sideRun : 0;
        double roomFront = -Math.Max(1700, Math.Max(sideLength + 500, islandLength > 0 ? 3100 : 0));
        var walls = new List<Mesh>
        {
            Mesh.CreateFromBox(new BoundingBox(-500, Depth, 0, wallX + 100, Depth + 100, Room), 1, 1, 1),
            Mesh.CreateFromBox(new BoundingBox(wallX, roomFront, 0, wallX + 100, Depth, Room), 1, 1, 1)
        };

        double worktopEur = Math.Round(topMetres * WorktopEur(worktop));
        csv.Add(string.Format(CultureInfo.InvariantCulture, "Worktop,{0},{1:0},,,{2:0}", worktop, topMetres * 1000, worktopEur));
        csv.Add(string.Format(CultureInfo.InvariantCulture, "Sink hob and hood,,,,,{0:0}", applianceEur));
        double total = Math.Round(carcassEur + frontEur + handleEur + wallEur) + worktopEur + applianceEur;
        csv.Add(string.Format(CultureInfo.InvariantCulture, "Total,,,,,{0:0}", total));

        Carcass = parts.Carcass;
        Panels = parts.Panels;
        Glass = parts.Glass;
        Metal = parts.Metal;
        Steel = parts.Steel;
        Dark = parts.Dark;
        Top = parts.Top;
        Splash = parts.Splash;
        Glow = parts.Glow;
        Walls = walls;
        Floor = new List<Mesh> { Mesh.CreateFromBox(new BoundingBox(-500, roomFront, -20, wallX + 100, Depth + 100, 0), 1, 1, 1) };
        GlowStrength = lightsOn ? 3.0 : 0.0;
        Lumens = lightsOn ? 500.0 : 0.0;
        Lines = string.Join("\n", lines);
        Csv = csv;
        PartNames = new List<string> { "Cabinets", "Fronts", "Handles", "Wall units", "Worktop", "Sink, hob and hood" };
        PartEur = new List<double> { Math.Round(carcassEur), Math.Round(frontEur), Math.Round(handleEur), Math.Round(wallEur), worktopEur, applianceEur };
        Total = string.Format(CultureInfo.InvariantCulture, "EUR {0:#,0}", total);
        TopMetres = string.Format(CultureInfo.InvariantCulture, "{0:0.0} m of {1}", topMetres, worktop.ToLowerInvariant());
    }

    const double Relief = 12, Depth = 600, Plinth = 120, Gap = 3, Board = 18, CarcassZ = 870, TopZ = 910, WallZ0 = 1450;
    const double WallDepth = 350, IslandTop = 900, SinkInset = 160, SinkFront = 90, SinkBack = 470;

    sealed class Parts
    {
        public readonly List<Mesh> Carcass = new List<Mesh>(), Panels = new List<Mesh>(), Glass = new List<Mesh>(), Metal = new List<Mesh>(),
            Steel = new List<Mesh>(), Dark = new List<Mesh>(), Top = new List<Mesh>(), Splash = new List<Mesh>(), Glow = new List<Mesh>();
    }

    static double WidthOf(string key)
    {
        switch (key)
        {
            case "back/sink":
            case "back/hob":
            case "side/crockery":
            case "island/cutlery":
            case "island/pans":
                return 800;
            case "island/end":
                return 400;
            default:
                return 600;
        }
    }

    static double FrontEur(string front)
    {
        switch (front)
        {
            case "Shaker door": return 110;
            case "Slab door": return 90;
            case "Push door": return 120;
            case "Glazed door": return 170;
            case "Shaker drawers": return 240;
            case "Slab drawers": return 220;
            case "Push drawers": return 260;
            default: return 60;
        }
    }

    static double HandleEur(string handle)
    {
        switch (handle)
        {
            case "Knob": return 8;
            case "Bar": return 14;
            case "Cup pull": return 12;
            case "Edge pull": return 18;
            default: return 0;
        }
    }

    static double WorktopEur(string worktop)
    {
        switch (worktop)
        {
            case "Walnut": return 260;
            case "Marble": return 420;
            case "Terrazzo": return 340;
            case "Slate": return 300;
            case "Concrete": return 240;
            case "Travertine": return 360;
            default: return 190;
        }
    }

    // A wall unit takes a door in the style of the cabinet under it.
    static string WallFront(string front)
    {
        if (front == "Open shelves" || front == "Glazed door") return front;
        return front.Replace("drawers", "door");
    }

    // Origin, run direction and the direction the fronts face.
    static (Point3d Origin, Vector3d Along, Vector3d Out) Wall(string section, double backLength, double islandLength)
    {
        switch (section)
        {
            case "Side wall": return (new Point3d(backLength, 0, 0), -Vector3d.YAxis, -Vector3d.XAxis);
            case "Island": return (new Point3d(Math.Max(0, (backLength - islandLength) / 2), -1500 - Depth, 0), Vector3d.XAxis, -Vector3d.YAxis);
            default: return (Point3d.Origin, Vector3d.XAxis, -Vector3d.YAxis);
        }
    }

    static void SinkAndTap(Cabinet cabinet, double w, Parts parts)
    {
        const double ua = SinkInset, va = SinkFront, vb = SinkBack, floor = 700;
        double ub = w - SinkInset;
        parts.Steel.Add(cabinet.Box(ua, ub, va, vb, floor, floor + 4));
        parts.Steel.Add(cabinet.Box(ua, ua + 4, va, vb, floor, TopZ + 2));
        parts.Steel.Add(cabinet.Box(ub - 4, ub, va, vb, floor, TopZ + 2));
        parts.Steel.Add(cabinet.Box(ua, ub, va, va + 4, floor, TopZ + 2));
        parts.Steel.Add(cabinet.Box(ua, ub, vb - 4, vb, floor, TopZ + 2));

        parts.Metal.Add(Cyl(cabinet.At(w / 2, 530, TopZ), Vector3d.ZAxis, 26, 12));
        parts.Metal.Add(Cyl(cabinet.At(w / 2, 530, TopZ), Vector3d.ZAxis, 11, 300));
        parts.Metal.Add(cabinet.Box(w / 2 - 9, w / 2 + 9, 330, 541, TopZ + 282, TopZ + 300));
        parts.Metal.Add(Cyl(cabinet.At(w / 2, 340, TopZ + 245), Vector3d.ZAxis, 9, 40));
    }

    static Mesh Cyl(Point3d from, Vector3d axis, double radius, double height) =>
        Mesh.CreateFromCylinder(new Cylinder(new Circle(new Plane(from, axis), radius), height), 1, 32, true, true);

    sealed class Cabinet
    {
        readonly (Point3d Origin, Vector3d Along, Vector3d Out) wall;
        readonly double u0, width, z0, z1, vFront, depth, bottom;
        // Where a pull meets its front: a Shaker frame stands proud of the panel.
        double face = -Board;

        // vFront is how far the cabinet's front sits behind the base cabinets' front plane.
        public Cabinet((Point3d, Vector3d, Vector3d) wall, double u0, double width, double z0, double z1, double vFront, bool plinth)
        {
            this.wall = wall; this.u0 = u0; this.width = width; this.z0 = z0; this.z1 = z1; this.vFront = vFront;
            depth = Depth - vFront;
            bottom = plinth ? z0 + Plinth : z0;
        }

        // u along the run, v from the front (0) to the back, z up. Negative v is in front.
        public Point3d At(double u, double v, double z) =>
            wall.Origin + wall.Along * (u0 + u) - wall.Out * (vFront + v) + Vector3d.ZAxis * z;

        public Mesh Box(double ua, double ub, double va, double vb, double za, double zb) =>
            Mesh.CreateFromBox(new BoundingBox(new[] { At(ua, va, za), At(ub, vb, zb) }), 1, 1, 1);

        /// <summary>A board as one mesh, with an optional rectangular cut-out (ua, ub, va, vb).</summary>
        public Mesh Slab(double ua, double ub, double va, double vb, double za, double zb, (double Ua, double Ub, double Va, double Vb)? hole)
        {
            Curve Rect(double a, double b, double c, double d) =>
                new Polyline(new[] { At(a, c, za), At(b, c, za), At(b, d, za), At(a, d, za), At(a, c, za) }).ToNurbsCurve();
            var outline = new List<Curve> { Rect(ua, ub, va, vb) };
            if (hole.HasValue) outline.Add(Rect(hole.Value.Ua, hole.Value.Ub, hole.Value.Va, hole.Value.Vb));
            var solid = Brep.CreateFromOffsetFace(Brep.CreatePlanarBreps(outline, 0.01)[0].Faces[0], zb - za, 0.01, false, true);
            // The face's normal decides which way the offset went.
            double below = za - solid.GetBoundingBox(true).Min.Z;
            if (below > 1) solid.Translate(0, 0, below);
            var slab = new Mesh();
            foreach (var face in Mesh.CreateFromBrep(solid, MeshingParameters.FastRenderMesh)) slab.Append(face);
            return slab;
        }

        public void Carcass(Parts parts, bool shelves, bool top)
        {
            var into = parts.Carcass;
            into.Add(Box(0, Board, 0, depth, bottom, z1));
            into.Add(Box(width - Board, width, 0, depth, bottom, z1));
            into.Add(Box(Board, width - Board, 0, depth, bottom, bottom + Board));
            into.Add(Box(Board, width - Board, depth - 6, depth, bottom, z1));
            if (top) into.Add(Box(Board, width - Board, 0, depth, z1 - Board, z1));
            if (bottom > z0) parts.Dark.Add(Box(0, width, 50, depth, z0, bottom));
            if (!shelves) return;
            int bays = Math.Max(2, (int)Math.Round((z1 - bottom) / 380));
            for (int s = 1; s < bays; s++)
            {
                double z = bottom + s * (z1 - bottom) / bays;
                into.Add(Box(Board, width - Board, 10, depth - 6, z, z + Board));
            }
        }

        /// <summary>Draws the fronts and returns how many pulls they took.</summary>
        public int Fronts(string front, string handle, Parts parts)
        {
            if (front == "Open shelves") return 0;
            face = front.StartsWith("Shaker") ? -Board - Relief : -Board;
            double f0 = bottom + Gap, f1 = z1 - Gap;
            if (!front.EndsWith("drawers")) return Doors(front, handle, parts, f0, f1);

            // A tall cabinet takes two drawers under worktop height and a door above.
            if (z1 - z0 < 1000) return Drawers(front, handle, parts, f0, f1, 3);
            return Drawers(front, handle, parts, f0, CarcassZ - Gap / 2, 2) +
                   Doors(front.Replace("drawers", "door"), handle, parts, CarcassZ + Gap / 2, f1);
        }

        int Drawers(string front, string handle, Parts parts, double f0, double f1, int count)
        {
            for (int i = 0; i < count; i++)
            {
                double za = f0 + i * (f1 - f0) / count + Gap / 2, zb = f0 + (i + 1) * (f1 - f0) / count - Gap / 2;
                Leaf(front, parts, Gap, width - Gap, za, zb);
                Pull(handle, parts.Metal, width / 2, zb - 60, Gap, width - Gap, za, zb, horizontal: true, opensRight: true);
            }
            return handle == "None" ? 0 : count;
        }

        int Doors(string front, string handle, Parts parts, double f0, double f1)
        {
            int count = width > 700 ? 2 : 1;
            for (int i = 0; i < count; i++)
            {
                double ua = i * width / count + Gap / 2, ub = (i + 1) * width / count - Gap / 2;
                Leaf(front, parts, ua, ub, f0, f1);

                // A pair opens in the middle. The pull sits low on a wall unit, at hand height on a
                // tall door, and near the top of a base door.
                bool right = count == 1 || i == 0;
                double z = z0 >= 1000 ? f0 + 120 : f1 > 1500 ? Math.Max(f0 + 120, 1050) : f1 - 120;
                Pull(handle, parts.Metal, right ? ub - 50 : ua + 50, z, ua, ub, f0, f1, horizontal: false, opensRight: right);
            }
            return handle == "None" ? 0 : count;
        }

        void Leaf(string front, Parts parts, double ua, double ub, double za, double zb)
        {
            if (front == "Glazed door")
            {
                Frame(parts.Panels, ua, ub, za, zb, 60, -Board, 0);
                parts.Glass.Add(Box(ua + 60, ub - 60, -Board / 2 - 2, -Board / 2 + 2, za + 60, zb - 60));
                return;
            }
            parts.Panels.Add(Box(ua, ub, -Board, 0, za, zb));
            if (front.StartsWith("Shaker")) Frame(parts.Panels, ua, ub, za, zb, 60, -Board - Relief, -Board);
        }

        void Frame(List<Mesh> into, double ua, double ub, double za, double zb, double rail, double va, double vb)
        {
            into.Add(Box(ua, ub, va, vb, za, za + rail));
            into.Add(Box(ua, ub, va, vb, zb - rail, zb));
            into.Add(Box(ua, ua + rail, va, vb, za + rail, zb - rail));
            into.Add(Box(ub - rail, ub, va, vb, za + rail, zb - rail));
        }

        void Pull(string handle, List<Mesh> into, double u, double z, double ua, double ub, double za, double zb, bool horizontal, bool opensRight)
        {
            switch (handle)
            {
                case "Knob":
                    into.Add(Cyl(At(u, face, z), wall.Out, 14, 24));
                    break;
                case "Bar":
                    if (horizontal) into.Add(Box(u - 80, u + 80, face - 24, face, z - 6, z + 6));
                    else into.Add(Box(u - 6, u + 6, face - 24, face, z - 80, z + 80));
                    break;
                case "Cup pull":
                    into.Add(Box(u - 45, u + 45, face - 18, face, z - 14, z + 6));
                    break;
                case "Edge pull":
                    // Along the top of a drawer or base door, the bottom of a wall unit, the opening edge of a tall door.
                    if (horizontal || zb - za < 1000 && z0 < 1000) into.Add(Box(ua + 20, ub - 20, face - 10, face, zb - 4, zb + 8));
                    else if (z0 >= 1000) into.Add(Box(ua + 20, ub - 20, face - 10, face, za - 8, za + 4));
                    else if (opensRight) into.Add(Box(ub - 4, ub + 8, face - 10, face, z - 120, z + 120));
                    else into.Add(Box(ua - 8, ua + 4, face - 10, face, z - 120, z + 120));
                    break;
            }
        }
    }

    static object At(List<object> list, int i) => i < list.Count ? list[i] : null;
    static string Txt(object o) { return o == null ? "" : o.ToString().Trim('"'); }
    static double Num(object o, double fallback) { return o != null && double.TryParse(o.ToString().Trim('"'), NumberStyles.Float, CultureInfo.InvariantCulture, out var n) ? n : fallback; }
    static bool Truthy(object o) { return o is bool flag ? flag : o != null && o.ToString().Equals("true", StringComparison.OrdinalIgnoreCase); }
}
# ---------- end kitchen ----------

# ---- group: Kitchen script / Outputs
kitchen_glowstrength = KitchenGlowStrength(kitchen.GlowStrength)
kitchen_partnames = KitchenPartNames(kitchen.PartNames)
kitchen_topmetres = KitchenTopMetres(kitchen.TopMetres)
kitchen_lumens = KitchenLumens(kitchen.Lumens)
kitchen_carcass = KitchenCarcass(kitchen.Carcass)
kitchen_parteur = KitchenPartEur(kitchen.PartEur)
kitchen_splash = KitchenSplash(kitchen.Splash)
kitchen_panels = KitchenPanels(kitchen.Panels)
kitchen_metal = KitchenMetal(kitchen.Metal)
kitchen_walls = KitchenWalls(kitchen.Walls)
kitchen_glass = KitchenGlass(kitchen.Glass)
kitchen_glow = KitchenGlow(kitchen.Glow)
kitchen_floor = KitchenFloor(kitchen.Floor)
kitchen_lines = KitchenLines(kitchen.Lines)
kitchen_steel = KitchenSteel(kitchen.Steel)
kitchen_total = KitchenTotal(kitchen.Total)
kitchen_dark = KitchenDark(kitchen.Dark)
kitchen_top = KitchenTop(kitchen.Top)
kitchen_csv = KitchenCsv(kitchen.Csv)

# ---- group: 3D view / Inputs
wall_paint_color = WallPaintColor(ColourSwatch(SwatchColor=RGB(206, 198, 184)))
carcass_color = CarcassColor(ColourSwatch(SwatchColor=RGB(232, 222, 204)))
glass_color = GlassColor(ColourSwatch(SwatchColor=RGB(230, 240, 240)))
black_color = BlackColor(ColourSwatch(SwatchColor=RGB(30, 31, 34)))
light_color = LightColor(ColourSwatch(SwatchColor=RGB(255, 226, 184)))
tiles_color = TilesColor(ColourSwatch(SwatchColor=RGB(240, 237, 228)))
bulb_color = BulbColor(ColourSwatch(SwatchColor=RGB(255, 250, 236)))

# ---- group: 3D view
# 3D VIEW
# One Display per part, each on its own layer. The strips under the wall units and the pendants are emissive: switch the viewer to Night. Off, they keep their material at strength 0.
kitchen_carcass_2 = KitchenCarcass(kitchen_carcass)
kitchen_glass_2 = KitchenGlass(kitchen_glass)
kitchen_dark_2 = KitchenDark(kitchen_dark)
kitchen_splash_2 = KitchenSplash(kitchen_splash)
kitchen_walls_2 = KitchenWalls(kitchen_walls)
kitchen_glow_2 = KitchenGlow(kitchen_glow)
kitchen_glowstrength_2 = KitchenGlowStrength(kitchen_glowstrength)
kitchen_lumens_2 = KitchenLumens(kitchen_lumens)
kitchen_steel_2 = KitchenSteel(kitchen_steel)
kitchen_panels_2 = KitchenPanels(kitchen_panels)
fronts_4 = Fronts(fronts_3)
kitchen_metal_2 = KitchenMetal(kitchen_metal)
metal_5 = Metal(metal_4)
kitchen_floor_2 = KitchenFloor(kitchen_floor)
kitchen_top_2 = KitchenTop(kitchen_top)
worktop_4 = Worktop(worktop_3)
bulb = ThreeMaterial(Color=bulb_color, Metalness=0, Roughness=0.25)
carcass = ThreeMaterial(Color=carcass_color, Metalness=0, Roughness=0.7)
glass = ThreeMaterial(Color=glass_color, Metalness=0, Roughness=0.05, Transmission=1)
black = ThreeMaterial(Color=black_color, Metalness=0, Roughness=0.35)
tiles = ThreeMaterial(Color=tiles_color, Metalness=0, Roughness=0.12)
wall_paint = ThreeMaterial(Color=wall_paint_color, Metalness=0, Roughness=0.9)
light = EmissiveMaterial(Color=light_color, Strength=kitchen_glowstrength_2, Base=bulb, Kelvin=2700, Lumens=kitchen_lumens_2)
steel = MaterialPreset(Preset=1)
wood_floor = MaterialPreset(Preset=7)
carcass_2 = Display(Geo=kitchen_carcass_2, Name="Carcass", Layer="Kitchen/Carcass", Material=carcass)
glass_2 = Display(Geo=kitchen_glass_2, Name="Glass", Layer="Kitchen/Glass", Material=glass)
black_parts = Display(Geo=kitchen_dark_2, Name="Plinth and stools", Layer="Kitchen/Black", Material=black)
splashback = Display(Geo=kitchen_splash_2, Name="Splashback", Layer="Kitchen/Splashback", Material=tiles)
walls = Display(Geo=kitchen_walls_2, Name="Walls", Layer="Room/Walls", Material=wall_paint)
lights = Display(Geo=kitchen_glow_2, Name="Lights", Layer="Kitchen/Lights", Material=light)
appliances = Display(Geo=kitchen_steel_2, Name="Sink, hob and hood", Layer="Kitchen/Appliances", Material=steel)
fronts_5 = Display(Geo=kitchen_panels_2, Name="Fronts", Layer="Kitchen/Fronts", Material=fronts_4)
metal_6 = Display(Geo=kitchen_metal_2, Name="Handles and tap", Layer="Kitchen/Metal", Material=metal_5)
floor = Display(Geo=kitchen_floor_2, Name="Floor", Layer="Room/Floor", Material=wood_floor)
worktop_5 = Display(Geo=kitchen_top_2, Name="Worktop", Layer="Kitchen/Worktop", Material=worktop_4)
kitchen_2 = CombineDisplay(WebDisplay=[carcass_2, fronts_5, glass_2, metal_6, appliances, black_parts, worktop_5, splashback, lights, walls, floor])

# ---- group: Order
# ORDER
# The script prices each cabinet from its picks, the worktop by the metre, and the sink, hob and hood. One Context Print per value; the labels are what the page shows.
kitchen_lines_2 = KitchenLines(kitchen_lines)
kitchen_partnames_2 = KitchenPartNames(kitchen_partnames)
kitchen_parteur_2 = KitchenPartEur(kitchen_parteur)
kitchen_total_2 = KitchenTotal(kitchen_total)
kitchen_topmetres_2 = KitchenTopMetres(kitchen_topmetres)
layout_3 = Layout(Title="Where the money goes (EUR)", Width=0, Height=0)
price_slices = PieChart(Values=kitchen_parteur_2, Labels=kitchen_partnames_2, Hole=True)
price_chart = Figure(Traces=price_slices, Layout=layout_3, ExportFormat="png")

# ---- group: Order / Outputs
c_bake_6 = ContextBake(PriceBreakdown=price_chart)
c_print = ContextPrint(WorktopM=kitchen_topmetres_2)
c_print_2 = ContextPrint(TotalEUR=kitchen_total_2)
c_print_3 = ContextPrint(CabinetList=kitchen_lines_2)

# ---- group: 3D view / Outputs
c_bake_7 = ContextBake(Kitchen=kitchen_2)
kitchen_3 = Kitchen(kitchen_2)

# ---- group: Downloads
# DOWNLOADS
# The order as a CSV, and the model as a 3DM with the 3D view's layers and colours.
kitchen_carcass_3 = KitchenCarcass(kitchen_carcass)
kitchen_panels_3 = KitchenPanels(kitchen_panels)
kitchen_glass_3 = KitchenGlass(kitchen_glass)
kitchen_metal_3 = KitchenMetal(kitchen_metal)
kitchen_steel_3 = KitchenSteel(kitchen_steel)
kitchen_dark_3 = KitchenDark(kitchen_dark)
kitchen_top_3 = KitchenTop(kitchen_top)
kitchen_splash_3 = KitchenSplash(kitchen_splash)
kitchen_glow_3 = KitchenGlow(kitchen_glow)
kitchen_walls_3 = KitchenWalls(kitchen_walls)
kitchen_floor_3 = KitchenFloor(kitchen_floor)
kitchen_csv_2 = KitchenCsv(kitchen_csv)
kitchen_4 = Kitchen(kitchen_3)
order_list = CreateFile(Data=kitchen_csv_2, Name="kitchen-order", Extension=".csv", IsBase64=False)
kitchen_parts = Merge(
    Data1=flatten(kitchen_carcass_3),
    Data2=flatten(kitchen_panels_3),
    Data3=flatten(kitchen_glass_3),
    Data4=flatten(kitchen_metal_3),
    Data5=flatten(kitchen_steel_3),
    Data6=flatten(kitchen_dark_3),
    Data7=flatten(kitchen_top_3),
    Data8=flatten(kitchen_splash_3),
    Data9=flatten(kitchen_glow_3),
    Data10=flatten(kitchen_walls_3),
    Data11=flatten(kitchen_floor_3))
model_parts = DeconstructDisplay(WebDisplay=kitchen_4)  # -> Meshes, Names, Layers, Colors
model = GeometryToFile(
    Geometry=flatten(kitchen_parts),
    LayerNames=flatten(model_parts.Layers),
    LayerColors=flatten(model_parts.Colors),
    FileNames="kitchen-run",
    FileEnding=".3dm")

# ---- group: Downloads / Outputs
c_bake_8 = ContextBake(OrderListCSV=order_list)
c_bake_9 = ContextBake(Model3DM=model)
