# Grasshopper definition shelving-unit.gh (Grasshopper 1.0.9)
# plug-ins: Selva

# ---- group: Finish / Inputs
# shelving-unit
# Blue: inputs to change.   Green: outputs (charts, results, values passed on).   Named parameters mark each group's inputs and outputs.
# SHELVING UNIT
# Dynamic value lists: Grasshopper computes the options from the size, and each Set Dynamic Value List is wired into the Get Dynamic Value List it fills. The pick is then checked against the options in the same solve, so Width → Bays → Doors is one solve, and a pick no longer offered falls back to the first option.
# FINISH
# Static value lists, for comparison: their options never change.
wood_options = ValueList({"Oak", "Walnut", "Maple"}, selected="Oak")
door_colour_options = ValueList({"White", "Sage", "Charcoal", "Terracotta"}, selected="White")
wood = GetValueList(
    wood_options,
    AtLeast=1,
    AtMost=1,
    Immediate=True,
    ListAccess=False,
    Prompt="Wood",
    StoredItems="""[
  {
    "name": "Oak",
    "expression": "Oak"
  },
  {
    "name": "Walnut",
    "expression": "Walnut"
  },
  {
    "name": "Maple",
    "expression": "Maple"
  }
]""",
    TreeAccess=False)
door_colour = GetValueList(
    door_colour_options,
    AtLeast=1,
    AtMost=1,
    Immediate=True,
    ListAccess=False,
    Prompt="Door colour",
    StoredItems="""[
  {
    "name": "White",
    "expression": "White"
  },
  {
    "name": "Sage",
    "expression": "Sage"
  },
  {
    "name": "Charcoal",
    "expression": "Charcoal"
  },
  {
    "name": "Terracotta",
    "expression": "Terracotta"
  }
]""",
    TreeAccess=False)

# ---- group: UI Bridge / Inputs
toggle = BooleanToggle(False)

# ---- group: Size / Inputs
# SIZE
# Width and height decide which bay and shelf counts fit, so they decide the options of the lists below.
width_default = Slider(1500, range=600..2400)
height_default = Slider(1800, range=700..2200)
depth_default = Slider(350, range=250..450)
width = GetInteger(width_default, AtLeast=1, AtMost=1, Maximum=2400, Minimum=600, Prompt="Width", TreeAccess=False)
height = GetInteger(height_default, AtLeast=1, AtMost=1, Maximum=2200, Minimum=700, Prompt="Height", TreeAccess=False)
depth = GetInteger(depth_default, AtLeast=1, AtMost=1, Maximum=450, Minimum=250, Prompt="Depth", TreeAccess=False)

# ---- group: UI Bridge
uibridge = UIBridge(Enable=toggle, Schema="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")  # -> Schema, URL

# ---- group: UI Bridge / Outputs
c_bake = ContextBake(Content=uibridge.Schema)

# ---- group: Shelves
# SHELVES
# Every shelf count that spaces the shelves 230 to 420 mm apart in the height between the bottom and the top.
height_2 = Height(height)
clear_height = Evaluate(E="x-96", x=height_2)
fewest_shelves = Evaluate(E="Ceiling(x/420)-1", x=clear_height)
most_shelves = Evaluate(E="Floor(x/230)-1", x=clear_height)
shelf_choices = Evaluate(E="y-x+1", x=fewest_shelves, y=most_shelves)
shelf_counts = Series(Start=fewest_shelves, Step=1, Count=shelf_choices)
spacing = Evaluate(E="x/(y+1)", x=clear_height, y=shelf_counts)
shelf_pairs = Format(Format="\"{0} ({1:0} mm apart)\" = {0}", Culture=127, Data0=shelf_counts, Data1=spacing)
shelf_options = SetDynamicValueList(Options=shelf_pairs)
shelves = GetDynamicValueList(
    shelf_options,
    AtLeast=1,
    AtMost=1,
    Immediate=True,
    ListAccess=False,
    StoredItems="""[
  {
    "name": "4 (341 mm apart)",
    "expression": "4"
  },
  {
    "name": "5 (284 mm apart)",
    "expression": "5"
  },
  {
    "name": "6 (243 mm apart)",
    "expression": "6"
  }
]""",
    TreeAccess=False)

# ---- group: Bays
# BAYS
# Every bay count whose bays come out 350 to 800 mm wide, written as "name" = value. The output is wired into Bays as well as into the Context Bake: that wire is what makes Bays check its pick in this solve.
width_2 = Width(width)
fewest_bays = Evaluate(E="Ceiling(x/800)", x=width_2)
most_bays = Evaluate(E="Floor(x/350)", x=width_2)
bay_choices = Evaluate(E="y-x+1", x=fewest_bays, y=most_bays)
bay_counts = Series(Start=fewest_bays, Step=1, Count=bay_choices)
bay_width = Evaluate(E="x/y", x=width_2, y=bay_counts)
bay_pairs = Format(Format="\"{0} ({1:0} mm wide)\" = {0}", Culture=127, Data0=bay_counts, Data1=bay_width)
bay_options = SetDynamicValueList(Options=bay_pairs)
bays = GetDynamicValueList(
    bay_options,
    AtLeast=1,
    AtMost=1,
    Immediate=True,
    ListAccess=False,
    StoredItems="""[
  {
    "name": "2 (750 mm wide)",
    "expression": "2"
  },
  {
    "name": "3 (500 mm wide)",
    "expression": "3"
  },
  {
    "name": "4 (375 mm wide)",
    "expression": "4"
  }
]""",
    TreeAccess=False)

# ---- group: Bays / Outputs
c_bake_2 = ContextBake(BayOptions=bay_options)

# ---- group: Shelves / Outputs
c_bake_3 = ContextBake(ShelfOptions=shelf_options)

# ---- group: Doors / Inputs
door_patterns = Panel(""""None" = None
"All bays" = All bays
"Left bay" = Left bay
"Alternate bays" = Alternate bays
"Outer bays" = Outer bays""")
bays_needed_per_pattern = Panel("""1
1
2
2
3""")
door_patterns_2 = DoorPatterns(door_patterns)
bays_needed = Number(bays_needed_per_pattern)

# ---- group: Doors
# DOORS
# The door patterns that fit the bay count Bays resolved to in this solve: Outer bays needs three bays, Left bay and Alternate bays two. A chain of two lists, and still one solve.
bays_name = Text(bays)
bay_count = Number(bays_name)
fits = Evaluate(E="x<=y", x=bays_needed, y=bay_count)
door_pairs = CullPattern(List=door_patterns_2, CullPattern=fits)
door_options = SetDynamicValueList(Options=door_pairs)
doors = GetDynamicValueList(
    door_options,
    AtLeast=1,
    AtMost=1,
    Immediate=True,
    ListAccess=False,
    StoredItems="""[
  {
    "name": "None",
    "expression": "None"
  },
  {
    "name": "All bays",
    "expression": "All bays"
  },
  {
    "name": "Left bay",
    "expression": "Left bay"
  },
  {
    "name": "Alternate bays",
    "expression": "Alternate bays"
  }
]""",
    TreeAccess=False)

# ---- group: Doors / Outputs
c_bake_4 = ContextBake(DoorOptions=door_options)

# ---- group: Shelving script
# SHELVING SCRIPT
# Builds the unit from the resolved picks. Source: Shelving.script.cs beside the generator.
width_3 = Width(width)
height_3 = Height(height)
depth_2 = Depth(depth)
shelving = CSharpScript(Width=width_3, Height=height_3, Depth=depth_2, Bays=bays, Shelves=shelves, Doors=doors)  # -> out, Carcass, Fronts, Knobs, Floor, Summary
# ---------- shelving: C# ----------
// Grasshopper Script Instance
using System;
using System.Collections.Generic;

using Rhino.Geometry;

using Grasshopper.Kernel;

public class Script_Instance : GH_ScriptInstance
{
    // A shelving unit in millimetres, standing on the floor at the origin with its front along -Y.
    // Bays, Shelves and Doors arrive resolved by their Get Dynamic Value Lists, so they always fit.
    private void RunScript(object Width, object Height, object Depth, object Bays, object Shelves, object Doors,
        ref object Carcass, ref object Fronts, ref object Knobs, ref object Floor, ref object Summary)
    {
        const double board = 18, plinth = 60, back = 6, gap = 3;
        double w = Num(Width, 1500), h = Num(Height, 1800), d = Num(Depth, 350);
        int bays = Math.Max(1, (int)Math.Round(Num(Bays, 3)));
        int shelves = Math.Max(0, (int)Math.Round(Num(Shelves, 4)));
        string doors = Txt(Doors, "None");
        double bay = w / bays;

        var carcass = new List<Mesh>();
        for (int i = 0; i <= bays; i++)
        {
            double x = Math.Min(Math.Max(i * bay - board / 2, 0), w - board);
            carcass.Add(Box(x, x + board, 0, d, 0, h));
        }
        carcass.Add(Box(board, w - board, 20, d, 0, plinth));
        carcass.Add(Box(board, w - board, 0, d, plinth, plinth + board));
        carcass.Add(Box(board, w - board, 0, d, h - board, h));
        carcass.Add(Box(board, w - board, d - back, d, plinth + board, h - board));

        // Shelves sit evenly between the bottom and the top: the spacing the Shelves options name.
        double clear = h - plinth - 2 * board, step = clear / (shelves + 1);
        for (int i = 0; i < bays; i++)
        {
            double x0 = i * bay + board / 2, x1 = (i + 1) * bay - board / 2;
            for (int s = 1; s <= shelves; s++)
            {
                double z = plinth + board + s * step - board / 2;
                carcass.Add(Box(x0, x1, 0, d - back, z, z + board));
            }
        }

        var fronts = new List<Mesh>();
        var knobs = new List<Mesh>();
        for (int i = 0; i < bays; i++)
        {
            if (!HasDoor(doors, i, bays)) continue;
            double x0 = i * bay + gap / 2, x1 = (i + 1) * bay - gap / 2;
            fronts.Add(Box(x0, x1, -board, 0, plinth + gap, h - gap));
            // The knob sits on the side away from the hinge: outer bays open outwards.
            double kx = i < bays / 2.0 ? x1 - 40 : x0 + 40;
            knobs.Add(Knob(new Point3d(kx, -board, plinth + clear / 2)));
        }

        Carcass = carcass;
        Fronts = fronts;
        Knobs = knobs;
        Floor = new List<Mesh> { Box(-900, w + 900, -1400, d + 200, -20, 0) };
        Summary = string.Format("{0} × {1:0} mm bays, {2} {3} each, doors: {4}", bays, bay, shelves,
            shelves == 1 ? "shelf" : "shelves", doors.ToLowerInvariant());
    }

    static bool HasDoor(string pattern, int i, int bays)
    {
        switch (pattern)
        {
            case "All bays": return true;
            case "Left bay": return i == 0;
            case "Alternate bays": return i % 2 == 0;
            case "Outer bays": return i == 0 || i == bays - 1;
            default: return false;
        }
    }

    static Mesh Box(double x0, double x1, double y0, double y1, double z0, double z1) =>
        Mesh.CreateFromBox(new BoundingBox(x0, y0, z0, x1, y1, z1), 1, 1, 1);

    static Mesh Knob(Point3d at)
    {
        var circle = new Circle(new Plane(at, -Vector3d.YAxis), 12);
        return Mesh.CreateFromCylinder(new Cylinder(circle, 22), 1, 24, true, true);
    }

    static string Txt(object o, string fallback) { return o == null || o.ToString().Trim('"') == "" ? fallback : o.ToString().Trim('"'); }
    static double Num(object o, double fallback) { double v; return o != null && GH_Convert.ToDouble(o, out v, GH_Conversion.Both) ? v : fallback; }
}
# ---------- end shelving ----------

# ---- group: Shelving script / Outputs
shelving_summary = ShelvingSummary(shelving.Summary)
shelving_carcass = ShelvingCarcass(shelving.Carcass)
shelving_fronts = ShelvingFronts(shelving.Fronts)
shelving_knobs = ShelvingKnobs(shelving.Knobs)
shelving_floor = ShelvingFloor(shelving.Floor)

# ---- group: 3D view / Inputs
wood_preset_table = Panel("""23
12
24""")
wood_index_options = Panel("""Oak
Walnut
Maple""")
door_colour_index_options = Panel("""White
Sage
Charcoal
Terracotta""")
door_colour_index_options_2 = DoorColourIndexOptions(door_colour_index_options)
wood_index_options_2 = WoodIndexOptions(wood_index_options)
door_paints_data_1 = DoorPaintsData1(ColourSwatch(SwatchColor=RGB(240, 238, 232)))
door_paints_data_2 = DoorPaintsData2(ColourSwatch(SwatchColor=RGB(150, 168, 140)))
door_paints_data_3 = DoorPaintsData3(ColourSwatch(SwatchColor=RGB(58, 60, 64)))
door_paints_data_4 = DoorPaintsData4(ColourSwatch(SwatchColor=RGB(184, 98, 70)))
wood_preset_table_2 = WoodPresetTable(wood_preset_table)
knob_color = KnobColor(ColourSwatch(SwatchColor=RGB(70, 70, 72)))
floor_color = FloorColor(ColourSwatch(SwatchColor=RGB(214, 210, 202)))

# ---- group: 3D view
# 3D VIEW
# One Display per part. Wood picks a material preset; the doors take a paint colour.
shelving_carcass_2 = ShelvingCarcass(shelving_carcass)
wood_2 = Wood(wood)
shelving_fronts_2 = ShelvingFronts(shelving_fronts)
door_colour_2 = DoorColour(door_colour)
shelving_knobs_2 = ShelvingKnobs(shelving_knobs)
shelving_floor_2 = ShelvingFloor(shelving_floor)
wood_name = Text(wood_2)
door_colour_name = Text(door_colour_2)
door_paints = Merge(Data1=door_paints_data_1, Data2=door_paints_data_2, Data3=door_paints_data_3, Data4=door_paints_data_4)
wood_index = MemberIndex(Set=wood_index_options_2, Member=wood_name)  # -> Index, Count
door_colour_index = MemberIndex(Set=door_colour_index_options_2, Member=door_colour_name)  # -> Index, Count
wood_preset = ListItem(List=wood_preset_table_2, Index=wood_index.Index, Wrap=True)
door_paint = ListItem(List=door_paints, Index=door_colour_index.Index, Wrap=True)
wood_3 = MaterialPreset(Preset=wood_preset)
door_paint_2 = ThreeMaterial(Color=door_paint, Metalness=0, Roughness=0.55)
knob = ThreeMaterial(Color=knob_color, Metalness=1, Roughness=0.35)
floor = ThreeMaterial(Color=floor_color, Metalness=0, Roughness=0.9)
carcass = Display(Geo=shelving_carcass_2, Name="Carcass", Layer="Shelving/Carcass", Material=wood_3)
doors_2 = Display(Geo=shelving_fronts_2, Name="Doors", Layer="Shelving/Doors", Material=door_paint_2)
knobs = Display(Geo=shelving_knobs_2, Name="Knobs", Layer="Shelving/Knobs", Material=knob)
floor_2 = Display(Geo=shelving_floor_2, Name="Floor", Layer="Context/Floor", Material=floor)
shelving_unit = CombineDisplay(WebDisplay=[carcass, doors_2, knobs, floor_2])

# ---- group: Result
# RESULT
# What the solve built, from the picks it resolved.
shelving_summary_2 = ShelvingSummary(shelving_summary)

# ---- group: Result / Outputs
c_print = ContextPrint(Summary=shelving_summary_2)

# ---- group: 3D view / Outputs
c_bake_5 = ContextBake(ShelvingUnit=shelving_unit)
