# Grasshopper definition studio-task-lamp.gh (Grasshopper 1.0.9)
# plug-ins: Selva Canopy, Selva

# ---- group: Light and desk / Inputs
# LIGHT AND DESK
# The light switch, its colour temperature and the desk top.
light_on_default = BooleanToggle(True)
colour_temperature_default = Slider(2700, range=2200..6500)
desk_options = ValueList({"Oak", "Walnut", "Maple", "Wenge"}, selected="Walnut")
colour_temperature = GetInteger(
    colour_temperature_default,
    AtLeast=1,
    AtMost=1,
    Maximum=6500,
    Minimum=2200,
    Prompt="Colour temperature",
    TreeAccess=False)
light_on = GetBoolean(light_on_default, AtLeast=1, AtMost=1, FalseValue="False", Prompt="Light on", TreeAccess=False, TrueValue="True")
desk = GetValueList(
    desk_options,
    AtLeast=1,
    AtMost=1,
    Immediate=True,
    ListAccess=False,
    Prompt="Desk",
    StoredItems="""[
  {
    "name": "Oak",
    "expression": "Oak"
  },
  {
    "name": "Walnut",
    "expression": "Walnut"
  },
  {
    "name": "Maple",
    "expression": "Maple"
  },
  {
    "name": "Wenge",
    "expression": "Wenge"
  }
]""",
    TreeAccess=False)

# ---- group: Finish / Inputs
# FINISH
# Powder coat takes a colour, or any colour from the picker under Custom. Metals carry their own.
finish_options = ValueList({"Powder Coat", "Anodised", "Brass", "Chrome"}, selected="Brass")
body_colour_options = ValueList({"Forest", "Oxide", "Cream", "Graphite", "Ocean", "Custom"}, selected="Forest")
lining_options = ValueList({"White", "Cream", "Gold"}, selected="Cream")
diffuser_default = BooleanToggle(True)
cable_default = BooleanToggle(True)
cable_colour_options = ValueList({"Black", "Copper", "White"}, selected="Copper")
custom_colour = GetColor(
    ColourSwatch(SwatchColor=RGB(214, 96, 52)),
    AtLeast=1,
    AtMost=1,
    Immediate=True,
    Prompt="Custom colour",
    TreeAccess=False)
finish = GetValueList(
    finish_options,
    AtLeast=1,
    AtMost=1,
    Immediate=True,
    ListAccess=False,
    Prompt="Finish",
    StoredItems="""[
  {
    "name": "Powder Coat",
    "expression": "Powder Coat"
  },
  {
    "name": "Anodised",
    "expression": "Anodised"
  },
  {
    "name": "Brass",
    "expression": "Brass"
  },
  {
    "name": "Chrome",
    "expression": "Chrome"
  }
]""",
    TreeAccess=False)
body_colour = GetValueList(
    body_colour_options,
    AtLeast=1,
    AtMost=1,
    Immediate=True,
    ListAccess=False,
    Prompt="Body colour",
    StoredItems="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",
    TreeAccess=False)
lining = GetValueList(
    lining_options,
    AtLeast=1,
    AtMost=1,
    Immediate=True,
    ListAccess=False,
    Prompt="Lining",
    StoredItems="""[
  {
    "name": "White",
    "expression": "White"
  },
  {
    "name": "Cream",
    "expression": "Cream"
  },
  {
    "name": "Gold",
    "expression": "Gold"
  }
]""",
    TreeAccess=False)
diffuser = GetBoolean(diffuser_default, AtLeast=1, AtMost=1, FalseValue="False", Prompt="Diffuser", TreeAccess=False, TrueValue="True")
cable = GetBoolean(cable_default, AtLeast=1, AtMost=1, FalseValue="False", Prompt="Cable", TreeAccess=False, TrueValue="True")
cable_colour = GetValueList(
    cable_colour_options,
    AtLeast=1,
    AtMost=1,
    Immediate=True,
    ListAccess=False,
    Prompt="Cable colour",
    StoredItems="""[
  {
    "name": "Black",
    "expression": "Black"
  },
  {
    "name": "Copper",
    "expression": "Copper"
  },
  {
    "name": "White",
    "expression": "White"
  }
]""",
    TreeAccess=False)

# ---- group: Order / Inputs
# ORDER
# The project name goes into the spec sheet's title block. Quantity sets the price break.
project_default = Panel("Studio fit-out")
quantity_default = Slider(1, range=1..200)
project = GetString(project_default, AtLeast=1, AtMost=1, Prompt="Project", TreeAccess=False)
quantity = GetInteger(quantity_default, AtLeast=1, AtMost=1, Maximum=200, Minimum=1, Prompt="Quantity", TreeAccess=False)

# ---- group: UI Bridge / Inputs
toggle = BooleanToggle(False)

# ---- group: Arm / Inputs
# ARM
# Height and reach place the head's knuckle. Elbow moves the joint of the two-joint arm.
arm_options = ValueList({"Straight", "Two-Joint", "Arc"}, selected="Arc")
height_default = Slider(500, range=300..700)
reach_default = Slider(340, range=150..600)
elbow_default = Slider(45, range=20..80)
arm = GetValueList(
    arm_options,
    AtLeast=1,
    AtMost=1,
    Immediate=True,
    ListAccess=False,
    Prompt="Arm",
    StoredItems="""[
  {
    "name": "Straight",
    "expression": "Straight"
  },
  {
    "name": "Two-Joint",
    "expression": "Two-Joint"
  },
  {
    "name": "Arc",
    "expression": "Arc"
  }
]""",
    TreeAccess=False)
height = GetInteger(height_default, AtLeast=1, AtMost=1, Maximum=700, Minimum=300, Prompt="Height", TreeAccess=False)
reach = GetInteger(reach_default, AtLeast=1, AtMost=1, Maximum=600, Minimum=150, Prompt="Reach", TreeAccess=False)
elbow = GetInteger(elbow_default, AtLeast=1, AtMost=1, Maximum=80, Minimum=20, Prompt="Elbow", TreeAccess=False)

# ---- group: Head / Inputs
# HEAD
# The head's shape and size decide which light sources fit in it.
head_options = ValueList({"Dome", "Cone", "Cylinder", "Linear Bar"}, selected="Dome")
head_size_default = Slider(200, range=90..260)
bar_length_default = Slider(420, range=200..700)
head_tilt_default = Slider(22, range=0..60)
head = GetValueList(
    head_options,
    AtLeast=1,
    AtMost=1,
    Immediate=True,
    ListAccess=False,
    Prompt="Head",
    StoredItems="""[
  {
    "name": "Dome",
    "expression": "Dome"
  },
  {
    "name": "Cone",
    "expression": "Cone"
  },
  {
    "name": "Cylinder",
    "expression": "Cylinder"
  },
  {
    "name": "Linear Bar",
    "expression": "Linear Bar"
  }
]""",
    TreeAccess=False)
head_size = GetInteger(head_size_default, AtLeast=1, AtMost=1, Maximum=260, Minimum=90, Prompt="Head size", TreeAccess=False)
bar_length = GetInteger(bar_length_default, AtLeast=1, AtMost=1, Maximum=700, Minimum=200, Prompt="Bar length", TreeAccess=False)
head_tilt = GetInteger(head_tilt_default, AtLeast=1, AtMost=1, Maximum=60, Minimum=0, Prompt="Head tilt", TreeAccess=False)

# ---- group: Base / Inputs
# BASE
# Round or square on the desk, or a clamp on its edge. A clamp swaps the base size for the desk thickness.
base_options = ValueList({"Round", "Square", "Clamp"}, selected="Round")
base_size_default = Slider(190, range=120..280)
weighted_base_default = BooleanToggle(False)
desk_thickness_default = Slider(30, range=15..60)
weighted_base = GetBoolean(
    weighted_base_default,
    AtLeast=1,
    AtMost=1,
    FalseValue="False",
    Prompt="Weighted base",
    TreeAccess=False,
    TrueValue="True")
desk_thickness = GetInteger(desk_thickness_default, AtLeast=1, AtMost=1, Maximum=60, Minimum=15, Prompt="Desk thickness", TreeAccess=False)
base = GetValueList(
    base_options,
    AtLeast=1,
    AtMost=1,
    Immediate=True,
    ListAccess=False,
    Prompt="Base",
    StoredItems="""[
  {
    "name": "Round",
    "expression": "Round"
  },
  {
    "name": "Square",
    "expression": "Square"
  },
  {
    "name": "Clamp",
    "expression": "Clamp"
  }
]""",
    TreeAccess=False)
base_size = GetInteger(base_size_default, AtLeast=1, AtMost=1, Maximum=280, Minimum=120, Prompt="Base size", TreeAccess=False)

# ---- group: UI Bridge
uibridge = UIBridge(Enable=toggle, Schema="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")  # -> Schema, URL

# ---- group: UI Bridge / Outputs
c_bake = ContextBake(Content=uibridge.Schema)

# ---- group: Finish values / Inputs
# studio-task-lamp
# Blue: inputs to change.   Green: outputs (charts, results, values passed on).   Named parameters mark each group's inputs and outputs.
# STUDIO TASK LAMP
# A desk lamp configurator. Four small C# Scripts do the head's light sources, the geometry, the light on the desk and the drawing views; the rest is stock and Selva components: a light-source list that follows the head, night-look lighting, checks, charts, a two-sheet A3 PDF, the model and a parts list.
metalness_table = Panel("""0
1
1
1""")
roughness_table = Panel("""0.42
0.38
0.3
0.08""")
finish_index_options = Panel("""Powder Coat
Anodised
Brass
Chrome""")
clearcoat_table = Panel("""0.45
0
0
0""")
forest = ColourSwatch(SwatchColor=RGB(30, 62, 54))
oxide = ColourSwatch(SwatchColor=RGB(148, 58, 40))
cream = ColourSwatch(SwatchColor=RGB(236, 228, 208))
graphite = ColourSwatch(SwatchColor=RGB(44, 46, 50))
ocean = ColourSwatch(SwatchColor=RGB(28, 70, 104))
colour_index_options = Panel("""Forest
Oxide
Cream
Graphite
Ocean
Custom""")
anodised = ColourSwatch(SwatchColor=RGB(182, 186, 192))
brass = ColourSwatch(SwatchColor=RGB(198, 158, 92))
chrome = ColourSwatch(SwatchColor=RGB(232, 234, 238))
white = ColourSwatch(SwatchColor=RGB(250, 248, 242))
cream_2 = ColourSwatch(SwatchColor=RGB(236, 228, 208))
gold = ColourSwatch(SwatchColor=RGB(214, 170, 96))
lining_index_options = Panel("""White
Cream
Gold""")
black = ColourSwatch(SwatchColor=RGB(22, 22, 24))
copper = ColourSwatch(SwatchColor=RGB(176, 92, 58))
white_2 = ColourSwatch(SwatchColor=RGB(250, 248, 242))
cable_index_options = Panel("""Black
Copper
White""")
colour_index_options_2 = ColourIndexOptions(colour_index_options)
lining_index_options_2 = LiningIndexOptions(lining_index_options)
finish_index_options_2 = FinishIndexOptions(finish_index_options)
cable_index_options_2 = CableIndexOptions(cable_index_options)
roughness_table_2 = RoughnessTable(roughness_table)
metalness_table_2 = MetalnessTable(metalness_table)
clearcoat_table_2 = ClearcoatTable(clearcoat_table)
anodised_2 = Anodised(anodised)
graphite_2 = Graphite(graphite)
chrome_2 = Chrome(chrome)
forest_2 = Forest(forest)
oxide_2 = Oxide(oxide)
cream_3 = Cream(cream)
ocean_2 = Ocean(ocean)
brass_2 = Brass(brass)
white_3 = White(white)
cream_4 = Cream(cream_2)
gold_2 = Gold(gold)
black_2 = Black(black)
copper_2 = Copper(copper)
white_4 = White(white_2)

# ---- group: Finish values
# FINISH VALUES
# Each choice's index picks its row from a small table: metalness, roughness and clearcoat by finish, and a colour per option. Powder coat takes the colour list, Custom the picker.
custom_colour_2 = CustomColour(custom_colour)
finish_2 = Finish(finish)
body_colour_2 = BodyColour(body_colour)
lining_2 = Lining(lining)
cable_colour_2 = CableColour(cable_colour)
finish_name = Text(finish_2)
body_colour_name = Text(body_colour_2)
lining_name = Text(lining_2)
cable_colour_name = Text(cable_colour_2)
paints = Merge(Data1=forest_2, Data2=oxide_2, Data3=cream_3, Data4=graphite_2, Data5=ocean_2, Data6=custom_colour_2)
finish_index = MemberIndex(Set=finish_index_options_2, Member=finish_name)  # -> Index, Count
linings = Merge(Data1=white_3, Data2=cream_4, Data3=gold_2)
cables = Merge(Data1=black_2, Data2=copper_2, Data3=white_4)
colour_index = MemberIndex(Set=colour_index_options_2, Member=body_colour_name)  # -> Index, Count
lining_index = MemberIndex(Set=lining_index_options_2, Member=lining_name)  # -> Index, Count
cable_index = MemberIndex(Set=cable_index_options_2, Member=cable_colour_name)  # -> Index, Count
metalness = ListItem(List=metalness_table_2, Index=finish_index.Index, Wrap=True)
roughness = ListItem(List=roughness_table_2, Index=finish_index.Index, Wrap=True)
clearcoat = ListItem(List=clearcoat_table_2, Index=finish_index.Index, Wrap=True)
paint = ListItem(List=paints, Index=colour_index.Index, Wrap=True)
lining_colour = ListItem(List=linings, Index=lining_index.Index, Wrap=True)
cable_colour_3 = ListItem(List=cables, Index=cable_index.Index, Wrap=True)
body_colour_3 = StreamFilter(Gate=finish_index.Index, Stream0=paint, Stream1=anodised_2, Stream2=brass_2, Stream3=chrome_2)

# ---- group: Light source
# LIGHT SOURCE
# The head script lists the light sources that fit the shade. Set Dynamic Value List sends them into Light source and into a Context Bake. Change the head and a source that no longer fits falls back to the brightest one that does, in the same solve. Source: LampHead.script.cs.
diffuser_2 = Diffuser(diffuser)
head_2 = Head(head)
head_size_2 = HeadSize(head_size)
bar_length_2 = BarLength(bar_length)
head_3 = CSharpScript(Head=head_2, HeadSize=head_size_2, BarLength=bar_length_2, Diffuser=diffuser_2)  # -> out, Options, Sources, Profile
# ---------- head_3: C# ----------
// Grasshopper Script Instance
using System;
using System.Linq;
using System.Collections.Generic;
using System.Globalization;

using Rhino;
using Rhino.Geometry;

using Grasshopper;
using Grasshopper.Kernel;
using Grasshopper.Kernel.Types;

public class Script_Instance : GH_ScriptInstance
{
    // The shade's profile and the light sources that fit it. It runs before the Light source input, so the
    // list offered and the pick made from it belong to one solve. Profile is the shade's half section:
    // x the radius, z the depth along the light direction.
    private void RunScript(object Head, object HeadSize, object BarLength, object Diffuser,
		ref object Options, ref object Sources, ref object Profile)
    {
        string head = Txt(Head, "Dome");
        double R = Num(HeadSize, 170) / 2, barLen = Num(BarLength, 420);
        bool diffuser = Bool(Diffuser, true), bar = head == "Linear Bar";

        var profile = bar ? new List<Point3d> { new Point3d(23, 0, 0), new Point3d(23, 0, 28) } : HeadProfile(head, R);
        double depth = profile[profile.Count - 1].Z, mouth = profile[profile.Count - 1].X;

        // Behind a diffuser a bulb must sit inside the shade; without one it may stand proud of the rim,
        // like an exposed filament globe.
        var fits = new List<Lamp>();
        if (bar)
            fits.AddRange(Strips.Select(s => new Lamp(s.Id, s.Name, s.Lm * barLen / 1000, s.W * barLen / 1000, s.Price * barLen / 1000, 0, 0, "strip") { Label = Label(s) }));
        else
        {
            double room = 2 * mouth * (head == "Cylinder" ? 0.95 : 0.8);
            double reachOut = depth + (diffuser ? -4 : 30);
            fits.AddRange(Bulbs.Where(b => b.Dia + 10 <= room && Tip(b, profile) <= reachOut));
            if (fits.Count == 0) fits.Add(Bulbs[Bulbs.Length - 1]);
        }
        fits = fits.OrderByDescending(o => o.Lm).ToList();

        // The label is the option's name in the form, so it must not change with the bar's length.
        Options = fits.Select(o => string.Format(Inv, "\"{0}\" = {1}", o.Label ?? Label(o), o.Id)).ToList();
        Sources = fits.Select(o => string.Format(Inv, "{0}|{1}|{2:0.#}|{3:0.##}|{4:0.##}|{5}|{6}|{7}|{8:0.#}|{9:0.#}",
            o.Id, o.Name, o.Lm, o.W, o.Price, o.Dia, o.Len, o.Kind, Seat(o, profile), Tip(o, profile))).ToList();
        Profile = profile;
    }

    static readonly CultureInfo Inv = CultureInfo.InvariantCulture;

    // A light source: lumens, watts and price, and for bulbs the diameter and length the head must hold.
    class Lamp
    {
        public string Id, Name, Kind, Label; public double Lm, W, Price, Dia, Len;
        public Lamp(string id, string name, double lm, double w, double price, double dia, double len, string kind)
        { Id = id; Name = name; Lm = lm; W = w; Price = price; Dia = dia; Len = len; Kind = kind; }
    }

    static readonly Lamp[] Bulbs =
    {
        new Lamp("globe-6", "Filament globe 6 W", 470, 6, 14, 95, 135, "globe"),
        new Lamp("e27-13", "E27 LED 13 W", 1521, 13, 9, 67, 120, "bulb"),
        new Lamp("e27-9", "E27 LED 9 W", 806, 9, 6, 60, 105, "bulb"),
        new Lamp("gu10-7", "GU10 LED 7 W", 600, 7, 7, 50, 55, "spot"),
        new Lamp("module-6", "LED module 6 W", 600, 6, 11, 40, 18, "module"),
    };

    static string Label(Lamp s) { return string.Format(Inv, s.Kind == "strip" ? "{0}, {1:#,0} lm/m" : "{0}, {1:#,0} lm", s.Name, s.Lm); }

    // Per metre of bar.
    static readonly Lamp[] Strips =
    {
        new Lamp("strip-high", "High-output strip", 1600, 15, 26, 0, 0, "strip"),
        new Lamp("strip-std", "LED strip", 900, 9, 18, 0, 0, "strip"),
    };

    // Where a source starts along the head's axis. A bulb's narrow E27 neck sits in the collar; a spot or
    // module is as wide as its face, so it moves down the shade until the shade is wider than it.
    static double Seat(Lamp s, List<Point3d> profile)
    {
        if (s.Kind != "spot" && s.Kind != "module") return 0;
        for (double z = 0; z < profile[profile.Count - 1].Z; z += 1)
            if (HalfWidth(profile, z) >= s.Dia / 2 + 2) return z;
        return profile[profile.Count - 1].Z;
    }

    // Where a source's front ends.
    static double Tip(Lamp s, List<Point3d> profile)
    {
        if (s.Kind == "strip") return profile[profile.Count - 1].Z;
        return s.Kind == "module" ? Seat(s, profile) + 5 : Seat(s, profile) + s.Len - 12;
    }

    // The shade's inside radius at a depth along its axis.
    static double HalfWidth(List<Point3d> profile, double z)
    {
        double best = 0;
        for (int i = 1; i < profile.Count; i++)
        {
            Point3d a = profile[i - 1], b = profile[i];
            if (b.Z <= a.Z || z > b.Z || z < a.Z) continue;
            best = Math.Max(best, a.X + (b.X - a.X) * (z - a.Z) / (b.Z - a.Z));
        }
        return best;
    }

    static List<Point3d> HeadProfile(string head, double R)
    {
        var p = new List<Point3d>();
        if (head == "Cone")
        {
            p.Add(new Point3d(R * 0.14, 0, 0)); p.Add(new Point3d(R, 0, R * 0.92));
            return p;
        }
        if (head == "Cylinder")
        {
            double r = R * 0.62, d = R * 1.5;
            p.Add(new Point3d(0.01, 0, 0)); p.Add(new Point3d(r, 0, 0)); p.Add(new Point3d(r, 0, d));
            return p;
        }
        double depth = R * 0.74;
        p.Add(new Point3d(0.01, 0, 0));
        for (int i = 1; i <= 8; i++)
        {
            double t = i / 8.0 * Math.PI / 2;
            p.Add(new Point3d(R * Math.Sin(t), 0, depth * (1 - Math.Cos(t))));
        }
        return p;
    }

    static string Txt(object o, string fallback) { return o == null || o.ToString().Trim('"') == "" ? fallback : o.ToString().Trim('"'); }
    static double Num(object o, double fallback) { double v; return o != null && GH_Convert.ToDouble(o, out v, GH_Conversion.Both) ? v : fallback; }
    static bool Bool(object o, bool fallback) { bool v; return o != null && GH_Convert.ToBoolean(o, out v, GH_Conversion.Both) ? v : fallback; }
}
# ---------- end head_3 ----------
light_source_options = SetDynamicValueList(Options=head_3.Options)
light_source = GetDynamicValueList(
    light_source_options,
    AtLeast=1,
    AtMost=1,
    Immediate=True,
    ListAccess=False,
    StoredItems="""[
  {
    "name": "GU10 LED 7 W, 600 lm",
    "expression": "gu10-7"
  },
  {
    "name": "LED module 6 W, 600 lm",
    "expression": "module-6"
  }
]""",
    TreeAccess=False)

# ---- group: Light source / Outputs
c_bake_2 = ContextBake(LightSourceOptions=light_source_options)
head_sources = HeadSources(head_3.Sources)
head_profile = HeadProfile(head_3.Profile)

# ---- group: Finish values / Outputs
body_colour_name_2 = BodyColourName(body_colour_name)
lining_colour_2 = LiningColour(lining_colour)
cable_colour_4 = CableColour(cable_colour_3)
body_colour_4 = BodyColour(body_colour_3)
finish_name_2 = FinishName(finish_name)
finish_index_2 = FinishIndex(finish_index.Index)
roughness_2 = Roughness(roughness)
metalness_2 = Metalness(metalness)
clearcoat_2 = Clearcoat(clearcoat)

# ---- group: Lamp script
# LAMP SCRIPT
# Builds the lamp in millimetres, with the things on the desk. It also reports the beam for the light on the desk, whether the lamp stands, and its parts at list price. Source: Lamp.script.cs beside the generator.
light_on_2 = LightOn(light_on)
diffuser_3 = Diffuser(diffuser)
cable_2 = Cable(cable)
arm_2 = Arm(arm)
height_2 = Height(height)
reach_2 = Reach(reach)
elbow_2 = Elbow(elbow)
head_sources_2 = HeadSources(head_sources)
head_profile_2 = HeadProfile(head_profile)
head_4 = Head(head)
head_size_3 = HeadSize(head_size)
bar_length_3 = BarLength(bar_length)
head_tilt_2 = HeadTilt(head_tilt)
base_2 = Base(base)
base_size_2 = BaseSize(base_size)
weighted_base_2 = WeightedBase(weighted_base)
desk_thickness_2 = DeskThickness(desk_thickness)
lamp = CSharpScript(
    Base=base_2,
    BaseSize=base_size_2,
    DeskThickness=desk_thickness_2,
    Weighted=weighted_base_2,
    Arm=arm_2,
    Height=height_2,
    Reach=reach_2,
    Elbow=elbow_2,
    Tilt=head_tilt_2,
    Head=head_4,
    HeadSize=head_size_3,
    BarLength=bar_length_3,
    Diffuser=diffuser_3,
    CableOn=cable_2,
    Profile=head_profile_2,
    Sources=head_sources_2,
    Source=light_source,
    LightOn=light_on_2)  # -> out, Body, Trim, Inner, Glass, Light, Cable, Desk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; inputs Profile: list, Sources: list
# ---------- lamp: C# ----------
// Grasshopper Script Instance
using System;
using System.Linq;
using System.Collections;
using System.Collections.Generic;
using System.Drawing;
using System.Globalization;

using Rhino;
using Rhino.Geometry;

using Grasshopper;
using Grasshopper.Kernel;
using Grasshopper.Kernel.Data;
using Grasshopper.Kernel.Types;

public class Script_Instance : GH_ScriptInstance
{
    // A desk lamp in millimetres, base on the desk at the origin, reaching along +X. Besides the parts
    // it reports the beam the light script needs, whether the lamp stands, and a priced parts list.
    // The shade's profile and the light sources that fit it come from the head script.
    private void RunScript(
		object Base, object BaseSize, object DeskThickness, object Weighted,
		object Arm, object Height, object Reach, object Elbow, object Tilt,
		object Head, object HeadSize, object BarLength, object Diffuser, object CableOn,
		List<object> Profile, List<object> Sources, object Source, object LightOn,
		ref object Body, ref object Trim, ref object Inner, ref object Glass, ref object Light, ref object Cable,
		ref object Desk, ref object Props, ref object Lumens,
		ref object Beam, ref object Spread, ref object Cutoff, ref object Efficiency,
		ref object Steady, ref object GlareFree,
		ref object SourceName, ref object PowerW, ref object Stability, ref object WeightKg,
		ref object PartNames, ref object PartNotes, ref object PartEur)
    {
        string baseType = Txt(Base, "Round"), arm = Txt(Arm, "Two-Joint"), head = Txt(Head, "Dome");
        double size = Num(BaseSize, 180), deskT = Num(DeskThickness, 30), h = Num(Height, 480), reach = Num(Reach, 360);
        double elbow = Num(Elbow, 45) / 100.0, tilt = Num(Tilt, 25) * Math.PI / 180, headSize = Num(HeadSize, 170), barLen = Num(BarLength, 420);
        bool heavy = Bool(Weighted, false), diffuser = Bool(Diffuser, true), cableOn = Bool(CableOn, true), lightOn = Bool(LightOn, true);

        var body = new List<Mesh>(); var inner = new List<Mesh>(); var glass = new List<Mesh>();
        var light = new List<Mesh>(); var cable = new List<Mesh>(); var desk = new List<Mesh>();
        var trim = new List<Mesh>(); var props = new List<Mesh>();

        bool clamp = baseType == "Clamp";
        bool bar = head == "Linear Bar";

        // Desk: a clamp needs an edge, so the desk starts at the lamp.
        double deskFrom = clamp ? 0 : -300, deskTo = Math.Max(reach + 260, 620);
        desk.Add(Mesh.CreateFromBox(new BoundingBox(deskFrom, -300, -deskT, deskTo, 300, 0), 1, 1, 1));

        // Base
        double baseTop, baseMassKg, footprint;
        if (baseType == "Square")
        {
            double t = heavy ? 30 : 16;
            var rr = RoundedRect(size, size * 0.8, 16);
            body.Add(ToMesh(Extrusion.Create(rr, t, true).ToBrep()));
            baseTop = t; footprint = size / 2;
            baseMassKg = size * size * 0.8 * t * 7.85e-6;
        }
        else if (clamp)
        {
            // One C-section gripping the desk edge at x = 0, tightened by a screw from below.
            const double top = 12, width = 52, rear = -12, front = 92, screw = 62;
            var section = new Polyline(new[]
            {
                new Point3d(rear, -deskT - 16, 0), new Point3d(front, -deskT - 16, 0), new Point3d(front, -deskT - 6, 0), new Point3d(0, -deskT - 6, 0),
                new Point3d(0, 0, 0), new Point3d(front, 0, 0), new Point3d(front, top, 0), new Point3d(rear, top, 0), new Point3d(rear, -deskT - 16, 0)
            }).ToNurbsCurve();
            var rounded = Curve.CreateFilletCornersCurve(section, 2, 0.01, 0.1) ?? section;
            var jaw = ToMesh(Extrusion.Create(rounded, width, true).ToBrep());
            jaw.Transform(Transform.Rotation(Math.PI / 2, Vector3d.XAxis, Point3d.Origin));
            var box = jaw.GetBoundingBox(true);
            jaw.Transform(Transform.Translation(0, -(box.Min.Y + box.Max.Y) / 2, 0));
            body.Add(jaw);
            body.Add(ToMesh(Tube(new LineCurve(new Point3d(screw, 0, -deskT - 56), new Point3d(screw, 0, -deskT - 5)), 6)));
            body.Add(ToMesh(new Cylinder(new Circle(new Plane(new Point3d(screw, 0, -deskT - 5), Vector3d.ZAxis), 14), 5).ToBrep(true, true)));
            body.Add(ToMesh(new Cylinder(new Circle(new Plane(new Point3d(screw, 0, -deskT - 68), Vector3d.ZAxis), 15), 12).ToBrep(true, true)));
            baseTop = top; footprint = 0; baseMassKg = 0.65;
        }
        else
        {
            double t = heavy ? 30 : 16, R = size / 2, r = 6;
            var pts = new List<Point3d> { new Point3d(0, 0, 0), new Point3d(R, 0, 0), new Point3d(R, 0, t - r) };
            var profile = new PolyCurve();
            profile.Append(new Line(pts[0], pts[1]));
            profile.Append(new Line(pts[1], pts[2]));
            profile.Append(new Arc(pts[2], Vector3d.ZAxis, new Point3d(R - r, 0, t)));
            profile.Append(new Line(new Point3d(R - r, 0, t), new Point3d(0, 0, t)));
            body.Add(ToMesh(Revolve(profile)));
            baseTop = t; footprint = R;
            baseMassKg = Math.PI * R * R * t * 7.85e-6;
        }

        if (!clamp)
            trim.Add(Mesh.CreateFromBox(new BoundingBox(-footprint * 0.62 - 11, -7, baseTop - 1, -footprint * 0.62 + 11, 7, baseTop + 3.5), 1, 1, 1));

        // Arm: pivot at the base, head knuckle at (reach, 0, height).
        var pivot = new Point3d(clamp ? 36 : 0, 0, baseTop + 22);
        var knuckle = new Point3d(reach, 0, h);
        body.Add(ToMesh(Tube(new LineCurve(new Point3d(pivot.X, 0, baseTop - 1), pivot), 11)));
        body.Add(ToMesh(Joint(pivot, 15, 38)));
        trim.Add(ToMesh(Knob(pivot, 38)));

        double armLen, armRadius;
        var armPath = new List<Curve>();
        if (arm == "Straight")
        {
            var c = new LineCurve(pivot, knuckle);
            body.Add(ToMesh(Tube(c, 9)));
            armLen = c.GetLength(); armRadius = 9;
            armPath.Add(c);
        }
        else if (arm == "Arc")
        {
            var c = new ArcCurve(new Arc(pivot, Vector3d.ZAxis, knuckle));
            body.Add(ToMesh(Tube(c, 8)));
            armLen = c.GetLength(); armRadius = 8;
            armPath.Add(c);
        }
        else
        {
            var e = new Point3d(pivot.X + reach * (elbow - 0.42), 0, baseTop + (h - baseTop) * 0.66);
            foreach (double y in new[] { -10.0, 10.0 })
            {
                var off = new Vector3d(0, y, 0);
                body.Add(ToMesh(Tube(new LineCurve(pivot + off, e + off), 5)));
                body.Add(ToMesh(Tube(new LineCurve(e + off, knuckle + off), 5)));
            }
            body.Add(ToMesh(Joint(e, 13, 34)));
            trim.Add(ToMesh(Knob(e, 34)));
            armLen = pivot.DistanceTo(e) + e.DistanceTo(knuckle); armRadius = 5;
            armPath.Add(new LineCurve(pivot, e)); armPath.Add(new LineCurve(e, knuckle));
        }

        // Head: local +Z is the light direction.
        var dir = new Vector3d(Math.Sin(tilt), 0, -Math.Cos(tilt));
        var x = Vector3d.CrossProduct(Vector3d.YAxis, dir);
        var outer = Profile.Select(ToPoint).ToList();
        if (outer.Count < 2) outer = new List<Point3d> { new Point3d(23, 0, 0), new Point3d(23, 0, 28) };
        double depth = outer[outer.Count - 1].Z, mouth = outer[outer.Count - 1].X;
        var sources = Sources.Select(o => Lamp.Parse(Txt(o, ""))).Where(o => o != null).ToList();
        var src = sources.FirstOrDefault(o => o.Id == Txt(Source, "")) ?? sources.FirstOrDefault()
            ?? Lamp.Parse("module-6|LED module 6 W|600|6|11|40|18|module|0|5");

        // A wide head on a short reach swallows its own arm, so the head moves out on a neck until it clears.
        double neck = NeckToClear(knuckle, dir, x, armPath, armRadius, outer);
        var mount = knuckle + Vector3d.XAxis * neck;
        body.Add(ToMesh(new Sphere(knuckle, 13).ToBrep()));
        trim.Add(ToMesh(Joint(knuckle, 5.5, 34)));
        if (neck > 0)
        {
            body.Add(ToMesh(Tube(new LineCurve(knuckle, mount), 6)));
            body.Add(ToMesh(new Sphere(mount, 10).ToBrep()));
        }
        var c0 = mount + dir * 30;
        body.Add(ToMesh(Tube(new LineCurve(mount, c0), 6)));
        var frame = new Plane(c0, x, Vector3d.CrossProduct(dir, x));
        var toHead = Transform.PlaneToPlane(Plane.WorldXY, frame);

        double headMassKg, lightZ;
        if (bar)
        {
            var section = RoundedRect(46, 28, 11);
            var bodyMesh = ToMesh(Extrusion.Create(section, barLen, true).ToBrep());
            bodyMesh.Transform(Transform.Translation(0, 0, -barLen / 2));
            bodyMesh.Transform(Transform.Rotation(Math.PI / 2, Vector3d.XAxis, Point3d.Origin));
            bodyMesh.Transform(Transform.Translation(0, 0, 14));
            bodyMesh.Transform(toHead);
            body.Add(bodyMesh);
            var strip = Mesh.CreateFromBox(new BoundingBox(-16, -barLen / 2 + 12, 26, 16, barLen / 2 - 12, 29), 1, 1, 1);
            strip.Transform(toHead);
            light.Add(strip);
            headMassKg = 0.2 + barLen / 1000 * 0.7;
            lightZ = 27;
        }
        else
        {
            var skin = Curve.CreateInterpolatedCurve(outer, 3);
            if (head == "Cone" || head == "Cylinder") skin = new Polyline(outer).ToNurbsCurve();
            var shell = ToMesh(Revolve(skin)); shell.Transform(toHead); body.Add(shell);

            var offset = outer.Select(p => new Point3d(Math.Max(p.X - 2.5, 0.01), 0, p.Z + 1.5)).ToList();
            var liner = Curve.CreateInterpolatedCurve(offset, 3);
            if (head == "Cone" || head == "Cylinder") liner = new Polyline(offset).ToNurbsCurve();
            var linerMesh = ToMesh(Revolve(liner)); linerMesh.Transform(toHead); inner.Add(linerMesh);

            var rim = ToMesh(new Torus(new Plane(new Point3d(0, 0, depth), Vector3d.ZAxis), mouth - 0.5, 3.2).ToNurbsSurface().ToBrep());
            rim.Transform(toHead); body.Add(rim);

            var collar = ToMesh(new Cylinder(new Circle(new Plane(new Point3d(0, 0, -12), Vector3d.ZAxis), 15), 16).ToBrep(true, true));
            collar.Transform(toHead); body.Add(collar);

            foreach (var part in BulbMeshes(src, src.Seat, out lightZ)) { part.Transform(toHead); light.Add(part); }

            if (diffuser)
            {
                var lens = ToMesh(new Cylinder(new Circle(new Plane(new Point3d(0, 0, depth - 2), Vector3d.ZAxis), mouth - 2.5), 2.5).ToBrep(true, true));
                lens.Transform(toHead); glass.Add(lens);
            }
            headMassKg = 0.2 + Math.Pow(headSize / 170, 2) * 0.3;
        }

        // Cable: hidden inside a tube arm, or threaded between twin rods over saddles. It leaves the back
        // of the base through a strain relief and runs flat on the desk to a grommet. A clamp has no
        // desk behind it, so there it drops off the edge.
        if (cableOn)
        {
            const double r = 2.6;
            if (arm != "Straight" && arm != "Arc")
                foreach (var link in armPath)
                {
                    cable.Add(ToMesh(Tube(link, r)));
                    var along = link.PointAtEnd - link.PointAtStart; along.Unitize();
                    var below = Vector3d.CrossProduct(along, Vector3d.YAxis);
                    if (below.Z > 0) below = -below;
                    foreach (double t in new[] { 0.3, 0.7 })
                    {
                        var at = link.PointAtNormalizedLength(t) + below * (r + 2);
                        body.Add(ToMesh(Tube(new LineCurve(at - Vector3d.YAxis * 10, at + Vector3d.YAxis * 10), 2)));
                    }
                }

            double exit = clamp ? -12 : -footprint;
            double exitZ = clamp ? 6 : 5;
            cable.Add(ToMesh(Tube(new LineCurve(new Point3d(exit + 2, 0, exitZ), new Point3d(exit - 12, 0, exitZ)), 4.6)));
            cable.Add(ToMesh(Tube(new LineCurve(new Point3d(exit - 10, 0, exitZ), new Point3d(exit - 24, 0, exitZ)), 3.7)));

            List<Point3d> route;
            Vector3d arrival;
            if (clamp)
            {
                double drop = exit - 54;
                route = new List<Point3d> { new Point3d(exit, 0, exitZ), new Point3d(exit - 28, 0, exitZ), new Point3d(drop, 0, -24), new Point3d(drop, 0, -deskT - 240) };
                arrival = -Vector3d.ZAxis;
            }
            else
            {
                const double gx = -262, gy = 84, flat = r + 0.1, bend = 9;
                double settled = exit - 40;
                var entry = new Point3d(gx + bend, gy, flat);
                route = new List<Point3d>
                {
                    new Point3d(exit, 0, exitZ), new Point3d(exit - 26, 0, exitZ), new Point3d(settled, 0, flat), new Point3d(gx + 70, gy, flat), entry
                };
                arrival = -Vector3d.XAxis;

                // Flat to the hole, then one bend down: a spline through both wriggles on the desk.
                cable.Add(ToMesh(Tube(new ArcCurve(new Arc(entry, -Vector3d.XAxis, new Point3d(gx, gy, flat - bend))), r)));
                var grommet = new Point3d(gx, gy, 0.2);
                cable.Add(ToMesh(new Torus(new Plane(grommet, Vector3d.ZAxis), 13, 1).ToNurbsSurface().ToBrep()));
                cable.Add(ToMesh(new Cylinder(new Circle(new Plane(new Point3d(gx, gy, 0), Vector3d.ZAxis), 12.5), 0.2).ToBrep(true, true)));
            }
            cable.Add(ToMesh(Tube(Curve.CreateInterpolatedCurve(route, 3, CurveKnotStyle.Chord, -Vector3d.XAxis, arrival), r)));
        }

        // On the desk: a sketchbook where the light falls, a pencil and a mug.
        double bookX = Math.Max(reach + 60, footprint + 150);
        var onDesk = Transform.Translation(bookX, -110, 0) * Transform.Rotation(0.2, Vector3d.ZAxis, Point3d.Origin);
        foreach (var part in new[]
        {
            Tuple.Create(trim, Mesh.CreateFromBox(new BoundingBox(-105, -74, 0, 105, 74, 2.5), 1, 1, 1)),
            Tuple.Create(props, Mesh.CreateFromBox(new BoundingBox(-101, -71, 2.5, 102, 71, 12), 1, 1, 1)),
            Tuple.Create(trim, Mesh.CreateFromBox(new BoundingBox(-105, -74, 12, 105, 74, 14.5), 1, 1, 1)),
            Tuple.Create(trim, ToMesh(Tube(new LineCurve(new Point3d(-80, -104, 3.7), new Point3d(95, -96, 3.7)), 3.6))),
        })
        {
            part.Item2.Transform(onDesk);
            part.Item1.Add(part.Item2);
        }
        var mugAt = Transform.Translation(Math.Min(bookX + 185, deskTo - 60), 165, 0);
        var mugWall = new Polyline(new[]
        {
            new Point3d(0.01, 0, 0), new Point3d(36, 0, 0), new Point3d(40, 0, 6), new Point3d(40, 0, 92), new Point3d(36.5, 0, 92),
            new Point3d(36.5, 0, 7), new Point3d(0.01, 0, 5)
        }).ToNurbsCurve();
        var handle = new ArcCurve(new Arc(new Point3d(39, 0, 74), new Point3d(64, 0, 48), new Point3d(39, 0, 22)));
        foreach (var part in new[] { ToMesh(Revolve(mugWall)), ToMesh(Tube(handle, 4.5)) })
        {
            part.Transform(mugAt);
            props.Add(part);
        }

        // Tipping about the base edge on the head's side.
        double armMassKg = armLen / 1000 * 0.55;
        double baseKg = heavy ? baseMassKg : baseMassKg * 0.75;
        double overturn = headMassKg * (reach + neck - footprint) + armMassKg * (reach / 2 - footprint);
        double margin = clamp || overturn <= 0 ? double.PositiveInfinity : baseKg * footprint / overturn;
        string stability;
        if (clamp) stability = "Clamped to the desk";
        else if (overturn <= 0) stability = "Stable: the head sits inside the base";
        else stability = margin >= 1.25 ? string.Format(Inv, "Stable, {0:0.0}x margin", margin)
            : margin >= 1 ? string.Format(Inv, "Marginal, {0:0.0}x: widen or weight the base", margin)
            : string.Format(Inv, "Tips over at {0:0.0}x: widen or weight the base", margin);

        // Parts at list price before the finish. The Price section adds the finish and the quantity break.
        var parts = new List<Tuple<string, string, double>>
        {
            Tuple.Create("Base", clamp ? "Desk clamp, steel" : string.Format(Inv, "{0}, {1}{2:0} mm, {3} mm steel", baseType, baseType == "Round" ? "Ø" : "", size, heavy ? 30 : 16), clamp ? 22 : 10 + baseKg * 7),
            Tuple.Create("Arm", string.Format(Inv, "{0}, {1:0} mm", arm, armLen), 8 + armLen * 0.05),
            Tuple.Create("Head", bar ? string.Format(Inv, "Linear bar, {0:0} mm", barLen) : string.Format(Inv, "{0}, Ø{1:0} mm", head, headSize), bar ? barLen * 0.09 : headSize * 0.22),
            Tuple.Create("Light source", string.Format(Inv, "{0}, {1:#,0} lm", src.Name, src.Lm), src.Price),
            Tuple.Create("Diffuser", "Frosted glass", diffuser && !bar ? 9.0 : 0),
            Tuple.Create("Cable", "Textile, 2 m, strain relief", cableOn ? 6.0 : 0),
            Tuple.Create("Assembly", "Wiring, test and pack", 16.0),
        }.Where(p => p.Item3 > 0).ToList();

        // Light: the beam leaves the source along the head's axis. n says how tightly the shade focuses
        // it; a diffuser softens it and takes some of the light.
        double n = head == "Cylinder" ? 6 : head == "Cone" ? 3 : bar ? 1 : 1.5;
        if (diffuser && !bar) n *= 0.7;
        double cutoff = bar ? 80 : Math.Min(Math.Atan2(mouth, Math.Max(depth - lightZ, 5)) * 180 / Math.PI, 85);

        Body = body; Trim = trim; Inner = inner; Glass = glass; Light = light; Cable = cable; Desk = desk; Props = props;
        Lumens = lightOn ? src.Lm : 0;
        Beam = new Plane(c0 + dir * lightZ, dir);
        Spread = n;
        Cutoff = cutoff;
        Efficiency = (bar ? 0.9 : 0.8) * (diffuser && !bar ? 0.85 : 1);
        Steady = margin >= 1;
        // A bare source standing out of the rim shines straight into the eye.
        GlareFree = bar || diffuser || src.Tip <= depth;
        SourceName = string.Format(Inv, "{0}, {1:#,0} lm", src.Name, src.Lm);
        PowerW = Math.Round(src.W, 1);
        Stability = stability;
        WeightKg = Math.Round(baseKg + headMassKg + armMassKg + (cableOn ? 0.08 : 0), 2);
        PartNames = parts.Select(p => p.Item1).ToList();
        PartNotes = parts.Select(p => p.Item2).ToList();
        PartEur = parts.Select(p => Math.Round(p.Item3, 2)).ToList();
    }

    static readonly CultureInfo Inv = CultureInfo.InvariantCulture;

    // A light source as the head script lists it: id|name|lm|W|EUR|diameter|length|kind|seat|tip.
    class Lamp
    {
        public string Id, Name, Kind; public double Lm, W, Price, Dia, Len, Seat, Tip;
        public static Lamp Parse(string line)
        {
            var f = line.Split('|');
            if (f.Length < 10) return null;
            Func<int, double> n = i => double.Parse(f[i], Inv);
            return new Lamp { Id = f[0], Name = f[1], Lm = n(2), W = n(3), Price = n(4), Dia = n(5), Len = n(6), Kind = f[7], Seat = n(8), Tip = n(9) };
        }
    }

    // The source in the head's frame, from its seat. lightZ is where it emits from.
    static List<Mesh> BulbMeshes(Lamp s, double seat, out double lightZ)
    {
        var parts = new List<Mesh>();
        if (s.Kind == "module")
        {
            parts.Add(ToMesh(new Cylinder(new Circle(new Plane(new Point3d(0, 0, seat + 2), Vector3d.ZAxis), s.Dia / 2), 3).ToBrep(true, true)));
            lightZ = seat + 5;
        }
        else if (s.Kind == "spot")
        {
            parts.Add(ToMesh(new Cylinder(new Circle(new Plane(new Point3d(0, 0, seat), Vector3d.ZAxis), s.Dia / 2), s.Len - 12).ToBrep(true, true)));
            lightZ = seat + s.Len - 14;
        }
        else
        {
            double centre = s.Len - 12 - s.Dia / 2;
            parts.Add(ToMesh(new Cylinder(new Circle(new Plane(new Point3d(0, 0, -12), Vector3d.ZAxis), 13.5), centre + 12).ToBrep(true, true)));
            parts.Add(ToMesh(new Sphere(new Point3d(0, 0, centre), s.Dia / 2).ToBrep()));
            lightZ = centre;
        }
        return parts;
    }

    static double NeckToClear(Point3d knuckle, Vector3d dir, Vector3d x, List<Curve> arm, double armRadius, List<Point3d> profile)
    {
        for (double neck = 0; neck < 500; neck += 10)
        {
            var head = knuckle + Vector3d.XAxis * neck + dir * 30;
            if (!arm.Any(c => Hits(c, head, dir, x, armRadius, profile))) return neck;
        }
        return 500;
    }

    static bool Hits(Curve arm, Point3d head, Vector3d dir, Vector3d x, double armRadius, List<Point3d> profile)
    {
        const double clearance = 6;
        for (int i = 0; i <= 80; i++)
        {
            double t;
            arm.NormalizedLengthParameter(i / 80.0, out t);
            var v = arm.PointAt(t) - head;
            double along = v * dir;
            if (along < -16 || along > profile[profile.Count - 1].Z) continue;
            if (Math.Abs(v * x) < WidthAt(profile, along) + armRadius + clearance) return true;
        }
        return false;
    }

    // Half-width of the head at a depth along its axis, the collar included.
    static double WidthAt(List<Point3d> profile, double depth)
    {
        for (int i = 1; i < profile.Count; i++)
        {
            Point3d a = profile[i - 1], b = profile[i];
            if (b.Z <= a.Z || depth > b.Z || depth < a.Z) continue;
            return Math.Max(15, a.X + (b.X - a.X) * (depth - a.Z) / (b.Z - a.Z));
        }
        return 15;
    }

    static Curve RoundedRect(double w, double d, double r)
    {
        var rect = new Rectangle3d(Plane.WorldXY, new Interval(-w / 2, w / 2), new Interval(-d / 2, d / 2));
        var c = Curve.CreateFilletCornersCurve(rect.ToNurbsCurve(), r, 0.01, 0.1);
        return c ?? rect.ToNurbsCurve();
    }

    static Brep Revolve(Curve c)
    {
        return Brep.CreateFromRevSurface(RevSurface.Create(c, new Line(Point3d.Origin, Vector3d.ZAxis, 10)), false, false);
    }

    static Brep Tube(Curve c, double r)
    {
        var pipes = Brep.CreatePipe(c, r, false, PipeCapMode.Round, true, 0.05, 0.02);
        return pipes[0];
    }

    static Brep Joint(Point3d at, double r, double width)
    {
        var plane = new Plane(at - Vector3d.YAxis * width / 2, Vector3d.YAxis);
        return new Cylinder(new Circle(plane, r), width).ToBrep(true, true);
    }

    // The tightening knob on one side of a joint.
    static Brep Knob(Point3d at, double width)
    {
        var plane = new Plane(at - Vector3d.YAxis * (width / 2 + 9), Vector3d.YAxis);
        return new Cylinder(new Circle(plane, 9), 9).ToBrep(true, true);
    }

    static Point3d ToPoint(object o) { var p = Point3d.Origin; GH_Convert.ToPoint3d(o, ref p, GH_Conversion.Both); return p; }

    static Mesh ToMesh(Brep b)
    {
        var mp = new MeshingParameters(0.85, 0.5) { JaggedSeams = false, RefineGrid = true };
        var m = new Mesh();
        foreach (var part in Mesh.CreateFromBrep(b, mp)) m.Append(part);
        m.Normals.ComputeNormals();
        return m;
    }

    static string Txt(object o, string fallback) { return o == null || o.ToString().Trim('"') == "" ? fallback : o.ToString().Trim('"'); }
    static double Num(object o, double fallback) { double v; return o != null && GH_Convert.ToDouble(o, out v, GH_Conversion.Both) ? v : fallback; }
    static bool Bool(object o, bool fallback) { bool v; return o != null && GH_Convert.ToBoolean(o, out v, GH_Conversion.Both) ? v : fallback; }
}
# ---------- end lamp ----------

# ---- group: Lamp script / Outputs
lamp_sourcename = LampSourceName(lamp.SourceName)
lamp_partnames = LampPartNames(lamp.PartNames)
lamp_weightkg = LampWeightKg(lamp.WeightKg)
lamp_partnotes = LampPartNotes(lamp.PartNotes)
lamp_glarefree = LampGlareFree(lamp.GlareFree)
lamp_efficiency = LampEfficiency(lamp.Efficiency)
lamp_powerw = LampPowerW(lamp.PowerW)
lamp_stability = LampStability(lamp.Stability)
lamp_lumens = LampLumens(lamp.Lumens)
lamp_parteur = LampPartEur(lamp.PartEur)
lamp_spread = LampSpread(lamp.Spread)
lamp_steady = LampSteady(lamp.Steady)
lamp_cutoff = LampCutoff(lamp.Cutoff)
lamp_cable = LampCable(lamp.Cable)
lamp_props = LampProps(lamp.Props)
lamp_beam = LampBeam(lamp.Beam)
lamp_inner = LampInner(lamp.Inner)
lamp_glass = LampGlass(lamp.Glass)
lamp_body = LampBody(lamp.Body)
lamp_light = LampLight(lamp.Light)
lamp_desk = LampDesk(lamp.Desk)
lamp_trim = LampTrim(lamp.Trim)

# ---- group: 3D view / Inputs
desk_preset_table = Panel("""23
12
24
25""")
desk_index_options = Panel("""Oak
Walnut
Maple
Wenge""")
paper_and_ceramic_color = PaperAndCeramicColor(ColourSwatch(SwatchColor=RGB(244, 241, 232)))
diffuser_glow_color = DiffuserGlowColor(ColourSwatch(SwatchColor=RGB(255, 232, 196)))
frosted_glass_color = FrostedGlassColor(ColourSwatch(SwatchColor=RGB(250, 250, 246)))
desk_index_options_2 = DeskIndexOptions(desk_index_options)
desk_preset_table_2 = DeskPresetTable(desk_preset_table)
trim_color = TrimColor(ColourSwatch(SwatchColor=RGB(26, 27, 30)))
bulb_color = BulbColor(ColourSwatch(SwatchColor=RGB(255, 250, 236)))

# ---- group: 3D view
# 3D VIEW
# One Display per part, each on its own layer. The light source and diffuser are emissive: switch the viewer to Night. Off, the source keeps its material at strength 0, so the Display never empties.
lamp_body_2 = LampBody(lamp_body)
body_colour_5 = BodyColour(body_colour_4)
metalness_3 = Metalness(metalness_2)
roughness_3 = Roughness(roughness_2)
clearcoat_3 = Clearcoat(clearcoat_2)
lamp_trim_2 = LampTrim(lamp_trim)
lamp_glass_2 = LampGlass(lamp_glass)
lamp_props_2 = LampProps(lamp_props)
colour_temperature_2 = ColourTemperature(colour_temperature)
lamp_light_2 = LampLight(lamp_light)
lamp_lumens_2 = LampLumens(lamp_lumens)
lamp_desk_2 = LampDesk(lamp_desk)
desk_2 = Desk(desk)
lamp_inner_2 = LampInner(lamp_inner)
lining_colour_3 = LiningColour(lining_colour_2)
lamp_cable_2 = LampCable(lamp_cable)
cable_colour_5 = CableColour(cable_colour_4)
desk_name = Text(desk_2)
desk_index = MemberIndex(Set=desk_index_options_2, Member=desk_name)  # -> Index, Count
frosted_glass = ThreeMaterial(Color=frosted_glass_color, Metalness=0, Roughness=0.45, Transmission=1)
desk_preset = ListItem(List=desk_preset_table_2, Index=desk_index.Index, Wrap=True)
bulb = ThreeMaterial(Color=bulb_color, Metalness=0, Roughness=0.25)
diffuser_glow = Evaluate(E="x/160*0.3", x=lamp_lumens_2)
glow_strength = Evaluate(E="if(x>0,4,0)", x=lamp_lumens_2)
body = ThreeMaterial(Color=body_colour_5, Metalness=metalness_3, Roughness=roughness_3, Clearcoat=clearcoat_3, ClearcoatRoughness=0.25)
trim = ThreeMaterial(Color=trim_color, Metalness=0, Roughness=0.55)
diffuser_glow_2 = EmissiveMaterial(Color=diffuser_glow_color, Strength=diffuser_glow, Base=frosted_glass, Kelvin=colour_temperature_2)
paper_and_ceramic = ThreeMaterial(Color=paper_and_ceramic_color, Metalness=0, Roughness=0.5)
light = EmissiveMaterial(Color=diffuser_glow_color, Strength=glow_strength, Base=bulb, Kelvin=colour_temperature_2, Lumens=lamp_lumens_2)
desk_top = MaterialPreset(Preset=desk_preset)
lining_3 = ThreeMaterial(Color=lining_colour_3, Metalness=0, Roughness=0.5)
cable_3 = ThreeMaterial(Color=cable_colour_5, Metalness=0, Roughness=0.6)
body_2 = Display(Geo=lamp_body_2, Name="Body", Layer="Lamp/Body", Material=body)
trim_2 = Display(Geo=lamp_trim_2, Name="Knobs and switch", Layer="Lamp/Trim", Material=trim)
diffuser_4 = Display(Geo=lamp_glass_2, Name="Diffuser", Layer="Lamp/Diffuser", Material=diffuser_glow_2)
on_the_desk = Display(Geo=lamp_props_2, Name="On the desk", Layer="Context/On the desk", Material=paper_and_ceramic)
light_source_2 = Display(Geo=lamp_light_2, Name="Light source", Layer="Lamp/Light", Material=light)
desk_3 = Display(Geo=lamp_desk_2, Name="Desk", Layer="Context/Desk", Material=desk_top)
lining_4 = Display(Geo=lamp_inner_2, Name="Inner", Layer="Lamp/Shade lining", Material=lining_3)
cable_4 = Display(Geo=lamp_cable_2, Name="Cable", Layer="Lamp/Cable", Material=cable_3)
lamp_2 = CombineDisplay(WebDisplay=[body_2, trim_2, lining_4, diffuser_4, light_source_2, cable_4, desk_3, on_the_desk])

# ---- group: Price / Inputs
finish_factor_table = Panel("""1
1.2
1.65
1.45""")
finish_label = Panel("Finish")
finish_factor_table_2 = FinishFactorTable(finish_factor_table)
finish_label_2 = FinishLabel(finish_label)

# ---- group: Price
# PRICE
# The parts at list price, times the finish's factor, less a quantity break: 10% from 10 lamps, 18% from 50. The donut shows one lamp at list price.
finish_index_3 = FinishIndex(finish_index_2)
lamp_parteur_2 = LampPartEur(lamp_parteur)
lamp_partnames_2 = LampPartNames(lamp_partnames)
quantity_2 = Quantity(quantity)
quantity_break = Evaluate(E="if(x>=50,0.18,if(x>=10,0.1,0))", x=quantity_2)
finish_factor = ListItem(List=finish_factor_table_2, Index=finish_index_3, Wrap=True)
parts_total = MassAddition(Input=lamp_parteur_2)  # -> Result, PartialResults
finish_premium = Evaluate(E="x*(y-1)", x=parts_total.Result, y=finish_factor)
list_price = Evaluate(E="x*y", x=parts_total.Result, y=finish_factor)
slice_values = Merge(Data1=flatten(lamp_parteur_2), Data2=flatten(finish_premium))
slice_labels = Merge(Data1=flatten(lamp_partnames_2), Data2=flatten(finish_label_2))
unit_price = Evaluate(E="Round(x*(1-y))", x=list_price, y=quantity_break)
price_slices = PieChart(Values=flatten(slice_values), Labels=flatten(slice_labels), Hole=True)
order_total = Evaluate(E="x*y", x=unit_price, y=quantity_2)
layout = Layout(Title="One lamp at list price (EUR)", Width=0, Height=0)
price_chart = Figure(Traces=price_slices, Layout=layout, ExportFormat="png")

# ---- group: Light on the desk / Inputs
target_lx = Panel("""500
500""")
illuminance_color = IlluminanceColor(ColourSwatch(SwatchColor=RGB(232, 160, 60)))
task_target_color = TaskTargetColor(ColourSwatch(SwatchColor=RGB(120, 120, 120)))
target_lx_2 = TargetLx(target_lx)

# ---- group: Light on the desk
# LIGHT ON THE DESK
# A second script follows the beam from the light source to the desk: illuminance along the lamp's centre line, its peak and how much of the desk gets 500 lx. Source: LampLight.script.cs.
lamp_desk_3 = LampDesk(lamp_desk)
lamp_lumens_3 = LampLumens(lamp_lumens)
lamp_beam_2 = LampBeam(lamp_beam)
lamp_spread_2 = LampSpread(lamp_spread)
lamp_cutoff_2 = LampCutoff(lamp_cutoff)
lamp_efficiency_2 = LampEfficiency(lamp_efficiency)
light_on_the_desk = CSharpScript(
    Beam=lamp_beam_2,
    Lumens=lamp_lumens_3,
    Spread=lamp_spread_2,
    Cutoff=lamp_cutoff_2,
    Efficiency=lamp_efficiency_2,
    Desk=lamp_desk_3)  # -> out, LuxX, LuxY, BrightEnough, TaskLight, Peak, LitWidth; inputs Desk: list
# ---------- light_on_the_desk: C# ----------
// Grasshopper Script Instance
using System;
using System.Linq;
using System.Collections.Generic;
using System.Globalization;

using Rhino;
using Rhino.Geometry;

using Grasshopper;
using Grasshopper.Kernel;
using Grasshopper.Kernel.Types;

public class Script_Instance : GH_ScriptInstance
{
    // Illuminance along the desk under the lamp, in millimetres from the base. The shade throws
    // I0·cos^Spread(θ) inside its cut-off cone; I0 makes the light inside the cone add up to Lumens × Efficiency.
    private void RunScript(
        object Beam,
        object Lumens,
        object Spread,
        object Cutoff,
        object Efficiency,
        List<object> Desk,
        ref object LuxX,
        ref object LuxY,
        ref object BrightEnough,
        ref object TaskLight,
        ref object Peak,
        ref object LitWidth)
    {
        var beam = Plane.WorldXY;
        GH_Convert.ToPlane(Beam, ref beam, GH_Conversion.Both);
        double lumens = Num(Lumens, 0), n = Num(Spread, 1.5), cutoff = Num(Cutoff, 60) * Math.PI / 180;
        double i0 = Num(Efficiency, 0.8) * lumens * (n + 1) / (2 * Math.PI * (1 - Math.Pow(Math.Cos(cutoff), n + 1)));

        var desk = BoundingBox.Empty;
        foreach (var o in Desk)
        {
            var m = o as Mesh ?? (o as GH_Mesh)?.Value;
            if (m != null) desk.Union(m.GetBoundingBox(true));
        }

        var xs = new List<double>(); var lux = new List<double>();
        double peak = 0, lit = 0, step = (desk.Max.X - desk.Min.X) / 120;
        for (double px = desk.Min.X; px <= desk.Max.X + 0.01; px += step)
        {
            var toDesk = new Point3d(px, 0, desk.Max.Z) - beam.Origin;
            double d = toDesk.Length / 1000, theta = Vector3d.VectorAngle(beam.ZAxis, toDesk);
            double e = beam.Origin.Z > desk.Max.Z && theta <= cutoff
                ? i0 * Math.Pow(Math.Cos(theta), n) * (-toDesk.Z / toDesk.Length) / (d * d) : 0;
            xs.Add(Math.Round(px)); lux.Add(Math.Round(e));
            peak = Math.Max(peak, e);
            if (e >= 500) lit += step;
        }

        LuxX = xs; LuxY = lux;
        Peak = Math.Round(peak);
        LitWidth = Math.Round(lit);
        TaskLight = lumens == 0 ? "Light off"
            : peak >= 500 ? string.Format(CultureInfo.InvariantCulture, "Meets the 500 lx task target over {0:0} mm of desk", lit)
            : string.Format(CultureInfo.InvariantCulture, "Below the 500 lx task target: {0:0} lx at best", peak);
        BrightEnough = lumens == 0 || peak >= 500;
    }

    static double Num(object o, double fallback) { double v; return o != null && GH_Convert.ToDouble(o, out v, GH_Conversion.Both) ? v : fallback; }
}
# ---------- end light_on_the_desk ----------
bnd = Bounds(Numbers=light_on_the_desk.LuxX)
desk_span = DeconstructDomain(Domain=bnd)  # -> Start, End
target_x = Merge(Data1=desk_span.Start, Data2=desk_span.End)
illuminance = Scatter2D(X=light_on_the_desk.LuxX, Y=light_on_the_desk.LuxY, Name="Illuminance", Mode=1, Color=illuminance_color, Size=8)
task_target = Scatter2D(X=target_x, Y=target_lx_2, Name="500 lx task target", Mode=1, Color=task_target_color, Size=8)
light_traces = Merge(Data1=illuminance, Data2=task_target)
layout_2 = Layout(Title="Light on the desk", XAxis="Distance from the base (mm)", YAxis="Illuminance (lx)", Width=0, Height=0)
light_chart = Figure(Traces=light_traces, Layout=layout_2, ExportFormat="png")

# ---- group: Drawing views
# DRAWING VIEWS
# A third script turns the lamp's meshes into an elevation and a plan: each part's silhouette, the light source as hidden lines, dimensions, and the scale each view needs. Source: LampViews.script.cs.
lamp_body_3 = LampBody(lamp_body)
lamp_light_3 = LampLight(lamp_light)
height_3 = Height(height)
lamp_cable_3 = LampCable(lamp_cable)
reach_3 = Reach(reach)
head_5 = Head(head)
head_size_4 = HeadSize(head_size)
bar_length_4 = BarLength(bar_length)
base_3 = Base(base)
base_size_3 = BaseSize(base_size)
desk_thickness_3 = DeskThickness(desk_thickness)
drawing_views = CSharpScript(
    Body=lamp_body_3,
    Light=lamp_light_3,
    Cable=lamp_cable_3,
    Base=base_3,
    BaseSize=base_size_3,
    DeskThickness=desk_thickness_3,
    Height=height_3,
    Reach=reach_3,
    Head=head_5,
    HeadSize=head_size_4,
    BarLength=bar_length_4)  # -> out, ElevScaleNeed, PlanScaleNeed, ElevSize, PlanSize, ElevLines, ElevHidden, ElevDesk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; inputs Body: list, Light: list, Cable: list
# ---------- drawing_views: C# ----------
// Grasshopper Script Instance
using System;
using System.Linq;
using System.Collections.Generic;
using System.Globalization;

using Rhino;
using Rhino.Geometry;

using Grasshopper;
using Grasshopper.Kernel;
using Grasshopper.Kernel.Types;

public class Script_Instance : GH_ScriptInstance
{
    // The spec sheet's two views, flat on XY in model millimetres: an elevation looking along +Y with Z
    // up, and a plan. Each comes with its dimensions, the scale it needs and its longest side.
    private void RunScript(
        List<object> Body,
        List<object> Light,
        List<object> Cable,
        object Base,
        object BaseSize,
        object DeskThickness,
        object Height,
        object Reach,
        object Head,
        object HeadSize,
        object BarLength,
        ref object ElevScaleNeed,
        ref object PlanScaleNeed,
        ref object ElevSize,
        ref object PlanSize,
        ref object ElevLines,
        ref object ElevHidden,
        ref object ElevDesk,
        ref object ElevDimA,
        ref object ElevDimB,
        ref object ElevDimLabel,
        ref object PlanLines,
        ref object PlanHidden,
        ref object PlanDimA,
        ref object PlanDimB,
        ref object PlanDimLabel)
    {
        string baseType = Txt(Base, "Round"), head = Txt(Head, "Dome");
        double size = Num(BaseSize, 180), deskT = Num(DeskThickness, 30), h = Num(Height, 480), reach = Num(Reach, 360);
        bool clamp = baseType == "Clamp", bar = head == "Linear Bar";
        double footprint = clamp ? 0 : size / 2;
        List<Mesh> body = Meshes(Body), light = Meshes(Light), cable = Meshes(Cable);

        // The elevation stops 50 mm behind the base, so the cable's run across the desk doesn't halve the
        // scale. Break lines mark where the desk is cut.
        double cutX = -footprint - 50, cutY = -deskT - (clamp ? 90 : 1);
        var elevLines = Clip(Outlines(body.Concat(cable), true), cutX, cutY);
        var elevHidden = Clip(Outlines(light, true), cutX, cutY);
        var lampBox = Box(elevLines);
        double deskTo = lampBox.Max.X + 30, deskFrom = clamp ? 0 : cutX;
        var desk = new List<Point3d> { new Point3d(deskTo, 0, 0), new Point3d(deskFrom, 0, 0) };
        if (clamp) desk.Add(new Point3d(0, -deskT, 0)); else desk.AddRange(Break(new Point3d(deskFrom, 0, 0), deskT, -1));
        var rightEnd = Break(new Point3d(deskTo, 0, 0), deskT, 1);
        rightEnd.Reverse();
        desk.AddRange(rightEnd);
        desk.Add(new Point3d(deskTo, 0, 0));
        double top = lampBox.Max.Y;

        var planLines = Outlines(body, false);
        var planBox = Box(planLines);
        var planA = new List<Point3d>(); var planB = new List<Point3d>(); var planLabel = new List<string>();
        if (!clamp)
        {
            planA.Add(new Point3d(-footprint, planBox.Min.Y, 0)); planB.Add(new Point3d(footprint, planBox.Min.Y, 0));
            planLabel.Add(string.Format(Inv, baseType == "Round" ? "Ø{0:0}" : "{0:0}", size));
        }
        double headHalf = bar ? Num(BarLength, 420) / 2 : Num(HeadSize, 170) / 2;
        planA.Add(new Point3d(planBox.Max.X, -headHalf, 0)); planB.Add(new Point3d(planBox.Max.X, headHalf, 0));
        planLabel.Add(string.Format(Inv, bar ? "{0:0}" : "Ø{0:0}", headHalf * 2));

        // An A3 sheet holds the elevation in about 175 x 170 mm and the plan in 155 x 85 mm.
        var elevBox = lampBox;
        foreach (var p in desk) elevBox.Union(p);
        elevBox.Union(new Point3d(cutX, h, 0));
        var planAll = planBox;
        foreach (var p in planA.Concat(planB)) planAll.Union(p);

        ElevLines = elevLines; ElevHidden = elevHidden; ElevDesk = new PolylineCurve(desk);
        ElevDimA = new List<Point3d> { new Point3d(cutX, 0, 0), new Point3d(0, top, 0) };
        ElevDimB = new List<Point3d> { new Point3d(cutX, h, 0), new Point3d(reach, top, 0) };
        ElevDimLabel = new List<string> { string.Format(Inv, "{0:0}", h), string.Format(Inv, "{0:0}", reach) };
        ElevScaleNeed = Math.Max(elevBox.Diagonal.X / 175, elevBox.Diagonal.Y / 170);
        ElevSize = Math.Max(elevBox.Diagonal.X, elevBox.Diagonal.Y);
        PlanLines = planLines; PlanHidden = Outlines(light, false);
        PlanDimA = planA; PlanDimB = planB; PlanDimLabel = planLabel;
        PlanScaleNeed = Math.Max(planAll.Diagonal.X / 155, planAll.Diagonal.Y / 85);
        PlanSize = Math.Max(planAll.Diagonal.X, planAll.Diagonal.Y);
    }

    static readonly CultureInfo Inv = CultureInfo.InvariantCulture;

    static List<Mesh> Meshes(List<object> items)
    {
        return items.Select(o => o as Mesh ?? (o as GH_Mesh)?.Value).Where(m => m != null).ToList();
    }

    // Each part's silhouette, open edges and creases over 30°, flat on XY: an elevation maps (x, z) to
    // (x, y). Mesh.GetOutlines gives one clean union but took seconds on some heads, and
    // Silhouette.Compute missed whole parts; walking the mesh edges is linear and never misses.
    static List<Curve> Outlines(IEnumerable<Mesh> meshes, bool elevation)
    {
        var view = elevation ? Vector3d.YAxis : -Vector3d.ZAxis;
        Func<Point3d, Point3d> flat = p => elevation ? new Point3d(p.X, p.Z, 0) : new Point3d(p.X, p.Y, 0);
        var segments = new List<Curve>();
        foreach (var m in meshes)
        {
            m.FaceNormals.ComputeFaceNormals();
            var edges = m.TopologyEdges;
            for (int e = 0; e < edges.Count; e++)
            {
                var faces = edges.GetConnectedFaces(e);
                bool draw = faces.Length == 1;
                if (faces.Length == 2)
                {
                    Vector3d a = m.FaceNormals[faces[0]], b = m.FaceNormals[faces[1]];
                    draw = (a * view) * (b * view) < 0 || Vector3d.VectorAngle(a, b) > Math.PI / 6;
                }
                if (!draw) continue;
                var line = edges.EdgeLine(e);
                var from = flat(line.From); var to = flat(line.To);
                if (from.DistanceTo(to) > 0.01) segments.Add(new LineCurve(from, to));
            }
        }
        var joined = new List<Curve>();
        foreach (var c in Curve.JoinCurves(segments, 0.01))
        {
            Polyline pl;
            if (c.TryGetPolyline(out pl)) joined.Add(new PolylineCurve(pl));
        }
        return joined;
    }

    // The runs of each polyline with x >= x0 and y >= y0.
    static List<Curve> Clip(IEnumerable<Curve> curves, double x0, double y0)
    {
        Func<Point3d, bool> inside = p => p.X >= x0 && p.Y >= y0;
        var kept = new List<Curve>();
        foreach (var c in curves)
        {
            Polyline pl;
            if (!c.TryGetPolyline(out pl)) continue;
            var run = new List<Point3d>();
            for (int i = 0; i < pl.Count; i++)
            {
                if (i > 0 && inside(pl[i]) != inside(pl[i - 1])) run.Add(Crossing(pl[i - 1], pl[i], x0, y0));
                if (inside(pl[i])) { run.Add(pl[i]); continue; }
                if (run.Count > 1) kept.Add(new PolylineCurve(run));
                run = new List<Point3d>();
            }
            if (run.Count > 1) kept.Add(new PolylineCurve(run));
        }
        return kept;
    }

    // Where segment a-b crosses the edge of the region x >= x0, y >= y0.
    static Point3d Crossing(Point3d a, Point3d b, double x0, double y0)
    {
        foreach (var t in new[] { (x0 - a.X) / (b.X - a.X), (y0 - a.Y) / (b.Y - a.Y) })
        {
            if (double.IsNaN(t) || double.IsInfinity(t) || t < 0 || t > 1) continue;
            var p = a + (b - a) * t;
            if (p.X >= x0 - 1e-6 && p.Y >= y0 - 1e-6) return p;
        }
        return a;
    }

    // A break line down through a slab of depth d at x: a zigzag bulging towards side (-1 left, +1 right).
    static List<Point3d> Break(Point3d top, double d, int side)
    {
        double w = 4 * side;
        return new List<Point3d>
        {
            new Point3d(top.X + w, top.Y - d * 0.4, 0), new Point3d(top.X - w, top.Y - d * 0.6, 0), new Point3d(top.X, top.Y - d, 0)
        };
    }

    static BoundingBox Box(List<Curve> curves)
    {
        var box = BoundingBox.Empty;
        foreach (var c in curves) box.Union(c.GetBoundingBox(true));
        return box;
    }

    static string Txt(object o, string fallback) { return o == null || o.ToString().Trim('"') == "" ? fallback : o.ToString().Trim('"'); }
    static double Num(object o, double fallback) { double v; return o != null && GH_Convert.ToDouble(o, out v, GH_Conversion.Both) ? v : fallback; }
}
# ---------- end drawing_views ----------

# ---- group: Drawing views / Outputs
drawing_views_planscaleneed = DrawingViewsPlanScaleNeed(drawing_views.PlanScaleNeed)
drawing_views_elevscaleneed = DrawingViewsElevScaleNeed(drawing_views.ElevScaleNeed)
drawing_views_plandimlabel = DrawingViewsPlanDimLabel(drawing_views.PlanDimLabel)
drawing_views_elevdimlabel = DrawingViewsElevDimLabel(drawing_views.ElevDimLabel)
drawing_views_planhidden = DrawingViewsPlanHidden(drawing_views.PlanHidden)
drawing_views_elevhidden = DrawingViewsElevHidden(drawing_views.ElevHidden)
drawing_views_plandima = DrawingViewsPlanDimA(drawing_views.PlanDimA)
drawing_views_elevdima = DrawingViewsElevDimA(drawing_views.ElevDimA)
drawing_views_plandimb = DrawingViewsPlanDimB(drawing_views.PlanDimB)
drawing_views_elevdimb = DrawingViewsElevDimB(drawing_views.ElevDimB)
drawing_views_planlines = DrawingViewsPlanLines(drawing_views.PlanLines)
drawing_views_elevlines = DrawingViewsElevLines(drawing_views.ElevLines)
drawing_views_elevdesk = DrawingViewsElevDesk(drawing_views.ElevDesk)
drawing_views_plansize = DrawingViewsPlanSize(drawing_views.PlanSize)
drawing_views_elevsize = DrawingViewsElevSize(drawing_views.ElevSize)

# ---- group: 3D view / Outputs
c_bake_3 = ContextBake(Lamp=lamp_2)
lamp_3 = Lamp(lamp_2)

# ---- group: Light on the desk / Outputs
light_on_the_desk_brightenough = LightOnTheDeskBrightEnough(light_on_the_desk.BrightEnough)
light_on_the_desk_tasklight = LightOnTheDeskTaskLight(light_on_the_desk.TaskLight)
light_on_the_desk_litwidth = LightOnTheDeskLitWidth(light_on_the_desk.LitWidth)
light_on_the_desk_peak = LightOnTheDeskPeak(light_on_the_desk.Peak)
c_bake_4 = ContextBake(LightOnTheDesk=light_chart)

# ---- group: Price / Outputs
c_bake_5 = ContextBake(PriceBreakdown=price_chart)
finish_premium_2 = FinishPremium(finish_premium)
quantity_break_2 = QuantityBreak(quantity_break)
order_total_2 = OrderTotal(order_total)
unit_price_2 = UnitPrice(unit_price)
list_price_2 = ListPrice(list_price)

# ---- group: Downloads / Inputs
csv_header = Panel("Part,Description,Qty,Unit price (EUR),Line total (EUR)")
csv_header_2 = CSVHeader(csv_header)

# ---- group: Downloads
# DOWNLOADS
# The model takes its layers and colours from the 3D view through Deconstruct Display, but the script's own meshes: the view's come back triangulated and write four times slower. The parts list is priced for the order.
finish_name_3 = FinishName(finish_name_2)
quantity_3 = Quantity(quantity)
lamp_4 = Lamp(lamp_3)
lamp_body_4 = LampBody(lamp_body)
lamp_trim_3 = LampTrim(lamp_trim)
lamp_inner_3 = LampInner(lamp_inner)
lamp_glass_3 = LampGlass(lamp_glass)
lamp_light_4 = LampLight(lamp_light)
lamp_cable_4 = LampCable(lamp_cable)
lamp_desk_4 = LampDesk(lamp_desk)
lamp_props_3 = LampProps(lamp_props)
lamp_partnames_3 = LampPartNames(lamp_partnames)
lamp_partnotes_2 = LampPartNotes(lamp_partnotes)
lamp_parteur_3 = LampPartEur(lamp_parteur)
finish_premium_3 = FinishPremium(finish_premium_2)
quantity_break_3 = QuantityBreak(quantity_break_2)
unit_price_3 = UnitPrice(unit_price_2)
order_total_3 = OrderTotal(order_total_2)
lamp_parts = Merge(
    Data1=flatten(lamp_body_4),
    Data2=flatten(lamp_trim_3),
    Data3=flatten(lamp_inner_3),
    Data4=flatten(lamp_glass_3),
    Data5=flatten(lamp_light_4),
    Data6=flatten(lamp_cable_4),
    Data7=flatten(lamp_desk_4),
    Data8=flatten(lamp_props_3))
model_parts = DeconstructDisplay(WebDisplay=lamp_4)  # -> Meshes, Names, Layers, Colors
model = GeometryToFile(
    Geometry=flatten(lamp_parts),
    LayerNames=flatten(model_parts.Layers),
    LayerColors=flatten(model_parts.Colors),
    FileNames="studio-task-lamp",
    FileEnding=".3dm")
net_part_price = Evaluate(E="x*(1-y)", x=lamp_parteur_3, y=quantity_break_3)
net_finish_premium = Evaluate(E="x*(1-y)", x=finish_premium_3, y=quantity_break_3)
net_line_total = Evaluate(E="x*y", x=net_part_price, y=quantity_3)
net_finish_total = Evaluate(E="x*y", x=net_finish_premium, y=quantity_3)
part_rows = Format(
    Format="{0},\"{1}\",{2},{3:0.00},{4:0.00}",
    Culture=127,
    Data0=lamp_partnames_3,
    Data1=lamp_partnotes_2,
    Data2=quantity_3,
    Data3=net_part_price,
    Data4=net_line_total)
closing_rows = Format(
    Format="""Finish,"{0}",{1},{2:0.00},{3:0.00}
Total,,{1},{4:0.00},{5:0.00}""",
    Culture=127,
    Data0=finish_name_3,
    Data1=quantity_3,
    Data2=net_finish_premium,
    Data3=net_finish_total,
    Data4=unit_price_3,
    Data5=order_total_3)
csv_lines = Merge(Data1=flatten(csv_header_2), Data2=flatten(part_rows), Data3=flatten(closing_rows))
parts_list = CreateFile(Data=csv_lines, Name="studio-task-lamp-parts", Extension=".csv", IsBase64=False)

# ---- group: Results
# RESULTS
# One Context Print per value. The labels are what the page shows.
finish_name_4 = FinishName(finish_name_2)
arm_3 = Arm(arm)
lamp_powerw_2 = LampPowerW(lamp_powerw)
lamp_stability_2 = LampStability(lamp_stability)
lamp_weightkg_2 = LampWeightKg(lamp_weightkg)
head_6 = Head(head)
base_4 = Base(base)
unit_price_4 = UnitPrice(unit_price_2)
order_total_4 = OrderTotal(order_total_2)
light_on_the_desk_tasklight_2 = LightOnTheDeskTaskLight(light_on_the_desk_tasklight)
light_on_the_desk_peak_2 = LightOnTheDeskPeak(light_on_the_desk_peak)
light_on_the_desk_litwidth_2 = LightOnTheDeskLitWidth(light_on_the_desk_litwidth)
base_name = Text(base_4)
arm_name = Text(arm_3)
head_name = Text(head_6)
configuration = Format(
    Format="{0} base, {1} arm, {2} head, {3}",
    Culture=127,
    Data0=base_name,
    Data1=arm_name,
    Data2=head_name,
    Data3=finish_name_4)

# ---- group: Checks
# CHECKS
# Message components report in the page: a warning when the lamp tips over, remarks when a bare bulb will glare or the desk gets under 500 lx.
lamp_steady_2 = LampSteady(lamp_steady)
lamp_glarefree_2 = LampGlareFree(lamp_glarefree)
light_on_the_desk_brightenough_2 = LightOnTheDeskBrightEnough(light_on_the_desk_brightenough)

# ---- group: Sheet scale and styles / Inputs
desk_section_fill_color = DeskSectionFillColor(ColourSwatch(SwatchColor=RGB(232, 222, 204)))
hidden_stroke_color = HiddenStrokeColor(ColourSwatch(SwatchColor=RGB(110, 110, 110)))

# ---- group: Sheet scale and styles
# SHEET SCALE
# Each view takes the next of 1:5, 1:10 and 1:20 that fits. The title block says 'As shown' when they differ.
drawing_views_elevscaleneed_2 = DrawingViewsElevScaleNeed(drawing_views_elevscaleneed)
drawing_views_elevsize_2 = DrawingViewsElevSize(drawing_views_elevsize)
drawing_views_planscaleneed_2 = DrawingViewsPlanScaleNeed(drawing_views_planscaleneed)
drawing_views_plansize_2 = DrawingViewsPlanSize(drawing_views_plansize)
visible = PathStyle(StrokeWidth=0.25)
view_title = TextStyle(FontSize=4, Weight=1)
table_text = TextStyle(FontSize=3)
hidden = PathStyle(StrokeColor=hidden_stroke_color, StrokeWidth=0.13, DashPattern=[1.5, 0.8])
desk_section = PathStyle(StrokeWidth=0.35, FillColor=desk_section_fill_color, Fill=True)
scale_1 = Evaluate(E="if(x<=5,5,if(x<=10,10,20))", x=drawing_views_elevscaleneed_2)
scale_1_2 = Evaluate(E="if(x<=5,5,if(x<=10,10,20))", x=drawing_views_planscaleneed_2)
elevation_length_mm = Evaluate(E="x/y", x=drawing_views_elevsize_2, y=scale_1)
same_scale = Equality(FirstNumber=scale_1, SecondNumber=scale_1_2)  # -> Equality, Inequality
plan_scale = Format(Format="1:{0}", Culture=127, Data0=scale_1_2)
plan_length_mm = Evaluate(E="x/y", x=drawing_views_plansize_2, y=scale_1_2)
elevation_scale = Format(Format="1:{0}", Culture=127, Data0=scale_1)
sheet_scale = StreamFilter(Gate=same_scale.Equality, Stream0="As shown", Stream1=elevation_scale)

# ---- group: Checks / Outputs
tips_over = Message(
    Condition=lamp_steady_2,
    Message="The lamp tips over: widen the base, weight it, or shorten the reach.",
    Level=1,
    Notify=1)
glare = Message(
    Condition=lamp_glarefree_2,
    Message="The bare bulb stands out of the shade and will glare: add the diffuser, or pick a shorter light source.",
    Level=0,
    Notify=1)
dim_desk = Message(
    Condition=light_on_the_desk_brightenough_2,
    Message="Under 500 lx on the desk: pick a brighter light source, or lower the head.",
    Level=0,
    Notify=1)

# ---- group: Results / Outputs
c_print = ContextPrint(PeakIlluminanceLx=light_on_the_desk_peak_2)
c_print_2 = ContextPrint(WellLitWidthMm=light_on_the_desk_litwidth_2)
c_print_3 = ContextPrint(OrderTotalEUR=order_total_4)
c_print_4 = ContextPrint(UnitPriceEUR=unit_price_4)
c_print_5 = ContextPrint(Configuration=configuration)
c_print_6 = ContextPrint(WeightKg=lamp_weightkg_2)
c_print_7 = ContextPrint(PowerW=lamp_powerw_2)
c_print_8 = ContextPrint(TaskLight=light_on_the_desk_tasklight_2)
configuration_2 = Configuration(configuration)
c_print_9 = ContextPrint(Stability=lamp_stability_2)

# ---- group: Sheet scale and styles / Outputs
elevation_length_mm_2 = ElevationLengthMm(elevation_length_mm)
plan_length_mm_2 = PlanLengthMm(plan_length_mm)
elevation_scale_2 = ElevationScale(elevation_scale)
desk_section_2 = DeskSection(desk_section)
sheet_scale_2 = SheetScale(sheet_scale)
table_text_2 = TableText(table_text)
plan_scale_2 = PlanScale(plan_scale)
view_title_2 = ViewTitle(view_title)
visible_2 = Visible(visible)
hidden_2 = Hidden(hidden)

# ---- group: Downloads / Outputs
c_bake_6 = ContextBake(PartsListCSV=parts_list)
c_bake_7 = ContextBake(Model3DM=model)

# ---- group: Sheet 2
# SHEET 2: PARTS AND PRICE
# One row per part from the script, then the finish, list price, quantity break and totals, under a slim continuation title strip.
finish_name_5 = FinishName(finish_name_2)
finish_premium_4 = FinishPremium(finish_premium_2)
quantity_break_4 = QuantityBreak(quantity_break_2)
list_price_3 = ListPrice(list_price_2)
quantity_4 = Quantity(quantity)
unit_price_5 = UnitPrice(unit_price_2)
order_total_5 = OrderTotal(order_total_2)
view_title_3 = ViewTitle(view_title_2)
lamp_partnames_4 = LampPartNames(lamp_partnames)
lamp_partnotes_3 = LampPartNotes(lamp_partnotes)
lamp_parteur_4 = LampPartEur(lamp_parteur)
project_2 = Project(project)
table_text_3 = TableText(table_text_2)
break = Evaluate(E="x*100", x=quantity_break_4)
break_eur = Evaluate(E="x*y", x=list_price_3, y=quantity_break_4)
total_lines = Format(
    Format="""Finish;{0};{1:0.00}
List price;One lamp;{2:0.00}
Quantity break;{3:0}% at {4} pcs;-{5:0.00}
Unit price;Rounded to the euro;{6:0.00}
Order total;{4} x unit price;{7:#,0.00}""",
    Culture=127,
    Data0=finish_name_5,
    Data1=finish_premium_4,
    Data2=list_price_3,
    Data3=break,
    Data4=quantity_4,
    Data5=break_eur,
    Data6=unit_price_5,
    Data7=order_total_5)
part_lines = Format(Format="{0};{1};{2:0.00}", Culture=127, Data0=lamp_partnames_4, Data1=lamp_partnotes_3, Data2=lamp_parteur_4)
parts_text = Merge(Data1=flatten(part_lines), Data2=flatten(total_lines))
parts_lines = TextSplit(Text=flatten(parts_text))
parts_cells = TextSplit(Text=flatten(parts_lines), Separators=";")
title_strip = TitleBlock(
    Variant=1,
    Project=project_2,
    Title="Studio task lamp: parts and price",
    DrawingNo="STL-101",
    Revision="A",
    Scale="-",
    Sheet="{page}/{pages}",
    Date="{date:dd.MM.yyyy}",
    Width=170)
parts_and_price_anchor = ConstructPoint(XCoordinate=0, YCoordinate=0, ZCoordinate=0)
parts_table = Table(
    Headers=["Part", "Description", "EUR"],
    Rows=parts_cells,
    ColumnWidths=[44, 150, 30],
    DefaultStyle=table_text_3,
    ColumnAlign=["l", "l", "r"],
    BorderStyle=1)
sheet_2_footer_parts = Merge(Data1=flatten(title_strip))
parts_and_price = DrawText(Text="PARTS AND PRICE", Position=parts_and_price_anchor, Style=view_title_3, Rotation=0, Padding=1, Radius=0)
sheet_2_parts = Merge(Data1=flatten(parts_and_price), Data2=flatten(parts_table))
sheet_2_footer = Stack(Drawings=sheet_2_footer_parts, Orientation=1, Spacing=12, CrossAlign=2)
sheet_2_body = Stack(Drawings=sheet_2_parts, Orientation=0, Spacing=4, CrossAlign=0)
sheet_2_footer_override = LayoutOverride(Footer=sheet_2_footer, FooterAlign=2, FooterPlacement=1, Units=1)
sheet_2 = Page(
    Drawings=sheet_2_body,
    Title="Parts and price",
    Override=sheet_2_footer_override,
    KeepTogether=True,
    Arrange=0,
    Spacing=5)

# ---- group: Elevation
# ELEVATION
# The parts, the light source dashed inside the shade, the desk in section with break lines, height and reach.
drawing_views_elevdesk_2 = DrawingViewsElevDesk(drawing_views_elevdesk)
desk_section_3 = DeskSection(desk_section_2)
drawing_views_elevlines_2 = DrawingViewsElevLines(drawing_views_elevlines)
visible_3 = Visible(visible_2)
drawing_views_elevdima_2 = DrawingViewsElevDimA(drawing_views_elevdima)
drawing_views_elevdimb_2 = DrawingViewsElevDimB(drawing_views_elevdimb)
drawing_views_elevdimlabel_2 = DrawingViewsElevDimLabel(drawing_views_elevdimlabel)
drawing_views_elevhidden_2 = DrawingViewsElevHidden(drawing_views_elevhidden)
hidden_3 = Hidden(hidden_2)
elevation_length_mm_3 = ElevationLengthMm(elevation_length_mm_2)
elevation_dimensions = LinearDimension(
    PointA=drawing_views_elevdima_2,
    PointB=drawing_views_elevdimb_2,
    Offset=8,
    Label=drawing_views_elevdimlabel_2,
    TextSize=3)
draw_desk = DrawCurve(Curve=drawing_views_elevdesk_2, Style=desk_section_3)
draw_elevation = DrawCurve(Curve=drawing_views_elevlines_2, Style=visible_3)
draw_elevation_hidden = DrawCurve(Curve=drawing_views_elevhidden_2, Style=hidden_3)
elevation_view_drawings = Merge(Data1=draw_desk, Data2=draw_elevation, Data3=draw_elevation_hidden, Data4=elevation_dimensions)
elevation_view = DrawingView(Drawings=flatten(elevation_view_drawings), Length=elevation_length_mm_3, Padding=4, ScaleCaption=False, Units=1)  # -> Drawings, Scale

# ---- group: Plan
# PLAN
# The lamp from above, the light source dashed under the shade, with the base and head sizes.
drawing_views_planlines_2 = DrawingViewsPlanLines(drawing_views_planlines)
visible_4 = Visible(visible_2)
drawing_views_plandima_2 = DrawingViewsPlanDimA(drawing_views_plandima)
drawing_views_plandimb_2 = DrawingViewsPlanDimB(drawing_views_plandimb)
drawing_views_plandimlabel_2 = DrawingViewsPlanDimLabel(drawing_views_plandimlabel)
drawing_views_planhidden_2 = DrawingViewsPlanHidden(drawing_views_planhidden)
hidden_4 = Hidden(hidden_2)
plan_length_mm_3 = PlanLengthMm(plan_length_mm_2)
plan_dimensions = LinearDimension(
    PointA=drawing_views_plandima_2,
    PointB=drawing_views_plandimb_2,
    Offset=-8,
    Label=drawing_views_plandimlabel_2,
    TextSize=3)
draw_plan = DrawCurve(Curve=drawing_views_planlines_2, Style=visible_4)
draw_plan_hidden = DrawCurve(Curve=drawing_views_planhidden_2, Style=hidden_4)
plan_view_drawings = Merge(Data1=draw_plan, Data2=draw_plan_hidden, Data3=plan_dimensions)
plan_view = DrawingView(Drawings=flatten(plan_view_drawings), Length=plan_length_mm_3, Padding=4, ScaleCaption=False, Units=1)  # -> Drawings, Scale

# ---- group: Elevation / Outputs
elevation_view_drawings_2 = ElevationViewDrawings(elevation_view.Drawings)

# ---- group: Plan / Outputs
plan_view_drawings_2 = PlanViewDrawings(plan_view.Drawings)

# ---- group: Sheet 2 / Outputs
sheet_2_2 = Sheet2(sheet_2)

# ---- group: Sheet 1 / Inputs
notes_text = Panel("""NOTES
1. Dimensions in millimetres, from the desk top.
2. Light figures model the shade as a cosine beam inside its cut-off: a guide, not a photometric test.
3. Drawn by Selva from the model: change an input and the sheet redraws.""")
notes_text_2 = NotesText(notes_text)

# ---- group: Sheet 1
# SHEET 1
# Elevation left, plan and specification right, notes and title block in the footer. The table's rows are one Format, split into lines and then at each ';' into cells.
finish_index_4 = FinishIndex(finish_index_2)
colour_temperature_3 = ColourTemperature(colour_temperature)
finish_name_6 = FinishName(finish_name_2)
body_colour_name_3 = BodyColourName(body_colour_name_2)
project_3 = Project(project)
quantity_5 = Quantity(quantity)
lamp_sourcename_2 = LampSourceName(lamp_sourcename)
lamp_powerw_3 = LampPowerW(lamp_powerw)
lamp_stability_3 = LampStability(lamp_stability)
lamp_weightkg_3 = LampWeightKg(lamp_weightkg)
configuration_3 = Configuration(configuration_2)
quantity_break_5 = QuantityBreak(quantity_break_2)
unit_price_6 = UnitPrice(unit_price_2)
order_total_6 = OrderTotal(order_total_2)
elevation_scale_3 = ElevationScale(elevation_scale_2)
light_on_the_desk_peak_3 = LightOnTheDeskPeak(light_on_the_desk_peak)
light_on_the_desk_litwidth_3 = LightOnTheDeskLitWidth(light_on_the_desk_litwidth)
plan_scale_3 = PlanScale(plan_scale_2)
view_title_4 = ViewTitle(view_title_2)
table_text_4 = TableText(table_text_2)
sheet_scale_3 = SheetScale(sheet_scale_2)
elevation_view_drawings_3 = ElevationViewDrawings(elevation_view_drawings_2)
plan_view_drawings_3 = PlanViewDrawings(plan_view_drawings_2)
powder_coat = Equality(FirstNumber=finish_index_4, SecondNumber=0)  # -> Equality, Inequality
paint_text = Format(Format="Powder coat, {0}", Culture=127, Data0=body_colour_name_3)
finish_text = StreamFilter(Gate=powder_coat.Equality, Stream0=finish_name_6, Stream1=paint_text)
break_2 = Evaluate(E="x*100", x=quantity_break_5)
specification_text = Format(
    Format="""Configuration;{0}
Finish;{1}
Light source;{2}
Power;{3} W
Colour temperature;{4} K
Light on the desk;{5:#,0} lx peak, 500 lx over {6:0} mm
Stability;{7}
Weight;{8:0.00} kg
Unit price;EUR {9:#,0}, quantity break {12:0}%
Order;{10} x EUR {9:#,0} = EUR {11:#,0}""",
    Culture=127,
    Data0=configuration_3,
    Data1=finish_text,
    Data2=lamp_sourcename_2,
    Data3=lamp_powerw_3,
    Data4=colour_temperature_3,
    Data5=light_on_the_desk_peak_3,
    Data6=light_on_the_desk_litwidth_3,
    Data7=lamp_stability_3,
    Data8=lamp_weightkg_3,
    Data9=unit_price_6,
    Data10=quantity_5,
    Data11=order_total_6,
    Data12=break_2)
specification_text_2 = Merge(Data1=flatten(specification_text))
specification_lines = TextSplit(Text=flatten(specification_text_2))
specification_cells = TextSplit(Text=flatten(specification_lines), Separators=";")
specification_anchor = ConstructPoint(XCoordinate=0, YCoordinate=0, ZCoordinate=0)
elevation_anchor = ConstructPoint(XCoordinate=0, YCoordinate=0, ZCoordinate=0)
plan_anchor = ConstructPoint(XCoordinate=0, YCoordinate=0, ZCoordinate=0)
elevation_text = Format(Format="ELEVATION   {0}", Culture=127, Data0=elevation_scale_3)
plan_text = Format(Format="PLAN   {0}", Culture=127, Data0=plan_scale_3)
elevation = DrawText(Text=elevation_text, Position=elevation_anchor, Style=view_title_4, Rotation=0, Padding=1, Radius=0)
specification = Table(Rows=specification_cells, ColumnWidths=[44, 136], DefaultStyle=table_text_4, ColumnAlign=["l", "l"], BorderStyle=1)
plan = DrawText(Text=plan_text, Position=plan_anchor, Style=view_title_4, Rotation=0, Padding=1, Radius=0)
specification_2 = DrawText(Text="SPECIFICATION", Position=specification_anchor, Style=view_title_4, Rotation=0, Padding=1, Radius=0)
left_column = Merge(Data1=flatten(elevation_view_drawings_3), Data2=flatten(elevation))
right_column = Merge(Data1=flatten(plan_view_drawings_3), Data2=flatten(plan), Data3=flatten(specification_2), Data4=flatten(specification))
title_block = TitleBlock(
    Project=project_3,
    Owner="Selva showcase",
    Title="Studio task lamp: specification",
    DrawingNo="STL-100",
    Revision="A",
    Scale=sheet_scale_3,
    Sheet="{page}/{pages}",
    CreatedBy="Selva",
    Date="{date:dd.MM.yyyy}",
    Width=170)
notes = TextFlow(Text=notes_text_2, Width=170, Style=table_text_4)
left_column_2 = Stack(Drawings=left_column, Orientation=0, Spacing=4, CrossAlign=0)
right_column_2 = Stack(Drawings=right_column, Orientation=0, Spacing=4, CrossAlign=0)
sheet_footer_parts = Merge(Data1=flatten(notes), Data2=flatten(title_block))
columns = Merge(Data1=flatten(left_column_2), Data2=flatten(right_column_2))
sheet_footer = Stack(Drawings=sheet_footer_parts, Orientation=1, Spacing=12, CrossAlign=2)
sheet_body = Stack(Drawings=columns, Orientation=1, Spacing=16, CrossAlign=0)
sheet_footer_override = LayoutOverride(Footer=sheet_footer, FooterAlign=2, FooterPlacement=1, Units=1)
sheet_1 = Page(Drawings=sheet_body, Title="Specification", Override=sheet_footer_override, KeepTogether=True, Arrange=0, Spacing=5)

# ---- group: Sheet 1 / Outputs
sheet_1_2 = Sheet1(sheet_1)

# ---- group: Document
# DOCUMENT
# Both sheets on A3 landscape with 12 mm margins, rendered to one PDF.
sheet_1_3 = Sheet1(sheet_1_2)
sheet_2_3 = Sheet2(sheet_2_2)
pages = Merge(Data1=sheet_1_3, Data2=sheet_2_3)
a3_landscape = LayoutOverride(PaperSize=3, Landscape=True, Margin=12, Units=1)
spec_sheet = Document(Pages=pages, Title="Studio task lamp", Author="Selva", Override=a3_landscape, Culture="en-US")
pdf = RenderPDF(Document=spec_sheet, Name="studio-task-lamp-spec", AutoFit=False)

# ---- group: Document / Outputs
c_bake_8 = ContextBake(SpecSheetPDF=pdf)
