# Grasshopper definition studio_task_lamp.gh (Grasshopper 1.0.9)
# plug-ins: Selva

base = ValueList({"Round", "Square", "Clamp"}, selected="Round")
base_size = Slider(190, range=120..280)
desk_thickness = Slider(30, range=15..60)
weighted_base = BooleanToggle(False)
arm = ValueList({"Straight", "Two-Joint", "Arc"}, selected="Two-Joint")
height = Slider(500, range=300..700)
reach = Slider(340, range=150..600)
elbow = Slider(45, range=20..80)
head_tilt = Slider(22, range=0..60)
head = ValueList({"Dome", "Cone", "Cylinder", "Linear Bar"}, selected="Dome")
head_size = Slider(180, range=90..260)
bar_length = Slider(420, range=200..700)
finish = ValueList({"Powder Coat", "Anodised", "Brass", "Chrome"}, selected="Powder Coat")
body_colour = ValueList({"Forest", "Oxide", "Cream", "Graphite", "Ocean"}, selected="Forest")
inner_colour = ValueList({"White", "Cream", "Gold"}, selected="Cream")
diffuser = BooleanToggle(True)
cable = BooleanToggle(True)
cable_colour = ValueList({"Black", "Copper", "White"}, selected="Copper")
light_on = BooleanToggle(True)
colour_temperature = Slider(2700, range=2200..6500)
luminous_flux = Slider(800, range=100..2000)
ui_bridge = UIBridge(
    Enable=Toggle(False),
    Schema="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",
    SelvaLinks="[{\"origin\":\"https://selvajs.com\",\"definitionGuid\":\"1e703d3c-f131-402b-ae10-0d47346ef87c\",\"versionId\":\"eac58943-3a88-481b-920f-cd6b2ea53320\",\"versionNumber\":2}]",
    Values="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")  # -> Schema, URL
c_bake = ContextBake(Content=ui_bridge.Schema)
base_2 = GetValueList(
    base,
    AtLeast=1,
    AtMost=1,
    Immediate=True,
    ListAccess=False,
    StoredItems="""[
  {
    "name": "Round",
    "expression": "Round"
  },
  {
    "name": "Square",
    "expression": "Square"
  },
  {
    "name": "Clamp",
    "expression": "Clamp"
  }
]""",
    TreeAccess=False)
base_size_2 = GetNumber(base_size, AtLeast=1, AtMost=1, Maximum=1.797693135e+308, Minimum=-1.797693135e+308, TreeAccess=False)
desk_thickness_2 = GetNumber(desk_thickness, AtLeast=1, AtMost=1, Maximum=1.797693135e+308, Minimum=-1.797693135e+308, TreeAccess=False)
weighted_base_2 = GetBoolean(weighted_base, AtLeast=1, AtMost=1, FalseValue="False", TreeAccess=False, TrueValue="True")
arm_2 = GetValueList(
    arm,
    AtLeast=1,
    AtMost=1,
    Immediate=True,
    ListAccess=False,
    StoredItems="""[
  {
    "name": "Straight",
    "expression": "Straight"
  },
  {
    "name": "Two-Joint",
    "expression": "Two-Joint"
  },
  {
    "name": "Arc",
    "expression": "Arc"
  }
]""",
    TreeAccess=False)
height_2 = GetNumber(height, AtLeast=1, AtMost=1, Maximum=1.797693135e+308, Minimum=-1.797693135e+308, TreeAccess=False)
reach_2 = GetNumber(reach, AtLeast=1, AtMost=1, Maximum=1.797693135e+308, Minimum=-1.797693135e+308, TreeAccess=False)
elbow_2 = GetNumber(elbow, AtLeast=1, AtMost=1, Maximum=1.797693135e+308, Minimum=-1.797693135e+308, TreeAccess=False)
head_tilt_2 = GetNumber(head_tilt, AtLeast=1, AtMost=1, Maximum=1.797693135e+308, Minimum=-1.797693135e+308, TreeAccess=False)
head_2 = GetValueList(
    head,
    AtLeast=1,
    AtMost=1,
    Immediate=True,
    ListAccess=False,
    StoredItems="""[
  {
    "name": "Dome",
    "expression": "Dome"
  },
  {
    "name": "Cone",
    "expression": "Cone"
  },
  {
    "name": "Cylinder",
    "expression": "Cylinder"
  },
  {
    "name": "Linear Bar",
    "expression": "Linear Bar"
  }
]""",
    TreeAccess=False)
head_size_2 = GetNumber(head_size, AtLeast=1, AtMost=1, Maximum=1.797693135e+308, Minimum=-1.797693135e+308, TreeAccess=False)
bar_length_2 = GetNumber(bar_length, AtLeast=1, AtMost=1, Maximum=1.797693135e+308, Minimum=-1.797693135e+308, TreeAccess=False)
finish_2 = GetValueList(
    finish,
    AtLeast=1,
    AtMost=1,
    Immediate=True,
    ListAccess=False,
    StoredItems="""[
  {
    "name": "Powder Coat",
    "expression": "Powder Coat"
  },
  {
    "name": "Anodised",
    "expression": "Anodised"
  },
  {
    "name": "Brass",
    "expression": "Brass"
  },
  {
    "name": "Chrome",
    "expression": "Chrome"
  }
]""",
    TreeAccess=False)
body_colour_2 = GetValueList(
    body_colour,
    AtLeast=1,
    AtMost=1,
    Immediate=True,
    ListAccess=False,
    StoredItems="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",
    TreeAccess=False)
inner_colour_2 = GetValueList(
    inner_colour,
    AtLeast=1,
    AtMost=1,
    Immediate=True,
    ListAccess=False,
    StoredItems="""[
  {
    "name": "White",
    "expression": "White"
  },
  {
    "name": "Cream",
    "expression": "Cream"
  },
  {
    "name": "Gold",
    "expression": "Gold"
  }
]""",
    TreeAccess=False)
diffuser_2 = GetBoolean(diffuser, AtLeast=1, AtMost=1, FalseValue="False", TreeAccess=False, TrueValue="True")
cable_2 = GetBoolean(cable, AtLeast=1, AtMost=1, FalseValue="False", TreeAccess=False, TrueValue="True")
cable_colour_2 = GetValueList(
    cable_colour,
    AtLeast=1,
    AtMost=1,
    Immediate=True,
    ListAccess=False,
    StoredItems="""[
  {
    "name": "Black",
    "expression": "Black"
  },
  {
    "name": "Copper",
    "expression": "Copper"
  },
  {
    "name": "White",
    "expression": "White"
  }
]""",
    TreeAccess=False)
light_on_2 = GetBoolean(light_on, AtLeast=1, AtMost=1, FalseValue="False", TreeAccess=False, TrueValue="True")
colour_temperature_2 = GetNumber(colour_temperature, AtLeast=1, AtMost=1, Maximum=1.797693135e+308, Minimum=-1.797693135e+308, TreeAccess=False)
luminous_flux_2 = GetNumber(luminous_flux, AtLeast=1, AtMost=1, Maximum=1.797693135e+308, Minimum=-1.797693135e+308, TreeAccess=False)
c_script = CSharpScript(
    Base=base_2,
    BaseSize=base_size_2,
    DeskThickness=desk_thickness_2,
    Weighted=weighted_base_2,
    Arm=arm_2,
    Height=height_2,
    Reach=reach_2,
    Elbow=elbow_2,
    Tilt=head_tilt_2,
    Head=head_2,
    HeadSize=head_size_2,
    BarLength=bar_length_2,
    Finish=finish_2,
    BodyColour=body_colour_2,
    InnerColour=inner_colour_2,
    Diffuser=diffuser_2,
    CableOn=cable_2,
    CableColour=cable_colour_2,
    LightOn=light_on_2,
    Kelvin=colour_temperature_2,
    Lumens=luminous_flux_2)  # -> out, Body, Inner, Glass, Light, Cable, Desk, BodyCol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
# ---------- c_script: C# ----------
// Grasshopper Script Instance
using System;
using System.Linq;
using System.Collections;
using System.Collections.Generic;
using System.Drawing;

using Rhino;
using Rhino.Geometry;

using Grasshopper;
using Grasshopper.Kernel;
using Grasshopper.Kernel.Data;
using Grasshopper.Kernel.Types;

public class Script_Instance : GH_ScriptInstance
{
    // A desk lamp in millimetres, base on the desk at the origin, reaching along +X.
    private void RunScript(
		object Base, object BaseSize, object DeskThickness, object Weighted,
		object Arm, object Height, object Reach, object Elbow, object Tilt,
		object Head, object HeadSize, object BarLength,
		object Finish, object BodyColour, object InnerColour, object Diffuser,
		object CableOn, object CableColour, object LightOn, object Kelvin, object Lumens,
		ref object Body, ref object Inner, ref object Glass, ref object Light, ref object Cable, ref object Desk,
		ref object BodyCol, ref object BodyMetal, ref object BodyRough, ref object InnerCol, ref object CableCol, ref object LightKelvin, ref object LightLumens, ref object GlowPower, ref object Illuminance, ref object TaskLight,
		ref object WeightKg, ref object Stability, ref object UnitCost, ref object Spec, ref object BodyCoat)
    {
        string baseType = Txt(Base, "Round"), arm = Txt(Arm, "Two-Joint"), head = Txt(Head, "Dome"), finish = Txt(Finish, "Powder Coat");
        double size = Num(BaseSize, 180), deskT = Num(DeskThickness, 30), h = Num(Height, 480), reach = Num(Reach, 360);
        double elbow = Num(Elbow, 45) / 100.0, tilt = Num(Tilt, 25) * Math.PI / 180, headSize = Num(HeadSize, 170), barLen = Num(BarLength, 420);
        bool heavy = Bool(Weighted, false), diffuser = Bool(Diffuser, true), cableOn = Bool(CableOn, true);

        var body = new List<Mesh>(); var inner = new List<Mesh>(); var glass = new List<Mesh>();
        var light = new List<Mesh>(); var cable = new List<Mesh>(); var desk = new List<Mesh>();

        bool clamp = baseType == "Clamp";

        // Desk: a clamp needs an edge, so the desk starts at the lamp.
        desk.Add(Mesh.CreateFromBox(new BoundingBox(clamp ? 0 : -300, -300, -deskT, Math.Max(reach + 260, 620), 300, 0), 1, 1, 1));

        // Base
        double baseTop, baseMassKg, footprint;
        if (baseType == "Square")
        {
            double t = heavy ? 30 : 16;
            var rr = RoundedRect(size, size * 0.8, 16);
            body.Add(ToMesh(Extrusion.Create(rr, t, true).ToBrep()));
            baseTop = t; footprint = size / 2;
            baseMassKg = size * size * 0.8 * t * 7.85e-6;
        }
        else if (clamp)
        {
            // One C-section gripping the desk edge at x = 0, tightened by a screw from below.
            const double top = 12, width = 52, rear = -12, front = 92, screw = 62;
            var section = new Polyline(new[]
            {
                new Point3d(rear, -deskT - 16, 0), new Point3d(front, -deskT - 16, 0), new Point3d(front, -deskT - 6, 0), new Point3d(0, -deskT - 6, 0),
                new Point3d(0, 0, 0), new Point3d(front, 0, 0), new Point3d(front, top, 0), new Point3d(rear, top, 0), new Point3d(rear, -deskT - 16, 0)
            }).ToNurbsCurve();
            var rounded = Curve.CreateFilletCornersCurve(section, 2, 0.01, 0.1) ?? section;
            var jaw = ToMesh(Extrusion.Create(rounded, width, true).ToBrep());
            jaw.Transform(Transform.Rotation(Math.PI / 2, Vector3d.XAxis, Point3d.Origin));
            var box = jaw.GetBoundingBox(true);
            jaw.Transform(Transform.Translation(0, -(box.Min.Y + box.Max.Y) / 2, 0));
            body.Add(jaw);
            body.Add(ToMesh(Tube(new LineCurve(new Point3d(screw, 0, -deskT - 56), new Point3d(screw, 0, -deskT - 5)), 6)));
            body.Add(ToMesh(new Cylinder(new Circle(new Plane(new Point3d(screw, 0, -deskT - 5), Vector3d.ZAxis), 14), 5).ToBrep(true, true)));
            body.Add(ToMesh(new Cylinder(new Circle(new Plane(new Point3d(screw, 0, -deskT - 68), Vector3d.ZAxis), 15), 12).ToBrep(true, true)));
            baseTop = top; footprint = 0; baseMassKg = 0.65;
        }
        else
        {
            double t = heavy ? 30 : 16, R = size / 2, r = 6;
            var pts = new List<Point3d> { new Point3d(0, 0, 0), new Point3d(R, 0, 0), new Point3d(R, 0, t - r) };
            var profile = new PolyCurve();
            profile.Append(new Line(pts[0], pts[1]));
            profile.Append(new Line(pts[1], pts[2]));
            profile.Append(new Arc(pts[2], Vector3d.ZAxis, new Point3d(R - r, 0, t)));
            profile.Append(new Line(new Point3d(R - r, 0, t), new Point3d(0, 0, t)));
            body.Add(ToMesh(Revolve(profile)));
            baseTop = t; footprint = R;
            baseMassKg = Math.PI * R * R * t * 7.85e-6;
        }

        // Arm: pivot at the base, head knuckle at (reach, 0, height).
        var pivot = new Point3d(clamp ? 36 : 0, 0, baseTop + 22);
        var knuckle = new Point3d(reach, 0, h);
        body.Add(ToMesh(Tube(new LineCurve(new Point3d(pivot.X, 0, baseTop - 1), pivot), 11)));
        body.Add(ToMesh(Joint(pivot, 15, 38)));

        double armLen, armRadius;
        var armPath = new List<Curve>();
        if (arm == "Straight")
        {
            var c = new LineCurve(pivot, knuckle);
            body.Add(ToMesh(Tube(c, 9)));
            armLen = c.GetLength(); armRadius = 9;
            armPath.Add(c);
        }
        else if (arm == "Arc")
        {
            var c = new ArcCurve(new Arc(pivot, Vector3d.ZAxis, knuckle));
            body.Add(ToMesh(Tube(c, 8)));
            armLen = c.GetLength(); armRadius = 8;
            armPath.Add(c);
        }
        else
        {
            var e = new Point3d(pivot.X + reach * (elbow - 0.42), 0, baseTop + (h - baseTop) * 0.66);
            foreach (double y in new[] { -10.0, 10.0 })
            {
                var off = new Vector3d(0, y, 0);
                body.Add(ToMesh(Tube(new LineCurve(pivot + off, e + off), 5)));
                body.Add(ToMesh(Tube(new LineCurve(e + off, knuckle + off), 5)));
            }
            body.Add(ToMesh(Joint(e, 13, 34)));
            armLen = pivot.DistanceTo(e) + e.DistanceTo(knuckle); armRadius = 5;
            armPath.Add(new LineCurve(pivot, e)); armPath.Add(new LineCurve(e, knuckle));
        }

        // Head: local +Z is the light direction.
        var dir = new Vector3d(Math.Sin(tilt), 0, -Math.Cos(tilt));
        bool bar = head == "Linear Bar";
        var x = Vector3d.CrossProduct(Vector3d.YAxis, dir);
        double headR = headSize / 2;
        var outer = new List<Point3d> { new Point3d(23, 0, 0), new Point3d(23, 0, 28) };
        double depth = bar ? 28 : HeadProfile(head, headR, out outer);

        // A wide head on a short reach swallows its own arm, so the head moves out on a neck until it clears.
        double neck = NeckToClear(knuckle, dir, x, armPath, armRadius, outer);
        var mount = knuckle + Vector3d.XAxis * neck;
        body.Add(ToMesh(new Sphere(knuckle, 13).ToBrep()));
        if (neck > 0)
        {
            body.Add(ToMesh(Tube(new LineCurve(knuckle, mount), 6)));
            body.Add(ToMesh(new Sphere(mount, 10).ToBrep()));
        }
        var c0 = mount + dir * 30;
        body.Add(ToMesh(Tube(new LineCurve(mount, c0), 6)));
        var frame = new Plane(c0, x, Vector3d.CrossProduct(dir, x));
        var toHead = Transform.PlaneToPlane(Plane.WorldXY, frame);

        double headMassKg;
        if (bar)
        {
            var section = RoundedRect(46, 28, 11);
            var bodyMesh = ToMesh(Extrusion.Create(section, barLen, true).ToBrep());
            bodyMesh.Transform(Transform.Translation(0, 0, -barLen / 2));
            bodyMesh.Transform(Transform.Rotation(Math.PI / 2, Vector3d.XAxis, Point3d.Origin));
            bodyMesh.Transform(Transform.Translation(0, 0, 14));
            bodyMesh.Transform(toHead);
            body.Add(bodyMesh);
            var strip = Mesh.CreateFromBox(new BoundingBox(-16, -barLen / 2 + 12, 26, 16, barLen / 2 - 12, 29), 1, 1, 1);
            strip.Transform(toHead);
            light.Add(strip);
            headMassKg = 0.2 + barLen / 1000 * 0.7;
        }
        else
        {
            double R = headR;
            var skin = Curve.CreateInterpolatedCurve(outer, 3);
            if (head == "Cone" || head == "Cylinder") skin = new Polyline(outer).ToNurbsCurve();

            var shell = ToMesh(Revolve(skin)); shell.Transform(toHead); body.Add(shell);

            var offset = outer.Select(p => new Point3d(Math.Max(p.X - 2.5, 0.01), 0, p.Z + 1.5)).ToList();
            var liner = Curve.CreateInterpolatedCurve(offset, 3);
            if (head == "Cone" || head == "Cylinder") liner = new Polyline(offset).ToNurbsCurve();
            var linerMesh = ToMesh(Revolve(liner)); linerMesh.Transform(toHead); inner.Add(linerMesh);

            double mouth = outer[outer.Count - 1].X;
            var rim = ToMesh(new Torus(new Plane(new Point3d(0, 0, depth), Vector3d.ZAxis), mouth - 0.5, 3.2).ToNurbsSurface().ToBrep());
            rim.Transform(toHead); body.Add(rim);

            var collar = ToMesh(new Cylinder(new Circle(new Plane(new Point3d(0, 0, -12), Vector3d.ZAxis), 15), 16).ToBrep(true, true));
            collar.Transform(toHead); body.Add(collar);

            var bulb = ToMesh(new Sphere(new Point3d(0, 0, depth * 0.55), Math.Min(R * 0.3, depth * 0.34)).ToBrep());
            bulb.Transform(toHead); light.Add(bulb);

            if (diffuser)
            {
                var lens = ToMesh(new Cylinder(new Circle(new Plane(new Point3d(0, 0, depth - 2), Vector3d.ZAxis), mouth - 2.5), 2.5).ToBrep(true, true));
                lens.Transform(toHead); glass.Add(lens);
            }
            headMassKg = 0.2 + Math.Pow(headSize / 170, 2) * 0.3;
        }

        // Cable: hidden inside a tube arm, or threaded between twin rods over saddles. It leaves the back
        // of the base through a strain relief and runs flat on the desk to a grommet. A clamp has no
        // desk behind it, so there it drops off the edge.
        if (cableOn)
        {
            const double r = 2.6;
            if (arm != "Straight" && arm != "Arc")
                foreach (var link in armPath)
                {
                    cable.Add(ToMesh(Tube(link, r)));
                    var along = link.PointAtEnd - link.PointAtStart; along.Unitize();
                    var below = Vector3d.CrossProduct(along, Vector3d.YAxis);
                    if (below.Z > 0) below = -below;
                    foreach (double t in new[] { 0.3, 0.7 })
                    {
                        var at = link.PointAtNormalizedLength(t) + below * (r + 2);
                        body.Add(ToMesh(Tube(new LineCurve(at - Vector3d.YAxis * 10, at + Vector3d.YAxis * 10), 2)));
                    }
                }

            double exit = clamp ? -12 : -footprint;
            double exitZ = clamp ? 6 : 5;
            cable.Add(ToMesh(Tube(new LineCurve(new Point3d(exit + 2, 0, exitZ), new Point3d(exit - 12, 0, exitZ)), 4.6)));
            cable.Add(ToMesh(Tube(new LineCurve(new Point3d(exit - 10, 0, exitZ), new Point3d(exit - 24, 0, exitZ)), 3.7)));

            List<Point3d> route;
            Vector3d arrival;
            if (clamp)
            {
                double drop = exit - 54;
                route = new List<Point3d> { new Point3d(exit, 0, exitZ), new Point3d(exit - 28, 0, exitZ), new Point3d(drop, 0, -24), new Point3d(drop, 0, -deskT - 240) };
                arrival = -Vector3d.ZAxis;
            }
            else
            {
                const double gx = -262, gy = 84, flat = r + 0.1, bend = 9;
                double settled = exit - 40;
                var entry = new Point3d(gx + bend, gy, flat);
                route = new List<Point3d>
                {
                    new Point3d(exit, 0, exitZ), new Point3d(exit - 26, 0, exitZ), new Point3d(settled, 0, flat), new Point3d(gx + 70, gy, flat), entry
                };
                arrival = -Vector3d.XAxis;

                // Flat to the hole, then one bend down: a spline through both wriggles on the desk.
                cable.Add(ToMesh(Tube(new ArcCurve(new Arc(entry, -Vector3d.XAxis, new Point3d(gx, gy, flat - bend))), r)));
                var grommet = new Point3d(gx, gy, 0.2);
                cable.Add(ToMesh(new Torus(new Plane(grommet, Vector3d.ZAxis), 13, 1).ToNurbsSurface().ToBrep()));
                cable.Add(ToMesh(new Cylinder(new Circle(new Plane(new Point3d(gx, gy, 0), Vector3d.ZAxis), 12.5), 0.2).ToBrep(true, true)));
            }
            cable.Add(ToMesh(Tube(Curve.CreateInterpolatedCurve(route, 3, CurveKnotStyle.Chord, -Vector3d.XAxis, arrival), r)));
        }

        // Tipping about the base edge on the head's side.
        double armMassKg = armLen / 1000 * 0.55;
        double baseKg = heavy ? baseMassKg : baseMassKg * 0.75;
        double overturn = headMassKg * (reach + neck - footprint) + armMassKg * (reach / 2 - footprint);
        double restoring = baseKg * footprint;
        string stability;
        if (clamp) stability = "Clamped to the desk";
        else if (overturn <= 0) stability = "Stable: the head sits inside the base";
        else
        {
            double margin = restoring / overturn;
            stability = margin >= 1.25 ? string.Format("Stable, {0:0.0}x margin", margin)
                : margin >= 1 ? string.Format("Marginal, {0:0.0}x: widen or weight the base", margin)
                : string.Format("Tips over at {0:0.0}x: widen or weight the base", margin);
        }

        // Finish
        Color col; double metal, rough, finishFactor;
        switch (finish)
        {
            case "Anodised": col = Color.FromArgb(182, 186, 192); metal = 1; rough = 0.38; finishFactor = 1.2; break;
            case "Brass": col = Color.FromArgb(198, 158, 92); metal = 1; rough = 0.3; finishFactor = 1.65; break;
            case "Chrome": col = Color.FromArgb(232, 234, 238); metal = 1; rough = 0.08; finishFactor = 1.45; break;
            default: col = Named(BodyColour); metal = 0; rough = 0.42; finishFactor = 1; break;
        }

        double total = baseKg + headMassKg + armMassKg;
        double cost = (34 + armLen * 0.05 + baseKg * 7 + (bar ? barLen * 0.09 : headSize * 0.22) + (diffuser && !bar ? 9 : 0) + (cableOn ? 6 : 0)) * finishFactor;

        double lumens = Bool(LightOn, true) ? Num(Lumens, 800) : 0;
        LightKelvin = Num(Kelvin, 2700);
        LightLumens = lumens;
        // Well under the bulb, so the viewer treats the diffuser as lit glass, not a second light.
        GlowPower = lumens / 160 * 0.3;

        // Lumen method at the spot under the head: the shade sends about 70% of the flux into a
        // 120 degree cone (a bar into a wider one), and tilting moves that spot away.
        double metres = Math.Max(0.05, c0.Z / 1000);
        double beam = bar ? 1.5 * Math.PI : Math.PI;
        double lux = Bool(LightOn, true) ? lumens * 0.7 / beam / (metres * metres) * Math.Pow(Math.Cos(tilt), 3) : 0;
        Illuminance = Math.Round(lux);
        TaskLight = !Bool(LightOn, true) ? "Light off"
            : lux >= 500 ? string.Format("Meets the 500 lx task target, {0:0} lx", lux)
            : string.Format("Below the 500 lx task target: {0:0} lx", lux);

        BodyCoat = finish == "Powder Coat" ? 0.45 : 0.0;
        Body = body; Inner = inner; Glass = glass; Light = light; Cable = cable; Desk = desk;
        BodyCol = col; BodyMetal = metal; BodyRough = rough;
        InnerCol = Named(InnerColour);
        CableCol = Named(CableColour);
        WeightKg = Math.Round(total, 2);
        UnitCost = Math.Round(cost);
        Stability = stability;
        Spec = string.Format("{0} base, {1} arm, {2} head, {3}", baseType, arm, head, finish);
    }

    static Color Named(object o)
    {
        switch (Txt(o, ""))
        {
            case "Oxide": return Color.FromArgb(148, 58, 40);
            case "Cream": return Color.FromArgb(236, 228, 208);
            case "Graphite": return Color.FromArgb(44, 46, 50);
            case "Ocean": return Color.FromArgb(28, 70, 104);
            case "White": return Color.FromArgb(250, 248, 242);
            case "Gold": return Color.FromArgb(214, 170, 96);
            case "Black": return Color.FromArgb(22, 22, 24);
            case "Copper": return Color.FromArgb(176, 92, 58);
            default: return Color.FromArgb(30, 62, 54);
        }
    }

    static double NeckToClear(Point3d knuckle, Vector3d dir, Vector3d x, List<Curve> arm, double armRadius, List<Point3d> profile)
    {
        for (double neck = 0; neck < 500; neck += 10)
        {
            var head = knuckle + Vector3d.XAxis * neck + dir * 30;
            if (!arm.Any(c => Hits(c, head, dir, x, armRadius, profile))) return neck;
        }
        return 500;
    }

    static bool Hits(Curve arm, Point3d head, Vector3d dir, Vector3d x, double armRadius, List<Point3d> profile)
    {
        const double clearance = 6;
        for (int i = 0; i <= 80; i++)
        {
            double t;
            arm.NormalizedLengthParameter(i / 80.0, out t);
            var v = arm.PointAt(t) - head;
            double along = v * dir;
            if (along < -16 || along > profile[profile.Count - 1].Z) continue;
            if (Math.Abs(v * x) < WidthAt(profile, along) + armRadius + clearance) return true;
        }
        return false;
    }

    // Half-width of the head at a depth along its axis, the collar included.
    static double WidthAt(List<Point3d> profile, double depth)
    {
        for (int i = 1; i < profile.Count; i++)
        {
            Point3d a = profile[i - 1], b = profile[i];
            if (b.Z <= a.Z || depth > b.Z || depth < a.Z) continue;
            return Math.Max(15, a.X + (b.X - a.X) * (depth - a.Z) / (b.Z - a.Z));
        }
        return 15;
    }

    static double HeadProfile(string head, double R, out List<Point3d> p)
    {
        p = new List<Point3d>();
        if (head == "Cone")
        {
            p.Add(new Point3d(R * 0.14, 0, 0)); p.Add(new Point3d(R, 0, R * 0.92));
            return R * 0.92;
        }
        if (head == "Cylinder")
        {
            double r = R * 0.62, d = R * 1.5;
            p.Add(new Point3d(0.01, 0, 0)); p.Add(new Point3d(r, 0, 0)); p.Add(new Point3d(r, 0, d));
            return d;
        }
        double depth = R * 0.74;
        for (int i = 1; i <= 8; i++)
        {
            double t = i / 8.0 * Math.PI / 2;
            p.Insert(p.Count, new Point3d(R * Math.Sin(t), 0, depth * (1 - Math.Cos(t))));
        }
        p.Insert(0, new Point3d(0.01, 0, 0));
        return depth;
    }

    static Curve RoundedRect(double w, double d, double r)
    {
        var rect = new Rectangle3d(Plane.WorldXY, new Interval(-w / 2, w / 2), new Interval(-d / 2, d / 2));
        var c = Curve.CreateFilletCornersCurve(rect.ToNurbsCurve(), r, 0.01, 0.1);
        return c ?? rect.ToNurbsCurve();
    }

    static Brep Revolve(Curve c)
    {
        return Brep.CreateFromRevSurface(RevSurface.Create(c, new Line(Point3d.Origin, Vector3d.ZAxis, 10)), false, false);
    }

    static Brep Tube(Curve c, double r)
    {
        var pipes = Brep.CreatePipe(c, r, false, PipeCapMode.Round, true, 0.05, 0.02);
        return pipes[0];
    }

    static Brep Joint(Point3d at, double r, double width)
    {
        var plane = new Plane(at - Vector3d.YAxis * width / 2, Vector3d.YAxis);
        return new Cylinder(new Circle(plane, r), width).ToBrep(true, true);
    }

    static Mesh ToMesh(Brep b)
    {
        var mp = new MeshingParameters(0.85, 0.5) { JaggedSeams = false, RefineGrid = true };
        var m = new Mesh();
        foreach (var part in Mesh.CreateFromBrep(b, mp)) m.Append(part);
        m.Normals.ComputeNormals();
        return m;
    }

    static string Txt(object o, string fallback) { return o == null ? fallback : o.ToString().Trim('"'); }
    static double Num(object o, double fallback) { double v; return o != null && GH_Convert.ToDouble(o, out v, GH_Conversion.Both) ? v : fallback; }
    static bool Bool(object o, bool fallback) { bool v; return o != null && GH_Convert.ToBoolean(o, out v, GH_Conversion.Both) ? v : fallback; }
    static Color Col(object o, Color fallback) { Color v = fallback; return o != null && GH_Convert.ToColor(o, out v, GH_Conversion.Both) ? v : fallback; }
}
# ---------- end c_script ----------
body = ThreeMaterial(
    Color=c_script.BodyCol,
    Metalness=c_script.BodyMetal,
    Roughness=c_script.BodyRough,
    Clearcoat=c_script.BodyCoat,
    ClearcoatRoughness=0.25)
inner = ThreeMaterial(Color=c_script.InnerCol, Metalness=0, Roughness=0.5)
diffuser_3 = ThreeMaterial(Color=RGB(250, 250, 246), Metalness=0, Roughness=0.35, Opacity=0.55, Transparent=True)
light_source = ThreeMaterial(Color=RGB(255, 250, 236), Metalness=0, Roughness=0.25)
mpre = MaterialPreset(Preset=7)
diffuser_4 = EmissiveMaterial(Color=RGB(255, 232, 196), Strength=c_script.GlowPower, Base=diffuser_3, Kelvin=c_script.LightKelvin)
light_source_2 = EmissiveMaterial(Color=RGB(255, 232, 196), Strength=4, Base=light_source, Kelvin=c_script.LightKelvin, Lumens=c_script.LightLumens)
cable_3 = ThreeMaterial(Color=c_script.CableCol, Metalness=0, Roughness=0.6)
desk = ThreeMaterial(Base=mpre)
c_print = ContextPrint(DeskIlluminanceLx=c_script.Illuminance)
c_print_2 = ContextPrint(UnitCostEUR=c_script.UnitCost)
c_print_3 = ContextPrint(Configuration=c_script.Spec)
c_print_4 = ContextPrint(WeightKg=c_script.WeightKg)
c_print_5 = ContextPrint(TaskLight=c_script.TaskLight)
c_print_6 = ContextPrint(Stability=c_script.Stability)
D = Display(Geo=c_script.Body, Name="Body", Layer="Lamp/Body", Material=body)
D_2 = Display(Geo=c_script.Inner, Name="Inner", Layer="Lamp/Shade lining", Material=inner)
D_3 = Display(Geo=c_script.Glass, Name="Diffuser", Layer="Lamp/Diffuser", Material=diffuser_4)
D_4 = Display(Geo=c_script.Light, Name="Light source", Layer="Lamp/Light", Material=light_source_2)
D_5 = Display(Geo=c_script.Cable, Name="Cable", Layer="Lamp/Cable", Material=cable_3)
D_6 = Display(Geo=c_script.Desk, Name="Desk", Layer="Context/Desk", Material=desk)
codisplay = CombineDisplay(WebDisplay=[D, D_2, D_3, D_4, D_5, D_6])
c_bake_2 = ContextBake(Content=codisplay)
