# Grasshopper definition timber-gridshell-pavilion.gh (Grasshopper 1.0.9)
# plug-ins: Selva Canopy, Selva

# ---- group: Shape / Inputs
openings_default = Slider(0.55, range=0..0.85)
height_default = Slider(5.5, range=3..9)
span_default = Slider(18, range=10..30)
depth_default = Slider(13, range=8..24)
waves_default = Slider(2, range=1..4)
# timber-gridshell-pavilion
# Blue: inputs to change.   Green: outputs (charts, results, values passed on).   Named parameters mark each group's inputs and outputs.
# TIMBER LAMELLA PAVILION
# A timber lamella shell over a town square. Choose a form, size the shell and its lamellas, then download the drawing set, the cut list and the model. Every step is a stock or Selva component.
# SHAPE
# Pillow stands on four corners with an arched opening on every side. Vault and Wave spring from the long edges.
form_options = ValueList({"Pillow", "Vault", "Wave"}, selected="Pillow")
form = GetValueList(
    form_options,
    AtLeast=1,
    AtMost=1,
    Immediate=True,
    ListAccess=False,
    Prompt="Form",
    StoredItems="""[
  {
    "name": "Pillow",
    "expression": "Pillow"
  },
  {
    "name": "Vault",
    "expression": "Vault"
  },
  {
    "name": "Wave",
    "expression": "Wave"
  }
]""",
    TreeAccess=False)
span = GetNumber(span_default, AtLeast=1, AtMost=1, Maximum=30, Minimum=10, Prompt="Span", TreeAccess=False)
depth = GetNumber(depth_default, AtLeast=1, AtMost=1, Maximum=24, Minimum=8, Prompt="Depth", TreeAccess=False)
height = GetNumber(height_default, AtLeast=1, AtMost=1, Maximum=9, Minimum=3, Prompt="Height", TreeAccess=False)
openings = GetNumber(openings_default, AtLeast=1, AtMost=1, Maximum=0.85, Minimum=0, Prompt="Openings", TreeAccess=False)
waves = GetInteger(waves_default, AtLeast=1, AtMost=1, Maximum=4, Minimum=1, Prompt="Waves", TreeAccess=False)

# ---- group: Structure / Inputs
lamella_spacing_default = Slider(0.9, range=0.5..1.6)
lamella_depth_default = Slider(24, range=12..40)
lamella_width_default = Slider(10, range=6..16)
timber_options = ValueList({"Larch", "Walnut", "Charred"}, selected="Larch")
edge_beam_colour_get_color = EdgeBeamColourGetColor(
    ColourSwatch(SwatchColor=RGB(52, 58, 62)),
    AtLeast=1,
    AtMost=1,
    Immediate=True,
    Prompt="Select a color",
    TreeAccess=False)
lamella_spacing = GetNumber(lamella_spacing_default, AtLeast=1, AtMost=1, Maximum=1.6, Minimum=0.5, Prompt="Lamella spacing", TreeAccess=False)
lamella_depth = GetInteger(lamella_depth_default, AtLeast=1, AtMost=1, Maximum=40, Minimum=12, Prompt="Lamella depth", TreeAccess=False)
lamella_width = GetInteger(lamella_width_default, AtLeast=1, AtMost=1, Maximum=16, Minimum=6, Prompt="Lamella width", TreeAccess=False)
timber = GetValueList(
    timber_options,
    AtLeast=1,
    AtMost=1,
    Immediate=True,
    ListAccess=False,
    Prompt="Timber",
    StoredItems="""[
  {
    "name": "Larch",
    "expression": "Larch"
  },
  {
    "name": "Walnut",
    "expression": "Walnut"
  },
  {
    "name": "Charred",
    "expression": "Charred"
  }
]""",
    TreeAccess=False)

# ---- group: Site / Inputs
# SITE
# Paving for the square, an optional glass roof, and pendant lamps that light up in the viewer's Night look.
paving_options = ValueList({"Concrete", "Brick", "Limestone"}, selected="Concrete")
evening_lights_default = BooleanToggle(True)
glass_roof_default = BooleanToggle(False)
paving = GetValueList(
    paving_options,
    AtLeast=1,
    AtMost=1,
    Immediate=True,
    ListAccess=False,
    Prompt="Paving",
    StoredItems="""[
  {
    "name": "Concrete",
    "expression": "Concrete"
  },
  {
    "name": "Brick",
    "expression": "Brick"
  },
  {
    "name": "Limestone",
    "expression": "Limestone"
  }
]""",
    TreeAccess=False)
glass_roof = GetBoolean(glass_roof_default, AtLeast=1, AtMost=1, FalseValue="False", Prompt="Glass roof", TreeAccess=False, TrueValue="True")
evening_lights = GetBoolean(
    evening_lights_default,
    AtLeast=1,
    AtMost=1,
    FalseValue="False",
    Prompt="Evening lights",
    TreeAccess=False,
    TrueValue="True")

# ---- group: Other / Inputs
toggle = BooleanToggle(False)

# ---- group: Other
uibridge = UIBridge(Enable=toggle, Schema="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")  # -> Schema, URL

# ---- group: Other / Outputs
c_bake = ContextBake(Content=uibridge.Schema)

# ---- group: Structure
# STRUCTURE
# Two sets of glulam lamellas cut from the shell on vertical planes at 45°. Sizes in centimetres.
edge_beam_colour = GetColor(edge_beam_colour_get_color, AtLeast=1, AtMost=1, Immediate=True, Prompt="Edge beam colour", TreeAccess=False)

# ---- group: Shell / Inputs
form_index_options = Panel("""Pillow
Vault
Wave""")
edge_arches_expression = EdgeArchesExpression("sin(pi*x)+sin(pi*y)-2*sin(pi*x)*sin(pi*y)")
form_index_options_2 = FormIndexOptions(form_index_options)
wave_expression = WaveExpression("sin(pi*y)*(0.72+0.28*cos(2*pi*x))")
sin_pi_x_sin_pi_y = SinPiXSinPiY("sin(pi*x)*sin(pi*y)")
sin_pi_y_0_x = SinPiY0X("sin(pi*y)+0*x")
x_0_5_y = X05Y("(x-0.5)*y")
x_0_5_y_2 = X05Y("(x-0.5)*y")

# ---- group: Sheet scale and styles / Inputs
x_5_1000_y = X51000Y("(x+5)*1000/y")
x_10_1000_520 = X101000520("(x+10)*1000/520")
x_5_2_1000_270 = X521000270("(x+5.2)*1000/270")
scale_1_expression = Scale1Expression("if(x<=100,100,if(x<=200,200,500))")
x_5_1000_y_2 = X51000Y("(x+5)*1000/y")
x_5_1000_y_3 = X51000Y("(x+5)*1000/y")
x_5_1150_y = X51150Y("(x+5)*1150/y")
hairline_stroke_color = HairlineStrokeColor(ColourSwatch(SwatchColor=RGB(160, 160, 160)))
thin_stroke_color = ThinStrokeColor(ColourSwatch(SwatchColor=RGB(80, 80, 80)))
cut_fill_color = CutFillColor(ColourSwatch(SwatchColor=RGB(0, 0, 0)))
concrete_fill_color = ConcreteFillColor(ColourSwatch(SwatchColor=RGB(205, 205, 205)))

# ---- group: Sheet scale and styles
# SHEET SCALE
# The smallest of 1:100, 1:200 and 1:500 at which plan, section and elevation fit an A2 sheet.
medium = PathStyle(StrokeWidth=0.25)
addition = Addition(A=span, B=depth)
addition_2 = Addition(A=depth, B=height)
heavy = PathStyle(StrokeWidth=0.5)
ground_hatch = PathStyle(StrokeWidth=0.25, Fill=True, HatchPattern=1)
section_line = PathStyle(StrokeWidth=0.25, DashPattern=[8, 1.5, 1, 1.5])
view_title = TextStyle(FontSize=4, Weight=1)
section_tag = TextStyle(FontSize=4, Weight=1, HorizontalAnchor=1)
note_text = TextStyle()
lamella_number = TextStyle(FontSize=1.6, HorizontalAnchor=1, VerticalAnchor=1)
width_needs_1 = Evaluate(E=x_10_1000_520, x=addition)
height_needs_1 = Evaluate(E=x_5_2_1000_270, x=addition_2)
hairline = PathStyle(StrokeColor=hairline_stroke_color, StrokeWidth=0.09)
thin = PathStyle(StrokeColor=thin_stroke_color, StrokeWidth=0.13)
cut = PathStyle(StrokeWidth=0.13, FillColor=cut_fill_color, Fill=True)
concrete = PathStyle(StrokeWidth=0.25, FillColor=concrete_fill_color, Fill=True)
max = Maximum(A=width_needs_1, B=height_needs_1)
longest_side = Maximum(A=span, B=depth)
scale_1 = Evaluate(E=scale_1_expression, x=max)
plan_length_mm = Evaluate(E=x_5_1000_y, x=longest_side, y=scale_1)
scale_text = Format(Format="1:{0}", Culture=127, Data0=scale_1)
section_length_mm = Evaluate(E=x_5_1000_y_2, x=span, y=scale_1)
end_length_mm = Evaluate(E=x_5_1000_y_3, x=depth, y=scale_1)
axo_length_mm = Evaluate(E=x_5_1150_y, x=depth, y=scale_1)

# ---- group: Shell
# SHELL
# The height at (u, v) is the chosen form's function times the height. Pillow blends a dome (both arches) with the edge arches by Openings.
u = Range(Domain=Domain(0, 1), Steps=32)
v = Range(Domain=Domain(0, 1), Steps=24)
edge_arches = Evaluate(E=edge_arches_expression, x=graft(u), y=v)
dome = Evaluate(E=sin_pi_x_sin_pi_y, x=graft(u), y=v)
opening_lift = Multiplication(A=edge_arches, B=openings)
crests = Multiplication(A=u, B=waves)
form_name = Text(form)
wave = Evaluate(E=wave_expression, x=graft(crests), y=v)
vault = Evaluate(E=sin_pi_y_0_x, x=graft(u), y=v)
pillow = Addition(A=dome, B=opening_lift)
form_index = MemberIndex(Set=form_index_options_2, Member=form_name)  # -> Index, Count
chosen_form = StreamFilter(Gate=form_index.Index, Stream0=pillow, Stream1=vault, Stream2=wave)
x_along_span = Evaluate(E=x_0_5_y, x=u, y=span)
y_across_depth = Evaluate(E=x_0_5_y_2, x=v, y=depth)
z = Multiplication(A=chosen_form, B=height)
shell_points = ConstructPoint(XCoordinate=graft(x_along_span), YCoordinate=y_across_depth, ZCoordinate=z)
arches = Interpolate(Vertices=shell_points, Degree=3, Periodic=False, KnotStyle=1)  # -> Curve, Length, Domain
shell = Loft(
    Curves=flatten(arches.Curve),
    Options={Adjust=False, Closed=False, LoftEnds=0, LoftSimp=0, LoftType=0, Rebuild=10, Refit=0.01})
shaping_the_shell = ReportProgress(Data=shell, Message="Shaping the shell…")

# ---- group: Sheet scale and styles / Outputs
plan_length_mm_2 = PlanLengthMm(plan_length_mm)
medium_2 = Medium(medium)
scale_text_2 = ScaleText(scale_text)
section_length_mm_2 = SectionLengthMm(section_length_mm)
scale_1_2 = Scale1(scale_1)
end_length_mm_2 = EndLengthMm(end_length_mm)
axo_length_mm_2 = AxoLengthMm(axo_length_mm)
hairline_2 = Hairline(hairline)
thin_2 = Thin(thin)
cut_2 = Cut(cut)
concrete_2 = Concrete(concrete)
heavy_2 = Heavy(heavy)
ground_hatch_2 = GroundHatch(ground_hatch)
section_line_2 = SectionLine(section_line)
view_title_2 = ViewTitle(view_title)
section_tag_2 = SectionTag(section_tag)
note_text_2 = NoteText(note_text)
lamella_number_2 = LamellaNumber(lamella_number)

# ---- group: Shell / Outputs
shaping_the_shell_2 = ShapingTheShell(shaping_the_shell)

# ---- group: Lamellas / Inputs
x_100 = X100("x/100")
x_100_2 = X100("x/100")

# ---- group: Lamellas
# LAMELLAS
# Contours on vertical planes at ±45°. Each is extruded down by the lamella depth, then sideways by its width. Offcuts shorter than 60 cm are dropped.
shaping_the_shell_3 = ShapingTheShell(shaping_the_shell_2)
cutting_lamellas = ReportProgress(Data=shaping_the_shell_3, Message="Cutting lamellas…")
depth_m = Evaluate(E=x_100, x=lamella_depth)
width_m = Evaluate(E=x_100_2, x=lamella_width)
neg = Negative(Value=depth_m)
down = UnitZ(Factor=neg)

# ---- group: Lamellas / Outputs
cutting_lamellas_2 = CuttingLamellas(cutting_lamellas)
depth_m_2 = DepthM(depth_m)
width_m_2 = WidthM(width_m)
down_2 = Down(down)

# ---- group: Lamella set A
# SET A
# Lamellas running south-west to north-east.
cutting_lamellas_3 = CuttingLamellas(cutting_lamellas_2)
width_m_3 = WidthM(width_m_2)
down_3 = Down(down_2)
set_a_direction = VectorXYZ(XComponent=1, YComponent=1, ZComponent=0)  # -> Vector, Length
set_a = Contour(Shape=cutting_lamellas_3, Point=Point(0, 0, 0), Direction=set_a_direction.Vector, Distance=lamella_spacing)
set_a_list = FlattenTree(Tree=set_a, Path="{0}")
set_a_lengths = Length(Curve=set_a_list)
larger = LargerThan(FirstNumber=set_a_lengths, SecondNumber=0.6)  # -> LargerThan, OrEqualTo
set_a_trimmed = Dispatch(List=set_a_list, DispatchPattern=larger.LargerThan)  # -> ListA, ListB
set_a_cut_lengths = Length(Curve=set_a_trimmed.ListA)
set_a_ribbons = Extrude(Base=set_a_trimmed.ListA, Direction=down_3)
set_a_width = Amplitude(Vector=set_a_direction.Vector, Amplitude=width_m_3)
set_a_boards = Extrude(Base=set_a_ribbons, Direction=set_a_width)

# ---- group: Lamella set B
# SET B
# Lamellas running north-west to south-east.
cutting_lamellas_4 = CuttingLamellas(cutting_lamellas_2)
width_m_4 = WidthM(width_m_2)
down_4 = Down(down_2)
set_b_direction = VectorXYZ(XComponent=1, YComponent=-1, ZComponent=0)  # -> Vector, Length
set_b = Contour(Shape=cutting_lamellas_4, Point=Point(0, 0, 0), Direction=set_b_direction.Vector, Distance=lamella_spacing)
set_b_list = FlattenTree(Tree=set_b, Path="{0}")
set_b_lengths = Length(Curve=set_b_list)
larger_2 = LargerThan(FirstNumber=set_b_lengths, SecondNumber=0.6)  # -> LargerThan, OrEqualTo
set_b_trimmed = Dispatch(List=set_b_list, DispatchPattern=larger_2.LargerThan)  # -> ListA, ListB
set_b_cut_lengths = Length(Curve=set_b_trimmed.ListA)
set_b_ribbons = Extrude(Base=set_b_trimmed.ListA, Direction=down_4)
set_b_width = Amplitude(Vector=set_b_direction.Vector, Amplitude=width_m_4)
set_b_boards = Extrude(Base=set_b_ribbons, Direction=set_b_width)

# ---- group: Structure and site / Inputs
lamp_stations_along = Panel("""-0.25
0
0.25""")
lamp_stations_across = Panel("""-0.18
0.18""")
lamp_stations_along_2 = LampStationsAlong(lamp_stations_along)
lamp_stations_across_2 = LampStationsAcross(lamp_stations_across)
x_2 = X2("x/2")
x_2_2 = X2("x/2")
x_2_2_5 = X225("x/2+2.5")
x_2_2_5_2 = X225("x/2+2.5")
x_0_17 = X017("x*0.17")
x_0_2 = X02("x*0.2")
x_0_4 = X04("x*0.4")
x_1_2 = X12("-(x+1.2)")

# ---- group: Structure and site
# STRUCTURE AND SITE
# Edge beams on the shell's free edges, concrete footings at the corners, the square, two benches and six pendant lamps hung from the shell.
shaping_the_shell_4 = ShapingTheShell(shaping_the_shell_2)
depth_m_3 = DepthM(depth_m_2)
Z = UnitZ(Factor=0.04)
free_edges = BrepEdges(Brep=shaping_the_shell_4)  # -> Naked, Interior, NonManifold
half_span = Evaluate(E=x_2, x=span)
half_depth = Evaluate(E=x_2_2, x=depth)
square_centre = ConstructPoint(XCoordinate=0, YCoordinate=0, ZCoordinate=-0.1)
square_half_length = Evaluate(E=x_2_2_5, x=span)
square_half_width = Evaluate(E=x_2_2_5_2, x=depth)
bench_offset = Evaluate(E=x_0_2, x=depth)
bench_half_length = Evaluate(E=x_0_17, x=span)
glass_roof_2 = Move(Geometry=shaping_the_shell_4, Motion=Z)  # -> Geometry, Transform
multiplication = Multiplication(A=lamp_stations_along_2, B=span)
multiplication_2 = Multiplication(A=lamp_stations_across_2, B=depth)
beam_radius = Evaluate(E=x_0_4, x=depth_m_3)
lamp_floor_points = ConstructPoint(XCoordinate=multiplication, YCoordinate=graft(multiplication_2), ZCoordinate=0)
neg_2 = Negative(Value=half_span)
neg_3 = Negative(Value=half_depth)
square = CenterBox(Base=square_centre, X=square_half_length, Y=square_half_width, Z=0.1)
neg_4 = Negative(Value=bench_offset)
Z_2 = UnitZ(Factor=1)
cord_drop = Evaluate(E=x_1_2, x=depth_m_3)
edge_beams = Pipe(Curve=free_edges.Naked, Radius=beam_radius, Caps=1, FitRail=False)
corner_x = Merge(Data1=neg_2, Data2=half_span)
corner_y = Merge(Data1=neg_3, Data2=half_depth)
merge = Merge(Data1=neg_4, Data2=bench_offset)
hanging_points = ProjectPoint(Point=flatten(lamp_floor_points), Direction=Z_2, Geometry=shaping_the_shell_4)  # -> Point, Index
neg_5 = Negative(Value=bench_half_length)
cord = UnitZ(Factor=cord_drop)
corners = ConstructPoint(XCoordinate=corner_x, YCoordinate=graft(corner_y), ZCoordinate=0)
bench_centres = ConstructPoint(XCoordinate=0, YCoordinate=merge, ZCoordinate=0)
dom = ConstructDomain(DomainStart=neg_5, DomainEnd=bench_half_length)
dom_2 = ConstructDomain(DomainStart=-0.25, DomainEnd=0.25)
lamps = Move(Geometry=hanging_points.Point, Motion=cord)  # -> Geometry, Transform
footings = Cylinder(Base=flatten(corners), Radius=0.35, Length=0.45)
Z_3 = UnitZ(Factor=0.45)
bench_outlines = Rectangle(Plane=bench_centres, XSize=dom, YSize=dom_2, Radius=0)  # -> Rectangle, Length
cord_lines = Line(StartPoint=hanging_points.Point, EndPoint=lamps.Geometry)
bulbs = Sphere(Base=lamps.Geometry, Radius=0.17)
extr = Extrude(Base=bench_outlines.Rectangle, Direction=Z_3)
cords = Pipe(Curve=cord_lines, Radius=0.01, Caps=0, FitRail=False)
benches = CapHoles(Brep=extr)

# ---- group: Lamella set A / Outputs
set_a_cut_lengths_2 = SetACutLengths(set_a_cut_lengths)
set_a_trimmed_2 = SetATrimmed(set_a_trimmed.ListA)
set_a_boards_2 = SetABoards(set_a_boards)

# ---- group: Lamella set B / Outputs
set_b_cut_lengths_2 = SetBCutLengths(set_b_cut_lengths)
set_b_trimmed_2 = SetBTrimmed(set_b_trimmed.ListA)
set_b_boards_2 = SetBBoards(set_b_boards)

# ---- group: Structure and site / Outputs
bench_half_length_2 = BenchHalfLength(bench_half_length)
bench_outlines_2 = BenchOutlines(bench_outlines.Rectangle)
bench_offset_2 = BenchOffset(bench_offset)
hanging_points_2 = HangingPoints(hanging_points.Point)
beam_radius_2 = BeamRadius(beam_radius)
edge_beams_2 = EdgeBeams(edge_beams)
footings_2 = Footings(footings)
corners_2 = Corners(corners)
half_span_2 = HalfSpan(half_span)
half_depth_2 = HalfDepth(half_depth)
square_2 = Square(square)
benches_2 = Benches(benches)
glass_roof_3 = GlassRoof(glass_roof_2.Geometry)
cords_2 = Cords(cords)
bulbs_2 = Bulbs(bulbs)
lamps_2 = Lamps(lamps.Geometry)
free_edges_2 = FreeEdges(free_edges.Naked)

# ---- group: Both sets
# BOTH SETS
# Boards for the 3D view and the model; centre lines and lengths for the drawings, quantities and cut list.
set_a_cut_lengths_3 = SetACutLengths(set_a_cut_lengths_2)
set_b_cut_lengths_3 = SetBCutLengths(set_b_cut_lengths_2)
set_a_trimmed_3 = SetATrimmed(set_a_trimmed_2)
set_b_trimmed_3 = SetBTrimmed(set_b_trimmed_2)
set_a_boards_3 = SetABoards(set_a_boards_2)
set_b_boards_3 = SetBBoards(set_b_boards_2)
all_boards = Merge(Data1=set_a_boards_3, Data2=set_b_boards_3)
all_lamella_lines = Merge(Data1=set_a_trimmed_3, Data2=set_b_trimmed_3)
all_lengths = Merge(Data1=set_a_cut_lengths_3, Data2=set_b_cut_lengths_3)

# ---- group: Both sets / Outputs
all_lamella_lines_2 = AllLamellaLines(all_lamella_lines)
all_boards_2 = AllBoards(all_boards)
all_lengths_2 = AllLengths(all_lengths)

# ---- group: 3D view / Inputs
timber_index_options = Panel("""Larch
Walnut
Charred""")
paving_preset_table = Panel("""8
13
14""")
paving_index_options = Panel("""Concrete
Brick
Limestone""")
timber_index_options_2 = TimberIndexOptions(timber_index_options)
paving_index_options_2 = PavingIndexOptions(paving_index_options)
paving_preset_table_2 = PavingPresetTable(paving_preset_table)
lamp_light_color = LampLightColor(ColourSwatch(SwatchColor=RGB(255, 190, 120)))
charred_color = CharredColor(ColourSwatch(SwatchColor=RGB(38, 33, 30)))
if_x_1_0 = IfX10("if(x,1,0)")
if_x_6_0 = IfX60("if(x,6,0)")

# ---- group: Quantities / Inputs
x_y = XY("x/y")
x_0_9 = X09("x*0.9")
length_histogram_color = LengthHistogramColor(ColourSwatch(SwatchColor=RGB(166, 123, 80)))
x_2400_y_140 = X2400Y140("x*2400+y*140")

# ---- group: Plan / Inputs
x_2_5 = X25("x+2.5")
x_2_5_2 = X25("x+2.5")
x_1000 = X1000("x*1000")
x_0_9_2 = X09("x+0.9")
_2_5_1000_x_8 = _251000X8("-(2.5*1000/x+8)")
x_1000_2 = X1000("x*1000")
x_1_5 = X15("x+1.5")

# ---- group: Downloads / Inputs
csv_header = Panel("Lamella,Set,Length (m),Width (mm),Depth (mm)")
csv_header_2 = CSVHeader(csv_header)

# ---- group: Downloads
# DOWNLOADS
# A cut list with one row per lamella, and the whole pavilion as a Rhino model.
set_a_cut_lengths_4 = SetACutLengths(set_a_cut_lengths_2)
set_b_cut_lengths_4 = SetBCutLengths(set_b_cut_lengths_2)
edge_beams_3 = EdgeBeams(edge_beams_2)
all_boards_3 = AllBoards(all_boards_2)
footings_3 = Footings(footings_2)
benches_3 = Benches(benches_2)
model_parts = Merge(Data1=all_boards_3, Data2=edge_beams_3, Data3=footings_3, Data4=benches_3)
lng = ListLength(List=set_a_cut_lengths_4)
lng_2 = ListLength(List=set_b_cut_lengths_4)
model = GeometryToFile(Geometry=flatten(model_parts), LayerNames="Pavilion", FileNames="lamella-pavilion", FileEnding=".3dm")
set_a_numbers = Series(Start=1, Step=1, Count=lng)
multiplication_3 = Multiplication(A=lamella_width, B=10)
multiplication_4 = Multiplication(A=lamella_depth, B=10)
set_b_numbers = Series(Start=1, Step=1, Count=lng_2)
multiplication_5 = Multiplication(A=lamella_width, B=10)
multiplication_6 = Multiplication(A=lamella_depth, B=10)
set_a_rows = Format(
    Format="A{0:00},A,{1:0.000},{2:0},{3:0}",
    Culture=127,
    Data0=set_a_numbers,
    Data1=set_a_cut_lengths_4,
    Data2=multiplication_3,
    Data3=multiplication_4)
set_b_rows = Format(
    Format="B{0:00},B,{1:0.000},{2:0},{3:0}",
    Culture=127,
    Data0=set_b_numbers,
    Data1=set_b_cut_lengths_4,
    Data2=multiplication_5,
    Data3=multiplication_6)
csv_rows = Merge(Data1=set_a_rows, Data2=set_b_rows)
csv_lines = Merge(Data1=csv_header_2, Data2=csv_rows)
cut_list = CreateFile(Data=flatten(csv_lines), Name="lamella-cut-list", Extension=".csv", IsBase64=False)

# ---- group: Quantities
# QUANTITIES AND CHECKS
# Timber volume, stored carbon (0.9 t CO₂e per m³ of timber) and a rough cost. Warns when the shell is shallow or a lamella is too long to transport.
shaping_the_shell_5 = ShapingTheShell(shaping_the_shell_2)
depth_m_4 = DepthM(depth_m_2)
width_m_5 = WidthM(width_m_2)
all_lengths_3 = AllLengths(all_lengths_2)
section_area = Multiplication(A=depth_m_4, B=width_m_5)
total_length = MassAddition(Input=all_lengths_3)  # -> Result, PartialResults
lamella_count = ListLength(List=all_lengths_3)
sorted_lengths = SortList(Keys=all_lengths_3)  # -> Keys, ValuesA
shell_area = Area(Geometry=shaping_the_shell_5)  # -> Area, Centroid
rise_over_depth = Evaluate(E=x_y, x=height, y=depth)
layout = Layout(Title="Lamella lengths (m)", Width=0, Height=0)
length_histogram = Histogram(X=all_lengths_3, Bins=12, Color=length_histogram_color, Norm=0)
timber_volume = Multiplication(A=total_length.Result, B=section_area)
format_0_0 = Format(Format="{0:0}", Culture=127, Data0=total_length.Result)
longest_lamella = ListItem(List=sorted_lengths.Keys, Index=-1, Wrap=True)
format_0_0_2 = Format(Format="{0:0}", Culture=127, Data0=shell_area.Area)
deep_enough = LargerThan(FirstNumber=rise_over_depth, SecondNumber=0.25)  # -> LargerThan, OrEqualTo
lengths_chart = Figure(Traces=length_histogram, Layout=layout, ExportFormat="png")
stored_carbon = Evaluate(E=x_0_9, x=timber_volume)
cost_estimate = Evaluate(E=x_2400_y_140, x=timber_volume, y=shell_area.Area)
format_0_0_0 = Format(Format="{0:0.0}", Culture=127, Data0=timber_volume)
format_0_0_00 = Format(Format="{0:0.00}", Culture=127, Data0=longest_lamella)
transportable = SmallerThan(FirstNumber=longest_lamella, SecondNumber=24)  # -> SmallerThan, OrEqualTo
shallow_shell = Message(
    Condition=deep_enough.LargerThan,
    Message="Shallow shell: raise the height or reduce the depth, or the lamellas need a deeper section.",
    Level=1,
    Notify=1)
format_0_0_0_2 = Format(Format="{0:0.0}", Culture=127, Data0=stored_carbon)
format_0_0_3 = Format(Format="{0:#,0}", Culture=127, Data0=cost_estimate)
lamella_too_long = Message(
    Condition=transportable.SmallerThan,
    Message="A lamella is longer than 24 m, past what a glulam truck carries: lower the span or plan a splice.",
    Level=1,
    Notify=1)

# ---- group: Plan
# PLAN
# Lamella centre lines, edge beams, footings, benches and lamps, the square, and the section line A–A.
plan_length_mm_3 = PlanLengthMm(plan_length_mm_2)
all_lamella_lines_3 = AllLamellaLines(all_lamella_lines_2)
bench_outlines_3 = BenchOutlines(bench_outlines_2)
free_edges_3 = FreeEdges(free_edges_2)
section_tag_3 = SectionTag(section_tag_2)
section_line_3 = SectionLine(section_line_2)
half_depth_3 = HalfDepth(half_depth_2)
concrete_3 = Concrete(concrete_2)
half_span_3 = HalfSpan(half_span_2)
medium_3 = Medium(medium_2)
thin_3 = Thin(thin_2)
heavy_3 = Heavy(heavy_2)
lamps_3 = Lamps(lamps_2)
corners_3 = Corners(corners_2)
scale_1_3 = Scale1(scale_1_2)
footing_circles = Circle(Plane=flatten(corners_3), Radius=0.35)
square_half_width_2 = Evaluate(E=x_2_5, x=half_depth_3)
square_half_length_2 = Evaluate(E=x_2_5_2, x=half_span_3)
section_line_end = Evaluate(E=x_1_5, x=half_span_3)
neg_6 = Negative(Value=square_half_width_2)
neg_7 = Negative(Value=square_half_length_2)
tag_x = Evaluate(E=x_0_9_2, x=half_span_3)
neg_8 = Negative(Value=section_line_end)
span_dimension_mm = Evaluate(E=x_1000, x=span)
depth_dimension_mm = Evaluate(E=x_1000_2, x=depth)
dom_3 = ConstructDomain(DomainStart=neg_6, DomainEnd=square_half_width_2)
dom_4 = ConstructDomain(DomainStart=neg_7, DomainEnd=square_half_length_2)
xy = XYPlane(Origin=Point(0, 0, 0))
neg_9 = Negative(Value=tag_x)
cut_start = ConstructPoint(XCoordinate=neg_8, YCoordinate=0, ZCoordinate=0)
cut_end = ConstructPoint(XCoordinate=section_line_end, YCoordinate=0, ZCoordinate=0)
neg_10 = Negative(Value=half_depth_3)
neg_11 = Negative(Value=half_depth_3)
neg_12 = Negative(Value=half_depth_3)
neg_13 = Negative(Value=half_span_3)
format = Format(Format="{0:0}", Culture=127, Data0=span_dimension_mm)
format_2 = Format(Format="{0:0}", Culture=127, Data0=depth_dimension_mm)
square_outline = Rectangle(Plane=xy, XSize=dom_4, YSize=dom_3, Radius=0)  # -> Rectangle, Length
tag_left = ConstructPoint(XCoordinate=neg_9, YCoordinate=0.5, ZCoordinate=0)
tag_right = ConstructPoint(XCoordinate=tag_x, YCoordinate=0.5, ZCoordinate=0)
section_line_4 = Line(StartPoint=cut_start, EndPoint=cut_end)
dimension_offset_mm = Evaluate(E=_2_5_1000_x_8, x=scale_1_3)
sw_corner = ConstructPoint(XCoordinate=neg_13, YCoordinate=neg_10, ZCoordinate=0)
se_corner = ConstructPoint(XCoordinate=half_span_3, YCoordinate=neg_11, ZCoordinate=0)
se_corner_2 = ConstructPoint(XCoordinate=half_span_3, YCoordinate=neg_12, ZCoordinate=0)
ne_corner = ConstructPoint(XCoordinate=half_span_3, YCoordinate=half_depth_3, ZCoordinate=0)
lamp_circles = Circle(Plane=lamps_3, Radius=0.17)
tag_a_right = DrawText(Text="A", Position=tag_right, Style=section_tag_2, Rotation=0, Padding=1, Radius=0)
span_dimension = LinearDimension(PointA=sw_corner, PointB=se_corner, Offset=dimension_offset_mm, Label=format)
draw_square = DrawCurve(Curve=square_outline.Rectangle, Style=medium_3)
depth_dimension = LinearDimension(PointA=se_corner_2, PointB=ne_corner, Offset=dimension_offset_mm, Label=format_2)
tag_a_left = DrawText(Text="A", Position=tag_left, Style=section_tag_3, Rotation=0, Padding=1, Radius=0)
draw_section_line = DrawCurve(Curve=section_line_4, Style=section_line_3)
draw_lamellas = DrawCurve(Curve=all_lamella_lines_3, Style=thin_3)
draw_edge_beams = DrawCurve(Curve=free_edges_3, Style=heavy_3)
draw_footings = DrawCurve(Curve=footing_circles, Style=concrete_3)
draw_benches = DrawCurve(Curve=bench_outlines_3, Style=medium_2)
draw_lamps = DrawCurve(Curve=lamp_circles, Style=thin_2)
plan_view_drawings = Merge(
    Data1=draw_square,
    Data2=draw_lamellas,
    Data3=draw_edge_beams,
    Data4=draw_footings,
    Data5=draw_benches,
    Data6=draw_lamps,
    Data7=draw_section_line,
    Data8=tag_a_left,
    Data9=tag_a_right,
    Data10=span_dimension,
    Data11=depth_dimension)
plan_view = DrawingView(Drawings=flatten(plan_view_drawings), Length=plan_length_mm_3, Padding=4, ScaleCaption=False, Units=1)  # -> Drawings, Scale

# ---- group: 3D view
# 3D VIEW
# One Display per part, each on its own layer. The glass roof is always there: switched off it takes an invisible material. Glass keeps its reflections at any opacity, so an opacity of 0 would still show it.
edge_beams_4 = EdgeBeams(edge_beams_2)
all_boards_4 = AllBoards(all_boards_2)
glass_roof_4 = GlassRoof(glass_roof_3)
square_3 = Square(square_2)
bulbs_3 = Bulbs(bulbs_2)
benches_4 = Benches(benches_2)
footings_4 = Footings(footings_2)
cords_3 = Cords(cords_2)
mpre = MaterialPreset(Preset=7)
timber_name = Text(timber)
paving_name = Text(paving)
charred = ThreeMaterial(Color=charred_color, Roughness=0.85, Base=mpre)
paving_index = MemberIndex(Set=paving_index_options_2, Member=paving_name)  # -> Index, Count
larch = MaterialPreset(Preset=7)
walnut = MaterialPreset(Preset=12)
invisible = ThreeMaterial(Opacity=0, Transparent=True)
glass_preset = MaterialPreset(Preset=9)
timber_index = MemberIndex(Set=timber_index_options_2, Member=timber_name)  # -> Index, Count
glass_shown = Evaluate(E=if_x_1_0, x=glass_roof)
paving_preset = ListItem(List=paving_preset_table_2, Index=paving_index.Index, Wrap=True)
timbers = Merge(Data1=larch, Data2=walnut, Data3=charred)
lamp_strength = Evaluate(E=if_x_6_0, x=evening_lights)
glass_choices = Merge(Data1=invisible, Data2=glass_preset)
timber_2 = ListItem(List=timbers, Index=timber_index.Index, Wrap=True)
paving_2 = MaterialPreset(Preset=paving_preset)
lamp_light = EmissiveMaterial(Color=lamp_light_color, Strength=lamp_strength)
glass = ListItem(List=glass_choices, Index=glass_shown, Wrap=True)
beam_finish = ThreeMaterial(Color=edge_beam_colour, Metalness=0.6, Roughness=0.35)
concrete_4 = MaterialPreset(Preset=8)
cord_2 = MaterialPreset(Preset=6)
edge_beams_5 = Display(Geo=flatten(edge_beams_4), Name="Edge beams", Layer="Structure/Edge beams", Material=beam_finish)
cords_4 = Display(Geo=flatten(cords_3), Name="Cords", Layer="Lighting/Cords", Material=cord_2)
square_4 = Display(Geo=square_3, Name="Square", Layer="Site/Square", Material=paving_2)
lamellas = Display(Geo=all_boards_4, Name="Lamellas", Layer="Shell/Lamellas", Material=timber_2)
lamps_4 = Display(Geo=bulbs_3, Name="Lamps", Layer="Lighting/Lamps", Material=lamp_light)
benches_5 = Display(Geo=benches_4, Name="Benches", Layer="Site/Benches", Material=timber_2)
glass_roof_5 = Display(Geo=glass_roof_4, Name="Glass roof", Layer="Shell/Glass", Material=glass)
footings_5 = Display(Geo=footings_4, Name="Footings", Layer="Structure/Footings", Material=concrete_4)
pavilion = CombineDisplay(WebDisplay=[lamellas, glass_roof_5, edge_beams_5, footings_5, square_4, benches_5, lamps_4, cords_4])

# ---- group: Quantities / Outputs
c_bake_2 = ContextBake(LamellaLengths=lengths_chart)
c_print = ContextPrint(StoredCarbonTCO₂e=format_0_0_0_2)
c_print_2 = ContextPrint(CostEstimateEUR=format_0_0_3)
c_print_3 = ContextPrint(TimberVolumeM³=format_0_0_0)
c_print_4 = ContextPrint(LamellaLengthM=format_0_0)
total_length_2 = TotalLength(total_length.Result)
c_print_5 = ContextPrint(Lamellas=lamella_count)
lamella_count_2 = LamellaCount(lamella_count)
c_print_6 = ContextPrint(LongestLamellaM=format_0_0_00)
c_print_7 = ContextPrint(ShellAreaM²=format_0_0_2)

# ---- group: Downloads / Outputs
c_bake_3 = ContextBake(CutListCSV=cut_list)
c_bake_4 = ContextBake(Model3DM=model)

# ---- group: 3D view / Outputs
timber_name_2 = TimberName(timber_name)
c_bake_5 = ContextBake(Pavilion=pavilion)

# ---- group: Plan / Outputs
square_half_width_3 = SquareHalfWidth(square_half_width_2)
square_outline_2 = SquareOutline(square_outline.Rectangle)
square_half_length_3 = SquareHalfLength(square_half_length_2)
plan_view_drawings_2 = PlanViewDrawings(plan_view.Drawings)
footing_circles_2 = FootingCircles(footing_circles)

# ---- group: Section A–A / Inputs
x_1000_3 = X1000("x*1000")
x_1 = X1("x+1")

# ---- group: Sheet 2 / Inputs
set_a_tags_background = SetATagsBackground(ColourSwatch(SwatchColor=RGB(255, 255, 255)))
set_b_tags_background = SetBTagsBackground(ColourSwatch(SwatchColor=RGB(255, 255, 255)))
x_y_10000 = XY10000("x*y/10000")
x_y_10000_2 = XY10000("x*y/10000")
x_y_2 = XY("x*y")
x_y_3 = XY("x*y")

# ---- group: Section A–A
# SECTION A–A
# Cut through the boards on y = 0 (black), with the lamellas, beams, benches and lamps beyond it.
section_length_mm_3 = SectionLengthMm(section_length_mm_2)
square_half_length_4 = SquareHalfLength(square_half_length_3)
bench_half_length_3 = BenchHalfLength(bench_half_length_2)
all_lamella_lines_4 = AllLamellaLines(all_lamella_lines_2)
hanging_points_3 = HangingPoints(hanging_points_2)
ground_hatch_3 = GroundHatch(ground_hatch_2)
set_a_boards_4 = SetABoards(set_a_boards_2)
free_edges_4 = FreeEdges(free_edges_2)
set_b_boards_4 = SetBBoards(set_b_boards_2)
half_span_4 = HalfSpan(half_span_2)
hairline_3 = Hairline(hairline_2)
lamps_5 = Lamps(lamps_2)
cut_3 = Cut(cut_2)
midpt = CurveMiddle(Curve=all_lamella_lines_4)
midpt_2 = CurveMiddle(Curve=free_edges_4)
lamp_coordinates = Deconstruct(Point=lamps_5)  # -> XComponent, YComponent, ZComponent
sheet_plane = XYPlane(Origin=Point(0, 0, 0))
lamellas_beyond_midpoints = Deconstruct(Point=midpt)  # -> XComponent, YComponent, ZComponent
edges_beyond_midpoints = Deconstruct(Point=midpt_2)  # -> XComponent, YComponent, ZComponent
larger_3 = LargerThan(FirstNumber=lamp_coordinates.YComponent, SecondNumber=0)  # -> LargerThan, OrEqualTo
larger_4 = LargerThan(FirstNumber=lamp_coordinates.YComponent, SecondNumber=0)  # -> LargerThan, OrEqualTo
neg_14 = Negative(Value=half_span_4)
larger_5 = LargerThan(FirstNumber=lamellas_beyond_midpoints.YComponent, SecondNumber=-0.05)  # -> LargerThan, OrEqualTo
larger_6 = LargerThan(FirstNumber=edges_beyond_midpoints.YComponent, SecondNumber=-0.05)  # -> LargerThan, OrEqualTo
footing_x = Merge(Data1=neg_14, Data2=half_span_4)
hangs_beyond = Dispatch(List=hanging_points_3, DispatchPattern=larger_3.LargerThan)  # -> ListA, ListB
lamps_beyond = Dispatch(List=lamps_5, DispatchPattern=larger_4.LargerThan)  # -> ListA, ListB
section_plane = XZPlane(Origin=Point(0, 0, 0))
neg_15 = Negative(Value=square_half_length_4)
neg_16 = Negative(Value=square_half_length_4)
neg_17 = Negative(Value=bench_half_length_3)
cut_set_a = BrepPlane(Brep=flatten(set_a_boards_4), Plane=section_plane)  # -> Curves, Points
cut_set_b = BrepPlane(Brep=flatten(set_b_boards_4), Plane=section_plane)  # -> Curves, Points
xy_2 = XYPlane(Origin=Point(0, 0, 0))
height_dimension_mm = Evaluate(E=x_1000_3, x=height)
level_x = Evaluate(E=x_1, x=half_span_4)
dom_5 = ConstructDomain(DomainStart=neg_15, DomainEnd=square_half_length_4)
dom_6 = ConstructDomain(DomainStart=-0.2, DomainEnd=0)
ground_west = ConstructPoint(XCoordinate=neg_16, YCoordinate=0, ZCoordinate=0)
ground_east = ConstructPoint(XCoordinate=square_half_length_4, YCoordinate=0, ZCoordinate=0)
lamellas_beyond = Dispatch(List=all_lamella_lines_4, DispatchPattern=larger_5.LargerThan)  # -> ListA, ListB
edges_beyond = Dispatch(List=free_edges_4, DispatchPattern=larger_6.LargerThan)  # -> ListA, ListB
dom_7 = ConstructDomain(DomainStart=neg_17, DomainEnd=bench_half_length_3)
dom_8 = ConstructDomain(DomainStart=0, DomainEnd=0.45)
footing_feet = ConstructPoint(XCoordinate=footing_x, YCoordinate=0, ZCoordinate=0)
dom_9 = ConstructDomain(DomainStart=-0.35, DomainEnd=0.35)
dom_10 = ConstructDomain(DomainStart=0, DomainEnd=0.45)
xy_3 = XYPlane(Origin=Point(0, 0, 0))
hangs_in_section = Orient(Geometry=hangs_beyond.ListA, Source=section_plane, Target=sheet_plane)  # -> Geometry, Transform
lamps_in_section = Orient(Geometry=lamps_beyond.ListA, Source=section_plane, Target=sheet_plane)  # -> Geometry, Transform
lamps_in_section_2 = Orient(Geometry=lamps_beyond.ListA, Source=section_plane, Target=sheet_plane)  # -> Geometry, Transform
format_3 = Format(Format="{0:0}", Culture=127, Data0=height_dimension_mm)
level_0 = ConstructPoint(XCoordinate=level_x, YCoordinate=0, ZCoordinate=0)
level_crown = ConstructPoint(XCoordinate=level_x, YCoordinate=height, ZCoordinate=0)
section_slab = Rectangle(Plane=xy_2, XSize=dom_5, YSize=dom_6, Radius=0)  # -> Rectangle, Length
section_ground = Line(StartPoint=ground_west, EndPoint=ground_east)
section_bench = Rectangle(Plane=xy_3, XSize=dom_7, YSize=dom_8, Radius=0)  # -> Rectangle, Length
section_footings = Rectangle(Plane=footing_feet, XSize=dom_9, YSize=dom_10, Radius=0)  # -> Rectangle, Length
lamellas_in_section = Orient(Geometry=lamellas_beyond.ListA, Source=section_plane, Target=sheet_plane)  # -> Geometry, Transform
edges_in_section = Orient(Geometry=edges_beyond.ListA, Source=section_plane, Target=sheet_plane)  # -> Geometry, Transform
section_cords = Line(StartPoint=hangs_in_section.Geometry, EndPoint=lamps_in_section.Geometry)
section_lamp_circles = Circle(Plane=lamps_in_section_2.Geometry, Radius=0.17)
set_a_cut = Orient(Geometry=cut_set_a.Curves, Source=section_plane, Target=sheet_plane)  # -> Geometry, Transform
set_b_cut = Orient(Geometry=cut_set_b.Curves, Source=section_plane, Target=sheet_plane)  # -> Geometry, Transform
height_dimension = LinearDimension(PointA=level_0, PointB=level_crown, Offset=-4, Label=format_3)
draw_slab = DrawCurve(Curve=section_slab.Rectangle, Style=ground_hatch_3)
draw_ground = DrawCurve(Curve=section_ground, Style=heavy_2)
draw_lamellas_beyond = DrawCurve(Curve=lamellas_in_section.Geometry, Style=hairline_3)
draw_section_bench = DrawCurve(Curve=section_bench.Rectangle, Style=medium_2)
draw_section_footings = DrawCurve(Curve=section_footings.Rectangle, Style=concrete_2)
draw_beams_beyond = DrawCurve(Curve=edges_in_section.Geometry, Style=medium_2)
draw_cords = DrawCurve(Curve=section_cords, Style=thin_2)
draw_section_lamps = DrawCurve(Curve=section_lamp_circles, Style=thin_2)
draw_cut_a = DrawCurve(Curve=set_a_cut.Geometry, Style=cut_3)
draw_cut_b = DrawCurve(Curve=set_b_cut.Geometry, Style=cut_2)
section_view_drawings = Merge(
    Data1=draw_slab,
    Data2=draw_ground,
    Data3=draw_lamellas_beyond,
    Data4=draw_beams_beyond,
    Data5=draw_section_footings,
    Data6=draw_section_bench,
    Data7=draw_cords,
    Data8=draw_section_lamps,
    Data9=draw_cut_a,
    Data10=draw_cut_b,
    Data11=height_dimension)
section_view = DrawingView(Drawings=flatten(section_view_drawings), Length=section_length_mm_3, Padding=4, ScaleCaption=False, Units=1)  # -> Drawings, Scale

# ---- group: Sheet 2
# SHEET 2: LAMELLA SCHEDULE
# Every lamella numbered on a key plan, and its length and volume in a table per set. Numbers match the cut list.
set_a_cut_lengths_5 = SetACutLengths(set_a_cut_lengths_2)
plan_length_mm_4 = PlanLengthMm(plan_length_mm_2)
set_b_cut_lengths_5 = SetBCutLengths(set_b_cut_lengths_2)
lamella_number_3 = LamellaNumber(lamella_number_2)
all_lamella_lines_5 = AllLamellaLines(all_lamella_lines_2)
square_outline_3 = SquareOutline(square_outline_2)
set_a_trimmed_4 = SetATrimmed(set_a_trimmed_2)
set_b_trimmed_4 = SetBTrimmed(set_b_trimmed_2)
free_edges_5 = FreeEdges(free_edges_2)
scale_text_3 = ScaleText(scale_text_2)
section_m² = Evaluate(E=x_y_10000, x=lamella_width, y=lamella_depth)
section_m²_2 = Evaluate(E=x_y_10000_2, x=lamella_width, y=lamella_depth)
lng_3 = ListLength(List=set_a_cut_lengths_5)
lng_4 = ListLength(List=set_b_cut_lengths_5)
set_a_volumes = Evaluate(E=x_y_2, x=set_a_cut_lengths_5, y=section_m²)
set_b_volumes = Evaluate(E=x_y_3, x=set_b_cut_lengths_5, y=section_m²_2)
series = Series(Start=1, Step=1, Count=lng_3)
series_2 = Series(Start=1, Step=1, Count=lng_4)
set_a_volume_text = Format(Format="{0:0.000}", Culture=127, Data0=set_a_volumes)
set_b_volume_text = Format(Format="{0:0.000}", Culture=127, Data0=set_b_volumes)
set_a_numbers_2 = Format(Format="A{0:00}", Culture=127, Data0=series)
set_a_length_text = Format(Format="{0:0.000}", Culture=127, Data0=set_a_cut_lengths_5)
set_b_numbers_2 = Format(Format="B{0:00}", Culture=127, Data0=series_2)
set_b_length_text = Format(Format="{0:0.000}", Culture=127, Data0=set_b_cut_lengths_5)
midpt_3 = CurveMiddle(Curve=set_a_trimmed_4)
midpt_4 = CurveMiddle(Curve=set_b_trimmed_4)
set_b_tags = DrawText(
    Text=set_b_numbers_2,
    Position=midpt_4,
    Style=lamella_number_2,
    Rotation=-45,
    Background=set_b_tags_background,
    Padding=0.3,
    Radius=0)
set_a_columns = Entwine(Branch00=set_a_numbers_2, Branch01=set_a_length_text, Branch02=set_a_volume_text, FlattenInputs=True)
set_a_tags = DrawText(
    Text=set_a_numbers_2,
    Position=midpt_3,
    Style=lamella_number_3,
    Rotation=45,
    Background=set_a_tags_background,
    Padding=0.3,
    Radius=0)
set_b_columns = Entwine(Branch00=set_b_numbers_2, Branch01=set_b_length_text, Branch02=set_b_volume_text, FlattenInputs=True)
key_square = DrawCurve(Curve=square_outline_3, Style=medium_2)
key_lamellas = DrawCurve(Curve=all_lamella_lines_5, Style=hairline_2)
key_edges = DrawCurve(Curve=free_edges_5, Style=medium_2)
title_strip = TitleBlock(
    Variant=1,
    Project="Selva showcase",
    Title="Timber lamella pavilion: lamella schedule",
    DrawingNo="LP-101",
    Revision="A",
    Scale=scale_text_3,
    Sheet="{page}/{pages}",
    Date="{date:dd.MM.yyyy}",
    Width=190)
set_a_rows_2 = FlipMatrix(Data=set_a_columns)
set_b_rows_2 = FlipMatrix(Data=set_b_columns)
key_plan_view_drawings = Merge(Data1=key_square, Data2=key_lamellas, Data3=key_edges, Data4=set_a_tags, Data5=set_b_tags)
format_4 = Format(Format="KEY PLAN   {0}", Culture=127, Data0=scale_text_3)
key_plan_anchor = ConstructPoint(XCoordinate=0, YCoordinate=0, ZCoordinate=0)
set_a_anchor = ConstructPoint(XCoordinate=0, YCoordinate=0, ZCoordinate=0)
set_b_anchor = ConstructPoint(XCoordinate=0, YCoordinate=0, ZCoordinate=0)
key_plan_view = DrawingView(Drawings=flatten(key_plan_view_drawings), Length=plan_length_mm_4, Padding=4, ScaleCaption=False, Units=1)  # -> Drawings, Scale
set_a_schedule = Table(
    Headers=["Lamella", "Length (m)", "Volume (m³)"],
    Rows=set_a_rows_2,
    ColumnWidths=[18, 24, 24],
    RowHeight=4.2,
    DefaultStyle=note_text_2,
    ColumnAlign=["l", "r", "r"],
    BorderStyle=1)
set_b_schedule = Table(
    Headers=["Lamella", "Length (m)", "Volume (m³)"],
    Rows=set_b_rows_2,
    ColumnWidths=[18, 24, 24],
    RowHeight=4.2,
    DefaultStyle=note_text_2,
    ColumnAlign=["l", "r", "r"],
    BorderStyle=1)
sheet_2_footer_parts = Merge(Data1=flatten(title_strip))
key_plan = DrawText(Text=format_4, Position=key_plan_anchor, Style=view_title_2, Rotation=0, Padding=1, Radius=0)
set_a_2 = DrawText(Text="SET A", Position=set_a_anchor, Style=view_title_2, Rotation=0, Padding=1, Radius=0)
set_b_2 = DrawText(Text="SET B", Position=set_b_anchor, Style=view_title_2, Rotation=0, Padding=1, Radius=0)
sheet_2_footer = Stack(Drawings=sheet_2_footer_parts, Orientation=1, Spacing=12, CrossAlign=2)
sheet_2_layout_cells = Merge(
    Data1=flatten(key_plan),
    Data2=flatten(set_a_2),
    Data3=flatten(set_b_2),
    Data4=flatten(key_plan_view.Drawings),
    Data5=flatten(set_a_schedule),
    Data6=flatten(set_b_schedule))
sheet_2_layout = Grid(
    ColumnWidths=[0, 0, 0],
    Drawings=flatten(sheet_2_layout_cells),
    AtRow=[0, 0, 0, 1, 1, 1],
    AtColumn=[0, 1, 2, 0, 1, 2],
    ColumnSpacing=20,
    RowSpacing=5,
    Columns=0)
sheet_2_footer_override = LayoutOverride(Footer=sheet_2_footer, FooterAlign=2, FooterPlacement=1, Units=1)
sheet_2 = Page(
    Drawings=sheet_2_layout,
    Title="Lamella schedule",
    Override=sheet_2_footer_override,
    KeepTogether=True,
    Arrange=0,
    Spacing=5)

# ---- group: Section A–A / Outputs
section_view_drawings_2 = SectionViewDrawings(section_view.Drawings)
sheet_plane_2 = SheetPlane(sheet_plane)

# ---- group: Sheet 2 / Outputs
sheet_2_2 = Sheet2(sheet_2)

# ---- group: East elevation / Inputs
x_1000_4 = X1000("x*1000")
x_1_3 = X1("x+1")

# ---- group: Axonometric
# AXONOMETRIC
# The model seen from the south-east and above: the view plane's x runs (1, 1, 0) and its y (-1, 1, 2).
axo_length_mm_3 = AxoLengthMm(axo_length_mm_2)
square_outline_4 = SquareOutline(square_outline_2)
all_lamella_lines_6 = AllLamellaLines(all_lamella_lines_2)
footing_circles_3 = FootingCircles(footing_circles_2)
bench_outlines_4 = BenchOutlines(bench_outlines_2)
sheet_plane_3 = SheetPlane(sheet_plane_2)
depth_m_5 = DepthM(depth_m_2)
free_edges_6 = FreeEdges(free_edges_2)
neg_18 = Negative(Value=depth_m_5)
Z_4 = UnitZ(Factor=neg_18)
axo_origin = ConstructPoint(XCoordinate=0, YCoordinate=0, ZCoordinate=0)
vec = VectorXYZ(XComponent=1, YComponent=1, ZComponent=0)  # -> Vector, Length
vec_2 = VectorXYZ(XComponent=-1, YComponent=1, ZComponent=2)  # -> Vector, Length
lamella_undersides = Move(Geometry=all_lamella_lines_6, Motion=Z_4)  # -> Geometry, Transform
axo_plane = ConstructPlane(Origin=axo_origin, XAxis=vec.Vector, YAxis=vec_2.Vector)
square_in_axo = Orient(Geometry=square_outline_4, Source=axo_plane, Target=sheet_plane_3)  # -> Geometry, Transform
undersides_in_axo = Orient(Geometry=lamella_undersides.Geometry, Source=axo_plane, Target=sheet_plane_3)  # -> Geometry, Transform
lamellas_in_axo = Orient(Geometry=all_lamella_lines_6, Source=axo_plane, Target=sheet_plane_3)  # -> Geometry, Transform
edges_in_axo = Orient(Geometry=free_edges_6, Source=axo_plane, Target=sheet_plane_3)  # -> Geometry, Transform
footings_in_axo = Orient(Geometry=footing_circles_3, Source=axo_plane, Target=sheet_plane_3)  # -> Geometry, Transform
benches_in_axo = Orient(Geometry=bench_outlines_4, Source=axo_plane, Target=sheet_plane_3)  # -> Geometry, Transform
draw_axo_square = DrawCurve(Curve=square_in_axo.Geometry, Style=medium_2)
draw_axo_undersides = DrawCurve(Curve=undersides_in_axo.Geometry, Style=hairline_2)
draw_axo_lamellas = DrawCurve(Curve=lamellas_in_axo.Geometry, Style=thin_2)
draw_axo_beams = DrawCurve(Curve=edges_in_axo.Geometry, Style=heavy_2)
draw_axo_footings = DrawCurve(Curve=footings_in_axo.Geometry, Style=medium_2)
draw_axo_benches = DrawCurve(Curve=benches_in_axo.Geometry, Style=thin_2)
axo_view_drawings = Merge(
    Data1=draw_axo_square,
    Data2=draw_axo_undersides,
    Data3=draw_axo_lamellas,
    Data4=draw_axo_beams,
    Data5=draw_axo_footings,
    Data6=draw_axo_benches)
axo_view = DrawingView(Drawings=flatten(axo_view_drawings), Length=axo_length_mm_3, Padding=4, ScaleCaption=False, Units=1)  # -> Drawings, Scale

# ---- group: East elevation
# EAST ELEVATION
# The whole shell seen from the east: its end arch, every lamella behind it, footings, benches and lamps.
square_half_width_4 = SquareHalfWidth(square_half_width_3)
all_lamella_lines_7 = AllLamellaLines(all_lamella_lines_2)
hanging_points_4 = HangingPoints(hanging_points_2)
end_length_mm_3 = EndLengthMm(end_length_mm_2)
free_edges_7 = FreeEdges(free_edges_2)
bench_offset_3 = BenchOffset(bench_offset_2)
sheet_plane_4 = SheetPlane(sheet_plane_2)
half_depth_4 = HalfDepth(half_depth_2)
lamps_6 = Lamps(lamps_2)
neg_19 = Negative(Value=half_depth_4)
neg_20 = Negative(Value=bench_offset_3)
footing_y = Merge(Data1=neg_19, Data2=half_depth_4)
bench_y = Merge(Data1=neg_20, Data2=bench_offset_3)
elevation_plane = YZPlane(Origin=Point(0, 0, 0))
neg_21 = Negative(Value=square_half_width_4)
neg_22 = Negative(Value=square_half_width_4)
xy_4 = XYPlane(Origin=Point(0, 0, 0))
end_height_dimension_mm = Evaluate(E=x_1000_4, x=height)
level_y = Evaluate(E=x_1_3, x=half_depth_4)
dom_11 = ConstructDomain(DomainStart=neg_21, DomainEnd=square_half_width_4)
dom_12 = ConstructDomain(DomainStart=-0.2, DomainEnd=0)
ground_south = ConstructPoint(XCoordinate=neg_22, YCoordinate=0, ZCoordinate=0)
ground_north = ConstructPoint(XCoordinate=square_half_width_4, YCoordinate=0, ZCoordinate=0)
footing_feet_y = ConstructPoint(XCoordinate=footing_y, YCoordinate=0, ZCoordinate=0)
dom_13 = ConstructDomain(DomainStart=-0.35, DomainEnd=0.35)
dom_14 = ConstructDomain(DomainStart=0, DomainEnd=0.45)
bench_feet = ConstructPoint(XCoordinate=bench_y, YCoordinate=0, ZCoordinate=0)
dom_15 = ConstructDomain(DomainStart=-0.25, DomainEnd=0.25)
dom_16 = ConstructDomain(DomainStart=0, DomainEnd=0.45)
hangs_in_elevation = Orient(Geometry=hanging_points_4, Source=elevation_plane, Target=sheet_plane_4)  # -> Geometry, Transform
lamps_in_elevation = Orient(Geometry=lamps_6, Source=elevation_plane, Target=sheet_plane_4)  # -> Geometry, Transform
lamps_in_elevation_2 = Orient(Geometry=lamps_6, Source=elevation_plane, Target=sheet_plane_4)  # -> Geometry, Transform
format_5 = Format(Format="{0:0}", Culture=127, Data0=end_height_dimension_mm)
end_level_0 = ConstructPoint(XCoordinate=level_y, YCoordinate=0, ZCoordinate=0)
end_level_crown = ConstructPoint(XCoordinate=level_y, YCoordinate=height, ZCoordinate=0)
elevation_slab = Rectangle(Plane=xy_4, XSize=dom_11, YSize=dom_12, Radius=0)  # -> Rectangle, Length
elevation_ground = Line(StartPoint=ground_south, EndPoint=ground_north)
elevation_footings = Rectangle(Plane=footing_feet_y, XSize=dom_13, YSize=dom_14, Radius=0)  # -> Rectangle, Length
elevation_benches = Rectangle(Plane=bench_feet, XSize=dom_15, YSize=dom_16, Radius=0)  # -> Rectangle, Length
lamellas_in_elevation = Orient(Geometry=all_lamella_lines_7, Source=elevation_plane, Target=sheet_plane_4)  # -> Geometry, Transform
edges_in_elevation = Orient(Geometry=free_edges_7, Source=elevation_plane, Target=sheet_plane_4)  # -> Geometry, Transform
elevation_cords = Line(StartPoint=hangs_in_elevation.Geometry, EndPoint=lamps_in_elevation.Geometry)
elevation_lamp_circles = Circle(Plane=lamps_in_elevation_2.Geometry, Radius=0.17)
end_height_dimension = LinearDimension(PointA=end_level_0, PointB=end_level_crown, Offset=-4, Label=format_5)
draw_elevation_slab = DrawCurve(Curve=elevation_slab.Rectangle, Style=ground_hatch_2)
draw_elevation_ground = DrawCurve(Curve=elevation_ground, Style=heavy_2)
draw_elevation_footings = DrawCurve(Curve=elevation_footings.Rectangle, Style=concrete_2)
draw_elevation_benches = DrawCurve(Curve=elevation_benches.Rectangle, Style=medium_2)
draw_elevation_lamellas = DrawCurve(Curve=lamellas_in_elevation.Geometry, Style=thin_2)
draw_elevation_beams = DrawCurve(Curve=edges_in_elevation.Geometry, Style=heavy_2)
draw_elevation_cords = DrawCurve(Curve=elevation_cords, Style=thin_2)
draw_elevation_lamps = DrawCurve(Curve=elevation_lamp_circles, Style=thin_2)
elevation_view_drawings = Merge(
    Data1=draw_elevation_slab,
    Data2=draw_elevation_ground,
    Data3=draw_elevation_lamellas,
    Data4=draw_elevation_beams,
    Data5=draw_elevation_footings,
    Data6=draw_elevation_benches,
    Data7=draw_elevation_cords,
    Data8=draw_elevation_lamps,
    Data9=end_height_dimension)
elevation_view = DrawingView(Drawings=flatten(elevation_view_drawings), Length=end_length_mm_3, Padding=4, ScaleCaption=False, Units=1)  # -> Drawings, Scale

# ---- group: Axonometric / Outputs
axo_view_drawings_2 = AxoViewDrawings(axo_view.Drawings)

# ---- group: East elevation / Outputs
elevation_view_drawings_2 = ElevationViewDrawings(elevation_view.Drawings)

# ---- group: Sheet 1 / Inputs
x_2000 = X2000("x*2000")

# ---- group: Sheet 1
# SHEET 1: GENERAL ARRANGEMENT
# Plan and axonometric on top, section and elevation below. The notes and title block sit in the footer, bottom right.
elevation_view_drawings_3 = ElevationViewDrawings(elevation_view_drawings_2)
section_view_drawings_3 = SectionViewDrawings(section_view_drawings_2)
plan_view_drawings_3 = PlanViewDrawings(plan_view_drawings_2)
axo_view_drawings_3 = AxoViewDrawings(axo_view_drawings_2)
timber_name_3 = TimberName(timber_name_2)
lamella_count_3 = LamellaCount(lamella_count_2)
total_length_3 = TotalLength(total_length_2)
beam_radius_3 = BeamRadius(beam_radius_2)
view_title_3 = ViewTitle(view_title_2)
scale_text_4 = ScaleText(scale_text_2)
note_text_3 = NoteText(note_text_2)
multiplication_7 = Multiplication(A=lamella_width, B=10)
multiplication_8 = Multiplication(A=lamella_depth, B=10)
beam_diameter_mm = Evaluate(E=x_2000, x=beam_radius_3)
notes_text = Format(
    Format="""NOTES
1. Dimensions in millimetres, heights above the finished square.
2. Lamellas: {0} glulam, {1:0} × {2:0} mm, {3} pieces, {4:0} m in all.
3. Lamellas cut on vertical planes at 45°, {5:0.00} m apart.
4. Edge beams: steel tube Ø {6:0} mm. Footings: concrete Ø 700 mm.
5. Drawn by Selva from the model: change an input and the sheet redraws.""",
    Culture=127,
    Data0=timber_name_3,
    Data1=multiplication_7,
    Data2=multiplication_8,
    Data3=lamella_count_3,
    Data4=total_length_3,
    Data5=lamella_spacing,
    Data6=beam_diameter_mm)
title_block = TitleBlock(
    Project="Selva showcase",
    Owner="Example client",
    Title="Timber lamella pavilion: general arrangement",
    DrawingNo="LP-100",
    Revision="A",
    Scale=scale_text_4,
    Sheet="{page}/{pages}",
    CreatedBy="Selva",
    Date="{date:dd.MM.yyyy}",
    Width=190)
notes = TextFlow(Text=notes_text, Width=190, Style=note_text_3)
format_6 = Format(Format="PLAN   {0}", Culture=127, Data0=scale_text_4)
plan_anchor = ConstructPoint(XCoordinate=0, YCoordinate=0, ZCoordinate=0)
axonometric_anchor = ConstructPoint(XCoordinate=0, YCoordinate=0, ZCoordinate=0)
format_7 = Format(Format="SECTION A–A   {0}", Culture=127, Data0=scale_text_4)
section_a_a_anchor = ConstructPoint(XCoordinate=0, YCoordinate=0, ZCoordinate=0)
format_8 = Format(Format="EAST ELEVATION   {0}", Culture=127, Data0=scale_text_4)
east_elevation_anchor = ConstructPoint(XCoordinate=0, YCoordinate=0, ZCoordinate=0)
plan = DrawText(Text=format_6, Position=plan_anchor, Style=view_title_3, Rotation=0, Padding=1, Radius=0)
axonometric = DrawText(Text="AXONOMETRIC", Position=axonometric_anchor, Style=view_title_2, Rotation=0, Padding=1, Radius=0)
section_a_a = DrawText(Text=format_7, Position=section_a_a_anchor, Style=view_title_2, Rotation=0, Padding=1, Radius=0)
east_elevation = DrawText(Text=format_8, Position=east_elevation_anchor, Style=view_title_2, Rotation=0, Padding=1, Radius=0)
sheet_1_footer_parts = Merge(Data1=flatten(notes), Data2=flatten(title_block))
sheet_1_layout_cells = Merge(
    Data1=flatten(plan_view_drawings_3),
    Data2=flatten(axo_view_drawings_3),
    Data3=flatten(plan),
    Data4=flatten(axonometric),
    Data5=flatten(section_view_drawings_3),
    Data6=flatten(elevation_view_drawings_3),
    Data7=flatten(section_a_a),
    Data8=flatten(east_elevation))
sheet_1_footer = Stack(Drawings=sheet_1_footer_parts, Orientation=1, Spacing=12, CrossAlign=2)
sheet_1_layout = Grid(
    ColumnWidths=[0, -1],
    Drawings=flatten(sheet_1_layout_cells),
    AtRow=[0, 0, 1, 1, 2, 2, 3, 3],
    AtColumn=[0, 1, 0, 1, 0, 1, 0, 1],
    ColumnSpacing=20,
    RowSpacing=5,
    Columns=0)
sheet_1_footer_override = LayoutOverride(Footer=sheet_1_footer, FooterAlign=2, FooterPlacement=1, Units=1)
sheet_1 = Page(
    Drawings=sheet_1_layout,
    Title="General arrangement",
    Override=sheet_1_footer_override,
    KeepTogether=True,
    Arrange=0,
    Spacing=5)

# ---- group: Sheet 1 / Outputs
sheet_1_2 = Sheet1(sheet_1)

# ---- group: Drawing set
# DRAWING SET
# Both sheets on A2 landscape with 12 mm margins, rendered to one PDF.
sheet_1_3 = Sheet1(sheet_1_2)
sheet_2_3 = Sheet2(sheet_2_2)
pages = Merge(Data1=sheet_1_3, Data2=sheet_2_3)
a2_landscape = LayoutOverride(PaperSize=2, Landscape=True, Margin=12, Units=1)
drawing_set = Document(Pages=pages, Title="Timber lamella pavilion", Author="Selva", Override=a2_landscape, Culture="en-US")
drawing_the_sheets = ReportProgress(Data=drawing_set, Message="Drawing the sheets…")
pdf = RenderPDF(Document=drawing_the_sheets, Name="lamella-pavilion-drawings", AutoFit=False)

# ---- group: Drawing set / Outputs
c_bake_6 = ContextBake(DrawingsPDF=pdf)
