# Grasshopper definition FELIX- Sheetmetal Quick Calculator_0.67__20250919.gh (Grasshopper 1.0.8)
# Copyright: Julian Raabe
# plug-ins: Heteroptera, treesloth01, Pufferfish, Synapse, SheepMetal, opennest_2 Info, PancakeSpreadsheet, MetaHopper, Wombat, Telepathy

# ----
# Input / Output - Import /Export
data = Data()
data_2 = Data()

# ----
# Operation
data_3 = Data()
data_4 = Data()

# ----
# Work in Progress
data_5 = Data()
data_6 = Data()

# ----
# Preview
data_7 = Data()
data_8 = Data()

# ----
# Ready to be organized
data_9 = Data()
data_10 = Data()

# ----
# Error / Problem
data_11 = Data()
data_12 = Data()

# ----
# Non parametric part of solution
data_13 = Data()
data_14 = Data()

# ----
# Old version of a group
data_15 = Data()
data_16 = Data()

# ----
# Changed/ New version of a group
data_17 = Data()
data_18 = Data()

# ----
# Meta-Data Inputs
data_19 = Data()
data_20 = Data()

# ----
# Logikcheck
data_21 = Data()
data_22 = Data()

# ----
# Export
data_23 = Data()
data_24 = Data()

# ----
# Synapse
data_25 = Data()
data_26 = Data()

# ----
# Layouthelper
height = Slider(70, range=0..1000)
panel = Panel("""Spacing
Size""")
width = Number("400")
snpsize = SnpSize(Width=width, Height=height)
text = Text(panel)
text_2 = Text("5")
merge = Merge(Data1=text_2, Data2=snpsize)
snppropertyvalue_mainfunctions = RemoteSender(merge)
snpproperty_mainfunctions = RemoteSender(text)

datenquelle_material_typ_dichte_preis_ma = Panel("""Custom
Normalstahl (St37-2):7.85:1.0:20
Hardox:7.85:2.75:20
Edelstahl (1.4301):7.93:3.5:10
Edelstahl (1.4541):7.93:4.7:10
Edelstahl (1.4571):7.93:6:10
Aluminium (AlMg³):2.17:2.26:8""")  # "Datenquelle Material - Typ : Dichte : Preis : Max Stärke Laser intern"
seperator = Panel(":")
text_split = TextSplit(Text=datenquelle_material_typ_dichte_preis_ma, Separators=seperator)
datenquelle_material = Text(text_split)

# ----
# Select Material - Dropdown
number_slider = Slider(60, range=0..100)
datenquelle_material_2 = Text(datenquelle_material)
enabled = BooleanToggle(False)
enabled_2 = BooleanToggle(False)
panel_2 = Panel("""MinValue
MaxValue
DecimalPlaces
Enabled
Size""")
min_max_value = Panel("""5.00
10.00""")
decimal_places = Panel("2")
panel_3 = Panel("""MinValue
MaxValue
DecimalPlaces
Enabled
Size""")
min_max_value_2 = Panel("""0.01
50.00""")
decimal_places_2 = Panel("2")
list_item = ListItem(List=datenquelle_material_2, Index=0, Wrap=True)
snpsize_2 = SnpSize(Width=number_slider, Height=Slider(20, range=0..100))
snpsize_3 = SnpSize(Width=Slider(60, range=0..100), Height=Slider(20, range=0..100))
text_3 = Text(panel_2)
integer = Integer(decimal_places)
text_4 = Text(panel_3)
number = Number(min_max_value_2)
number_2 = Number(min_max_value)
boolean = Boolean(enabled)
integer_2 = Integer(decimal_places_2)
boolean_2 = Boolean(enabled_2)
text_5 = Text("Select Material")
text_6 = Text("SelectedIndex")
integer_3 = Integer("1")
text_7 = Text(list_item)
text_8 = Text("Text")
merge_2 = Merge(Data1=number_2, Data2=integer, Data3=boolean, Data4=snpsize_2)
merge_3 = Merge(Data1=number, Data2=integer_2, Data3=boolean_2, Data4=snpsize_3)
snptextlabel = SnpTextLabel(Property=flatten(text_8), PropertyValue=flatten(text_5))  # -> AllProperties, Control
snpdropmenu = SnpDropMenu(Property=flatten(text_6), PropertyValue=flatten(integer_3), Options=flatten(text_7))  # -> AllProperties, Control
snpnumupdn = SnpNumUpDn(Property=flatten(text_3), PropertyValue=flatten(merge_2))  # -> AllProperties, Control
snpnumupdn_2 = SnpNumUpDn(Property=flatten(text_4), PropertyValue=flatten(merge_3))  # -> AllProperties, Control
data_27 = Data(snpdropmenu.Control)
data_28 = Data(snpnumupdn.Control)
data_29 = Data(snpnumupdn_2.Control)
merge_4 = Merge(Data1=data_27, Data2=data_28, Data3=data_29)
properties = Panel("""Orientation
Size
Spacing""")
orientation = Panel("Horizontal")
spacing = Panel("19")
data_30 = Data(data_28)
data_31 = Data(data_29)
snpsize_4 = SnpSize(Width=Slider(300, range=0..1000), Height=Slider(25, range=0..100))
merge_5 = Merge(Data1=orientation, Data2=snpsize_4, Data3=spacing)
text_9 = Text(properties)
snpstack = SnpStack(Property=flatten(text_9), PropertyValue=flatten(merge_5), Controls=flatten(merge_4))  # -> AllProperties, Control
merge_6 = Merge(Data1=snptextlabel.Control, Data2=snpstack.Control)
snpvaluequery = SnpValueQuery(SynapseObject=snpdropmenu.Control, Update=True)
snppropertyvalue_mainfunctions_2 = RemoteReceiver(snppropertyvalue_mainfunctions)
snpproperty_mainfunctions_2 = RemoteReceiver(snpproperty_mainfunctions)
data_32 = Data(merge_6)
snpstack_2 = SnpStack(
    Property=flatten(snpproperty_mainfunctions_2),
    PropertyValue=flatten(snppropertyvalue_mainfunctions_2),
    Controls=flatten(data_32))  # -> AllProperties, Control
index_mateial_selection = Integer(snpvaluequery)
data_33 = Data(snpstack_2.Control)
data_34 = Data(data_31)
data_35 = Data(data_30)

# ----
# Show Invalid Parts
ison = BooleanToggle(False)
text_10 = Text("Text")
text_11 = Text("Show Invalid Parts")
text_12 = Text("IsOn")
boolean_3 = Boolean(ison)
text_13 = Text("Text")
text_14 = Text("0/0")
snptextlabel_2 = SnpTextLabel(Property=flatten(text_10), PropertyValue=flatten(text_11))  # -> AllProperties, Control
snptoggle = SnpToggle(Property=flatten(text_12), PropertyValue=flatten(boolean_3))  # -> AllProperties, Control
snptextlabel_3 = SnpTextLabel(Property=flatten(text_13), PropertyValue=flatten(text_14))  # -> AllProperties, Control
properties_2 = Panel("""Orientation
Size
Spacing""")
orientation_2 = Panel("Horizontal")
spacing_2 = Panel("50")
snpsize_5 = SnpSize(Width=Slider(300, range=0..1000), Height=Slider(26, range=0..100))
merge_7 = Merge(Data1=orientation_2, Data2=snpsize_5, Data3=spacing_2)
merge_8 = Merge(Data1=snptoggle.Control, Data2=snptextlabel_3.Control)
data_36 = Data(snptoggle.Control)
text_15 = Text(properties_2)
snpvaluequery_2 = SnpValueQuery(SynapseObject=data_36, Update=True)
snpstack_3 = SnpStack(Property=flatten(text_15), PropertyValue=flatten(merge_7), Controls=flatten(merge_8))  # -> AllProperties, Control
merge_9 = Merge(Data1=snptextlabel_2.Control, Data2=snpstack_3.Control)
snppropertyvalue_mainfunctions_3 = RemoteReceiver(snppropertyvalue_mainfunctions)
snpproperty_mainfunctions_3 = RemoteReceiver(snpproperty_mainfunctions)
data_37 = Data(merge_9)
snpstack_4 = SnpStack(
    Property=flatten(snpproperty_mainfunctions_3),
    PropertyValue=flatten(snppropertyvalue_mainfunctions_3),
    Controls=flatten(data_37))  # -> AllProperties, Control
data_38 = Data(snpstack_4.Control)
boolean_4 = Boolean(snpvaluequery_2)
data_39 = Data(snptextlabel_3.Control)

# ----
# Analysis Result
panel_4 = Panel("Text")
text_16 = Text(panel_4)
text_17 = Text("Result not available yet...")
snptextlabel_4 = SnpTextLabel(Property=flatten(text_16), PropertyValue=flatten(text_17))  # -> AllProperties, Control
height_2 = Slider(500, range=0..1000)
data_40 = Data(snptextlabel_4.Control)
data_41 = Data(snptextlabel_4.Control)
panel_5 = Panel("""Width
Height
Content
Padding
Size
ExpandContentHeight""")
snpsize_6 = SnpSize(Width="300", Height=height_2)
_300 = Integer(300)
_800 = Integer(800)
boolean_5 = Boolean(Toggle(False))
merge_10 = Merge(Data1=_300, Data2=_800, Data3=data_40, Data4="10,10,10,10", Data5=snpsize_6, Data6=boolean_5)
addition = Addition(A=height_2, _50=50)
snpscroll = SnpScroll(Property=flatten(panel_5), PropertyValue=flatten(merge_10), stretchy=False)  # -> AllProperties, Control
snppropertyvalue_mainfunctions_4 = RemoteReceiver(snppropertyvalue_mainfunctions)
data_42 = Data(snpscroll.Control)
dispatch = Dispatch(List=snppropertyvalue_mainfunctions_4, DispatchPattern=[True, False])  # -> ListA, ListB
_300_2 = Number(300)
snpproperty_mainfunctions_4 = RemoteReceiver(snpproperty_mainfunctions)
snpsize_7 = SnpSize(Width=_300_2, Height=addition)
data_43 = Data(data_42)
merge_11 = Merge(Data1=dispatch.ListA, Data2=snpsize_7)
snpstack_5 = SnpStack(Property=flatten(snpproperty_mainfunctions_4), PropertyValue=flatten(merge_11), Controls=flatten(data_43))  # -> AllProperties, Control
data_44 = Data(data_41)
data_45 = Data(snpstack_5.Control)

# ----
# Show Sheetmetal Parts
ison_2 = BooleanToggle(True)
text_18 = Text("Text")
text_19 = Text("Show Sheetmetal Parts")
text_20 = Text("IsOn")
boolean_6 = Boolean(ison_2)
text_21 = Text("0/0")
text_22 = Text("Text")
snptextlabel_5 = SnpTextLabel(Property=flatten(text_18), PropertyValue=flatten(text_19))  # -> AllProperties, Control
snptoggle_2 = SnpToggle(Property=flatten(text_20), PropertyValue=flatten(boolean_6))  # -> AllProperties, Control
snptextlabel_6 = SnpTextLabel(Property=flatten(text_22), PropertyValue=flatten(text_21))  # -> AllProperties, Control
spacing_3 = Panel("50")
orientation_3 = Panel("Horizontal")
snpsize_8 = SnpSize(Width=Slider(300, range=0..1000), Height=Slider(26, range=0..100))
properties_3 = Panel("""Orientation
Size
Spacing""")
merge_12 = Merge(Data1=orientation_3, Data2=snpsize_8, Data3=spacing_3)
merge_13 = Merge(Data1=snptoggle_2.Control, Data2=snptextlabel_6.Control)
snpstack_6 = SnpStack(Property=flatten(properties_3), PropertyValue=flatten(merge_12), Controls=flatten(merge_13))  # -> AllProperties, Control
merge_14 = Merge(Data1=snptextlabel_5.Control, Data2=snpstack_6.Control)
snpvaluequery_3 = SnpValueQuery(SynapseObject=snptoggle_2.Control, Update=True)
snppropertyvalue_mainfunctions_5 = RemoteReceiver(snppropertyvalue_mainfunctions)
snpproperty_mainfunctions_5 = RemoteReceiver(snpproperty_mainfunctions)
data_46 = Data(merge_14)
snpstack_7 = SnpStack(
    Property=flatten(snpproperty_mainfunctions_5),
    PropertyValue=flatten(snppropertyvalue_mainfunctions_5),
    Controls=flatten(data_46))  # -> AllProperties, Control
data_47 = Data(snpstack_7.Control)
boolean_7 = Boolean(snpvaluequery_3)
data_48 = Data(snptextlabel_6.Control)

# ----
# Sheetmetal Cost Calculation
# Headline
panel_6 = Panel("Sheetmetal Cost Calculation")
panel_7 = Panel("""Text
Font""")
integer_4 = Integer("12")
snpfont = SnpFont(FontFamily="Arial", FontSize=integer_4, FontStyle=1, Decoration=0)
text_23 = Text(panel_7)
text_24 = Text(panel_6)
merge_15 = Merge(Data1=text_24, Data2=snpfont)
snptextlabel_7 = SnpTextLabel(Property=flatten(text_23), PropertyValue=flatten(merge_15))  # -> AllProperties, Control
data_49 = Data(snptextlabel_7.Control)
snppropertyvalue_mainfunctions_6 = RemoteReceiver(snppropertyvalue_mainfunctions)
snpproperty_mainfunctions_6 = RemoteReceiver(snpproperty_mainfunctions)
snpstack_8 = SnpStack(
    Property=flatten(snpproperty_mainfunctions_6),
    PropertyValue=flatten(snppropertyvalue_mainfunctions_6),
    Controls=flatten(data_49))  # -> AllProperties, Control
data_50 = Data(snpstack_8.Control)

# ---- group: Export
# Headline
panel_8 = Panel("4. Excel Export")
# Excel Export
panel_9 = Panel("""Text
Font""")
integer_5 = Integer("12")
snpfont_2 = SnpFont(FontFamily="Arial", FontSize=integer_5, FontStyle=1, Decoration=0)
text_25 = Text(panel_9)
text_26 = Text(panel_8)
merge_16 = Merge(Data1=text_26, Data2=snpfont_2)
snptextlabel_8 = SnpTextLabel(Property=flatten(text_25), PropertyValue=flatten(merge_16))  # -> AllProperties, Control
data_51 = Data(snptextlabel_8.Control)
snppropertyvalue_mainfunctions_7 = RemoteReceiver(snppropertyvalue_mainfunctions)
snpproperty_mainfunctions_7 = RemoteReceiver(snpproperty_mainfunctions)
snpstack_9 = SnpStack(
    Property=flatten(snpproperty_mainfunctions_7),
    PropertyValue=flatten(snppropertyvalue_mainfunctions_7),
    Controls=flatten(data_51))  # -> AllProperties, Control
data_52 = Data(snpstack_9.Control)

# ----
# 2. Import File
panel_10 = Panel("Text")
text_27 = Text(panel_10)
text_28 = Text("2. Import File")
text_29 = Text("Click to import")
width_2 = Number("300")
height_3 = Number("25")
panel_11 = Panel("""text
size""")
snpsize_9 = SnpSize(Width=width_2, Height=height_3)
snptextlabel_9 = SnpTextLabel(Property=flatten(text_27), PropertyValue=flatten(text_28))  # -> AllProperties, Control
merge_17 = Merge(Data1=text_29, Data2=snpsize_9)
text_30 = Text(panel_11)
snpbutton = SnpButton(Property=flatten(text_30), PropertyValue=flatten(merge_17), trueonly=False)  # -> AllProperties, Control
merge_18 = Merge(Data1=snptextlabel_9.Control, Data2=snpbutton.Control)
snpvaluequery_4 = SnpValueQuery(SynapseObject=snpbutton.Control, Update=True)
snppropertyvalue_mainfunctions_8 = RemoteReceiver(snppropertyvalue_mainfunctions)
snpproperty_mainfunctions_8 = RemoteReceiver(snpproperty_mainfunctions)
data_53 = Data(merge_18)
snpstack_10 = SnpStack(
    Property=flatten(snpproperty_mainfunctions_8),
    PropertyValue=flatten(snppropertyvalue_mainfunctions_8),
    Controls=flatten(data_53))  # -> AllProperties, Control
boolean_import = Boolean(snpvaluequery_4)
data_54 = Data(snpstack_10.Control)

# ----
# 3. Start Analysis
panel_12 = Panel("Text")  # disabled
panel_13 = Panel("3. Start Analysis")  # disabled
panel_14 = Panel("Click to Start")  # disabled
panel_15 = Panel("300")  # disabled
panel_16 = Panel("25")  # disabled
text_31 = Text(panel_12)  # disabled
text_32 = Text(panel_13)  # disabled
text_33 = Text(panel_14)  # disabled
width_3 = Number(panel_15)  # disabled
height_4 = Number(panel_16)  # disabled
panel_17 = Panel("""text
size""")  # disabled
snpsize_10 = SnpSize(Width=width_3, Height=height_4)  # disabled
snptextlabel_10 = SnpTextLabel(Property=flatten(text_31), PropertyValue=flatten(text_32))  # -> AllProperties, Control; disabled
merge_19 = Merge(Data1=text_33, Data2=snpsize_10)  # disabled
snpbutton_2 = SnpButton(Property=flatten(panel_17), PropertyValue=flatten(merge_19), trueonly=False)  # -> AllProperties, Control; disabled
merge_20 = Merge(Data1=snptextlabel_10.Control, Data2=snpbutton_2.Control)  # disabled
snpvaluequery_5 = SnpValueQuery(SynapseObject=snpbutton_2.Control, Update=True)  # disabled
snppropertyvalue_mainfunctions_9 = RemoteReceiver(snppropertyvalue_mainfunctions)  # disabled
snpproperty_mainfunctions_9 = RemoteReceiver(snpproperty_mainfunctions)  # disabled
data_55 = Data(merge_20)  # disabled
snpstack_11 = SnpStack(
    Property=flatten(snpproperty_mainfunctions_9),
    PropertyValue=flatten(snppropertyvalue_mainfunctions_9),
    Controls=flatten(data_55))  # -> AllProperties, Control; disabled
data_56 = Data(snpstack_11.Control)  # disabled
boolean_8 = Boolean(snpvaluequery_5)  # disabled

# ----
# 3. Launch Export Window
_300_3 = Number(300)
_25 = Number(25)
properties_4 = Panel("""text
size""")
snpsize_11 = SnpSize(Width=_300_3, Height=_25)
text_34 = Text("Click to open Export Window")
text_35 = Text("Text")
text_36 = Text("3. Launch Export Window")
text_37 = Text(properties_4)
merge_21 = Merge(Data1=text_34, Data2=snpsize_11)
snpbutton_3 = SnpButton(Property=flatten(text_37), PropertyValue=flatten(merge_21), trueonly=False)  # -> AllProperties, Control
snptextlabel_11 = SnpTextLabel(Property=flatten(text_35), PropertyValue=flatten(text_36))  # -> AllProperties, Control
snpvaluequery_6 = SnpValueQuery(SynapseObject=snpbutton_3.Control, Update=True)
merge_22 = Merge(Data1=snptextlabel_11.Control, Data2=snpbutton_3.Control)
snppropertyvalue_mainfunctions_10 = RemoteReceiver(snppropertyvalue_mainfunctions)
snpproperty_mainfunctions_10 = RemoteReceiver(snpproperty_mainfunctions)
data_57 = Data(merge_22)
snpstack_12 = SnpStack(
    Property=flatten(snpproperty_mainfunctions_10),
    PropertyValue=flatten(snppropertyvalue_mainfunctions_10),
    Controls=flatten(data_57))  # -> AllProperties, Control
data_58 = Data(snpstack_12.Control)
boolean_9 = Boolean(snpvaluequery_6)

# ---- group: Export
# Export Calculation
_300_4 = Number(300)
_25_2 = Number(25)
properties_5 = Panel("""Text
Size
Enabled""")
text_38 = Panel("Click to export")
enabled_3 = BooleanToggle(True)
snpsize_12 = SnpSize(Width=_300_4, Height=_25_2)
text_39 = Text(text_38)
text_40 = Text("Text")
text_41 = Text("Export Calculation")
text_42 = Text(properties_5)
merge_23 = Merge(Data1=text_39, Data2=snpsize_12, Data3=enabled_3)
snptextlabel_12 = SnpTextLabel(Property=flatten(text_40), PropertyValue=flatten(text_41))  # -> AllProperties, Control
snpbutton_4 = SnpButton(Property=flatten(text_42), PropertyValue=flatten(merge_23), trueonly=False)  # -> AllProperties, Control
merge_24 = Merge(Data1=snptextlabel_12.Control, Data2=snpbutton_4.Control)
snpvaluequery_7 = SnpValueQuery(SynapseObject=snpbutton_4.Control, Update=True)
snppropertyvalue_mainfunctions_11 = RemoteReceiver(snppropertyvalue_mainfunctions)
snpproperty_mainfunctions_11 = RemoteReceiver(snpproperty_mainfunctions)
data_59 = Data(merge_24)
snpstack_13 = SnpStack(
    Property=flatten(snpproperty_mainfunctions_11),
    PropertyValue=flatten(snppropertyvalue_mainfunctions_11),
    Controls=flatten(data_59))  # -> AllProperties, Control
data_60 = Data(snpstack_13.Control)
boolean_10 = Boolean(snpvaluequery_7)

# ----
# Show Laser Markings
ison_3 = BooleanToggle(True)
text_43 = Text("Text")
text_44 = Text("Show Laser Markings")
boolean_11 = Boolean(ison_3)
text_45 = Text("IsOn")
snptextlabel_13 = SnpTextLabel(Property=flatten(text_43), PropertyValue=flatten(text_44))  # -> AllProperties, Control
snptoggle_3 = SnpToggle(Property=flatten(text_45), PropertyValue=flatten(boolean_11))  # -> AllProperties, Control
merge_25 = Merge(Data1=snptextlabel_13.Control, Data2=snptoggle_3.Control)
snpvaluequery_8 = SnpValueQuery(SynapseObject=snptoggle_3.Control, Update=True)
snppropertyvalue_mainfunctions_12 = RemoteReceiver(snppropertyvalue_mainfunctions)
snpproperty_mainfunctions_12 = RemoteReceiver(snpproperty_mainfunctions)
data_61 = Data(merge_25)
snpstack_14 = SnpStack(
    Property=flatten(snpproperty_mainfunctions_12),
    PropertyValue=flatten(snppropertyvalue_mainfunctions_12),
    Controls=flatten(data_61))  # -> AllProperties, Control
data_62 = Data(snpstack_14.Control)
boolean_12 = Boolean(snpvaluequery_8)

# ----
# Calculate Sheets
ison_4 = BooleanToggle(False)
text_46 = Text("Text")
text_47 = Text("IsOn")
boolean_13 = Boolean(ison_4)
text_48 = Text("Calculate Sheets")
snptextlabel_14 = SnpTextLabel(Property=flatten(text_46), PropertyValue=flatten(text_48))  # -> AllProperties, Control
snptoggle_4 = SnpToggle(Property=flatten(text_47), PropertyValue=flatten(boolean_13))  # -> AllProperties, Control
merge_26 = Merge(Data1=snptextlabel_14.Control, Data2=snptoggle_4.Control)
snpvaluequery_9 = SnpValueQuery(SynapseObject=snptoggle_4.Control, Update=True)
snppropertyvalue_mainfunctions_13 = RemoteReceiver(snppropertyvalue_mainfunctions)
snpproperty_mainfunctions_13 = RemoteReceiver(snpproperty_mainfunctions)
data_63 = Data(merge_26)
snpstack_15 = SnpStack(
    Property=flatten(snpproperty_mainfunctions_13),
    PropertyValue=flatten(snppropertyvalue_mainfunctions_13),
    Controls=flatten(data_63))  # -> AllProperties, Control
data_64 = Data(snpstack_15.Control)
boolean_14 = Boolean(snpvaluequery_9)

# ----
# Show Sheets
ison_5 = BooleanToggle(True)
text_49 = Text("Text")
text_50 = Text("IsOn")
boolean_15 = Boolean(ison_5)
text_51 = Text("Show Sheets")
snptextlabel_15 = SnpTextLabel(Property=flatten(text_49), PropertyValue=flatten(text_51))  # -> AllProperties, Control
snptoggle_5 = SnpToggle(Property=flatten(text_50), PropertyValue=flatten(boolean_15))  # -> AllProperties, Control
merge_27 = Merge(Data1=snptextlabel_15.Control, Data2=snptoggle_5.Control)
snpvaluequery_10 = SnpValueQuery(SynapseObject=snptoggle_5.Control, Update=True)
snppropertyvalue_mainfunctions_14 = RemoteReceiver(snppropertyvalue_mainfunctions)
snpproperty_mainfunctions_14 = RemoteReceiver(snpproperty_mainfunctions)
data_65 = Data(merge_27)
snpstack_16 = SnpStack(
    Property=flatten(snpproperty_mainfunctions_14),
    PropertyValue=flatten(snppropertyvalue_mainfunctions_14),
    Controls=flatten(data_65))  # -> AllProperties, Control
data_66 = Data(snpstack_16.Control)
boolean_16 = Boolean(snpvaluequery_10)

# ---- group: Export
# Version
panel_18 = Panel("Text")
text_52 = Text(panel_18)
text_53 = Text("Version 0.62 - 20.08.2025")
snptextlabel_16 = SnpTextLabel(Property=flatten(text_52), PropertyValue=flatten(text_53))  # -> AllProperties, Control
data_67 = Data(snptextlabel_16.Control)
snppropertyvalue_mainfunctions_15 = RemoteReceiver(snppropertyvalue_mainfunctions)
snpproperty_mainfunctions_15 = RemoteReceiver(snpproperty_mainfunctions)
snpstack_17 = SnpStack(
    Property=flatten(snpproperty_mainfunctions_15),
    PropertyValue=flatten(snppropertyvalue_mainfunctions_15),
    Controls=flatten(data_67))  # -> AllProperties, Control
data_68 = Data(snpstack_17.Control)

# ----
text_54 = Text("Folder")
data_button_control = Data(snpbutton_4.Control)
show_laser_markings = RemoteSender(boolean_12)
show_invalid_parts = RemoteSender(boolean_4)
synapse_amount_of_invalid_parts = RemoteSender(data_39)
synapse_material_density_ui = RemoteSender(data_35)
synapse_material_price_ui = RemoteSender(data_34)
export_to_calc = RemoteSender(boolean_10)
show_sheetmetal_parts = RemoteSender(boolean_7)
synapse_amount_of_valid_sheetmetal_parts = RemoteSender(data_48)
synapse_analysis_result = RemoteSender(data_44)
show_sheets = RemoteSender(boolean_16)

# ----
# Enable Analysis
boolean_17 = Boolean()
panel_19 = Panel("Enabled")  # disabled
boolean_18 = Boolean(boolean_17)  # disabled
snpoverride = SnpOverride(Property=panel_19, Value=boolean_18, Control=data_56)  # disabled

data_69 = Data(data_47)
data_70 = Data(data_62)
data_71 = Data(data_38)
merge_28 = Merge(Data1=data_69, Data2=data_70, Data3=data_71)
text_55 = Text("Text")
text_56 = Text("Previews")
snpexpander = SnpExpander(Controls=flatten(merge_28), stretchy=False)  # -> AllProperties, Control
snptextlabel_17 = SnpTextLabel(Property=flatten(text_55), PropertyValue=flatten(text_56))  # -> AllProperties, Control
merge_29 = Merge(Data1=snptextlabel_17.Control, Data2=snpexpander.Control)
data_72 = Data(merge_29)

data_73 = Data(data_45)
text_57 = Text("Text")
text_58 = Text("Analysis Result")
snptextlabel_18 = SnpTextLabel(Property=flatten(text_57), PropertyValue=flatten(text_58))  # -> AllProperties, Control
snpexpander_2 = SnpExpander(Controls=flatten(data_73), stretchy=False)  # -> AllProperties, Control
merge_30 = Merge(Data1=snptextlabel_18.Control, Data2=snpexpander_2.Control)
data_74 = Data(merge_30)

data_75 = Data(data_64)
data_76 = Data(data_66)
merge_31 = Merge(Data1=data_75, Data2=data_76)
text_59 = Text("Text")
text_60 = Text("Time-consuming sheet calculation (not necessarily needed)")
snptextlabel_19 = SnpTextLabel(Property=flatten(text_59), PropertyValue=flatten(text_60))  # -> AllProperties, Control
snpexpander_3 = SnpExpander(Controls=flatten(merge_31), stretchy=False)  # -> AllProperties, Control
merge_32 = Merge(Data1=snptextlabel_19.Control, Data2=snpexpander_3.Control)
data_77 = Data(merge_32)

data_78 = Data(data_72)
data_79 = Data(data_33)
data_80 = Data(data_77)
data_81 = Data(data_52)
integer_index_mateial_selection = Integer(index_mateial_selection)
data_snp_import = Data(data_54)
boolean_import_2 = Boolean(boolean_import)

programmier_stundensatz = Panel("66")
programmieraufwand_pro_bauteil_min = Panel("10")

datenquelle_blechtafel = Panel("""1000:2000:Kleinformat:1
1250:2500:Mittelformat:1
1500:3000:Großformat:1
2000:4000:Maxiformat:0
2000:6000:Maxiformat:0""")
seperator_2 = Panel(":")
text_61 = Text(datenquelle_blechtafel)
text_split_2 = TextSplit(Text=text_61, Separators=seperator_2)
text_62 = Text(text_split_2)

datenquelle_kantvorgang = Panel("""Kantung≠90°:3:3.5
Kantung=90°:2:2.5
Kantung=180°:4:5""")
seperator_3 = Panel(":")
text_63 = Text(seperator_3)
text_split_3 = TextSplit(Text=datenquelle_kantvorgang, Separators=text_63)
text_64 = Text(text_split_3)

_1 = Integer(1)

number_3 = Number(Slider(5, range=0..10))
multiplication = Multiplication(A=number_3, _01=0.1)
number_4 = Number(number_3)
number_5 = Number(number_3)
panel_20 = Panel("""0.4
0.5
0.6""")
mm = Panel("""4
5
6""")
mm_2 = Panel("4")
integer_6 = Integer(mm_2)
larger_than = LargerThan(FirstNumber=number_5, SecondNumber=integer_6)  # -> LargerThan, OrEqualTo
panel_21 = Panel("""3.5
6.5""")
number_mm = Number(mm)
integer_7 = Integer("-1")
insert_items = InsertItems(List=panel_20, Item=multiplication, Indices=integer_7, Wrap=True)
larger_than_2 = LargerThan(FirstNumber=number_4, SecondNumber=number_mm)  # -> LargerThan, OrEqualTo
list_item_2 = ListItem(List=panel_21, Index=larger_than.LargerThan, Wrap=True)
mass_addition = MassAddition(Input=larger_than_2.LargerThan)  # -> Result, PartialResults
integer_8 = Integer(mass_addition.Result)
list_item_3 = ListItem(List=insert_items, Index=integer_8, Wrap=True)
schnittgeschwindigkeit_min_m = Number(list_item_3)
einstichzeit_sec = Number(list_item_2)

betriebskosten_kantpresse_maschine_mann = Panel("86")  # "Betriebskosten Kantpresse (Maschine + Mann) €/h"
abstand_zwischen_platten = Slider(200, range=1..1000)
sicherheitsabstand_außen_plattenbelegung = Slider(0.1, range=0.1..1.1)
rows = Slider(1, range=0..1)
run = BooleanToggle(True)

options = Options(
    Rotations=Slider(4, range=0..360),
    Wiggle=Slider(0, range=0..5.01),
    PlacementType=Slider(1, range=0..2),
    Spacing=Slider(8, range=0..100),
    Seed=Slider(3, range=0..100),
    SimplifyTolerance=Slider(1, range=0.01..10),
    Mutation=Slider(99, range=1..100),
    Population=Slider(10000, range=1..100000),
    Time=Slider(0, range=0..120),
    SheetFont="MecSoft_Font-1 -10")

format = Format(Culture=127)
enter = Panel("")
panel_22 = Panel("""GESAMT
Erwartete Kosten {14:0.00} €
ohne Verschnitt / ohne Oberflächenbehandlung 

PROGRAMMIERUNG
Anzahl Teile Programmierung {2} Stück
Kosten Programmierung {3:0.00} €

LASER
Gesamtkonturlänge mit Löcher {6:0.0} mm
Gesamtzahl Einstichpunkte {7}
Laserschnittdauer gesamt {12:0.00} h
Kosten Laser {13:0.00} €

KANTEN
Anzahl Teile mit Kantvorgang {8} Stück
Anzahl Kantungen gesamt {10} Stück
Kantzeit gesamt {0:0.00} h
Kosten Kanten {1:0.00} €

POSTPROZESS
Oberfläche gesamt {5:0.00} m²

MATERIAL
Blechgewicht gesamt {11:0.00} kg
Blechpreis ohne Verschnitt {4:0.00} €
Kosten Verschnitt {15:0.00} €
Prozent Verschnitt {16:0.00} %


ÜBERSICHT NACH BLECHSTÄRKE
{9}""")
panel_23 = Panel("""Ebene
Artikel-Nr.
Beschreibung
Beschreibung 2
Erw. Menge
Erw. Menge Einheit
EK-Preis (neuester) EUR
Geb. Eink.-Rechnung
Artikelkategoriencode
Produktgruppencode
Nettogewicht kg
Blechteil Oberfläche einzeln m²
Blechteil Oberfläche gesamt m²
Oberfläche innen m²
Anzahl Kantungen
Materialdichte g/cm³
Gesamtkonturlänge mit Löcher (mm)
Einstichpunkte
Kanban
Werkstoff""")
synapse_amount_of_valid_sheetmetal_parts_2 = RemoteReceiver(synapse_amount_of_valid_sheetmetal_parts)
synapse_amount_of_invalid_parts_2 = RemoteReceiver(synapse_amount_of_invalid_parts)
synapse_analysis_result_2 = RemoteReceiver(synapse_analysis_result)
always_create_a_new_spreadsheet_instead = BooleanToggle(True)  # "Always create a new spreadsheet, instead of modifying existing spreadsheet file."
sheetname = Panel("A nice Sheetname")
export_to_calc_2 = RemoteReceiver(export_to_calc)
export_to_calc_3 = Boolean(export_to_calc_2)

# ----
# 1. Choose Filepath
panel_24 = Panel("Text")
panel_25 = Panel(""".step
.stp
.3dm""")
text_65 = Text(panel_24)
text_66 = Text("1. Choose Filepath")
width_4 = Number("300")
height_5 = Number("30")
snpfiletype = SnpFileType(TypeName=flatten("Plain Text"), Extensions=panel_25)
panel_26 = Panel("""CurrentFilter
Size""")
snpsize_13 = SnpSize(Width=width_4, Height=height_5)
snptextlabel_20 = SnpTextLabel(Property=flatten(text_65), PropertyValue=flatten(text_66))  # -> AllProperties, Control
merge_33 = Merge(Data1=snpfiletype, Data2=snpsize_13)
snppropertyvalue_mainfunctions_16 = RemoteReceiver(snppropertyvalue_mainfunctions)
snpproperty_mainfunctions_16 = RemoteReceiver(snpproperty_mainfunctions)

text_67 = Text(panel_26)

snpfilepicker = SnpFilePicker(Property=flatten(text_67), PropertyValue=flatten(merge_33))  # -> AllProperties, Control
snpvaluequery_11 = SnpValueQuery(SynapseObject=snpfilepicker.Control, Update=True)
merge_34 = Merge(Data1=snptextlabel_20.Control, Data2=snpfilepicker.Control)
data_82 = Data(merge_34)
snpstack_18 = SnpStack(
    Property=flatten(snpproperty_mainfunctions_16),
    PropertyValue=flatten(snppropertyvalue_mainfunctions_16),
    Controls=flatten(data_82))  # -> AllProperties, Control
file_path = FilePath(snpvaluequery_11)
data_83 = Data(snpstack_18.Control)

# ----
# Synapse Connection Hub
data_84 = Data(data_50)
data_85 = Data(data_83)
data_86 = Data(data_54)
data_87 = Data(data_56)  # disabled
data_88 = Data(data_74)
data_89 = Data(data_58)
data_90 = Data(data_68)
merge_35 = Merge(
    Data1=data_84,
    Data2=data_85,
    Data3=data_86,
    Data4=data_87,
    Data5=data_78,
    Data6=data_79,
    Data7=data_88,
    Data8=data_80,
    Data10=data_89,
    Data11=data_90)
properties_6 = Panel("""Spacing
Padding""")
property_values = Panel("""0
40,40,0,40""")
data_91 = Data(merge_35)
snpstack_19 = SnpStack(Property=flatten(properties_6), PropertyValue=flatten(property_values), Controls=flatten(data_91))  # -> AllProperties, Control
data_92 = Data(snpstack_19.Control)

# ----
# Synapse Main Window
data_93 = Data(data_92)
topmost = BooleanToggle(True)
title = Panel("Sheetmetal Cost Calculation")
heigth = Slider(1350, range=0..10000)
snpsize_14 = SnpSize(Width=Slider(400, range=0..1000), Height=heigth)
text_68 = Text(title)
boolean_19 = Boolean(topmost)
merge_36 = Merge(Data1=text_68, Data2=boolean_19, Data3=snpsize_14)
property = Panel("""Title
Topmost
MinimumSize""")
show = BooleanToggle(True)
snpwindow = SnpWindow(
    Show=show,
    Property=flatten(property),
    PropertyValue=flatten(merge_36),
    Contents=flatten(data_93),
    ctrlfill=True,
    ctrlredo=True,
    ghowned=True,
    uitheme=True)  # -> AllProperties, Window

file_path_2 = FilePath(file_path)

# ---- group: Export
# Calculation Filepath
panel_27 = Panel("Text")
text_69 = Text(panel_27)
text_70 = Text("4.1 Choose folder")
_2 = Integer(2)
snptextlabel_21 = SnpTextLabel(Property=flatten(text_69), PropertyValue=flatten(text_70))  # -> AllProperties, Control
file_picker = FilePicker(FA=_2)  # -> file_picker
# ---------- file_picker: Python ----------
import Grasshopper.Kernel.Types as gt
import Eto
import Eto.Forms as forms
import Eto.Drawing as drawing
from System import EventHandler, Guid, Array
import Rhino
from typing import List, Optional, Tuple, Union

def create_file_picker(
    file_action: int = 0,
    extensions: Optional[forms.FileFilter] = None
) -> gt.GH_ObjectWrapper:
    """
    Creates a customized FilePicker control
    
    Args:
        size: Tuple of (width, height) for the picker
        file_action: Integer (0: file, 1: warning, 2: folder)
        extensions: FileFilter object from Synapse EtoFileFilter component
    
    Returns:
        GH_ObjectWrapper: Wrapped FilePicker control
    """
    # Create picker with initial settings
    picker = forms.FilePicker()
    picker.ID = str(Guid.NewGuid())
    
    # Configure file action based on integer input
    action_mapping = {
        0: Eto.FileAction.OpenFile,
        2: Eto.FileAction.SelectFolder
    }
    picker.FileAction = action_mapping.get(file_action, Eto.FileAction.OpenFile)
    
    # Set current filter if provided
    if extensions:
        if isinstance(extensions, forms.FileFilter):
            picker.Filters.Add(extensions)
            picker.CurrentFilter = extensions
        elif isinstance(extensions, list) or isinstance(extensions, Array):
            # Handle array of FileFilters
            for filter in extensions:
                picker.Filters.Add(filter)
            picker.CurrentFilter = extensions[0]  # Set first filter as current
    
    # Configure layout
    stack = next(
        ctrl for ctrl in picker.VisualControls 
        if isinstance(ctrl, forms.StackLayout)
    )
    
    stack.Spacing = 0
    stack.Padding = drawing.Padding(0)
    
    # Configure button text based on action
    button_text = {
        0: "Select File",
        1: "Warning",
        2: "Select Folder"
    }[file_action]
    
    # Configure stack items
    for item in stack.Items:
        if isinstance(item.Control, forms.TextBox):
            item.Control.Visible = False
            item.Expand = False
        elif isinstance(item.Control, forms.Button):
            item.Control.Text = button_text
            item.Expand = True
            item.HorizontalAlignment = forms.HorizontalAlignment.Stretch
            item.VerticalAlignment = forms.VerticalAlignment.Stretch
    

    
    return gt.GH_ObjectWrapper(picker)

# Example usage:
file_picker = create_file_picker(
    file_action=FA,
    extensions=F  # F is FileFilter object from Synapse EtoFileFilter component
)
# ---------- end file_picker ----------
snppropertyvalue_mainfunctions_17 = RemoteReceiver(snppropertyvalue_mainfunctions)
snpproperty_mainfunctions_17 = RemoteReceiver(snpproperty_mainfunctions)
snpvaluequery_12 = SnpValueQuery(SynapseObject=file_picker, Update=True)
concatenate = Concatenate(FragmentA="Selected folder =", FragmentB=snpvaluequery_12)
file_path_3 = FilePath(snpvaluequery_12)

# ----
snptextlabel_22 = SnpTextLabel(Property=flatten(text_69), PropertyValue=flatten(text_54))  # -> AllProperties, Control

# ---- group: Export (continued)
merge_37 = Merge(Data1=snptextlabel_21.Control, Data2=snptextlabel_22.Control, Data3=file_picker)
data_94 = Data(merge_37)
snpstack_20 = SnpStack(
    Property=flatten(snpproperty_mainfunctions_17),
    PropertyValue=flatten(snppropertyvalue_mainfunctions_17),
    Controls=flatten(data_94))  # -> AllProperties, Control
snpoverride_2 = SnpOverride(Property=text_69, Value=concatenate, Control=snptextlabel_22.Control)
snp_exportfilepath = Data(snpstack_20.Control)

# ----
export_filepath = RemoteSender(file_path_3)

# ----
# Synapse Export Connection Hub
snp_exportfilepath_2 = Data(snp_exportfilepath)
data_95 = Data(data_60)
merge_38 = Merge(Data1=data_81, Data2=snp_exportfilepath_2, Data3=data_95)
properties_7 = Panel("""Spacing
Padding""")
property_values_2 = Panel("""0
40,40,0,40""")
data_96 = Data(merge_38)
snpstack_21 = SnpStack(Property=flatten(properties_7), PropertyValue=flatten(property_values_2), Controls=flatten(data_96))  # -> AllProperties, Control
data_97 = Data(snpstack_21.Control)

file_path_4 = FilePath(file_path_3)
any_letter_or_number = Panel("""a
b
c
d
e
f
g
h
i
j
k
l
m
n
o
p
q
r
s
t
u
v
w
x
y
z
0
1
2
3
4
5
6
7
8
9""")
data_button_control_2 = Data(data_button_control)
text_71 = Text("*")
concatenate_2 = Concatenate(Fragment_A=text_71, Fragment_B=any_letter_or_number, A=text_71)
match_text = MatchText(Text=file_path_4, Pattern=concatenate_2, Case=True)
mass_addition_2 = MassAddition(Input=match_text)  # -> Result, PartialResults
boolean_20 = Boolean(mass_addition_2.Result)
snpoverride_3 = SnpOverride(Property="Enabled", Value=boolean_20, Control=data_button_control_2)

# ----
# Synapse Export Window
data_98 = Data(data_97)
boolean_21 = Boolean(boolean_9)
topmost_2 = BooleanToggle(True)
title_2 = Panel("Sheetmetal Excel Export")
heigth_2 = Slider(300, range=0..10000)
stream_freeze_gate = StreamFreezeGate(Data=boolean_21, PassingSwitch=boolean_21)
snpsize_15 = SnpSize(Width=Slider(500, range=0..1000), Height=heigth_2)
text_72 = Text(title_2)
boolean_22 = Boolean(topmost_2)
merge_39 = Merge(Data1=text_72, Data2=boolean_22, Data3=snpsize_15)
property_2 = Panel("""Title
Topmost
MinimumSize""")
snpwindow_2 = SnpWindow(
    Show=stream_freeze_gate,
    Property=flatten(property_2),
    PropertyValue=flatten(merge_39),
    Contents=flatten(data_98),
    ctrlfill=True,
    ctrlredo=True,
    ghowned=True,
    uitheme=True)  # -> AllProperties, Window

export_filepath_2 = RemoteReceiver(export_filepath)

# ----
# Check Validity of Filepath
# Remove parts that are not unrollable
file_path_5 = FilePath(file_path_2)
boolean_23 = Boolean(boolean_import_2)
seperator_4 = Panel(".")
boolean_24 = Boolean(boolean_23)
file_path_6 = FilePath(file_path_5)
characters = Characters(Text=file_path_6)  # -> Result, Unicode
text_split_4 = TextSplit(Text=file_path_6, Separators=seperator_4)
panel_28 = Panel("""stp
step
3dm""")
list_length = ListLength(List=characters.Result)
boolean_25 = Boolean(list_length)
filepath_present = Boolean(boolean_25)
import_triggered = Boolean(boolean_24)

integer_9 = Integer("-1")

list_item_4 = ListItem(List=text_split_4, Index=integer_9, Wrap=True)
match_text_2 = MatchText(Text=list_item_4, RegEx=panel_28, Case=True)
mass_addition_3 = MassAddition(Input=match_text_2)  # -> Result, PartialResults
filetype_correct = Boolean(mass_addition_3.Result)
gate_and = GateAnd(FilepathPresent=filepath_present, FiletypeCorrect=filetype_correct)
gate_and_2 = GateAnd(FilepathPresent=filepath_present, FiletypeCorrect=filetype_correct, ImportTriggered=import_triggered)
stream_filter = StreamFilter(Gate=gate_and, Stream1=file_path_6)
allow_import = Boolean(gate_and)
file_path_7 = FilePath(stream_filter)
filepath_selected_and_file_loaded = Boolean(gate_and_2)

filepath_selected_and_file_loaded_2 = RemoteSender(allow_import)

# ----
# File import and preparation
file_path_8 = FilePath(file_path_7)
filepath_selected_and_file_loaded_3 = Boolean(filepath_selected_and_file_loaded)
seperator_5 = Panel("\")
import_content = ImportContent(FilePath=file_path_8, Import=filepath_selected_and_file_loaded_3)  # -> ModelTransform, Objects, Layers, Linetypes, HatchPatterns, AnnotationStyles, Materials, BlockDefinitions
text_split_5 = TextSplit(Text=file_path_8, Separators=seperator_5)
list_item_5 = ListItem(List=text_split_5, Index=-1, Wrap=True)
seperator_6 = Panel(".")
model_object = ModelObject(import_content.Objects)
model_block_definition = ModelBlockDefinition(import_content.BlockDefinitions)
text_split_6 = TextSplit(Text=list_item_5, Separators=seperator_6)
list_length_2 = ListLength(List=model_block_definition)
list_item_6 = ListItem(List=text_split_6, Index=0, Wrap=True)
boolean_26 = Boolean(list_length_2)
stream_gate = StreamGate(Stream=model_object, Gate=boolean_26)  # -> Target0, Target1
text_73 = Text(list_item_6)
explode_object = ExplodeObject(Object=stream_gate.Target1, Recursive=False)
explode_object_2 = ExplodeObject(Object=stream_gate.Target1, Recursive=True)
model_block_definition_2 = ModelBlockDefinition(BlockDefinition=explode_object)  # -> BlockDefinition, Objects, Name
stream_filter_2 = StreamFilter(Gate=boolean_26, Stream0=stream_gate.Target0, Stream1=explode_object_2)
data_99 = Data(stream_filter_2)
stream_filter_3 = StreamFilter(Gate=boolean_26, Stream0=text_73, Stream1=model_block_definition_2.Name)
list_length_3 = ListLength(List=data_99)
anzahl_objekte_gesamt = Integer(list_length_3)
bauteilnamen = Text(stream_filter_3)
dateiname = Text(text_73)
data_100 = Data(data_99)

# ----
# Presort Curves and Breps
# ERROR | non-parametric solution: Not a parametric solution because some curves and some surfaces can be autoconverted in each user with the containers that are intended to act as filter
data_101 = Data(data_100)
curve = Curve(data_101)
null_item = NullItem(Item=curve)  # -> NullFlags, InvalidFlags, Description
dispatch_2 = Dispatch(List=data_101, DispatchPattern=null_item.NullFlags)  # -> ListA, ListB
curve_2 = Curve(dispatch_2.ListB)
brep = Brep(dispatch_2.ListA)

# ----
# Extract all Breps
brep_2 = Brep(brep)
clean_tree = CleanTree(RemoveNulls=True, RemoveInvalid=True, RemoveEmpty=False, Tree=brep_2)
is_polysurface_closed = IsPolysurfaceClosed(Polysurface=clean_tree)
dispatch_3 = Dispatch(List=clean_tree, DispatchPattern=is_polysurface_closed)  # -> ListA, ListB
list_length_4 = ListLength(List=dispatch_3.ListA)
list_length_5 = ListLength(List=dispatch_3.ListB)
anzahl_erkannter_closed_breps = Integer(list_length_4)
anzahl_erkannter_open_breps = Integer(list_length_5)
brep_3 = Brep(dispatch_3.ListA)
brep_4 = Brep(dispatch_3.ListB)

# ----
# Extract all Curves
curve_3 = Curve(curve_2)
clean_tree_2 = CleanTree(RemoveNulls=True, RemoveInvalid=True, RemoveEmpty=False, Tree=curve_3)
list_length_6 = ListLength(List=clean_tree_2)
join_curves = JoinCurves(Curves=clean_tree_2, Preserve=False)
list_length_7 = ListLength(List=join_curves)
anzahl_signierungskonturen = Integer(list_length_7)
anzahl_erkannter_kurven = Integer(list_length_6)
curve_4 = Curve(join_curves)

# ----
# Amount of identified geometries
anzahl_erkannter_closed_breps_2 = Integer(anzahl_erkannter_closed_breps)
anzahl_erkannter_kurven_2 = Integer(anzahl_erkannter_kurven)
anzahl_erkannter_open_breps_2 = Integer(anzahl_erkannter_open_breps)
addition_2 = Addition(
    AnzahlErkannterClosedBreps=anzahl_erkannter_closed_breps_2,
    AnzahlErkannterOpenBreps=anzahl_erkannter_open_breps_2,
    AnzahlErkannterKurven=anzahl_erkannter_kurven_2)
anzahl_erkannte_geometrien_gesamt = Integer(addition_2)

# ----
# Checksum
anzahl_objekte_gesamt_2 = Integer(anzahl_objekte_gesamt)
anzahl_erkannte_geometrien_gesamt_2 = Integer(anzahl_erkannte_geometrien_gesamt)
subtraction = Subtraction(A=anzahl_erkannte_geometrien_gesamt_2, B=anzahl_objekte_gesamt_2)
equality = Equality(FirstNumber=anzahl_erkannte_geometrien_gesamt_2, SecondNumber=anzahl_objekte_gesamt_2)  # -> Equality, Inequality
difference_to_checksum = Integer(subtraction)
checksum_okay = Boolean(equality.Equality)

# ----
# Try to convert Brep to Sheet
brep_5 = Brep(brep_3)
merge_coplanar_faces = BooleanToggle(False)
integer_10 = Integer("-1")
manifold_to_sheet = ManifoldToSheet(Brep=brep_5, RootFaceIndex=integer_10, MergeCoplanarFaces=merge_coplanar_faces)
sheet = Sheet(manifold_to_sheet)
brep_6 = Brep(brep_5)

curve_5 = Curve(curve_4)
brep_7 = Brep(brep_4)
manifold_to_sheet_2 = ManifoldToSheet(Brep=brep_7, RootFaceIndex=integer_10, MergeCoplanarFaces=merge_coplanar_faces)

# ----
# Beta  - Signierungsanzahl und Längen
curve_6 = Curve(curve_5)
length = Length(Curve=curve_6)
list_length_8 = ListLength(List=length)
mass_addition_4 = MassAddition(Input=length)  # -> Result, PartialResults
gesamtlänge_potentieller_lasersignierung = Number(mass_addition_4.Result)  # "Gesamtlänge potentieller Lasersignierungen"
anzahl_potentieller_lasersignierungen = Integer(list_length_8)

# ----
# Remove parts that are not recognized as Sheetmetal
brep_8 = Brep(brep_6)
sheet_2 = Sheet(sheet)
null_item_2 = NullItem(Item=sheet_2)  # -> NullFlags, InvalidFlags, Description
clean_tree_3 = CleanTree(RemoveNulls=True, RemoveInvalid=True, RemoveEmpty=True, Tree=sheet_2)
dispatch_4 = Dispatch(List=brep_8, DispatchPattern=null_item_2.NullFlags)  # -> ListA, ListB
dispatch_5 = Dispatch(List=sheet_2, DispatchPattern=null_item_2.NullFlags)  # -> ListA, ListB
list_length_9 = ListLength(List=sheet_2)
list_length_10 = ListLength(List=clean_tree_3)
subtraction_2 = Subtraction(A=list_length_9, B=list_length_10)
amount_of_parts_not_recognized_as_sheetm = Integer(subtraction_2)  # "Amount of parts not recognized as Sheetmetal"
amount_of_parts_recognized_as_sheetmetal = Integer(list_length_10)
sheet_3 = Sheet(dispatch_5.ListB)

boolean_27 = Boolean(null_item_2.NullFlags)
breps_not_recognized_as_sheetmetal = Brep(dispatch_4.ListB)
breps_recognized_as_sheetmetal = Brep(dispatch_4.ListA)

breps_not_recognized_as_sheetmetal_2 = Brep(breps_not_recognized_as_sheetmetal)
sheet_4 = Sheet(sheet_3)
compensation_strategy = Slider(0.35, range=0..1)
unroller = Unroller(Sheet=sheet_4, CompensationStrategy=compensation_strategy, Thicken=False)  # -> Unrolled, BendAxes, BendRegions, UnrollResult
null_item_3 = NullItem(Item=unroller.Unrolled)  # -> NullFlags, InvalidFlags, Description
dispatch_6 = Dispatch(List=sheet_4, DispatchPattern=null_item_3.NullFlags)  # -> ListA, ListB
dispatch_7 = Dispatch(List=unroller.Unrolled, DispatchPattern=null_item_3.NullFlags)  # -> ListA, ListB
dispatch_8 = Dispatch(List=breps_not_recognized_as_sheetmetal_2, DispatchPattern=null_item_3.NullFlags)  # -> ListA, ListB
brep_9 = Brep(dispatch_7.ListA)
brep_10 = Brep(dispatch_7.ListB)
list_length_11 = ListLength(List=brep_9)
list_length_12 = ListLength(List=brep_10)
merge_faces = MergeFaces(Brep=brep_10)  # -> Breps, Before, After
breps_not_recognized_as_sheetmetal_and_f = Brep(dispatch_8.ListB)  # "Breps not recognized as Sheetmetal and failed to unroll"
breps_not_recognized_as_sheetmetal_but_u = Brep(dispatch_8.ListA)  # "Breps not recognized as Sheetmetal but unrolled"
amount_of_sheetmetal_unrolling_errors = Integer(list_length_11)
amount_of_valid_sheetmetal_parts = Integer(list_length_12)
boolean_unrolled_null_flags = Boolean(null_item_3.NullFlags)
brep_11 = Brep(merge_faces.Breps)
sheet_5 = Sheet(dispatch_6.ListB)

# ----
# Colored Previews
closed_breps = Brep(brep_7)
breps_recognized_as_sheetmetal_2 = Brep(breps_recognized_as_sheetmetal)
breps_not_recognized_as_sheetmetal_and_f_2 = Brep(breps_not_recognized_as_sheetmetal_and_f)  # "Breps not recognized as Sheetmetal and failed to unroll"
breps_not_recognized_as_sheetmetal_but_u_2 = Brep(breps_not_recognized_as_sheetmetal_but_u)  # "Breps not recognized as Sheetmetal but unrolled"
open_breps_not_closed = ColourSwatch(SwatchColor=RGB(255, 217, 0))
breps_recognized_as_sheetmetal_3 = ColourSwatch(SwatchColor=RGB(125, 125, 125))
closed_breps_not_recognized_as_sheetmeta = ColourSwatch(SwatchColor=RGB(161, 0, 0))  # "Closed Breps not recognized as Sheetmetal"
breps_recognized_as_sheetmetal_but_not_u = ColourSwatch(SwatchColor=RGB(227, 145, 30))  # "Breps recognized as Sheetmetal but not unrollable"

curve_7 = Curve(curve_5)
text_74 = Text("Signierung")
number_6 = Number("3")
model_linetype = ModelLinetype(Name=text_74, Width=number_6, WidthUnits=2)  # -> Linetype, Name, Segments, CapStyle, JoinStyle, Width, WidthUnits, ScalingStyle
curve_middle = CurveMiddle(Curve=curve_7)
colour_swatch = ColourSwatch(SwatchColor=RGB(0, 255, 42))
size = Slider(25, range=0..100)
symbol_simple = SymbolSimple(Style=13, Size=size, Rotation=0, Colour=colour_swatch)

get_objects_in_group = GetObjectsInGroup()
show_invalid_parts_preview = CustomPreview(InvalidParts=closed_breps, Material=open_breps_not_closed)
show_invalid_parts_preview_2 = CustomPreview(InvalidParts=breps_recognized_as_sheetmetal_2, Material=closed_breps_not_recognized_as_sheetmeta)
show_invalid_parts_preview_3 = CustomPreview(InvalidParts=breps_not_recognized_as_sheetmetal_but_u_2, Material=breps_recognized_as_sheetmetal_but_not_u)

show_sheetmetal_parts_preview = CustomPreview(SheetmetalParts=breps_not_recognized_as_sheetmetal_and_f_2, Material=breps_recognized_as_sheetmetal_3)
get_objects_in_group_2 = GetObjectsInGroup()

show_invalid_parts_2 = RemoteReceiver(show_invalid_parts)
boolean_28 = Boolean(show_invalid_parts_2)
hide_show_object_preview = HideShowObjectPreview(Objects=get_objects_in_group, Visible=boolean_28)

show_sheetmetal_parts_2 = RemoteReceiver(show_sheetmetal_parts)
boolean_29 = Boolean(show_sheetmetal_parts_2)
hide_show_object_preview_2 = HideShowObjectPreview(Objects=get_objects_in_group_2, Visible=boolean_29)

get_objects_in_group_3 = GetObjectsInGroup()
show_laser_markings_location_preview = SymbolDisplay(Location=curve_middle, Display=symbol_simple)
show_laser_markings_preview = CustomCurvePreview(PotentialLaserMarkings=curve_7, Linetype=model_linetype.Linetype, Colour=colour_swatch)

show_laser_markings_2 = RemoteReceiver(show_laser_markings)
boolean_30 = Boolean(show_laser_markings_2)
hide_show_object_preview_3 = HideShowObjectPreview(Objects=get_objects_in_group_3, Visible=boolean_30)

anzahl_potentieller_lasersignierungen_2 = Integer(anzahl_potentieller_lasersignierungen)
dateiname_2 = Text(dateiname)
bauteilnamen_2 = Text(bauteilnamen)
checksum_okay_2 = Boolean(checksum_okay)
anzahl_erkannter_closed_breps_3 = Integer(anzahl_erkannter_closed_breps)
amount_of_parts_not_recognized_as_sheetm_2 = Integer(amount_of_parts_not_recognized_as_sheetm)  # "Amount of parts not recognized as Sheetmetal"
sheet_6 = Sheet(sheet_5)
amount_of_sheetmetal_unrolling_errors_2 = Integer(amount_of_sheetmetal_unrolling_errors)
amount_of_valid_sheetmetal_parts_2 = Integer(amount_of_valid_sheetmetal_parts)
brep_12 = Brep(brep_11)
gesamtlänge_potentieller_lasersignierung_2 = Number(gesamtlänge_potentieller_lasersignierung)  # "Gesamtlänge potentieller Lasersignierungen"
index_mateial_selection_2 = Integer(integer_index_mateial_selection)
datenquelle_material_3 = Text(datenquelle_material)

# ----
# Create Selected Material Values
index_mateial_selection_3 = Integer(index_mateial_selection_2)
datenquelle_material_4 = Text(datenquelle_material_3)
tree_statistics = TreeStatistics(Tree=datenquelle_material_4)  # -> Paths, Length, Count
list_item_7 = ListItem(List=tree_statistics.Paths, Index=index_mateial_selection_3, Wrap=True)
tree_branch = TreeBranch(Tree=datenquelle_material_4, Path=list_item_7, MaintainPaths=True)
unweave_pattern = Panel("""0
1
2
3""")
selected_material = Text(tree_branch)
unweave = Unweave(List=selected_material, UnweavePattern=unweave_pattern)  # -> Data0, Data1, Data2, Data3
material_max_stärke_laser_intern_mm = Number(unweave.Data3)
material_dichte_g_cm³ = Number(unweave.Data1)
material_preis_kg = Number(unweave.Data2)
material_typ = Text(unweave.Data0)

bauteilnamen_3 = Text(bauteilnamen_2)

parts_not_recognized_as_sheetmetal = Integer(amount_of_parts_not_recognized_as_sheetm_2)
amount_of_sheetmetal_unrolling_errors_3 = Integer(amount_of_sheetmetal_unrolling_errors_2)
addition_3 = Addition(
    PartsNotRecognizedAsSheetmetal=parts_not_recognized_as_sheetmetal,
    AmountOfSheetmetalUnrollingErrors=amount_of_sheetmetal_unrolling_errors_3)
total_amout_of_invalid_parts = Integer(addition_3)

# ----
# Amount of Unique Parts
text_75 = Text(bauteilnamen_3)
create_set = CreateSet(List=text_75)  # -> Set, Map
clone_structure = CloneStructure(List=text_75, Structure=create_set.Map)
list_length_13 = ListLength(List=create_set.Set)
anzahl_einzigartiger_bauteile = Integer(list_length_13)

text_sorted_parts = Text(clone_structure)

# ----
# Density & Price Override
material_dichte_g_cm³_2 = Number(material_dichte_g_cm³)
material_preis_kg_2 = Number(material_preis_kg)
boolean_31 = Boolean(index_mateial_selection_2)
index_mateial_selection_4 = Boolean(invert(boolean_31))
synapse_material_density_ui_2 = RemoteReceiver(synapse_material_density_ui)
synapse_material_price_ui_2 = RemoteReceiver(synapse_material_price_ui)
text_76 = Text("Enabled")
snpoverride_4 = SnpOverride(Property=text_76, Value=index_mateial_selection_4, Control=synapse_material_density_ui_2)
snpoverride_5 = SnpOverride(Property=text_76, Value=index_mateial_selection_4, Control=synapse_material_price_ui_2)
snpvaluequery_13 = SnpValueQuery(SynapseObject=synapse_material_density_ui_2, Update=snpoverride_4)
snpvaluequery_14 = SnpValueQuery(SynapseObject=synapse_material_price_ui_2, Update=snpoverride_5)
stream_filter_4 = StreamFilter(Gate=index_mateial_selection_4, Stream0=material_dichte_g_cm³_2, Stream1=snpvaluequery_13)
stream_filter_5 = StreamFilter(Gate=index_mateial_selection_4, Stream0=material_preis_kg_2, Stream1=snpvaluequery_14)
material_dichte_g_cm³_3 = Number(stream_filter_4)
material_preis_kg_3 = Number(stream_filter_5)
text_77 = Text("Value")
snpoverride_6 = SnpOverride(Property=text_77, Value=material_dichte_g_cm³_3, Control=synapse_material_density_ui_2)
snpoverride_7 = SnpOverride(Property=text_77, Value=material_preis_kg_3, Control=synapse_material_price_ui_2)
material_dichte_g_cm³_4 = Number(material_dichte_g_cm³_3)
material_preis_kg_4 = Number(material_preis_kg_3)

# ----
# Programmierung
programmier_stundensatz_2 = Number(programmier_stundensatz)
anzahl_einzigartiger_bauteile_2 = Integer(anzahl_einzigartiger_bauteile)
minuten = Panel("60")
programmieraufwand_pro_bauteil_min_2 = Number(programmieraufwand_pro_bauteil_min)
number_7 = Number(minuten)
division = Division(ProgrammierStundensatz=programmier_stundensatz_2, _60=number_7)
multiplication_2 = Multiplication(
    ProgrammieraufwandProBauteilMin=programmieraufwand_pro_bauteil_min_2,
    AnzahlEinzigartigerBauteile=anzahl_einzigartiger_bauteile_2)
multiplication_3 = Multiplication(ProgrammiererMin=division, GesamtProgrammieraufwandMin=multiplication_2)
kosten_programmierung_gesamt = Number(multiplication_3)

# ----
# Material informations
material_max_stärke_laser_intern_mm_2 = Number(material_max_stärke_laser_intern_mm)
material_dichte_g_cm³_5 = Number(material_dichte_g_cm³_4)
material_preis_kg_5 = Number(material_preis_kg_4)
material_typ_2 = Text(material_typ)

anzahl_einzigartiger_bauteile_3 = Integer(anzahl_einzigartiger_bauteile_2)

# ----
# Gewicht Bauteil (g)
sheet_7 = Sheet(sheet_6)
brep_13 = Brep(brep_12)
material_dichte_g_cm³_6 = Number(material_dichte_g_cm³_5)
sheet_info = SheetInfo(Sheet=sheet_7)  # -> Flanges, Bends, Hems, IHoles, NIHoles, CHoles, Thickness, port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
area = Area(Geometry=brep_13)
blechstärke = Number(sheet_info.Thickness)
blechfläche_mm2 = Multiplication(BlechstärkeMm=blechstärke, BlechflächeMm²=area)
volumen_der_blechteile_mm³ = Number(blechfläche_mm2)
division_2 = Division(VolumenDerBlechteileMm³=volumen_der_blechteile_mm³, _1000=1000)
material_dichte_g_cm³_7 = Number(material_dichte_g_cm³_6)
multiplication_4 = Multiplication(VolumenDerBlechteileCm³=division_2, MaterialDichteGCm³=material_dichte_g_cm³_7)
gewicht_der_blechteile_g = Number(multiplication_4)

brep_14 = Brep(brep_12)
sheet_8 = Sheet(sheet_6)

# ----
# Kantung - Hem detection is working now - Wie sollen Hems bewertet werden?
sheet_9 = Sheet(sheet_6)
sheet_info_2 = SheetInfo(Sheet=sheet_9)  # -> Flanges, Bends, Hems, IHoles, NIHoles, CHoles, Thickness, port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
anzahl_der_kantungen_im_teil_doppelt = Number(sheet_info_2.Hems)
anzahl_der_kantungen_im_teil_einfach = Number(sheet_info_2.Bends)
create_set_2 = CreateSet(List=sheet_info_2.BendRadius)  # -> Set, Map
list_length_14 = ListLength(List=create_set_2.Set)
mass_addition_5 = MassAddition(Input=anzahl_der_kantungen_im_teil_einfach)  # -> Result, PartialResults
mass_addition_6 = MassAddition(Input=anzahl_der_kantungen_im_teil_doppelt)  # -> Result, PartialResults
anzahl_der_kantungen_in_der_baugruppe_do = Number(mass_addition_6.Result)  # "Anzahl der Kantungen in der Baugruppe (doppelt)"
anzahl_der_kantungen_in_der_baugruppe_ei = Number(mass_addition_5.Result)  # "Anzahl der Kantungen in der Baugruppe (einfach)"
anzahl_der_kantungen_im_teil_doppelt_2 = Number(anzahl_der_kantungen_im_teil_doppelt)
anzahl_der_kantungen_im_teil_einfach_2 = Number(anzahl_der_kantungen_im_teil_einfach)
anzahl_unterschiedlicher_biegeradien = Integer(list_length_14)
bend_angle = Number(sheet_info_2.BendAngle)

# ----
# Oberfläche
brep_15 = Brep(sheet_6)
area_2 = Area(Geometry=brep_15)
division_3 = Division(BlechteilOberflächeEinzelnMm²=area_2, _1e6=1000000)
mass_addition_7 = MassAddition(Input=division_3)  # -> BlechteilOberflächeGesamtM², PartialResults
blechteil_oberfläche_einzeln_m² = Number(division_3)
blechteil_oberfläche_gesamt_m² = Number(mass_addition_7.BlechteilOberflächeGesamtM²)
blechteil_oberfläche_gesamt_m²_2 = Number(blechteil_oberfläche_gesamt_m²)
blechteil_oberfläche_einzeln_m²_2 = Number(blechteil_oberfläche_einzeln_m²)

# ----
# Laserschnittlängen und Einstichpunkte
brep_16 = Brep(brep_14)
merge_faces_2 = MergeFaces(Brep=brep_16)  # -> Breps, Before, After
brep_wireframe = BrepWireframe(Brep=merge_faces_2.Breps, Density=-1)
join_curves_2 = JoinCurves(Curves=brep_wireframe, Preserve=False)
closed = Closed(Curve=brep_wireframe)  # -> Closed, Periodic
dispatch_9 = Dispatch(List=brep_wireframe, DispatchPattern=closed.Closed)  # -> ListA, ListB
list_length_15 = ListLength(List=join_curves_2)
circle = Circle(dispatch_9.ListA)
mass_addition_8 = MassAddition(Input=flatten(list_length_15))  # -> Result, PartialResults
length_2 = Length(Curve=join_curves_2)
deconstruct_arc = DeconstructArc(Arc=circle)  # -> BasePlane, Radius, Angle
match_tree = MatchTree(Tree=deconstruct_arc.Radius, Guide=length_2)
merge_40 = Merge(Data1=simplify(length_2), Data2=simplify(match_tree))
mass_addition_9 = MassAddition(Input=merge_40)  # -> Result, PartialResults
mass_addition_10 = MassAddition(Input=flatten(mass_addition_9.Result))  # -> Result, PartialResults
gesamtkonturlänge_baugruppe_mit_löcher_m = Number(mass_addition_10.Result)  # "Gesamtkonturlänge Baugruppe mit Löcher (mm)"
gesamtzahl_einstichpunkte_baugruppe = Integer(mass_addition_8.Result)
gesamtzahl_einstichpunkte_bauteil = Integer(list_length_15)
gesamtkonturlänge_bauteil_mm = Number(mass_addition_9.Result)

sheet_10 = Sheet(sheet_8)
surface = Surface(brep_14)

# ----
# Außenkontur
brep_17 = Brep(brep_14)
brep_edges = BrepEdges(Brep=brep_17)  # -> Naked, Interior, NonManifold
join_curves_3 = JoinCurves(Curves=brep_edges.Naked, Preserve=False)
curve_8 = Curve(join_curves_3)
area_3 = Area(Geometry=curve_8)
index_0 = Index(0)
sort_list = SortList(Keys=area_3, ValuesValuesA=curve_8)  # -> Keys, reverse(ValuesValuesA)
cull_index = CullIndex(List=sort_list.ValuesValuesA, Indices=index_0, Wrap=True)
list_item_8 = ListItem(List=sort_list.ValuesValuesA, Index=index_0, Wrap=True)
curve_middle_2 = CurveMiddle(Curve=cull_index)
curve_9 = Curve(list_item_8)
closed_2 = Closed(Curve=curve_9)  # -> Closed, Periodic
point_in_curve = PointInCurve(Point=curve_middle_2, Curve=curve_9)  # -> Relationship, Point
curve_10 = Curve(curve_9)
equality_2 = Equality(FirstNumber=point_in_curve.Relationship, SecondNumber=2)  # -> Equality, Inequality
list_length_16 = ListLength(List=point_in_curve.Relationship)
mass_addition_11 = MassAddition(Input=equality_2.Equality)  # -> Result, PartialResults
equality_3 = Equality(FirstNumber=list_length_16, SecondNumber=mass_addition_11.Result)  # -> Equality, Inequality
gate_and_3 = GateAnd(A=closed_2.Closed, B=equality_3.Equality)
are_contour_curves_valid = Boolean(gate_and_3)
curve_11 = Curve(curve_10)
are_contour_curves_valid_2 = Boolean(are_contour_curves_valid)
sift_pattern = SiftPattern(List=curve_11, SiftPattern=are_contour_curves_valid_2)  # -> Output0, Output1
flatten_tree = FlattenTree(Tree=sift_pattern.Output1, Path="{0}")
curve_12 = Curve(flatten_tree)

bend_angle_2 = Number(bend_angle)
nulls_in_empty_branches = NullsInEmptyBranches(DataWithEmptyBranches=bend_angle_2)
list_length_17 = ListLength(List=bend_angle_2)
number_8 = Number("0")
bauteil_muss_gekantet_werden = Boolean(list_length_17)
replace_nulls = ReplaceNulls(Items=nulls_in_empty_branches, Replacements=number_8)  # -> Items, Count
bauteil_muss_gekantet_werden_2 = Boolean(bauteil_muss_gekantet_werden)
tree_statistics_2 = TreeStatistics(Tree=replace_nulls.Items)  # -> Paths, Length, Count
dispatch_10 = Dispatch(List=tree_statistics_2.Paths, DispatchPattern=flatten(bauteil_muss_gekantet_werden_2))  # -> ListA, ListB
mass_addition_12 = MassAddition(BauteilMussGekantetWerden=flatten(bauteil_muss_gekantet_werden_2))  # -> AnzahlDerBauteileMitKantungen, PartialResults
tree_branch_2 = TreeBranch(Tree=replace_nulls.Items, Path=dispatch_10.ListA, MaintainPaths=True)
tree_branch_3 = TreeBranch(Tree=replace_nulls.Items, Path=dispatch_10.ListB, MaintainPaths=True)
pi = Pi(Factor=1)
anzahl_der_bauteile_mit_kantungen = Integer(mass_addition_12.AnzahlDerBauteileMitKantungen)
division_4 = Division(A=tree_branch_2, B=pi)
absolute = Absolute(Value=division_4)
division_5 = Division(A=absolute, _05=0.5)
modulus = Modulus(A=division_5, B=1)
equality_within_tolerance = EqualityWithinTolerance(FirstNumber=modulus, SecondNumber=0, Tolerance=0.001)  # -> Equality, Inequality
sift_pattern_2 = SiftPattern(List=division_5, SiftPattern=equality_within_tolerance.Equality)  # -> Output0, Output1
integer_11 = Integer("0")
replace_nulls_2 = ReplaceNulls(Items=sift_pattern_2.Output1, Replacements=integer_11)  # -> Items, Count
_1_2 = Integer(1)
_0 = Integer(0)
replace_text = ReplaceText(Text=replace_nulls_2.Items, Find=_0, Replace=_1_2, RecursiveReplace=False)
mass_addition_13 = MassAddition(Input=replace_text)  # -> Result, PartialResults
merge_41 = Merge(Data1=mass_addition_13.Result, Data2=tree_branch_3)
mass_addition_14 = MassAddition(Input=flatten(mass_addition_13.Result))  # -> AnzahlKantvorgängeGesamt, PartialResults
anzahl_der_bauteile_mit_kantungen_2 = Integer(anzahl_der_bauteile_mit_kantungen)
anzahl_kantvorgänge_pro_bauteil = Integer(merge_41)
anzahl_kantvorgänge_gesamt = Number(mass_addition_14.AnzahlKantvorgängeGesamt)
typ_kantung = Integer(replace_nulls_2.Items)
data_102 = Data(tree_branch_3)

# ----
# Gewicht (g) to (kg)
gewicht_der_blechteile_g_2 = Number(gewicht_der_blechteile_g)
mass_addition_15 = MassAddition(GewichtDerBlechteileG=gewicht_der_blechteile_g_2)  # -> Gewicht, PartialResults
division_6 = Division(GewichtDerBlechteileG=gewicht_der_blechteile_g_2, _1000=1000)
gewicht_der_baugruppen_g = Number(mass_addition_15.Gewicht)
gewicht_der_blechteile_kg = Number(division_6)

# ---- group: Ende
length_3 = Length(Curve=dispatch_9.ListB)
mass_addition_16 = MassAddition(Input=length_3)  # -> Result, PartialResults
schnittlänge_der_konturen_innen_und_auße = Number(mass_addition_16.Result)  # "Schnittlänge der Konturen innen und außen"
schnittgeschwindigkeit = Number()
multiplication_5 = Multiplication(A=schnittlänge_der_konturen_innen_und_auße, B=schnittgeschwindigkeit)
laserlaufzeit_kontur = Number(multiplication_5)

# ----
# Gewicht Baugruppe gerundet (kg)
rundungsschritte = Panel("""0.001
0.01
0.1""")
gewicht_der_baugruppen_g_2 = Number(gewicht_der_baugruppen_g)
kg_für_spezielle_rundungsschritte = Panel("""1
10
100""")
division_7 = Division(GewichtDerBaugruppenG=gewicht_der_baugruppen_g_2, _1000=1000)
gewicht_der_baugruppen_kg = Number(division_7)
larger_than_3 = LargerThan(FirstNumber=gewicht_der_baugruppen_kg, SecondNumber=kg_für_spezielle_rundungsschritte)  # -> LargerThan, OrEqualTo
mass_addition_17 = MassAddition(Input=larger_than_3.LargerThan)  # -> Result, PartialResults
list_item_9 = ListItem(List=rundungsschritte, Index=mass_addition_17.Result, Wrap=True)
round_to_factor = RoundToFactor(NumberX=gewicht_der_baugruppen_kg, Factor=list_item_9, RoundType=0)  # -> Rounded, Difference, MultiplierR, MultiplierX
gewicht_der_baugruppe_gerundet_kg = Number(round_to_factor.Rounded)

# ----
# Gewicht Bauteile gerundet (kg)
gewicht_der_baugruppen_kg_2 = Number(gewicht_der_blechteile_kg)
kg_für_spezielle_rundungsschritte_2 = Panel("""1
10
100""")
rundungsschritte_2 = Panel("""0.001
0.01
0.1""")
larger_than_4 = LargerThan(FirstNumber=gewicht_der_baugruppen_kg_2, SecondNumber=kg_für_spezielle_rundungsschritte_2)  # -> LargerThan, OrEqualTo
mass_addition_18 = MassAddition(Input=larger_than_4.LargerThan)  # -> Result, PartialResults
list_item_10 = ListItem(List=rundungsschritte_2, Index=mass_addition_18.Result, Wrap=True)
round_to_factor_2 = RoundToFactor(NumberX=gewicht_der_baugruppen_kg_2, Factor=list_item_10, RoundType=0)  # -> Rounded, Difference, MultiplierR, MultiplierX
gewicht_der_bauteile_gerundet_kg = Number(round_to_factor_2.Rounded)

surface_2 = Surface(surface)
curve_13 = Curve(curve_12)
sheet_11 = Sheet(sheet_10)
null_item_4 = NullItem(Item=curve_13)  # -> NullFlags, InvalidFlags, Description
dispatch_11 = Dispatch(List=flatten(sheet_11), DispatchPattern=null_item_4.NullFlags)  # -> ListA, graft(ListB)
dispatch_12 = Dispatch(List=flatten(surface), DispatchPattern=null_item_4.NullFlags)  # -> ListA, graft(ListB)
dispatch_13 = Dispatch(List=curve_13, DispatchPattern=null_item_4.NullFlags)  # -> ListA, graft(ListB)
sheet_12 = Sheet(dispatch_11.ListB)
surface_3 = Surface(dispatch_12.ListB)
curve_14 = Curve(dispatch_13.ListB)

# ----
# Bauteil schwerer als 25kg?
gewicht_der_bauteile_gerundet_kg_2 = Number(gewicht_der_bauteile_gerundet_kg)
maximalgewicht = Panel("24.99")
larger_than_5 = LargerThan(FirstNumber=gewicht_der_bauteile_gerundet_kg_2, SecondNumber=maximalgewicht)  # -> LargerThan, OrEqualTo
bauteil_schwerer_als_25kg = Boolean(larger_than_5.LargerThan)
mass_addition_19 = MassAddition(Input=bauteil_schwerer_als_25kg)  # -> Result, PartialResults
integer_12 = Integer(mass_addition_19.Result)
anzahl_bauteile_schwerer_als_25kg = Boolean(integer_12)
bauteil_schwerer_als_25kg_2 = Boolean(bauteil_schwerer_als_25kg)

gewicht_der_bauteile_gerundet_kg_3 = Number(gewicht_der_bauteile_gerundet_kg)

# ----
# Blechpreis ohne Verschnitt (€)
gewicht_der_bauteile_gerundet_kg_4 = Number(gewicht_der_bauteile_gerundet_kg)
material_preis_kg_6 = Number(material_preis_kg_5)
multiplication_6 = Multiplication(GewichtDerBauteileGerundetKg=gewicht_der_bauteile_gerundet_kg_4, MaterialPreisKg=material_preis_kg_6)
mass_addition_20 = MassAddition(Input=multiplication_6)  # -> Result, PartialResults
blechpreis_baugruppe_ohne_verschnitt = Number(mass_addition_20.Result)
blechpreis_bauteile_ohne_verschnitt = Number(multiplication_6)

gesamtzahl_einstichpunkte_bauteil_2 = Integer(gesamtzahl_einstichpunkte_bauteil)
gesamtkonturlänge_bauteil_mm_2 = Number(gesamtkonturlänge_bauteil_mm)
surface_4 = Surface(surface_3)
gewicht_der_blechteile_kg_2 = Number(gewicht_der_blechteile_kg)
sheet_13 = Sheet(sheet_12)
curve_15 = Curve(curve_14)
sheet_info_3 = SheetInfo(Sheet=sheet_13)  # -> Flanges, Bends, Hems, IHoles, NIHoles, CHoles, Thickness, port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
blechstärke_2 = Number(flatten(sheet_info_3.Thickness))
create_set_3 = CreateSet(List=blechstärke_2)  # -> Set, Map
list_indices = ListIndices(List=create_set_3.Set)
map_blechstärke = Integer(create_set_3.Map)
map_blechstärke_2 = Integer(create_set_3.Map)
member_index = MemberIndex(UniqueBlechstärke=create_set_3.Map, Member=list_indices)  # -> Index, AnzahlDerTeileProBlechstärke
clone_structure_2 = CloneStructure(List=flatten(gewicht_der_blechteile_kg_2), Structure=map_blechstärke)
clone_structure_3 = CloneStructure(List=flatten(gesamtzahl_einstichpunkte_bauteil_2), Structure=map_blechstärke)
clone_structure_4 = CloneStructure(List=flatten(gesamtkonturlänge_bauteil_mm_2), Structure=map_blechstärke)
clone_structure_5 = CloneStructure(List=flatten(surface_4), Structure=map_blechstärke_2)
clone_structure_6 = CloneStructure(List=flatten(curve_15), Structure=map_blechstärke_2)
anzahl_der_teile_pro_blechstärke = Integer(member_index.AnzahlDerTeileProBlechstärke)
mass_addition_21 = MassAddition(Input=clone_structure_2)  # -> Result, PartialResults
mass_addition_22 = MassAddition(Input=clone_structure_3)  # -> Result, PartialResults
mass_addition_23 = MassAddition(Input=clone_structure_4)  # -> Result, PartialResults
unique_blechstärke = Number(flatten(create_set_3.Set))
unique_blechstärke_2 = Number(graft(create_set_3.Set))
sort_list_2 = SortList(
    UniqueBlechstärke=unique_blechstärke,
    ValuesUniqueBlechstärke=unique_blechstärke,
    ValuesAnzahlDerTeileProBlechstärke=anzahl_der_teile_pro_blechstärke)  # -> Keys, ValuesUniqueBlechstärke, ValuesAnzahlDerTeileProBlechstärke
gesamtzahl_einstichpunkte_pro_blechtärke = Integer(mass_addition_22.Result)
gesamtkonturlänge_pro_blechstärke_mm = Number(mass_addition_23.Result)
anzahl_der_teile_pro_blechstärke_2 = Integer(sort_list_2.ValuesAnzahlDerTeileProBlechstärke)
gegraftete_unique_blechstärke = Number(unique_blechstärke_2)
gewicht_pro_blechsorte_kg = Number(mass_addition_21.Result)
unique_blechstärke_3 = Number(create_set_3.Set)
unique_blechstärke_4 = Number(sort_list_2.ValuesUniqueBlechstärke)
map_blechstärke_3 = Integer(create_set_3.Map)
surface_5 = Surface(clone_structure_5)
curve_16 = Curve(clone_structure_6)

# ----
# Prüfung Blechtafel Kompatibilität
text_78 = Text(text_62)
curve_17 = Curve(curve_14)
bounding_rectangle = BoundingRectangle(Geometry=curve_17, Plane=PlaneXY(0, 0, 0), Axis=0, Slide=0, Union=False)  # -> Bounding, DimensionX, DimensionY
unweave_pattern_2 = Panel("""0
1
2
3""")
unweave_2 = Unweave(List=text_78, UnweavePattern=unweave_pattern_2)  # -> Data0, Data1, Data2, Data3
number_slider_2 = Slider(0.1, range=0..0.1)
number_9 = Number(bounding_rectangle.DimensionX)
number_10 = Number(bounding_rectangle.DimensionY)
maximum = Maximum(A=number_9, B=number_10)
minimum = Minimum(A=number_9, B=number_10)
subtraction_3 = Subtraction(A=unweave_2.Data0, B=number_slider_2)
subtraction_4 = Subtraction(A=unweave_2.Data1, B=number_slider_2)
x_domain_blechtafel = Domain(unweave_2.Data0)
xml_version_1_0_encoding_utf_8_standalon = Domain(unweave_2.Data1)  # "<?xml version=\"1.0\" encoding=\"utf-8\" standalone=\"yes\"?>"
text_79 = Text(unweave_2.Data2)
number_11 = Number(subtraction_3)
number_12 = Number(subtraction_4)
maximum_2 = Maximum(A=number_11, B=number_12)  # -> flatten(Result)
minimum_2 = Minimum(A=number_11, B=number_12)  # -> flatten(Result)
rectangle = Rectangle(Plane=PlaneXY(0, 0, 0), XSize=x_domain_blechtafel, YSize=xml_version_1_0_encoding_utf_8_standalon, Radius=0)  # -> Rectangle, Length
division_8 = Division(A=maximum_2, B=maximum)
division_9 = Division(A=minimum_2, B=minimum)
larger_than_6 = LargerThan(FirstNumber=division_8, SecondNumber=_1)  # -> LargerThan, OrEqualTo
larger_than_7 = LargerThan(FirstNumber=division_9, SecondNumber=_1)  # -> LargerThan, OrEqualTo
list_indices_2 = ListIndices(List=flatten(rectangle.Rectangle))
gate_and_4 = GateAnd(A=larger_than_6.OrEqualTo, B=larger_than_7.OrEqualTo)
dispatch_14 = Dispatch(BlechtafelFormate=flatten(list_indices_2), DispatchPattern=gate_and_4)  # -> GeeigneteBlechtafelFormate, UngeeigneteBlechtafelFormate
bounds = Bounds(Numbers=dispatch_14.GeeigneteBlechtafelFormate)
domain = Domain(bounds)
rectangle_2 = Rectangle(rectangle.Rectangle)

text_80 = Text(text_64)
unweave_pattern_3 = Panel("""0
1
2""")
typ_kantung_2 = Integer(typ_kantung)
data_103 = Data(data_102)
integer_13 = Integer(unweave_pattern_3)
unweave_3 = Unweave(List=text_80, UnweavePattern=integer_13)  # -> Data0, Data1, Data2
list_item_11 = ListItem(KantungZeitMin=flatten(unweave_3.Data1), Index=typ_kantung_2, Wrap=True)
list_item_12 = ListItem(KantungZeitMax=flatten(unweave_3.Data2), Index=typ_kantung_2, Wrap=True)
panel_29 = Panel(unweave_3.Data1)
mass_addition_24 = MassAddition(Input=list_item_11)  # -> Result, PartialResults
mass_addition_25 = MassAddition(Input=list_item_12)  # -> Result, PartialResults
merge_42 = Merge(Data1=data_103, Data2=mass_addition_24.Result)
merge_43 = Merge(Data1=data_103, Data2=mass_addition_25.Result)
merge_44 = Merge(Data1=merge_42, Data2=merge_43)
average = Average(Input=merge_44)
mass_addition_26 = MassAddition(Input=flatten(average))  # -> Result, PartialResults
mass_addition_27 = MassAddition(Input=flatten(mass_addition_24.Result))  # -> Result, PartialResults
mass_addition_28 = MassAddition(Input=flatten(mass_addition_25.Result))  # -> Result, PartialResults
minuten_in_h = Panel("60")
integer_14 = Integer(minuten_in_h)
decimal_places_3 = Panel("2")
division_10 = Division(A=mass_addition_27.Result, B=integer_14)
division_11 = Division(A=mass_addition_28.Result, B=integer_14)
division_12 = Division(A=mass_addition_26.Result, B=integer_14)
integer_15 = Integer(decimal_places_3)
round_to_decimal_place = RoundToDecimalPlace(NumberX=division_12, DecimalPlace=integer_15, RoundType=0)  # -> DurchschnittlicheKantzeitGesamtH, Difference
round_to_decimal_place_2 = RoundToDecimalPlace(NumberX=division_10, DecimalPlace=integer_15, RoundType=0)  # -> DurchschnittlicheKantzeitGesamtH, Difference
round_to_decimal_place_3 = RoundToDecimalPlace(NumberX=division_11, DecimalPlace=integer_15, RoundType=0)  # -> DurchschnittlicheKantzeitGesamtH, Difference
durchschnittliche_kantzeit_gesamt_h = Number(round_to_decimal_place.DurchschnittlicheKantzeitGesamtH)
maximum_kantzeit_gesamt_h = Number(round_to_decimal_place_3.DurchschnittlicheKantzeitGesamtH)
minimum_kantzeit_gesamt_h = Number(round_to_decimal_place_2.DurchschnittlicheKantzeitGesamtH)

# ---- group: Ende
text_81 = Text(text_79)
number_13 = Number(x_domain_blechtafel)
number_14 = Number(xml_version_1_0_encoding_utf_8_standalon)
format_2 = Format(Format="{0} {1}x{2}", Culture=127, Data0=text_81, Data1=number_13, Data2=number_14)
text_82 = Text(format_2)
dispatch_15 = Dispatch(BlechtafelFormate=flatten(rectangle.Rectangle), DispatchPattern=gate_and_4)  # -> GeeigneteBlechtafelFormate, UngeeigneteBlechtafelFormate
dispatch_16 = Dispatch(BlechtafelFormate=flatten(text_82), DispatchPattern=gate_and_4)  # -> GeeigneteBlechtafelFormate, UngeeigneteBlechtafelFormate
rectangle_3 = Rectangle(dispatch_15.GeeigneteBlechtafelFormate)
list_item_13 = ListItem(List=dispatch_16.GeeigneteBlechtafelFormate, Index=0, Wrap=True)
list_item_14 = ListItem(List=rectangle_3, Index=0, Wrap=True)
kleinste_geeignete_blechtafel_formate = Text(list_item_13)
geeignete_blechtafel_formate = Text(dispatch_16.GeeigneteBlechtafelFormate)
rectangle_4 = Rectangle(rectangle_3)
rectangle_5 = Rectangle(list_item_14)

# ----
# Kosten Kantpresse
betriebskosten_kantpresse_maschine_mann_2 = Number(betriebskosten_kantpresse_maschine_mann)  # "Betriebskosten Kantpresse (Maschine + Mann) €/h"
durchschnittliche_kantzeit_gesamt_h_2 = Number(durchschnittliche_kantzeit_gesamt_h)
multiplication_7 = Multiplication(
    BetriebskostenKantpresseMaschineMannH=betriebskosten_kantpresse_maschine_mann_2,
    KantzeitGesamtH=durchschnittliche_kantzeit_gesamt_h_2)
kosten_kantpresse_gesamt = Number(multiplication_7)

surface_6 = Surface(surface_5)
curve_18 = Curve(curve_16)
unique_blechstärke_5 = Number(unique_blechstärke_3)
gegraftete_unique_blechstärke_2 = Number(gegraftete_unique_blechstärke)

# ----
# Find smallest possible plate per thickness
rectangle_6 = Rectangle(rectangle_2)
domain_2 = Domain(domain)
map_blechstärke_4 = Integer(map_blechstärke_3)
clone_structure_7 = CloneStructure(List=flatten(domain_2), Structure=map_blechstärke_4)
deconstruct_domain = DeconstructDomain(Domain=clone_structure_7)  # -> Start, End
bounds_2 = Bounds(Numbers=deconstruct_domain.Start)
bounds_3 = Bounds(Numbers=deconstruct_domain.End)
deconstruct_domain_2 = DeconstructDomain(Domain=bounds_2)  # -> Start, End
deconstruct_domain_3 = DeconstructDomain(Domain=bounds_3)  # -> Start, End
construct_domain = ConstructDomain(DomainStart=deconstruct_domain_2.End, DomainEnd=deconstruct_domain_3.Start)
deconstruct_domain_4 = DeconstructDomain(Domain=construct_domain)  # -> Start, End
list_item_15 = ListItem(List=flatten(rectangle_6), Index=deconstruct_domain_4.Start, Wrap=True)
integer_16 = Integer(deconstruct_domain_4.Start)
_2_2 = Integer(2)
larger_than_8 = LargerThan(FirstNumber=integer_16, SecondNumber=_2_2)  # -> LargerThan, OrEqualTo
teile_zu_groß_für_herding_amberg = Boolean(larger_than_8.LargerThan)
rectangle_7 = Rectangle(list_item_15)

anzahl_der_teile_pro_blechstärke_3 = Integer(anzahl_der_teile_pro_blechstärke_2)
schnittgeschwindigkeit_min_m_2 = Number(schnittgeschwindigkeit_min_m)
gewicht_pro_blechsorte_kg_2 = Number(gewicht_pro_blechsorte_kg)
gesamtzahl_einstichpunkte_pro_blechtärke_2 = Integer(gesamtzahl_einstichpunkte_pro_blechtärke)
gesamtkonturlänge_pro_blechstärke_mm_2 = Number(gesamtkonturlänge_pro_blechstärke_mm)
unique_blechstärke_6 = Number(unique_blechstärke_4)
einstichzeit_sec_2 = Number(einstichzeit_sec)
teile_zu_groß_für_herding_amberg_2 = Boolean(teile_zu_groß_für_herding_amberg)
division_13 = Division(GesamtkonturlängeProBlechstärkeMm=gesamtkonturlänge_pro_blechstärke_mm_2, _1000=1000)
multiplication_8 = Multiplication(GesamtzahlEinstichpunkteProBlechtärke=gesamtzahl_einstichpunkte_pro_blechtärke_2, EinstichzeitSec=einstichzeit_sec_2)
multiplication_9 = Multiplication(GesamtkonturlängeProBlechstärkeM=division_13, SchnittgeschwindigkeitMinM=schnittgeschwindigkeit_min_m_2)
division_14 = Division(EinstichzeitProBlechstärkeSec=multiplication_8, _60=60)
merge_45 = Merge(Data1="Alles in Amberg fertigbar", Data2="Enthält Teile die nicht in Amberg gefertigt werden können")
list_item_16 = ListItem(List=merge_45, Index=teile_zu_groß_für_herding_amberg_2, Wrap=True)
addition_4 = Addition(KonturSchnittdauerMin=multiplication_9, EinstichzeitProBlechstärkeMin=division_14)
mass_addition_29 = MassAddition(GesamtSchnittdauerProBlechstärkeMin=flatten(addition_4))  # -> GesamtSchnittdauerProBaugruppeMin, PartialResults
format_3 = Panel("""{0:0} Teile in {1:0.0} mm Blech
Gewicht {2:0.00} kg
{3}
Schnittlänge {4:0} mm
Einstiche {5}
Schnittdauer {6:0.00} min""")
gewicht_pro_blechsorte_kg_3 = Number(gewicht_pro_blechsorte_kg_2)
gesamtkonturlänge_pro_blechstärke_mm_3 = Number(gesamtkonturlänge_pro_blechstärke_mm_2)
anzahl_der_teile_pro_blechstärke_4 = Integer(anzahl_der_teile_pro_blechstärke_3)
unique_blechstärke_7 = Number(unique_blechstärke_6)
teile_zu_groß_für_herding_amberg_3 = Boolean(list_item_16)
gesamtzahl_einstichpunkte_pro_blechtärke_3 = Integer(gesamtzahl_einstichpunkte_pro_blechtärke_2)
division_15 = Division(GesamtSchnittdauerProBaugruppeMin=mass_addition_29.GesamtSchnittdauerProBaugruppeMin, _60=60)
laserkosten_inklusive_personal_h = Panel("150")
format_4 = Format(
    Format=format_3,
    Culture=127,
    Data0=anzahl_der_teile_pro_blechstärke_4,
    Data1=unique_blechstärke_7,
    Data2=flatten(gewicht_pro_blechsorte_kg_3),
    Data3=flatten(teile_zu_groß_für_herding_amberg_3),
    Data4=flatten(gesamtkonturlänge_pro_blechstärke_mm_3),
    Data5=flatten(gesamtzahl_einstichpunkte_pro_blechtärke_3),
    Data6=flatten(addition_4))
multiplication_10 = Multiplication(LaserkostenInklusivePersonalH=laserkosten_inklusive_personal_h, GesamtSchnittdauerProBaugruppeH=division_15)
gesamtkonturlänge_pro_blechstärke_mm_4 = Number(gesamtkonturlänge_pro_blechstärke_mm_2)
gesamt_schnittdauer_pro_baugruppe_h = Number(division_15)
übersicht_anzahl_blechteile_pro_stärke = Text(format_4)
laserschnittkosten_gesamt = Number(multiplication_10)
gewicht_pro_blechsorte_kg_4 = Number(gewicht_pro_blechsorte_kg_2)

gegraftete_unique_blechstärke_3 = Number(gegraftete_unique_blechstärke_2)
material_dichte_g_cm³_8 = Number(material_dichte_g_cm³_5)
material_preis_kg_7 = Number(material_preis_kg_5)
unique_blechstärke_8 = Number(unique_blechstärke_5)
material_typ_3 = Text(material_typ_2)
surface_7 = Surface(surface_6)
curve_19 = Curve(curve_18)
rectangle_8 = Rectangle(rectangle_7)
blechteil_oberfläche_gesamt_m²_3 = Number(blechteil_oberfläche_gesamt_m²_2)
kosten_programmierung_gesamt_2 = Number(kosten_programmierung_gesamt)
anzahl_einzigartiger_bauteile_4 = Integer(anzahl_einzigartiger_bauteile_3)
blechteil_oberfläche_einzeln_m²_3 = Number(blechteil_oberfläche_einzeln_m²_2)
anzahl_potentieller_lasersignierungen_3 = Integer(anzahl_potentieller_lasersignierungen_2)
gesamtlänge_potentieller_lasersignierung_3 = Number(gesamtlänge_potentieller_lasersignierung_2)  # "Gesamtlänge potentieller Lasersignierungen"
anzahl_einzigartiger_bauteile_programmie = Integer(anzahl_einzigartiger_bauteile_4)  # "Anzahl einzigartiger Bauteile Programmierung"
kosten_programmierung_gesamt_3 = Number(kosten_programmierung_gesamt_2)
oberfläche_gesamt_m² = Number(blechteil_oberfläche_gesamt_m²_3)
filepath_selected_and_file_loaded_4 = RemoteReceiver(filepath_selected_and_file_loaded_2)

# ----
# Enable Import
property_3 = Panel("Enabled")
boolean_32 = Boolean(allow_import)
data_104 = Data(data_snp_import)

text_83 = Text(property_3)

snpoverride_8 = SnpOverride(Property=text_83, Value=boolean_32, Control=data_104)

# ----
# Blechplattenbelegung und Verschnitt
boolean_33 = Boolean(boolean_14)
number_15 = Number(abstand_zwischen_platten)
material_dichte_g_cm³_9 = Number(material_dichte_g_cm³_8)
material_preis_kg_8 = Number(material_preis_kg_7)
surface_8 = Surface(surface_7)
curve_20 = Curve(curve_19)
unique_blechstärke_9 = Number(unique_blechstärke_8)
gegraftete_unique_blechstärke_4 = Number(gegraftete_unique_blechstärke_3)
number_16 = Number(sicherheitsabstand_außen_plattenbelegung)
run_2 = Boolean(run)
integer_rows = Integer(rows)
rectangle_9 = Rectangle(rectangle_8)
stream_freeze_gate_2 = StreamFreezeGate(Data=material_dichte_g_cm³_9, PassingSwitch=boolean_33, Freeze=False)
stream_freeze_gate_3 = StreamFreezeGate(Data=material_preis_kg_8, PassingSwitch=boolean_33, Freeze=False)
stream_freeze_gate_4 = StreamFreezeGate(Data=surface_8, PassingSwitch=boolean_33, Freeze=False)
stream_freeze_gate_5 = StreamFreezeGate(Data=curve_20, PassingSwitch=boolean_33, Freeze=False)
stream_freeze_gate_6 = StreamFreezeGate(Data=unique_blechstärke_9, PassingSwitch=boolean_33, Freeze=False)
stream_freeze_gate_7 = StreamFreezeGate(Data=gegraftete_unique_blechstärke_4, PassingSwitch=boolean_33, Freeze=False)
stream_freeze_gate_8 = StreamFreezeGate(Data=number_16, PassingSwitch=boolean_33, Freeze=False)
stream_freeze_gate_9 = StreamFreezeGate(Data=run_2, PassingSwitch=boolean_33, Freeze=False)
stream_freeze_gate_10 = StreamFreezeGate(Data=integer_rows, PassingSwitch=boolean_33, Freeze=False)
stream_freeze_gate_11 = StreamFreezeGate(Data=rectangle_9, PassingSwitch=boolean_33, Freeze=False)
stream_freeze_gate_12 = StreamFreezeGate(Data=number_15, PassingSwitch=boolean_33, Freeze=False)
bounding_rectangle_2 = BoundingRectangle(Geometry=stream_freeze_gate_5, Plane=PlaneXY(0, 0, 0), Axis=0, Slide=0, Union=False)  # -> Bounding, DimensionX, DimensionY
number_17 = Number(bounding_rectangle_2.DimensionX)
number_18 = Number(bounding_rectangle_2.DimensionY)
larger_than_9 = LargerThan(FirstNumber=number_17, SecondNumber=number_18)  # -> LargerThan, OrEqualTo
panel_30 = Panel("""0
90""")
list_item_17 = ListItem(List=panel_30, Index=larger_than_9.LargerThan, Wrap=True)
rotate = Rotate(Geometry=stream_freeze_gate_4, Angle=degrees(list_item_17), Plane=PlaneXY(0, 0, 0))  # -> Geometry, Transform
rotate_2 = Rotate(Geometry=stream_freeze_gate_5, Angle=degrees(list_item_17), Plane=PlaneXY(0, 0, 0))  # -> Geometry, Transform
surface_9 = Surface(rotate.Geometry)
curve_21 = Curve(rotate_2.Geometry)
curve_to_polyline = CurveToPolyline(Curve=curve_21, ToleranceDistance=Slider(0.2, range=0..1), ToleranceAngle=0)  # -> Polyline, Segments
merge_faces_3 = MergeFaces(Brep=surface_9)  # -> Breps, Before, After
unique_blechstärke_10 = Number(stream_freeze_gate_6)
curve_22 = Curve(curve_to_polyline.Polyline)
tree_statistics_3 = TreeStatistics(Tree=curve_22)  # -> Paths, Length, Count
number_19 = Number(stream_freeze_gate_8)
sort_list_3 = SortList(
    Keys=tree_statistics_3.Length,
    ValuesTreePaths=tree_statistics_3.Paths,
    ValuesRectangle=flatten(stream_freeze_gate_11),
    ValuesTreeLenght=tree_statistics_3.Length,
    ValuesUniqueBlechstärke=unique_blechstärke_10)  # -> Keys, reverse(ValuesTreePaths), reverse(ValuesRectangle), reverse(ValuesTreeLenght), reverse(ValuesUniqueBlechstärke)
negative = Negative(Value=number_19)
unique_blechstärke_11 = Number(sort_list_3.ValuesUniqueBlechstärke)
rectangle_10 = Rectangle(sort_list_3.ValuesRectangle)
tree_branch_4 = TreeBranch(Tree=merge_faces_3.Breps, Path=sort_list_3.ValuesTreePaths, MaintainPaths=False)
tree_branch_5 = TreeBranch(Tree=curve_22, Path=sort_list_3.ValuesTreePaths, MaintainPaths=False)
offset_curve = OffsetCurve(Curve=rectangle_10, Distance=negative, Corners=1)
deconstruct_rectangle = DeconstructRectangle(Rectangle=rectangle_10)  # -> BasePlane, XInterval, YInterval
number_20 = Number(stream_freeze_gate_12)
number_21 = Number(flatten(deconstruct_rectangle.XInterval))
addition_5 = Addition(A=number_21, B=number_20)
mass_addition_30 = MassAddition(Input=addition_5)  # -> Result, PartialResults
_0_2 = Integer(0)
insert_items_2 = InsertItems(List=mass_addition_30.PartialResults, Item=_0_2, Indices=_0_2, Wrap=True)
integer_17 = Integer(-1)
cull_index_2 = CullIndex(List=insert_items_2, Indices=integer_17, Wrap=True)
unit_x = UnitX(Factor=cull_index_2)
move = Move(Geometry=offset_curve, Motion=graft(unit_x))  # -> Geometry, Transform
brep_18 = Brep(tree_branch_4)
curve_23 = Curve(tree_branch_5)
rectangle_11 = Rectangle(move.Geometry)
number_22 = Number(number_20)
surface_10 = Surface(rectangle_11)
simplify = Slider(10, range=0..10)
geometry_srf = GeometrySrf(Surfaces=curve_23, Simplify=simplify, Hull=False, Attributes=brep_18)  # -> Geometry, Borders
sheets_srf = SheetsSrf(Surfaces=graft(surface_10), Gap=number_22, Rows=stream_freeze_gate_10, Count=graft(rectangle_10))  # -> simplify(Sheets), Polylines
opennest2 = OpenNest2(Sheets=sheets_srf.Sheets, Geometry=geometry_srf.Geometry, Options=options, Iterations=1, Run=stream_freeze_gate_9)  # -> Sheets, Borders, AllGeo, Transforms, SheetId, SheetTxt, Attributes
number_23 = Number(number_19)
rectangle_12 = Rectangle(opennest2.Sheets)
offset_curve_2 = OffsetCurve(Curve=rectangle_12, Distance=number_23, Corners=1)
list_item_18 = ListItem(List=rectangle_12, Index=0, Wrap=True)
flip_matrix = FlipMatrix(Data=curve_23)
flip_matrix_2 = FlipMatrix(Data=opennest2.Attributes)
trim_tree = TrimTree(Tree=offset_curve_2, Depth=1)  # -> simplify(Tree)
explode = Explode(Curve=list_item_18, Recursive=True)  # -> Segments, Vertices
clean_tree_4 = CleanTree(RemoveNulls=True, RemoveInvalid=True, RemoveEmpty=False, Tree=flip_matrix)
clean_tree_5 = CleanTree(RemoveNulls=True, RemoveInvalid=True, RemoveEmpty=False, Tree=flip_matrix_2)
curve_middle_3 = CurveMiddle(Curve=explode.Segments)
unique_blechstärke_12 = Number(unique_blechstärke_11)
deconstruct = Deconstruct(Point=curve_middle_3)  # -> XComponent, YComponent, ZComponent
surface_11 = Surface(clean_tree_5)
sort_list_4 = SortList(Keys=deconstruct.YComponent, ValuesValuesA=curve_middle_3)  # -> Keys, ValuesValuesA
transform = Transform(Geometry=clean_tree_4, Transform=opennest2.Transforms)
factor = Slider(150, range=0..1000)
index = Index(-1)
unit_y = UnitY(Factor=factor)
list_item_19 = ListItem(List=sort_list_4.ValuesValuesA, Index=index, Wrap=True)
move_2 = Move(Geometry=list_item_19, Motion=unit_y)  # -> Geometry, Transform
xy_plane = XYPlane(Origin=move_2.Geometry)
flip_matrix_3 = FlipMatrix(Data=transform)
clean_tree_6 = CleanTree(RemoveNulls=True, RemoveInvalid=True, RemoveEmpty=False, Tree=flip_matrix_3)
rectangle_13 = Rectangle(trim_tree)
unique_blechstärke_mm = Number(graft(stream_freeze_gate_7))
curve_24 = Curve(clean_tree_6)
match_tree_2 = MatchTree(Tree=curve_24, Guide=rectangle_13)
area_4 = Area(Geometry=rectangle_13)
merge_46 = Merge(Data1=rectangle_13, Data2=match_tree_2)
mass_addition_31 = MassAddition(Input=area_4)  # -> GrundbedarfAnBlechMm², PartialResults
boundary_surfaces = BoundarySurfaces(Edges=merge_46)
area_5 = Area(Geometry=boundary_surfaces)
surface_12 = Surface(boundary_surfaces)
mass_addition_32 = MassAddition(Input=area_5)  # -> VerschnittInMm², PartialResults
division_16 = Division(A=mass_addition_32.VerschnittInMm², B=mass_addition_31.GrundbedarfAnBlechMm²)
multiplication_11 = Multiplication(VerschnittInMm²=mass_addition_32.VerschnittInMm², UniqueBlechstärkeMm=unique_blechstärke_mm)
multiplication_12 = Multiplication(A=division_16, _100=100)
division_17 = Division(VerschnittVolumenMm³=multiplication_11, _1000=1000)
material_dichte_g_cm³_10 = Number(stream_freeze_gate_2)
multiplication_13 = Multiplication(VerschnittVolumenCm³=division_17, MaterialDichteGCm³=material_dichte_g_cm³_10)
division_18 = Division(VerschnittGewichtG=multiplication_13, _1000=1000)
material_preis_kg_9 = Number(stream_freeze_gate_3)
multiplication_14 = Multiplication(MaterialPreisKg=material_preis_kg_9, VerschnittGewichtKg=division_18)
number_verschnitt_kosten = Number(multiplication_14)
verschnitt_in_prozent = Number(multiplication_12)
surface_13 = Surface(surface_12)
surface_14 = Surface(surface_11)
surface_15 = Surface(surface_12)

# ---- group: Ende
flip_matrix_4 = FlipMatrix(Data=curve_21)
flip_matrix_5 = FlipMatrix(Data=merge_faces_3.Breps)
clean_tree_7 = CleanTree(RemoveNulls=True, RemoveInvalid=True, RemoveEmpty=False, Tree=flip_matrix_5)
clean_tree_8 = CleanTree(RemoveNulls=True, RemoveInvalid=True, RemoveEmpty=False, Tree=flip_matrix_4)
transform_2 = Transform(Geometry=clean_tree_7, Transform=opennest2.Transforms)
flip_matrix_6 = FlipMatrix(Data=transform_2)
clean_tree_9 = CleanTree(RemoveNulls=True, RemoveInvalid=True, RemoveEmpty=False, Tree=flip_matrix_6)
param_viewer = ParamViewer(clean_tree_9)

# ----
# Outputs
total_amout_of_invalid_parts_2 = Integer(total_amout_of_invalid_parts)
dateiname_3 = Text(dateiname_2)
checksum_okay_3 = Boolean(checksum_okay_2)
durchschnittliche_kantzeit_gesamt_h_3 = Number(durchschnittliche_kantzeit_gesamt_h)
minimum_kantzeit_gesamt_h_2 = Number(minimum_kantzeit_gesamt_h)
anzahl_der_kantungen_in_der_baugruppe_ei_2 = Number(anzahl_der_kantungen_in_der_baugruppe_ei)  # "Anzahl der Kantungen in der Baugruppe (einfach)"
anzahl_der_kantungen_im_teil_doppelt_3 = Number(anzahl_der_kantungen_im_teil_doppelt_2)
anzahl_der_kantungen_in_der_baugruppe_do_2 = Number(anzahl_der_kantungen_in_der_baugruppe_do)  # "Anzahl der Kantungen in der Baugruppe (doppelt)"
anzahl_bauteile_schwerer_als_25kg_2 = Boolean(anzahl_bauteile_schwerer_als_25kg)
blechpreis_baugruppe_ohne_verschnitt_2 = Number(blechpreis_baugruppe_ohne_verschnitt)
blechpreis_bauteile_ohne_verschnitt_2 = Number(blechpreis_bauteile_ohne_verschnitt)
gesamtzahl_einstichpunkte_baugruppe_2 = Integer(gesamtzahl_einstichpunkte_baugruppe)
gesamtzahl_einstichpunkte_bauteil_3 = Integer(gesamtzahl_einstichpunkte_bauteil)
gesamtkonturlänge_baugruppe_mit_löcher_m_2 = Number(gesamtkonturlänge_baugruppe_mit_löcher_m)  # "Gesamtkonturlänge Baugruppe mit Löcher (mm)"
gesamtkonturlänge_bauteil_mm_3 = Number(gesamtkonturlänge_bauteil_mm)
übersicht_anzahl_blechteile_pro_stärke_2 = Text(übersicht_anzahl_blechteile_pro_stärke)
gewicht_pro_blechsorte_kg_5 = Number(gewicht_pro_blechsorte_kg_4)
gesamtkonturlänge_pro_blechstärke_mm_5 = Number(gesamtkonturlänge_pro_blechstärke_mm_4)
laserschnittkosten_gesamt_2 = Number(laserschnittkosten_gesamt)
gesamt_schnittdauer_pro_baugruppe_h_2 = Number(gesamt_schnittdauer_pro_baugruppe_h)
amount_of_valid_sheetmetal_parts_3 = Integer(amount_of_valid_sheetmetal_parts_2)
anzahl_erkannter_closed_breps_4 = Integer(anzahl_erkannter_closed_breps_3)
bauteilnamen_4 = Text(bauteilnamen_3)
bauteilnamen_5 = Text(bauteilnamen_4)
kosten_kantpresse_gesamt_2 = Number(kosten_kantpresse_gesamt)
maximum_kantzeit_gesamt_h_2 = Number(maximum_kantzeit_gesamt_h)
anzahl_der_kantungen_im_teil_einfach_3 = Number(anzahl_der_kantungen_im_teil_einfach_2)
anzahl_kantvorgänge_gesamt_2 = Number(anzahl_kantvorgänge_gesamt)
anzahl_kantvorgänge_pro_bauteil_2 = Integer(anzahl_kantvorgänge_pro_bauteil)
anzahl_der_bauteile_mit_kantungen_3 = Integer(anzahl_der_bauteile_mit_kantungen_2)
gewicht_der_baugruppe_gerundet_kg_2 = Number(gewicht_der_baugruppe_gerundet_kg)
gewicht_der_bauteile_gerundet_kg_5 = Number(gewicht_der_bauteile_gerundet_kg_3)
bauteil_schwerer_als_25kg_3 = Boolean(bauteil_schwerer_als_25kg_2)
material_typ_4 = Text(material_typ_3)
material_dichte_g_cm³_11 = Number(material_dichte_g_cm³_8)
material_preis_kg_10 = Number(material_preis_kg_7)
number_verschnitt_kosten_2 = Number(number_verschnitt_kosten)
verschnitt_in_prozent_2 = Number(verschnitt_in_prozent)

text_join = TextJoin(Text=flatten(übersicht_anzahl_blechteile_pro_stärke_2), Join=enter)
total_anzahl_invalid_parts = Integer(total_amout_of_invalid_parts_2)
kosten_kantpresse_gesamt_3 = Number(kosten_kantpresse_gesamt_2)
gesamtzahl_einstichpunkte = Integer(gesamtzahl_einstichpunkte_baugruppe_2)
anzahl_der_bauteile_mit_kantungen_4 = Integer(anzahl_der_bauteile_mit_kantungen_3)
übersicht_anzahl_blechteile_pro_stärke_3 = Text(text_join)
verschnitt_in_prozent_3 = Number(verschnitt_in_prozent_2)

# ---- group: TestiTest
blechteil_oberfläche_einzeln_m²_4 = Number(blechteil_oberfläche_einzeln_m²_3)
gesamtzahl_einstichpunkte_bauteil_4 = Integer(gesamtzahl_einstichpunkte_bauteil_3)
gewicht_der_bauteile_gerundet_kg_6 = Number(gewicht_der_bauteile_gerundet_kg_5)
anzahl_kantvorgänge_pro_bauteil_3 = Integer(anzahl_kantvorgänge_pro_bauteil_2)
gesamtkonturlänge_bauteil_mm_4 = Number(gesamtkonturlänge_bauteil_mm_3)

# ----
material_dichte_g_cm³_12 = Number(material_dichte_g_cm³_11)
amount_of_valid_sheetmetal_parts_4 = Integer(amount_of_valid_sheetmetal_parts_3)
anzahl_erkannter_volumenkörper = Integer(anzahl_erkannter_closed_breps_4)
durchschnittliche_kantzeit_gesamt_h_4 = Number(durchschnittliche_kantzeit_gesamt_h_3)
blechpreis_baugruppe_ohne_verschnitt_3 = Number(blechpreis_baugruppe_ohne_verschnitt_2)
gesamtkonturlänge_mit_löcher_mm = Number(gesamtkonturlänge_baugruppe_mit_löcher_m_2)
anzahl_kantvorgänge_gesamt_3 = Number(anzahl_kantvorgänge_gesamt_2)
gewicht_der_baugruppe_gerundet_kg_3 = Number(gewicht_der_baugruppe_gerundet_kg_2)
gesamt_schnittdauer_pro_baugruppe_h_3 = Number(gesamt_schnittdauer_pro_baugruppe_h_2)
laserschnittkosten_gesamt_3 = Number(laserschnittkosten_gesamt_2)
verschnitt_kosten = Number(number_verschnitt_kosten_2)
material_typ_5 = Text(material_typ_4)
list_length_18 = ListLength(List=gewicht_der_bauteile_gerundet_kg_6)
list_length_19 = ListLength(List=gewicht_der_bauteile_gerundet_kg_6)
addition_6 = Addition(
    LaserschnittkostenGesamt=laserschnittkosten_gesamt_3,
    KostenProgrammierungGesamt=kosten_programmierung_gesamt_3,
    BlechpreisBaugruppeOhneVerschnitt=blechpreis_baugruppe_ohne_verschnitt_3,
    KostenKantpresseGesamt=kosten_kantpresse_gesamt_3)
repeat_data = RepeatData(Data=material_dichte_g_cm³_12, Length=list_length_18)
repeat_data_2 = RepeatData(Data=material_typ_5, Length=list_length_19)
format_5 = Format(
    Format=panel_22,
    Culture=127,
    Data0=durchschnittliche_kantzeit_gesamt_h_4,
    Data1=kosten_kantpresse_gesamt_3,
    Data2=anzahl_einzigartiger_bauteile_programmie,
    Data3=kosten_programmierung_gesamt_3,
    Data4=blechpreis_baugruppe_ohne_verschnitt_3,
    Data5=oberfläche_gesamt_m²,
    Data6=gesamtkonturlänge_mit_löcher_mm,
    Data7=gesamtzahl_einstichpunkte,
    Data8=anzahl_der_bauteile_mit_kantungen_4,
    Data9=übersicht_anzahl_blechteile_pro_stärke_3,
    Data10=anzahl_kantvorgänge_gesamt_3,
    Data11=gewicht_der_baugruppe_gerundet_kg_3,
    Data12=gesamt_schnittdauer_pro_baugruppe_h_3,
    Data13=laserschnittkosten_gesamt_3,
    Data14=addition_6,
    Data15=verschnitt_kosten,
    Data16=verschnitt_in_prozent_3)
stack_trees = StackTrees(
    Data0="BC+GH?",
    Data1="BC",
    Data2="BC",
    Data3="BC",
    Data4="BC+GH?",
    Data5="BC+GH?",
    Data6="BC",
    Data7="BC?",
    Data8=flatten("BC"),
    Data9="BC",
    Data10=gewicht_der_bauteile_gerundet_kg_6,
    Data11=blechteil_oberfläche_einzeln_m²_4,
    Data12="BC + GH",
    Data13=flatten("INVENTOR?"),
    Data14=flatten(anzahl_kantvorgänge_pro_bauteil_3),
    Data15=flatten(repeat_data),
    Data16=flatten(gesamtkonturlänge_bauteil_mm_4),
    Data17=flatten(gesamtzahl_einstichpunkte_bauteil_4),
    Data18="BC",
    Data19=repeat_data_2,
    Reduce=True)
analysis_result_text = Text(format_5)
flip_matrix_7 = FlipMatrix(Data=stack_trees)
psappendlabels = AppendLabels(Data=flip_matrix_7, RowFirst=True, ColumnLabels=flatten(panel_23))
concatenate_3 = Concatenate(FragmentA=export_filepath_2, FragmentB="\", FragmentA_2=dateiname_3, FragmentB_2="quickcalc_beta.xlsx")

# ----
# Synapse Output - Show amount of Invalid Breps
total_anzahl_invalid_parts_2 = Integer(total_anzahl_invalid_parts)
data_105 = Data(synapse_amount_of_invalid_parts_2)
anzahl_erkannter_volumenkörper_2 = Integer(anzahl_erkannter_volumenkörper)
boolean_34 = Boolean(total_anzahl_invalid_parts_2)
leeres_panel = Panel("")
format_6 = Format(Format="{0}/{1}", Culture=127, Data0=total_anzahl_invalid_parts_2, Data1=anzahl_erkannter_volumenkörper_2)
stream_filter_6 = StreamFilter(Gate=boolean_34, Stream0=leeres_panel, Stream1=format_6)
property_4 = Panel("Text")
text_84 = Text(stream_filter_6)
snpoverride_9 = SnpOverride(Property=property_4, Value=text_84, Control=data_105)

# ----
# Synapse Output - Show amount ov Valid Sheetmetall Parts
data_106 = Data(synapse_amount_of_valid_sheetmetal_parts_2)
amount_of_valid_sheetmetal_parts_5 = Integer(amount_of_valid_sheetmetal_parts_4)
anzahl_erkannter_volumenkörper_3 = Integer(anzahl_erkannter_volumenkörper)
boolean_35 = Boolean(amount_of_valid_sheetmetal_parts_5)
leeres_panel_2 = Panel("")
format_7 = Format(Format="{0}/{1}", Culture=127, Data0=amount_of_valid_sheetmetal_parts_5, Data1=anzahl_erkannter_volumenkörper_3)
stream_filter_7 = StreamFilter(Gate=boolean_35, Stream0=leeres_panel_2, Stream1=format_7)
text_85 = Text(stream_filter_7)
property_5 = Panel("Text")
snpoverride_10 = SnpOverride(Property=property_5, Value=text_85, Control=data_106)

# ----
# Synapse Output - Update Analysis Text
boolean_36 = Boolean(filepath_selected_and_file_loaded_4)
analysis_result_text_2 = Text(analysis_result_text)
data_107 = Data(synapse_analysis_result_2)
panel_31 = Panel("""NO FILE LOADED

1. Select a .stp / .step / .3dm file 

2. Click button to import it

3. Analysis will start automatically""")
join = Panel("")
stream_filter_8 = StreamFilter(Gate=boolean_36, Stream0=panel_31, Stream1=analysis_result_text_2)
text_86 = Text(join)
text_join_2 = TextJoin(Text=flatten(stream_filter_8), Join=text_86)
property_6 = Panel("Text")
text_87 = Text(text_join_2)
snpoverride_11 = SnpOverride(Property=property_6, Value=text_87, Control=data_107)

panel_32 = Panel(concatenate_3)
simple_write_tree_to_xls_x = SimpleWriteTreeToXLSX(
    File=concatenate_3,
    SheetIdentifier=sheetname,
    Data=psappendlabels,
    RowFirst=True,
    ResizeColumn=True,
    CreateNew=always_create_a_new_spreadsheet_instead,
    IgnoreNull=False,
    OK=export_to_calc_3)
panel_33 = Panel(simple_write_tree_to_xls_x)

plane_blechdickenpositionen = Plane(xy_plane)
text_unique_blechstärke = Number(unique_blechstärke_12)
text_88 = Text("Arial")
model_font = ModelFont(FontFamily=text_88)  # -> Font, FontFamily, FontWeight, FontStyle
annotation_text_settings = AnnotationTextSettings(Font=model_font.Font, TextHeight=Slider(25, range=10..100))  # -> TextSettings, Font, TextHeight, TextGap, Mask, MaskColour, MaskMargins, MaskFrame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

round_to_decimal_place_4 = RoundToDecimalPlace(NumberX=text_unique_blechstärke, DecimalPlace=2, RoundType=0)  # -> Rounded, Difference

text_entity = TextEntity(
    Plane=plane_blechdickenpositionen,
    Text=graft(round_to_decimal_place_4.Rounded),
    TextSettings=annotation_text_settings.TextSettings)  # -> TextEntity, Plane, Text, Style, TextSettings
geometry_text_entity = Geometry(text_entity.TextEntity)

geometry = Geometry(geometry_text_entity)

# ----
# Calculated Sheet Preview
surface_16 = Surface(surface_13)
surface_17 = Surface(surface_14)
geometry_2 = Geometry(geometry)
sheet_color = ColourSwatch(SwatchColor=RGB(46, 46, 46))
part_color = ColourSwatch(SwatchColor=RGB(45, 209, 224))
part_color_2 = ColourSwatch(SwatchColor=RGB(0, 0, 0))

custom_preview = CustomPreview(Geometry=surface_16, Material=sheet_color)
custom_preview_2 = CustomPreview(Geometry=surface_17, Material=part_color)
custom_preview_3 = CustomPreview(Geometry=geometry_2, Material=part_color_2)
get_objects_in_group_4 = GetObjectsInGroup()

show_sheets_2 = RemoteReceiver(show_sheets)
boolean_37 = Boolean(show_sheets_2)
hide_show_object_preview_4 = HideShowObjectPreview(Objects=get_objects_in_group_4, Visible=boolean_37)
