# Grasshopper definition compute_default.gh (Grasshopper 1.0.8)
# plug-ins: SheepMetal, GHHeadless

# ---- group: TestGroup
num1 = Slider(10, range=10..100)

# ----
num1_2 = GetNumber(
    num1,
    AtLeast=1,
    AtMost=1,
    Maximum=1.797693135e+308,
    Minimum=-1.797693135e+308,
    Prompt="This is a input",
    TreeAccess=False)
num2 = Slider(10, range=10..30)
rectangle = Rectangle(Plane=PlaneXY(0, 0, 0), XSize=num1_2, YSize=Domain(-2, 2), Radius=0)  # -> Rectangle, Length
boundary_surfaces = BoundarySurfaces(Edges=rectangle.Rectangle)

# ---- group: TestGroup
num2_2 = GetNumber(
    num2,
    AtLeast=1,
    AtMost=1,
    Maximum=1.797693135e+308,
    Minimum=-1.797693135e+308,
    Prompt="This is a input",
    TreeAccess=False)

# ----
none_manifold_flange = NoneManifoldFlange(Brep=boundary_surfaces, EdgeIndex="1", FlangeHeight=num2_2, Angle=1.570796327, FromStart=0, FromEnd=0, Flip=False)
merge = Merge(Data1=boundary_surfaces, Data2=none_manifold_flange)
brep_join = BrepJoin(Breps=merge)  # -> Breps, Closed
non_manifold_to_sheet = NonManifoldToSheet(Brep=brep_join.Breps, Thickness="2", BendRadius=1, FlipOffset=False, FlipBendDirection=False)
brep = Brep(non_manifold_to_sheet)
display = Display(
    Geo=brep,
    Color=ColourSwatch(SwatchColor=RGB(255, 255, 255)),
    Metalness="0.89",
    Roughness="0.2",
    Opacity=1,
    MeshName="Mesh_")
