# Grasshopper definition compute_default1.gh (Grasshopper 1.0.8)
# plug-ins: SheepMetal, Compuceraptor

# ---- group: TestGroup
num1 = Slider(10, range=10..100)

# ----
construct_point = ConstructPoint(XCoordinate=0, YCoordinate=0, ZCoordinate=0)
unit_x = UnitX(Factor=1)
num2 = Slider(10, range=10..30)
num2_2 = Slider(90, range=10..90)
construct_point_2 = ConstructPoint(XCoordinate=0, YCoordinate=0, ZCoordinate=0)
panel = Panel("Test")
center_box = CenterBox(Base=PlaneXY(0, 0, 0), X=1, Y=1, Z=1)  # disabled
line_sdl = LineSDL(Start=construct_point, Direction=unit_x, Length="10")
num1_2 = GetNumber(
    num1,
    AtLeast=1,
    AtMost=1,
    Maximum=1.797693135e+308,
    Minimum=-1.797693135e+308,
    Prompt="This is a input",
    TreeAccess=False)
nogrop = GetNumber(
    num2_2,
    AtLeast=1,
    AtMost=1,
    Maximum=1.797693135e+308,
    Minimum=-1.797693135e+308,
    Prompt="This is a input",
    TreeAccess=False)

# ---- group: TestGroup
num2_3 = GetNumber(
    num2,
    AtLeast=1,
    AtMost=1,
    Maximum=1.797693135e+308,
    Minimum=-1.797693135e+308,
    Prompt="This is a input",
    TreeAccess=False)
angle = GetNumber(
    num2_2,
    AtLeast=1,
    AtMost=1,
    Maximum=1.797693135e+308,
    Minimum=-1.797693135e+308,
    Prompt="This is a input",
    TreeAccess=False)

# ---- group: Defaults
get_integer = GetInteger("10", AtLeast=1, AtMost=1, Maximum=2147483647, Minimum=-2147483648, TreeAccess=False)
get_line = GetLine(line_sdl, AtLeast=1, AtMost=1, Realtime=True, TreeAccess=False)
get_point = GetPoint(construct_point_2, AtLeast=1, AtMost=1, Realtime=True, TreeAccess=False)
get_string = GetString("Test", AtLeast=1, AtMost=1, Prompt="Get String Prompt", TreeAccess=False)
get_number = GetNumber("0.100001", AtLeast=1, AtMost=3, Maximum=1.797693135e+308, Minimum=-1.797693135e+308, TreeAccess=False)
get_geometry = GetGeometry(center_box, AnnotationTypeFilter=3966, AtLeast=1, AtMost=1, DeleteInput=False, Filter=1074081855, TreeAccess=True)  # disabled

# ----
preset_number = GetNumber(
    {"10", "20", "30"}, selected=[],
    AtLeast=1,
    AtMost=3,
    Maximum=1.797693135e+308,
    Minimum=-1.797693135e+308,
    Prompt="Prestet",
    TreeAccess=True)
rectangle = Rectangle(Plane=PlaneXY(0, 0, 0), XSize=num1_2, YSize=Slider(20, range=0..100), Radius=0)  # -> Rectangle, Length

# ---- group: Defaults / Inner group
get_boolean = GetBoolean(Toggle(False), AtLeast=1, AtMost=1, FalseValue="False", TreeAccess=True, TrueValue="True")

# ---- group: OuterInput / RH_IN::NumerIn
rh_i_input = Number()

# ----
boundary_surfaces = BoundarySurfaces(Edges=rectangle.Rectangle)
none_manifold_flange = NoneManifoldFlange(Brep=boundary_surfaces, EdgeIndex="1", FlangeHeight=num2_3, Angle=degrees(angle), FromStart=0, FromEnd=0, Flip=False)
merge = Merge(Data1=boundary_surfaces, Data2=none_manifold_flange)
brep_join = BrepJoin(Breps=merge)  # -> Breps, Closed
non_manifold_to_sheet = NonManifoldToSheet(Brep=brep_join.Breps, Thickness="2", BendRadius=1, FlipOffset=False, FlipBendDirection=False)
sheet_info = SheetInfo(Sheet=non_manifold_to_sheet)  # -> Flanges, Bends, Hems, IHoles, NIHoles, CHoles, Thickness, port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
brep = Brep(non_manifold_to_sheet)
display = Display(
    Geo=brep,
    Color=ColourSwatch(SwatchColor=RGB(232, 207, 130)),
    Metalness="0.89",
    Roughness="0.2",
    Opacity=1,
    MeshName="Mesh_")
bend_rad = ContextPrint(BendRad=sheet_info.BendRadius)
context_bake = ContextBake(BrepBake=display)
