# Grasshopper definition duen.gh (Grasshopper 1.0.8)
# plug-ins: Pufferfish, SheepMetal, VektorTools, GHHeadless, HDTTreeUtils

panel = Panel("{\"lines\":[{\"id\":\"d15caf7c-3bd4-4217-b2ec-5f52bfda7f1a\",\"x1\":0,\"y1\":0,\"x2\":1000,\"y2\":0,\"color\":\"black\",\"metadata\":{\"label\":\"first\"},\"angle\":0},{\"id\":\"44805298-6ea0-4144-aec5-a72b19222163\",\"x1\":1000,\"y1\":0,\"x2\":1000,\"y2\":2000,\"color\":\"black\",\"metadata\":{\"height\":100},\"angle\":1.5707963267948966},{\"id\":\"b652de0c-d3b1-4ddd-a17b-3f401a25a610\",\"x1\":1000,\"y1\":2000,\"x2\":-1000,\"y2\":2000,\"color\":\"black\",\"metadata\":{\"height\":100},\"angle\":1.5707963267948966}],\"mode\":\"continuous\",\"currentPoint\":{\"x\":-999.9999999999999,\"y\":2000.0000000000002}}")
num_length_angled_offset = Slider(25, range=5..25)
angle = Slider(30, range=20..30)
loch_durchmesser = Panel("3")

# ---- group: hidden
line_data = GetString(panel, AtLeast=1, AtMost=1, TreeAccess=False)  # disabled

# ----
c_script = CSharpScript(json=panel)  # -> out, a, angle, b; inputs json: String
# ---------- c_script: C# ----------
// Grasshopper Script Instance
#region Usings
using System;
using System.Linq;
using System.Collections;
using System.Collections.Generic;
using System.Drawing;
using System.Text;

using Rhino;
using Rhino.Geometry;

using Grasshopper;
using Grasshopper.Kernel;
using Grasshopper.Kernel.Data;
using Grasshopper.Kernel.Types;
using System.Text.Json;
#endregion


public class Script_Instance : GH_ScriptInstance
    {

    #region Notes
    /* 
      Members:
        RhinoDoc RhinoDocument
        GH_Document GrasshopperDocument
        IGH_Component Component
        int Iteration

      Methods (Virtual & overridable):
        Print(string text)
        Print(string format, params object[] args)
        Reflect(object obj)
        Reflect(object obj, string method_name)
    */
    #endregion

    private void RunScript(
		string json,
		ref object a,
		ref object angle,
		ref object b)
    {
        Root root = JsonSerializer.Deserialize<Root>(json);
        List<Curve> ghLines = new List<Curve>();
        List<double> iAngles = new List<double>();
        List<double> heigths = new List<double>();

        foreach (var l in root.lines)
        {
            var p1 = new Point3d(l.x1, l.y1, 0);
            var p2 = new Point3d(l.x2, l.y2, 0);
            ghLines.Add(new Line(p1, p2).ToNurbsCurve());
            iAngles.Add(RhinoMath.ToDegrees(l.angle));
            if(l.metadata.TryGetValue("height", out var h)){
                if(double.TryParse(h.ToString(), out var num)){
                    heigths.Add(num);
                }
            }
           
        }

        a = Curve.JoinCurves(ghLines);
        angle = iAngles;
        b = heigths;



    }



        public class LineData
    {
        public string id { get; set; }
        public double x1 { get; set; }
        public double y1 { get; set; }
        public double x2 { get; set; }
        public double y2 { get; set; }
        public string color { get; set; }
        public Dictionary<string, object> metadata { get; set; }
        public double angle { get; set; }
    }

    public class Root
    {
        public List<LineData> lines { get; set; }
        public string mode { get; set; }
        public Point currentPoint { get; set; }
    }

    public class Point
    {
        public double x { get; set; }
        public double y { get; set; }
    }
}
# ---------- end c_script ----------
crv_top = Curve(c_script.a)
polyline_segmenter = PolylineSegmenter(
    Polyline=c_script.a,
    Strategy=1,
    MaxLength=900,
    MinLength=300,
    Threshold=800,
    EdgeDistance=500,
    AngleTolerance=0.017,
    Validate=False,
    FlattenOutput=False)  # -> Segments, Lengths, Counts, Info
loch_durchmesser_2 = Number(loch_durchmesser)
radians = Radians(Degrees="1")
xy_plane = XYPlane(Origin=Point(0, 0, 0))
sheeptollerance = SheepTollerance(AngleToleranceRadians=radians, AngleToleranceDegrees="1", AbsoluteTolerance="0.001")
loch_durchmesser_3 = Number(loch_durchmesser_2)
loch_durchmesser_4 = Number(loch_durchmesser_2)
bend_relief_options = BendReliefOptions(Type=0, SlotWidth=0, Setback="0.3", Extension=0, CircularRadius=0)
settings_speed = SettingsSpeed()
panel_2 = Panel("0.89")  # disabled
number_slider = Slider(2, range=0..5)  # disabled
panel_3 = Panel("0.1")  # disabled
panel_4 = Panel("0.5")  # disabled
unit_z = UnitZ(Factor=panel_4)  # disabled

num_length_angled_offset_2 = Slider(10, range=10..15)
num_straight_part = Slider(30, range=25..35)
num_hem_extrusion = Slider(10, range=5..20)
num_sheet_tickness = Slider(0.5, range=0.5..1.5)
winkel_2 = Slider(32, range=10..80)
biege_rad = Panel("1.5")
num_length_angled_offset_1 = Number(num_length_angled_offset_2)
unit_z_2 = UnitZ(Factor=num_straight_part)
num_hem_extrusion_2 = Number(num_hem_extrusion)
num_hem_gap = Number("0.1")
num_bend_rad = Number(biege_rad)

# ---- group: Inputs
länge_2 = GetNumber(num_length_angled_offset, AtLeast=1, AtMost=1, Maximum=30, Minimum=5, TreeAccess=False)
winkel_1 = GetNumber(angle, AtLeast=1, AtMost=1, Maximum=30, Minimum=20, TreeAccess=False)
dicke = GetNumber(num_sheet_tickness, AtLeast=1, AtMost=1, Maximum=1, Minimum=0.5, TreeAccess=False)
winkel_2_2 = GetNumber(winkel_2, AtLeast=1, AtMost=1, Maximum=80, Minimum=10, TreeAccess=False)

# ----
subtraction = Subtraction(A="90", B=winkel_1)
num_length_angled_offset_2_2 = Number(länge_2)

num_sheet_tickness_2 = Number(dicke)
num_angled_deg_1 = Number(subtraction)
winkel_2_3 = Number(winkel_2_2)

num_sheet_tickness_3 = Number(num_sheet_tickness_2)
offset_curve = OffsetCurve(Curve=crv_top, Distance=num_sheet_tickness_3, Plane=PlaneXY(0, 0, 0), Corners=1)
explode = Explode(Curve=offset_curve, Recursive=True)  # -> Segments, Vertices
move = Move(
    Geometry=explode.Vertices,
    Motion=[Vector(0, 0, -120), Vector(0, 0, -121), Vector(0, 0, -123), Vector(0, 0, -126), Vector(0, 0, -124), Vector(0, 0, -121)])  # -> Geometry, Transform
polyline = PolyLine(Vertices=move.Geometry, Closed=False)
crv_lower = Curve(polyline)
crv_top_2 = Curve(offset_curve)

# ---- group: Create Preview Wall
crv_top_3 = Curve(crv_top_2)
crv_lower_2 = Curve(crv_lower)
wall_ticknesss = Panel("-30")
wall_min_offset = Panel("-1")
explode_2 = Explode(Curve=crv_lower_2, Recursive=True)  # -> Segments, Vertices
offset_curve_2 = OffsetCurve(Curve=crv_top_3, Distance=wall_ticknesss, Plane=xy_plane, Corners=1)
offset_curve_3 = OffsetCurve(Curve=crv_top_3, Distance=wall_min_offset, Plane=xy_plane, Corners=1)
deconstruct = Deconstruct(Point=explode_2.Vertices)  # -> XComponent, YComponent, ZComponent
curve_middle = CurveMiddle(Curve=offset_curve_3)
merge = Merge(Data1=offset_curve_2, Data2=offset_curve_3)  # -> flatten(Result)
sort_list = SortList(Keys=deconstruct.ZComponent)  # -> Keys, ValuesValuesA
deconstruct_2 = Deconstruct(Point=curve_middle)  # -> XComponent, YComponent, ZComponent
list_item = ListItem(List=sort_list.Keys, Index=0, Wrap=True)
subtraction_2 = Subtraction(A=deconstruct_2.ZComponent, B=list_item)
negative = Negative(Value=subtraction_2)
loft = Loft(Curves=merge, Options={Adjust=False, Closed=False, LoftEnds=0, LoftSimp=0, LoftType=0, Rebuild=10, Refit=0.01})
num_wall_height_200 = Number(200)
unit_z_3 = UnitZ(Factor=negative)
move_2 = Move(Geometry=loft, Motion=unit_z_3)  # -> Geometry, Transform
unit_z_4 = UnitZ(Factor=num_wall_height_200)
extrude = Extrude(Base=move_2.Geometry, Direction=unit_z_4)
brp_wall_preview = Brep(extrude)

# ----
subtraction_3 = Subtraction(A=num_length_angled_offset_1, B=num_sheet_tickness_2)
subtraction_4 = Subtraction(A=num_hem_extrusion_2, B=num_sheet_tickness_2)
num_hem_extrusion_3 = Number(subtraction_4)
vec_lin_1 = Vector(unit_z_2)
multiplication = Multiplication(A=vec_lin_1, _05="0.5")
num_angled_deg_2 = Number(winkel_2_3)
num_sheet_tickness_4 = Number(num_sheet_tickness_2)  # disabled
num_bend_rad_2 = Number(num_bend_rad)  # disabled
addition = Addition(A=num_bend_rad_2, B=num_sheet_tickness_4, C="2")  # disabled
num_hem_gap_2 = Number(num_hem_gap)
num_sheet_tickness_5 = Number(num_sheet_tickness_2)
addition_2 = Addition(A=num_sheet_tickness_5, B=num_hem_gap_2)
merge_2 = Merge(Data1=num_hem_gap_2, Data2=addition_2)
division = Division(A="1", B=addition)  # disabled
num_bend_rad_3 = Number(num_bend_rad)

# ---- group: Display Wall
brp_wall_preview_2 = Brep(brp_wall_preview)
custom_preview = CustomPreview(Geometry=brp_wall_preview_2, Material=ColourSwatch(SwatchColor=RGB(191, 191, 191)))

# ----
mesh_brep = MeshBrep(Brep=brp_wall_preview_2, Settings=settings_speed)
display = Display(
    Geo=mesh_brep,
    Color=ColourSwatch(SwatchColor=RGB(99, 140, 173)),
    Metalness=0,
    Roughness=0.5,
    Opacity=1,
    MeshName="Mesh_")

# ---- group: Adjust Angles
crv_segments = Curve(graft(polyline_segmenter.Segments))
crv_top_exp = Curve(flatten(crv_segments))
shift_list = ShiftList(List=crv_top_exp, Shift=1, Wrap=False)
angle_2 = Angle(VectorA=crv_top_exp, VectorB=shift_list, Plane=PlaneXY(0, 0, 0))  # -> Angle, Reflex
cull_index = CullIndex(List=angle_2.Angle, Indices=-1, Wrap=True)
degrees = Degrees(Radians=cull_index)
tree_statistics = TreeStatistics(Tree=crv_segments)  # -> Paths, Length, Count

# ----
c_script_2 = CSharpScript(angles=degrees)  # -> a; inputs angles: Double
# ---------- c_script_2: C# ----------
// Grasshopper Script Instance
#region Usings
using System;
using System.Linq;
using System.Collections;
using System.Collections.Generic;
using System.Drawing;

using Rhino;
using Rhino.Geometry;

using Grasshopper;
using Grasshopper.Kernel;
using Grasshopper.Kernel.Data;
using Grasshopper.Kernel.Types;
#endregion

public class Script_Instance : GH_ScriptInstance
{
    #region Notes
    /* 
      Members:
        RhinoDoc RhinoDocument
        GH_Document GrasshopperDocument
        IGH_Component Component
        int Iteration

      Methods (Virtual & overridable):
        Print(string text)
        Print(string format, params object[] args)
        Reflect(object obj)
        Reflect(object obj, string method_name)
    */
    #endregion

    private void RunScript(double angles, ref object a)
    {
        if(angles > 180){
            a = (360-angles)*-1;
        }else{
            a = angles;
        }
    }
}
# ---------- end c_script_2 ----------

# ---- group: Adjust Angles (continued)
multiplication_2 = Multiplication(A=c_script_2, B=-1)
insert_items = InsertItems(List=c_script_2, Item="0", Indices=0, Wrap=True)
insert_items_2 = InsertItems(List=multiplication_2, Item="0", Indices=-1, Wrap=True)

# ----
number = Number(graft(insert_items))
number_2 = Number(graft(insert_items_2))
tree_statistics_2 = TreeStatistics(Tree=number)  # -> Paths, Length, Count
replace_paths = ReplacePaths(Data=number, Search=tree_statistics_2.Paths, Replace=tree_statistics.Paths)
replace_paths_2 = ReplacePaths(Data=number_2, Search=tree_statistics_2.Paths, Replace=tree_statistics.Paths)

# ---- group: Adjust Angles (continued)
num_adj_angles_start = Number(expr("round(x,6)", replace_paths))
num_adj_angles_end = Number(expr("round(x,6)", replace_paths_2))

merge_3 = Merge(Data1=num_adj_angles_start, Data2=num_adj_angles_end)
round_to_decimal_place = RoundToDecimalPlace(NumberX=merge_3, DecimalPlace=2, RoundType=0)  # -> Rounded, Difference
c_script_3 = CSharpScript(angles=round_to_decimal_place.Rounded)  # -> types; inputs angles: tree of Double
# ---------- c_script_3: C# ----------
// Grasshopper Script Instance
#region Usings
using System;
using System.Linq;
using System.Collections;
using System.Collections.Generic;
using System.Drawing;

using Rhino;
using Rhino.Geometry;

using Grasshopper;
using Grasshopper.Kernel;
using Grasshopper.Kernel.Data;
using Grasshopper.Kernel.Types;
#endregion

public class Script_Instance : GH_ScriptInstance
{
    #region Notes
    /* 
      Members:
        RhinoDoc RhinoDocument
        GH_Document GrasshopperDocument
        IGH_Component Component
        int Iteration

      Methods (Virtual & overridable):
        Print(string text)
        Print(string format, params object[] args)
        Reflect(object obj)
        Reflect(object obj, string method_name)
    */
    #endregion

    private void RunScript(DataTree<double> angles, ref object types)
    {
        var branchCount = angles.BranchCount;
        var last = branchCount - 1;
        var output = new DataTree<string>();

        for (int i = 0; i < branchCount; i++)
        {
            var branch = angles.Branch(i);
            var path = angles.Path(i);

            double start = branch[0];
            double end = branch[1];

            var labels = new List<string>(2);

            // Start label
            if (start < 0.01)
                labels.Add(i == 0 ? "Start" : "StartFlat");
            else
                labels.Add(start > 0 ? "StartOuter" : "StartInner"); // fixed typo

            // End label
            if (end == 0)
                labels.Add(i == last ? "End" : "EndFlat");
            else
                labels.Add(end > 0 ? "EndInner" : "EndOuter");

            output.AddRange(labels, path);
        }

        types = output;
    }
}
# ---------- end c_script_3 ----------
str_segment_type = Text(c_script_3)
num_angle = Number(round_to_decimal_place.Rounded)

# ----
crv_segments_2 = Curve(graft(polyline_segmenter.Segments))
num_length_angled_offset_2_3 = Number(num_length_angled_offset_2_2)
num_adj_angles_start_2 = Number(num_adj_angles_start)
num_adj_angles_end_2 = Number(num_adj_angles_end)
winkel_2_4 = Number(winkel_2_3)
subtraction_5 = Subtraction(_180=180, B=winkel_2_4)
negative_2 = Negative(Value=subtraction_5)
ln_angled_1 = Line(crv_segments_2)
str_segment_type_2 = Text(str_segment_type)
c_script_4 = CSharpScript(type=str_segment_type_2)  # -> start, end; inputs type: list of String
# ---------- c_script_4: C# ----------
// Grasshopper Script Instance
#region Usings
using System;
using System.Linq;
using System.Collections;
using System.Collections.Generic;
using System.Drawing;

using Rhino;
using Rhino.Geometry;

using Grasshopper;
using Grasshopper.Kernel;
using Grasshopper.Kernel.Data;
using Grasshopper.Kernel.Types;
#endregion

public class Script_Instance : GH_ScriptInstance
{
    #region Notes
    /* 
      Members:
        RhinoDoc RhinoDocument
        GH_Document GrasshopperDocument
        IGH_Component Component
        int Iteration

      Methods (Virtual & overridable):
        Print(string text)
        Print(string format, params object[] args)
        Reflect(object obj)
        Reflect(object obj, string method_name)
    */
    #endregion

    private void RunScript(List<string> type, ref object start, ref object end)
    {
        // Write your logic here

        var startType = type[0];
        var endType = type[1];

        const double outerAdjustment = -0.1;

        switch (startType){
            case "StartOuter": start = outerAdjustment;
            break;
            default: start = 0;
            break;
        }

        switch (endType){
            case "EndOuter": end = outerAdjustment;
            break;
            default: end = 0;
            break;
        }
    }
}
            
        

        // a = (type == "FlatEnd" || type == "FlatStart" || type == "InnerStart") ? gap*-1 : 0;kngdgfhw
# ---------- end c_script_4 ----------
extend_curve = ExtendCurve(Curve=ln_angled_1, Type=0, Start=c_script_4.start, End=c_script_4.end)
line_offset_miter = LineOffsetMiter(
    Line=crv_segments_2,
    Distance=num_length_angled_offset_2_3,
    StartAngle=num_adj_angles_start_2,
    EndAngle=num_adj_angles_end_2,
    StartAdjust=0,
    EndAdjust=0,
    Rotation=negative_2)
crv_lower_start = Line(line_offset_miter)
ln_angled_1_2 = Line(extend_curve)

crv_lower_start_2 = Line(crv_lower_start)
num_sheet_tickness_6 = Number(num_sheet_tickness_2)
subtraction_6 = Subtraction(A="120", B=num_sheet_tickness_6)
unit_z_5 = UnitZ(Factor=subtraction_6)  # -> expr("x*-1", UnitVector)
move_3 = Move(Geometry=crv_lower_start_2, Motion=unit_z_5)  # -> Geometry, Transform
crv_lower_exp = Curve(move_3.Geometry)

str_segment_type_3 = Text(str_segment_type)
c_script_5 = CSharpScript(type=str_segment_type_3)  # -> start, end; inputs type: list of String
# ---------- c_script_5: C# ----------
// Grasshopper Script Instance
#region Usings
using System;
using System.Linq;
using System.Collections;
using System.Collections.Generic;
using System.Drawing;

using Rhino;
using Rhino.Geometry;

using Grasshopper;
using Grasshopper.Kernel;
using Grasshopper.Kernel.Data;
using Grasshopper.Kernel.Types;
#endregion

public class Script_Instance : GH_ScriptInstance
{
    #region Notes
    /* 
      Members:
        RhinoDoc RhinoDocument
        GH_Document GrasshopperDocument
        IGH_Component Component
        int Iteration

      Methods (Virtual & overridable):
        Print(string text)
        Print(string format, params object[] args)
        Reflect(object obj)
        Reflect(object obj, string method_name)
    */
    #endregion

    private void RunScript(List<string> type, ref object start, ref object end)
    {
        // Write your logic here

        var startType = type[0];
        var endType = type[1];

        const double innerShortening = -1;
        const double outerShortening = -0.2;

        switch (startType){
            case "StartOuter": start = outerShortening;
            break;
            case "StartInner": start = innerShortening;
            break;
            default: start = 0;
            break;
        }

        switch (endType){
            case "EndOuter": end = outerShortening;
            break;
            case "EndInner": end = innerShortening;
            break;
            default: end = 0;
            break;
        }
    }
}
# ---------- end c_script_5 ----------

crv_segments_3 = Curve(graft(polyline_segmenter.Segments))
str_segment_type_4 = Text(str_segment_type)
num_angle_2 = Number(num_angle)
c_script_6 = CSharpScript(segment=crv_segments_3, type=str_segment_type_4, angles=num_angle_2)  # -> a; inputs segment: tree of Line, type: tree of String, angles: tree of Double
# ---------- c_script_6: C# ----------
// Grasshopper Script Instance
#region Usings
using System;
using System.Linq;
using System.Collections;
using System.Collections.Generic;
using System.Drawing;

using Rhino;
using Rhino.Geometry;

using Grasshopper;
using Grasshopper.Kernel;
using Grasshopper.Kernel.Data;
using Grasshopper.Kernel.Types;
#endregion

public class Script_Instance : GH_ScriptInstance
{
    #region Notes
    /* 
      Members:
        RhinoDoc RhinoDocument
        GH_Document GrasshopperDocument
        IGH_Component Component
        int Iteration

      Methods (Virtual & overridable):
        Print(string text)
        Print(string format, params object[] args)
        Reflect(object obj)
        Reflect(object obj, string method_name)
    */
    #endregion

    private void RunScript(
		DataTree<Line> segment,
		DataTree<string> type,
		DataTree<double> angles,
		ref object a)
    {
        const double maxLen = 500;
        var currentLength = 0.0;
        var currentItemTheeIndex = 0;

        var listPaths = new List<int>();

        for (int i = 0; i < segment.BranchCount; i++){
            Line currentSegment = segment.Branch(i)[0];
            string currentEndType = type.Branch(i)[1];
            string currentStartType = type.Branch(i)[0];
            double currentEndAngle= angles.Branch(i)[1];

            if(currentEndType == "EndOuter"){
                listPaths.Add(currentItemTheeIndex);
                if(Math.Abs(currentEndAngle) < 45){
                    currentItemTheeIndex ++;
                }
                continue;
            }

            listPaths.Add(currentItemTheeIndex);
            currentItemTheeIndex ++;
            

        } 
        // listPaths your logic here
        a = listPaths;
    }
}
# ---------- end c_script_6 ----------

crv_lower_start_3 = Line(crv_lower_start)

str_segment_type_5 = Text(c_script_3)
num_angle_3 = Number(num_angle)
list_item_2 = ListItem(List=num_angle_3, Index=0, Wrap=True)
c_script_7 = CSharpScript(type=str_segment_type_5, curve=crv_lower_start_3, angle=list_item_2)  # -> a; inputs type: list of String, curve: Curve, angle: Double
# ---------- c_script_7: C# ----------
// Grasshopper Script Instance
#region Usings
using System;
using System.Linq;
using System.Collections;
using System.Collections.Generic;
using System.Drawing;

using Rhino;
using Rhino.Geometry;

using Grasshopper;
using Grasshopper.Kernel;
using Grasshopper.Kernel.Data;
using Grasshopper.Kernel.Types;
#endregion

public class Script_Instance : GH_ScriptInstance
{
    #region Notes
    /* 
      Members:
        RhinoDoc RhinoDocument
        GH_Document GrasshopperDocument
        IGH_Component Component
        int Iteration

      Methods (Virtual & overridable):
        Print(string text)
        Print(string format, params object[] args)
        Reflect(object obj)
        Reflect(object obj, string method_name)
    */
    #endregion

    private void RunScript(
		List<string> type,
		Curve curve,
		double angle,
		ref object a)
    {
        // Write your logic here
        var currentEnd = type[1];
        if(currentEnd == "EndOuter" && Math.Abs(angle) < 45){
            a = curve.PointAtEnd;
        }else{
            a = null;
        }
    }
}
# ---------- end c_script_7 ----------

str_segment_type_6 = Text(str_segment_type)
num_bend_rad_4 = Number(expr("(x+0.5)*-1", num_bend_rad))
c_script_8 = CSharpScript(type=str_segment_type_6, gap=num_bend_rad_4)  # -> start, end; inputs type: list of String, gap: Double
# ---------- c_script_8: C# ----------
// Grasshopper Script Instance
#region Usings
using System;
using System.Linq;
using System.Collections;
using System.Collections.Generic;
using System.Drawing;

using Rhino;
using Rhino.Geometry;

using Grasshopper;
using Grasshopper.Kernel;
using Grasshopper.Kernel.Data;
using Grasshopper.Kernel.Types;
#endregion

public class Script_Instance : GH_ScriptInstance
{
    #region Notes
    /* 
      Members:
        RhinoDoc RhinoDocument
        GH_Document GrasshopperDocument
        IGH_Component Component
        int Iteration

      Methods (Virtual & overridable):
        Print(string text)
        Print(string format, params object[] args)
        Reflect(object obj)
        Reflect(object obj, string method_name)
    */
    #endregion

    private void RunScript(
		List<string> type,
		double gap,
		ref object start,
		ref object end)
    {
        // Write your logic here

        var startType = type[0];
        var endType = type[1];
        gap -= 0;

        switch (startType){
            case "StartInner": start = gap;
            break;
            case "StartOuter": start = gap;
            break;
            default: start = 0;
            break;
        }

        switch (endType){
            case "EndInner": end = gap;
            break;
            case "EndOuter": end = gap;
            break;
            default: end = 0;
            break;
        }
    }
}
# ---------- end c_script_8 ----------
num_short_1hem_start = Number(c_script_8.start)
num_short_1hem_end = Number(c_script_8.end)

crv_top_exp_2 = Curve(crv_lower_start)
ln_angled_1_3 = Line(ln_angled_1_2)
merge_4 = Merge(Data1=simplify(graft(crv_top_exp_2)), Data2=simplify(graft(ln_angled_1_3)))
loft_2 = Loft(
    Curves=reverse(merge_4),
    Options={Adjust=False, Closed=False, LoftEnds=0, LoftSimp=0, LoftType=0, Rebuild=10, Refit=0.01})

crv_top_exp_3 = Curve(crv_lower_start)
crv_lower_exp_2 = Curve(crv_lower_exp)
merge_5 = Merge(Data1=simplify(graft(crv_top_exp_3)), Data2=simplify(graft(crv_lower_exp_2)))
loft_3 = Loft(Curves=merge_5, Options={Adjust=False, Closed=False, LoftEnds=0, LoftSimp=0, LoftType=0, Rebuild=10, Refit=0.01})

ln_angled_1_4 = Line(ln_angled_1_2)
str_segment_type_7 = Text(str_segment_type)
move_4 = Move(Geometry=ln_angled_1_4, Motion=multiplication)  # -> Geometry, Transform
c_script_9 = CSharpScript(crv=ln_angled_1_4, type=str_segment_type_7)  # -> start, end; inputs crv: Curve, type: list of String
# ---------- c_script_9: C# ----------
// Grasshopper Script Instance
#region Usings
using System;
using System.Linq;
using System.Collections;
using System.Collections.Generic;
using System.Drawing;

using Rhino;
using Rhino.Geometry;

using Grasshopper;
using Grasshopper.Kernel;
using Grasshopper.Kernel.Data;
using Grasshopper.Kernel.Types;
#endregion

public class Script_Instance : GH_ScriptInstance
{
    #region Notes
    /* 
      Members:
        RhinoDoc RhinoDocument
        GH_Document GrasshopperDocument
        IGH_Component Component
        int Iteration

      Methods (Virtual & overridable):
        Print(string text)
        Print(string format, params object[] args)
        Reflect(object obj)
        Reflect(object obj, string method_name)
    */
    #endregion

    private void RunScript(
		Curve crv,
		List<string> type,
		ref object start,
		ref object end)
    {
        // Write your logic here

        var startType = type[0];
        var endType = type[1];

        const double outerAdjustment = -20;
        var length = crv.GetLength();
        var valueStat = 0.0;
        var valueEnd = 0.0;

        switch (startType){
            case "StartOuter": valueStat = outerAdjustment;
            break;
            case "StartFlat": valueStat = -200;
            break;
            case "Start": valueStat = -60;
            break;
            default: valueStat = 0;
            break;
        }

        switch (endType){
            case "EndOuter": valueEnd = outerAdjustment;
            break;
            case "EndFlat": valueEnd = -200;
            break;
            case "End": valueEnd = -60;
            break;
            default: valueEnd = 0;
            break;
        }

        // if((Math.Abs(valueStat) + Math.Abs(valueEnd) + 20) >= length){
        //     valueEnd = 0;
        //     valueStat = 0;
        // }

        start = valueStat;
        end = valueEnd;
    }
}
            
        

        // a = (type == "FlatEnd" || type == "FlatStart" || type == "InnerStart") ? gap*-1 : 0;kngdgfhw
# ---------- end c_script_9 ----------
absolute = Absolute(Value=c_script_9.start)
absolute_2 = Absolute(Value=c_script_9.end)
addition_3 = Addition(A=absolute, B=absolute_2, C="10")
length = Length(Curve=move_4.Geometry)
larger_than = LargerThan(FirstNumber=addition_3, SecondNumber=length)  # -> LargerThan, OrEqualTo
str_segment_type_8 = Text(str_segment_type)
num_adj_angles_end_3 = Number(num_adj_angles_end)
dispatch = Dispatch(List=move_4.Geometry, DispatchPattern=larger_than.LargerThan)  # -> ListA, ListB
curve = Curve(dispatch.ListB)
extend_curve_2 = ExtendCurve(Curve=curve, Type=0, Start=c_script_9.start, End=c_script_9.end)
curve_2 = Curve(dispatch.ListA)
weave = Weave(Pattern=larger_than.LargerThan, Stream0=curve_2, Stream1=extend_curve_2, NullGaps=False)
length_2 = Length(Curve=weave)
division_2 = Division(A=length_2, B="250")
round = Round(Number=division_2)  # -> Nearest, Floor, Ceiling
divide_curve = DivideCurve(Curve=weave, Count=round.Nearest, Kinks=False)  # -> Points, Tangents, Parameters
sphere = Sphere(Base=c_script_7, Radius=addition)  # disabled
area = Area(Geometry=sphere)  # -> Area, Centroid; disabled
xy_plane_2 = XYPlane(Origin=area.Centroid)  # disabled
scale_nu = ScaleNU(Geometry=sphere, Plane=xy_plane_2, ScaleX=1, ScaleY=1, ScaleZ=division)  # -> Geometry, Transform; disabled
assignpaths = AssignPaths(InputData=flatten(scale_nu.Geometry), PathsToAssign=flatten(c_script_6))  # -> simplify(RestructuredData); disabled
list_item_3 = ListItem(List=assignpaths, Index=0, Wrap=True)  # disabled

num_hem_extrusion_4 = Number(subtraction_4)
num_adj_angles_start_3 = Number(num_adj_angles_start)
num_adj_angles_end_4 = Number(num_adj_angles_end)
num_angled_deg = Number(num_angled_deg_1)
negative_3 = Negative(Value=num_angled_deg)

num_angled_deg_3 = Number(num_angled_deg_1)
num_length_angled_offset_3 = Number(subtraction_3)
num_adj_angles_start_4 = Number(num_adj_angles_start)
num_adj_angles_end_5 = Number(num_adj_angles_end)
str_segment_type_9 = Text(str_segment_type)
subtraction_7 = Subtraction(_180="180", B=num_angled_deg_3)
c_script_10 = CSharpScript(type=str_segment_type_9)  # -> start, end; inputs type: list of String
# ---------- c_script_10: C# ----------
// Grasshopper Script Instance
#region Usings
using System;
using System.Linq;
using System.Collections;
using System.Collections.Generic;
using System.Drawing;

using Rhino;
using Rhino.Geometry;

using Grasshopper;
using Grasshopper.Kernel;
using Grasshopper.Kernel.Data;
using Grasshopper.Kernel.Types;
#endregion

public class Script_Instance : GH_ScriptInstance
{
    #region Notes
    /* 
      Members:
        RhinoDoc RhinoDocument
        GH_Document GrasshopperDocument
        IGH_Component Component
        int Iteration

      Methods (Virtual & overridable):
        Print(string text)
        Print(string format, params object[] args)
        Reflect(object obj)
        Reflect(object obj, string method_name)
    */
    #endregion

    private void RunScript(List<string> type, ref object start, ref object end)
    {
        // Write your logic here

        var startType = type[0];
        var endType = type[1];

        const double outerAdjustment = -0.1;

        switch (startType){
            case "StartOuter": start = outerAdjustment;
            break;
            default: start = 0;
            break;
        }

        switch (endType){
            case "EndOuter": end = outerAdjustment;
            break;
            default: end = 0;
            break;
        }
    }
}
# ---------- end c_script_10 ----------

crv_lower_exp_3 = Curve(crv_lower_exp)
num_hem_gap_3 = Number(num_hem_gap)
num_adj_angles_start_5 = Number(num_adj_angles_start)
num_adj_angles_end_6 = Number(num_adj_angles_end)
num_bend_rad_5 = Number(expr("(x+0.5)*-1", num_bend_rad))
num_short_1hem_start_2 = Number(num_short_1hem_start)
num_short_1hem_end_2 = Number(num_short_1hem_end)

line_offset_miter_2 = LineOffsetMiter(
    Line=crv_lower_exp_3,
    Distance=num_hem_gap_3,
    StartAngle=num_adj_angles_start_5,
    EndAngle=num_adj_angles_end_6,
    StartAdjust=num_short_1hem_start_2,
    EndAdjust=num_short_1hem_end_2,
    Rotation="0")

ln_hem_start = Line(line_offset_miter_2)

ln_hem_start_2 = Line(ln_hem_start)
num_adj_angles_start_6 = Number(num_adj_angles_start)
num_adj_angles_end_7 = Number(num_adj_angles_end)
line_offset_miter_3 = LineOffsetMiter(
    Line=ln_hem_start_2,
    Distance=num_hem_extrusion_3,
    StartAngle=num_adj_angles_start_6,
    EndAngle=num_adj_angles_end_7,
    StartAdjust=0,
    EndAdjust=0,
    Rotation=Slider(90, range=-180..180))
ln_hem_end = Line(line_offset_miter_3)

ln_hem_start_3 = Line(ln_hem_start)
ln_hem_end_2 = Line(ln_hem_end)
merge_6 = Merge(Data1=simplify(graft(ln_hem_start_3)), Data2=simplify(graft(ln_hem_end_2)))
loft_4 = Loft(Curves=merge_6, Options={Adjust=False, Closed=False, LoftEnds=0, LoftSimp=0, LoftType=0, Rebuild=10, Refit=0.01})
round_corners = CSharpScript(brep=loft_4, indices="3", rad="2")  # -> a; inputs brep: Brep, indices: list of Int32, rad: Double
# ---------- round_corners: C# ----------
// Grasshopper Script Instance
#region Usings
using System;
using System.Linq;
using System.Collections;
using System.Collections.Generic;
using System.Drawing;

using Rhino;
using Rhino.Geometry;

using Grasshopper;
using Grasshopper.Kernel;
using Grasshopper.Kernel.Data;
using Grasshopper.Kernel.Types;
#endregion

public class Script_Instance : GH_ScriptInstance
{
    #region Notes
    /* 
      Members:
        RhinoDoc RhinoDocument
        GH_Document GrasshopperDocument
        IGH_Component Component
        int Iteration

      Methods (Virtual & overridable):
        Print(string text)
        Print(string format, params object[] args)
        Reflect(object obj)
        Reflect(object obj, string method_name)
    */
    #endregion

    private void RunScript(Brep brep, List<int> indices, double rad, ref object a)
    {
        // Write your logic here
        if(brep != null){
            a = CreateFilletedSurface(brep, indices, rad, 0.1, 0.1);
        }
    }

    private Brep CreateFilletedSurface(Brep face, List<int> edgesToExclude, double rad, double tolerance, double angleTolerance)
    {
        if (face == null || face.Edges.Count == 0)
            throw new ArgumentException("Invalid face provided");

        // Create exclude set for faster lookup
        HashSet<int> excludeSet = new HashSet<int>();
        if (edgesToExclude != null)
        {
            foreach (int idx in edgesToExclude)
            {
                if (idx >= 0 && idx < face.Edges.Count)
                {
                    excludeSet.Add(idx);
                }
            }
        }

        // Separate edges into two groups
        List<Curve> edgesForFillet = new List<Curve>();
        List<Curve> edgesExcluded = new List<Curve>();

        for (int i = 0; i < face.Edges.Count; i++)
        {
            Curve edgeCurve = face.Edges[i].ToNurbsCurve();
            
            if (excludeSet.Contains(i))
            {
                edgesExcluded.Add(edgeCurve);
            }
            else
            {
                edgesForFillet.Add(edgeCurve);
            }
        }

        // Join the edges that will be filleted
        Curve[] joined = Curve.JoinCurves(edgesForFillet, tolerance);

        // Create final curve list starting with excluded edges
        List<Curve> finalCurves = new List<Curve>();
        finalCurves.AddRange(edgesExcluded);

        // Fillet each joined curve segment
        foreach (var curve in joined)
        {
            if (curve != null)
            {
                Curve filleted = Curve.CreateFilletCornersCurve(curve, rad, tolerance, angleTolerance);
                
                if (filleted != null)
                {
                    finalCurves.Add(filleted);
                }
                else
                {
                    // If filleting fails, add the original curve
                    finalCurves.Add(curve);
                }
            }
        }

        // Join all curves to create the final boundary
        Curve[] planarCurves = Curve.JoinCurves(finalCurves, tolerance);

        if (planarCurves == null || planarCurves.Length == 0)
        {
            throw new Exception("Failed to join curves into boundary");
        }

        // Create planar surface from the joined curves
        Brep[] results = Brep.CreatePlanarBreps(planarCurves, tolerance);

        if (results == null || results.Length == 0)
        {
            throw new Exception("Failed to create planar surface from curves");
        }

        // Return the first result (usually there's only one)
        return results[0];
    }
}
# ---------- end round_corners ----------

num_hem_gap_4 = Number(num_hem_gap)
num_adj_angles_start_7 = Number(num_adj_angles_start)
num_adj_angles_end_8 = Number(num_adj_angles_end)
num_angled_deg_4 = Number(num_angled_deg_1)
subtraction_8 = Subtraction(_90=90, B=num_angled_deg_4)

ln_angled_1_5 = Line(ln_angled_1_2)
str_segment_type_10 = Text(str_segment_type)
vec_lin_1_2 = Vector(unit_z_2)

c_script_11 = CSharpScript(type=str_segment_type_10)  # -> start, end; inputs type: list of String; same code as c_script_4
extend_curve_3 = ExtendCurve(Curve=ln_angled_1_5, Type=0, Start=c_script_11.start, End=c_script_11.end)

move_5 = Move(Geometry=extend_curve_3, Motion=vec_lin_1_2)  # -> Geometry, Transform
crv_end_straight = Curve(move_5.Geometry)

ln_angled_1_6 = Line(ln_angled_1_2)
crv_end_straight_2 = Curve(crv_end_straight)
merge_7 = Merge(Data1=simplify(graft(ln_angled_1_6)), Data2=simplify(graft(crv_end_straight_2)))  # -> reverse(Result)
loft_5 = Loft(Curves=merge_7, Options={Adjust=False, Closed=False, LoftEnds=0, LoftSimp=0, LoftType=0, Rebuild=10, Refit=0.01})

brep = Brep(loft_5)
surface_closest_point = SurfaceClosestPoint(Point=divide_curve.Points, Surface=brep)  # -> Point, UVPoint, Distance
evaluate_surface = EvaluateSurface(Surface=brep, Point=surface_closest_point.UVPoint)  # -> Point, Normal, UDirection, VDirection, Frame

crv_end_straight_3 = Curve(crv_end_straight)

line_offset_miter_4 = LineOffsetMiter(
    Line=crv_end_straight_3,
    Distance=num_length_angled_offset_3,
    StartAngle=num_adj_angles_start_4,
    EndAngle=num_adj_angles_end_5,
    StartAdjust=c_script_10.start,
    EndAdjust=c_script_10.end,
    Rotation=subtraction_7)

ln_hem_start_4 = Line(line_offset_miter_4)

crv_end_straight_4 = Curve(crv_end_straight)
ln_hem_start_5 = Line(ln_hem_start_4)
merge_8 = Merge(Data1=simplify(graft(crv_end_straight_4)), Data2=simplify(graft(ln_hem_start_5)))
loft_6 = Loft(
    Curves=reverse(merge_8),
    Options={Adjust=False, Closed=False, LoftEnds=0, LoftSimp=0, LoftType=0, Rebuild=10, Refit=0.01})

ln_hem_start_6 = Line(ln_hem_start_4)

line_offset_miter_5 = LineOffsetMiter(
    Line=ln_hem_start_6,
    Distance=num_hem_gap_4,
    StartAngle=num_adj_angles_start_7,
    EndAngle=num_adj_angles_end_8,
    StartAdjust=c_script_5.start,
    EndAdjust=c_script_5.end,
    Rotation=subtraction_8)

ln_hem_gap = Line(line_offset_miter_5)

ln_hem_gap_2 = Line(ln_hem_gap)
line_offset_miter_6 = LineOffsetMiter(
    Line=ln_hem_gap_2,
    Distance=num_hem_extrusion_4,
    StartAngle=num_adj_angles_start_3,
    EndAngle=num_adj_angles_end_4,
    StartAdjust=0,
    EndAdjust=0,
    Rotation=negative_3)
ln_hem_end_3 = Line(line_offset_miter_6)

ln_hem_gap_3 = Line(ln_hem_gap)
ln_hem_end_4 = Line(ln_hem_end_3)
merge_9 = Merge(Data1=simplify(graft(ln_hem_gap_3)), Data2=simplify(graft(ln_hem_end_4)))
loft_7 = Loft(
    Curves=reverse(merge_9),
    Options={Adjust=False, Closed=False, LoftEnds=0, LoftSimp=0, LoftType=0, Rebuild=10, Refit=0.01})
round_corners_2 = CSharpScript(brep=loft_7, indices="1", rad="2")  # -> a; inputs brep: Brep, indices: list of Int32, rad: Double; same code as round_corners

ln_hem_start_7 = Line(ln_hem_start_4)
ln_hem_gap_4 = Line(ln_hem_gap)
merge_10 = Merge(Data1=simplify(graft(ln_hem_start_7)), Data2=simplify(graft(ln_hem_gap_4)))  # -> reverse(Result)
loft_8 = Loft(Curves=merge_10, Options={Adjust=False, Closed=False, LoftEnds=0, LoftSimp=0, LoftType=0, Rebuild=10, Refit=0.01})

crv_lower_exp_4 = Curve(crv_lower_exp)
num_short_1hem_start_3 = Number(num_short_1hem_start)
num_short_1hem_end_3 = Number(num_short_1hem_end)
ln_hem_start_8 = Line(ln_hem_start)

extend_curve_4 = ExtendCurve(Curve=crv_lower_exp_4, Type=0, Start=num_short_1hem_start_3, End=num_short_1hem_end_3)

merge_11 = Merge(Data1=simplify(graft(extend_curve_4)), Data2=simplify(graft(ln_hem_start_8)))
loft_9 = Loft(Curves=merge_11, Options={Adjust=False, Closed=False, LoftEnds=0, LoftSimp=0, LoftType=0, Rebuild=10, Refit=0.01})

c_script_12 = CSharpScript(
    S7=loft_7,
    S6=loft_8,
    S5=loft_6,
    S4=loft_5,
    S3=loft_2,
    S2=loft_3,
    S1=loft_9,
    S0=loft_4,
    types=str_segment_type_8,
    angleAtEnd=num_adj_angles_end_3,
    angleS2To3=num_angled_deg_2)  # -> out, ES7, ES6, ES5, ES4, ES3, ES2, ES1, ES0; inputs S7: Brep, S6: Brep, S5: Brep, S4: Brep, S3: Brep, S2: Brep, S1: Brep, S0: Brep, types: list of String, angleAtEnd: Double, angleS2To3: Double
# ---------- c_script_12: C# ----------
// Grasshopper Script Instance
#region Usings
using System;
using System.Linq;
using System.Collections;
using System.Collections.Generic;
using System.Drawing;

using Rhino;
using Rhino.Geometry;

using Grasshopper;
using Grasshopper.Kernel;
using Grasshopper.Kernel.Data;
using Grasshopper.Kernel.Types;
#endregion

public class Script_Instance : GH_ScriptInstance
{
    #region Notes
    /* 
      Members:
        RhinoDoc RhinoDocument
        GH_Document GrasshopperDocument
        IGH_Component Component
        int Iteration

      Methods (Virtual & overridable):
        Print(string text)
        Print(string format, params object[] args)
        Reflect(object obj)
        Reflect(object obj, string method_name)
    */
    #endregion

    private void RunScript(
		Brep S7,
		Brep S6,
		Brep S5,
		Brep S4,
		Brep S3,
		Brep S2,
		Brep S1,
		Brep S0,
		List<string> types,
		double angleAtEnd,
		double angleS2To3,
		ref object ES7,
		ref object ES6,
		ref object ES5,
		ref object ES4,
		ref object ES3,
		ref object ES2,
		ref object ES1,
		ref object ES0)
    {
        var startType = types[0];
        var endType = types[1];
        var latch = 15;
        var latchStraightExtrusion = 50;

        var currentDirection = S2.Edges[1].TangentAtEnd;
        var extrusionVector = currentDirection * latch;
        var straigthExtrusionVector = currentDirection *latchStraightExtrusion;

        var sideIndex = 2;

        var eS2 = S2.Edges[sideIndex];
        var eS3 = S3.Edges[sideIndex];
        var eS4 = S4.Edges[sideIndex];
        var es5 = S5.Edges[sideIndex];

        if(endType == "EndFlat"){
            var eS2Short = eS2.Trim(CurveEnd.Start, 2);
            var es5short = es5.Trim(CurveEnd.End, 2);

            var resES2 = Surface.CreateExtrusion(eS2Short, straigthExtrusionVector).ToBrep();
            ES2 = CreateFilletedSurface(resES2, new List<int>(){3,2}, 1, 0.1, 0.1);
            ES3 = Surface.CreateExtrusion(eS3, straigthExtrusionVector);
            ES4 = Surface.CreateExtrusion(eS4, straigthExtrusionVector);
            var resES5 = Surface.CreateExtrusion(es5short, straigthExtrusionVector).ToBrep();
            ES5 = CreateFilletedSurface(resES5, new List<int>(){3,0}, 1, 0.1, 0.1);
        }
        
        else if(endType == "EndInner")
        {
            // extrusionVector.Rotate(RhinoMath.ToRadians(angleAtEnd*-1), Vector3d.ZAxis);

            var extrusionNormalized = extrusionVector;
            extrusionNormalized.Unitize();
            var eS2Short = eS2.Trim(CurveEnd.Both, 2);
            var resES2 = Surface.CreateExtrusion(eS2Short, extrusionVector).ToBrep();
            ES2 = CreateFilletedSurface(resES2, new List<int>(){3}, 1, 0.1, 0.1);
            var es3Trim = eS3.Trim(CurveEnd.Both, 3);

            var ptE3_1 = es3Trim.PointAtStart;
            var ptE3_2 = es3Trim.PointAtEnd;


            // var distInDot1 = extrusionNormalized * new Vector3d(ptE3_1.X, ptE3_1.Y, ptE3_1.Z);
            // var distInDot2 = extrusionNormalized * new Vector3d(ptE3_2.X, ptE3_2.Y, ptE3_2.Z);
            // var dist = Math.Abs(distInDot1-distInDot2);

            ptE3_1.Transform(Transform.Translation(extrusionNormalized * (latch)));
            ptE3_2.Transform(Transform.Translation(extrusionNormalized * (latch)));
            var endOfExtrusion = new Line(ptE3_1, ptE3_2).ToNurbsCurve();
            var eendOfExtrusion = endOfExtrusion.Trim(CurveEnd.Both, 0.1);
            var loftCurves = new List<Curve>(){es3Trim.ToNurbsCurve(), eendOfExtrusion.ToNurbsCurve()};

            var resES3 = Brep.CreateFromLoft(loftCurves, Point3d.Unset, Point3d.Unset, LoftType.Straight, false)[0];
            ES3 = CreateFilletedSurface(resES3, new List<int>(){3}, 1, 0.1, 0.1);

            var eS4Short = eS4.Trim(CurveEnd.Both, 2);
            var resES4 = Surface.CreateExtrusion(eS4Short, extrusionVector).ToBrep();
            ES4 = CreateFilletedSurface(resES4, new List<int>(){3}, 1, 0.1, 0.1);
        } 
        
        else if(endType == "EndOuter")
        {
            // extrusionVector.Rotate(RhinoMath.ToRadians(angleAtEnd*-1), Vector3d.ZAxis);

            var extrusionNormalized = extrusionVector;
            extrusionNormalized.Unitize();
            var angleAdjustment = 1.0;

            if(Math.Abs(angleAtEnd) < 45){
                var eS2Short = eS2.Trim(CurveEnd.Both, 1);
                var resES2 = Surface.CreateExtrusion(eS2Short, extrusionVector).ToBrep();
                ES2 = CreateFilletedSurface(resES2, new List<int>(){3}, 1, 0.1, 0.1);
            }

            var es3Trim = eS3.Trim(CurveEnd.Start, 3.5);
            es3Trim = es3Trim.Trim(CurveEnd.End, 3.5);

            var ptE3_1 = es3Trim.PointAtStart;
            var ptE3_2 = es3Trim.PointAtEnd;

            var distInDot1 = extrusionNormalized * new Vector3d(ptE3_1.X, ptE3_1.Y, ptE3_1.Z);
            var distInDot2 = extrusionNormalized * new Vector3d(ptE3_2.X, ptE3_2.Y, ptE3_2.Z);

            var dist = Math.Abs(distInDot1-distInDot2);

            if(Math.Abs(angleAtEnd) < 45){
                 ptE3_1.Transform(Transform.Translation(extrusionNormalized * (latch)));
                ptE3_2.Transform(Transform.Translation(extrusionNormalized * (dist + latch)));

            }else{
                ptE3_1.Transform(Transform.Translation(extrusionNormalized * (1)));
                ptE3_2.Transform(Transform.Translation(extrusionNormalized * (dist + 4)));
            }

            var endOfExtrusion = new Line(ptE3_1, ptE3_2);
            var loftCurves = new List<Curve>(){es3Trim.ToNurbsCurve(), endOfExtrusion.ToNurbsCurve()};


            var res = Brep.CreateFromLoft(loftCurves, Point3d.Unset, Point3d.Unset, LoftType.Straight, false)[0];

            ES3 = CreateFilletedSurface(res, new List<int>(){3}, 1, 0.1, 0.1);

            if(Math.Abs(angleAtEnd) >= 45){
             angleAdjustment = Math.Cos(RhinoMath.ToRadians(angleS2To3));
            }


            var eS4Short = eS4.Trim(CurveEnd.Both, 2);
            var resES4 = Surface.CreateExtrusion(eS4Short, extrusionVector * angleAdjustment).ToBrep();
            ES4 = CreateFilletedSurface(resES4, new List<int>(){3}, 1, 0.1, 0.1);
        }
    }

    private Brep CreateFilletedSurface(Brep face, List<int> edgesToExclude, double rad, double tolerance, double angleTolerance)
    {
        if (face == null || face.Edges.Count == 0)
            throw new ArgumentException("Invalid face provided");

        // Create exclude set for faster lookup
        HashSet<int> excludeSet = new HashSet<int>();
        if (edgesToExclude != null)
        {
            foreach (int idx in edgesToExclude)
            {
                if (idx >= 0 && idx < face.Edges.Count)
                {
                    excludeSet.Add(idx);
                }
            }
        }

        // Separate edges into two groups
        List<Curve> edgesForFillet = new List<Curve>();
        List<Curve> edgesExcluded = new List<Curve>();

        for (int i = 0; i < face.Edges.Count; i++)
        {
            Curve edgeCurve = face.Edges[i].ToNurbsCurve();
            
            if (excludeSet.Contains(i))
            {
                edgesExcluded.Add(edgeCurve);
            }
            else
            {
                edgesForFillet.Add(edgeCurve);
            }
        }

        // Join the edges that will be filleted
        Curve[] joined = Curve.JoinCurves(edgesForFillet, tolerance);

        // Create final curve list starting with excluded edges
        List<Curve> finalCurves = new List<Curve>();
        finalCurves.AddRange(edgesExcluded);

        // Fillet each joined curve segment
        foreach (var curve in joined)
        {
            if (curve != null)
            {
                Curve filleted = Curve.CreateFilletCornersCurve(curve, rad, tolerance, angleTolerance);
                
                if (filleted != null)
                {
                    finalCurves.Add(filleted);
                }
                else
                {
                    // If filleting fails, add the original curve
                    finalCurves.Add(curve);
                }
            }
        }

        // Join all curves to create the final boundary
        Curve[] planarCurves = Curve.JoinCurves(finalCurves, tolerance);

        if (planarCurves == null || planarCurves.Length == 0)
        {
            throw new Exception("Failed to join curves into boundary");
        }

        // Create planar surface from the joined curves
        Brep[] results = Brep.CreatePlanarBreps(planarCurves, tolerance);

        if (results == null || results.Length == 0)
        {
            throw new Exception("Failed to create planar surface from curves");
        }

        // Return the first result (usually there's only one)
        return results[0];
    }

    
}
# ---------- end c_script_12 ----------

brep_2 = Brep(c_script_12.ES4)
str_segment_type_11 = Text(c_script_3)
c_script_13 = CSharpScript(type=str_segment_type_11)  # -> a; inputs type: list of String
# ---------- c_script_13: C# ----------
// Grasshopper Script Instance
#region Usings
using System;
using System.Linq;
using System.Collections;
using System.Collections.Generic;
using System.Drawing;

using Rhino;
using Rhino.Geometry;

using Grasshopper;
using Grasshopper.Kernel;
using Grasshopper.Kernel.Data;
using Grasshopper.Kernel.Types;
#endregion

public class Script_Instance : GH_ScriptInstance
{
    #region Notes
    /* 
      Members:
        RhinoDoc RhinoDocument
        GH_Document GrasshopperDocument
        IGH_Component Component
        int Iteration

      Methods (Virtual & overridable):
        Print(string text)
        Print(string format, params object[] args)
        Reflect(object obj)
        Reflect(object obj, string method_name)
    */
    #endregion

    private void RunScript(List<string> type, ref object a)
    {
        // Write your logic here
        var currentEnd = type[1];
        if(currentEnd is not "EndOuter" and not "EndInner"){
            a = true;
        }
        
        else{
            a = false;
        }
    }
}
# ---------- end c_script_13 ----------
cull_pattern = CullPattern(List=brep_2, CullPattern=c_script_13)
area_2 = Area(Geometry=cull_pattern)  # -> Area, Centroid
surface_closest_point_2 = SurfaceClosestPoint(Point=area_2.Centroid, Surface=cull_pattern)  # -> Point, UVPoint, Distance
evaluate_surface_2 = EvaluateSurface(Surface=cull_pattern, Point=surface_closest_point_2.UVPoint)  # -> Point, Normal, UDirection, VDirection, Frame
plane = Plane(evaluate_surface_2.Frame)

plane_2 = Plane(plane)
point = Point(plane_2)
surface_closest_point_3 = SurfaceClosestPoint(Point=flatten(point), Surface=brep)  # -> Point, UVPoint, Distance
smaller_than = SmallerThan(FirstNumber=surface_closest_point_3.Distance, SecondNumber=1)  # -> SmallerThan, OrEqualTo
cull_pattern_2 = CullPattern(List=surface_closest_point_3.UVPoint, CullPattern=smaller_than.SmallerThan)
circle = Circle(Plane=plane_2, Radius=loch_durchmesser_3)
brep_3 = Brep(brep_2)
evaluate_surface_3 = EvaluateSurface(Surface=brep, Point=cull_pattern_2)  # -> Point, Normal, UDirection, VDirection, Frame
merge_12 = Merge(Data1=brep_3, Data2=circle)
merge_13 = Merge(Data1=simplify(evaluate_surface.Frame), Data2=simplify(evaluate_surface_3.Frame))
clean_tree = CleanTree(RemoveNulls=True, RemoveInvalid=True, RemoveEmpty=True, Tree=merge_12)
circle_2 = Circle(Plane=merge_13, Radius=loch_durchmesser_4)
boundary_surfaces = BoundarySurfaces(Edges=clean_tree)
merge_14 = Merge(Data1=simplify(brep), Data2=simplify(circle_2))
boundary_surfaces_2 = BoundarySurfaces(Edges=merge_14)

merge_15 = Merge(
    Data1=c_script_12.ES7,
    Data2=c_script_12.ES6,
    Data3=c_script_12.ES5,
    Data4=boundary_surfaces,
    Data5=c_script_12.ES3,
    Data6=c_script_12.ES2,
    Data7=c_script_12.ES1,
    Data8=c_script_12.ES0)
clean_tree_2 = CleanTree(RemoveNulls=True, RemoveInvalid=True, RemoveEmpty=False, Tree=merge_15)
merge_16 = Merge(
    Data1=simplify(round_corners_2),
    Data2=simplify(loft_8),
    Data3=simplify(loft_6),
    Data4=simplify(boundary_surfaces_2),
    Data5=simplify(loft_2),
    Data6=simplify(loft_3),
    Data7=simplify(loft_9),
    Data8=simplify(round_corners),
    Data9=simplify(clean_tree_2))

brep_join = BrepJoin(Breps=merge_16)  # -> Breps, Closed
merge_faces = MergeFaces(Brep=brep_join.Breps)  # -> Breps, Before, After
assignpaths_2 = AssignPaths(InputData=flatten(merge_faces.Breps), PathsToAssign=flatten(c_script_6))  # -> simplify(RestructuredData)
brep_join_2 = BrepJoin(Breps=assignpaths_2)  # -> Breps, Closed
area_3 = Area(Geometry=brep_join_2.Breps)  # -> flatten(Area), Centroid
mass_addition = MassAddition(Input=area_3.Area)  # -> Result, PartialResults
division_3 = Division(A=mass_addition.Result, B=1000)
context_print = ContextPrint(Text=division_3)
non_manifold_to_sheet = NonManifoldToSheet(
    Brep=brep_join_2.Breps,
    Thickness=num_sheet_tickness_5,
    BendRadius=num_bend_rad_3,
    FlipOffset=False,
    FlipBendDirection=False,
    HemDetectionWidths=merge_2,
    ReliefOptions=bend_relief_options)
brep_4 = Brep(non_manifold_to_sheet)

# ---- group: Display Sheet
settings_speed_2 = SettingsSpeed()  # disabled
sheet = Sheet(non_manifold_to_sheet)  # disabled
mesh_brep_2 = MeshBrep(Brep=sheet, Settings=settings_speed_2)  # disabled
colour_swatch = ColourSwatch(SwatchColor=RGB(112, 112, 112))  # disabled
custom_preview_2 = CustomPreview(Geometry=mesh_brep_2, Material=colour_swatch)  # disabled

# ----
mesh_brep_3 = MeshBrep(Brep=brep_4, Settings=settings_speed)
display_2 = Display(
    Geo=mesh_brep_3,
    Color=ColourSwatch(SwatchColor=RGB(168, 150, 150)),
    Metalness=0,
    Roughness=0.5,
    Opacity=1,
    MeshName="Mesh_")
split_brep = SplitBrep(Brep=brep_join_2.Breps, Cutter=list_item_3)  # disabled
sheet_2 = Sheet(non_manifold_to_sheet)  # disabled
sort_list_2 = SortList(Keys=split_brep, ValuesValuesA=split_brep)  # -> Keys, reverse(ValuesValuesA); disabled
unroller = Unroller(Sheet=sheet_2, CompensationStrategy=panel_2, Thicken=False)  # -> Unrolled, BendAxes, BendRegions, UnrollResult; disabled
list_item_4 = ListItem(List=sort_list_2.ValuesValuesA, Index=0, Wrap=True)  # disabled
sort_list_3 = SortList(Keys=unroller.BendAxes, ValuesValuesA=unroller.BendAxes)  # -> Keys, reverse(ValuesValuesA); disabled
list_item_5 = ListItem(List=flatten(list_item_4), Index=number_slider, Wrap=True)  # disabled

list_item_6 = ListItem(List=sort_list_3.ValuesValuesA, Index=0, Wrap=True)  # disabled
angle_3 = Angle(VectorA=list_item_6, VectorB=Vector(0, 1, 0), Plane=PlaneXY(0, 0, 0))  # -> Angle, Reflex; disabled
rotate = Rotate(Geometry=simplify(graft(unroller.Unrolled)), Angle=simplify(angle_3.Angle), Plane=PlaneXY(0, 0, 0))  # -> Geometry, Transform; disabled
bounding_rectangle = BoundingRectangle(Geometry=rotate.Geometry, Plane=PlaneXY(0, 0, 0), Axis=0, Slide=0, Union=True)  # -> Bounding, DimensionX, DimensionY; disabled
gap = Panel("20")  # disabled
explode_3 = Explode(Curve=bounding_rectangle.Bounding, Recursive=True)  # -> Segments, Vertices; disabled
addition_4 = Addition(A=bounding_rectangle.DimensionX, B=gap)  # -> flatten(Result); disabled
mass_addition_2 = MassAddition(Input=addition_4)  # -> Result, simplify(PartialResults); disabled
list_item_7 = ListItem(List=explode_3.Vertices, Index=0, Wrap=True)  # disabled
move_to_point = MoveToPoint(Geometry=rotate.Geometry, PointA=list_item_7, PointB=Point(0, 0, 0))  # -> Moved, Vector, Transform; disabled
list_item_8 = ListItem(List=mass_addition_2.PartialResults, Index=0, Wrap=True)  # disabled
subtraction_9 = Subtraction(A=mass_addition_2.PartialResults, B=list_item_8)  # disabled
unit_x = UnitX(Factor=subtraction_9)  # disabled
move_6 = Move(Geometry=simplify(move_to_point.Moved), Motion=graft(unit_x))  # -> Geometry, Transform; disabled
brep_5 = Brep(move_6.Geometry)  # disabled

merge_17 = Merge(Data1=simplify(rotate.Transform), Data2=simplify(move_to_point.Transform), Data3=simplify(move_6.Transform))  # disabled
compound = Compound(Transforms=merge_17)  # disabled
transform = Transform(Geometry=unroller.BendAxes, Transform=compound)  # disabled
transform_2 = Transform(Geometry=unroller.BendRegions, Transform=compound)  # disabled
merge_faces_2 = MergeFaces(Brep=brep_5)  # -> Breps, Before, After; disabled
brep_edges = BrepEdges(Brep=merge_faces_2.Breps)  # -> Naked, Interior, NonManifold; disabled
join_curves = JoinCurves(Curves=brep_edges.Naked, Preserve=False)  # disabled
fillet_distance = FilletDistance(Curve=join_curves, Distance=panel_3)  # disabled
boundary_surfaces_3 = BoundarySurfaces(Edges=fillet_distance)  # disabled
extrude_2 = Extrude(Base=boundary_surfaces_3, Direction=unit_z)  # disabled
