# Grasshopper definition input_test.gh (Grasshopper 1.0.8)

entwine = Entwine(Branch00="1", Branch01="2", Branch02="3", FlattenInputs=True)  # -> flatten(Result)
entwine_2 = Entwine(Branch00="1", Branch01="2", Branch02="3", FlattenInputs=True)  # -> flatten(Result)
entwine_3 = Entwine(Branch00="1", Branch01="2", Branch02="3", FlattenInputs=True)
entwine_4 = Entwine(Branch00="1", Branch01="2", Branch02="3", FlattenInputs=True)
tree_statistics = TreeStatistics(Tree=entwine_4)  # -> Paths, Length, Count
deconstruct_path = DeconstructPath(Branch=tree_statistics.Paths)
list_item = ListItem(List=deconstruct_path, Index=0, Wrap=True)  # -> Item, Item1
addition = Addition(A=list_item.Item, B="1")
merge = Merge(Data1=addition, Data2=list_item.Item1)
construct_path = ConstructPath(Indices=merge)  # -> flatten(Branch)
replace_paths = ReplacePaths(Data=entwine_4, Search=tree_statistics.Paths, Replace=construct_path)
merge_2 = Merge(Data1=entwine_3, Data2=replace_paths)
complex_branch = GetNumber(merge_2, AtLeast=1, AtMost=1, Maximum=1.797693135e+308, Minimum=-1.797693135e+308, TreeAccess=True)
flat_input_tree = GetNumber(entwine, AtLeast=1, AtMost=1, Maximum=1.797693135e+308, Minimum=-1.797693135e+308, TreeAccess=False)
one_branch = GetNumber(entwine_2, AtLeast=1, AtMost=1, Maximum=1.797693135e+308, Minimum=-1.797693135e+308, TreeAccess=True)
context_print = ContextPrint(ExampleOut1=flat_input_tree)
context_print_2 = ContextPrint(ExampleOut2=one_branch)
context_print_3 = ContextPrint(ExampleOut3=complex_branch)
