# Grasshopper definition output_test.gh (Grasshopper 1.0.8)
# plug-ins: Compuceraptor

construct_point = ConstructPoint(XCoordinate=0, YCoordinate=0, ZCoordinate=0)
construct_point_2 = ConstructPoint(XCoordinate=Slider(20, range=0..100), YCoordinate=Slider(20, range=0..100), ZCoordinate=Slider(20, range=0..100))
line = Line(StartPoint=construct_point, EndPoint=construct_point_2)
curve = Curve(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)
box_2pt = Box2Pt(PointA=construct_point, PointB=construct_point_2, Plane=PlaneXY(0, 0, 0))
brep = Brep(box_2pt)
brep_2 = Brep(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)
datatofile = DataToFile(
    Geometry=brep,
    LayerNames="Default",
    LayerColors=ColourSwatch(SwatchColor=RGB(145, 145, 145)),
    FileName="Test",
    FileEnding=".3dm")
display = Display(Geo=brep_2, Color=ColourSwatch(SwatchColor=RGB(255, 255, 255)), Metalness=0, Roughness=0.5, Opacity=1, MeshName="Mesh_")
context_print = ContextPrint(ContextDouble=Slider(0.2, range=0..1))
context_print_2 = ContextPrint(ContextString="TEEEST")
context_bake = ContextBake(ContextBrep=brep_2)
context_print_3 = ContextPrint(ContextBool=Toggle(False))
context_bake_2 = ContextBake(ContextBox=box_2pt)
context_print_4 = ContextPrint(ContextInt=Slider(1, range=0..1))
context_bake_3 = ContextBake(ContextFile=datatofile)
context_bake_4 = ContextBake(FIleData=construct_point_2)
context_bake_5 = ContextBake(Content=curve)
context_bake_6 = ContextBake(Content=construct_point_2)
context_bake_7 = ContextBake(Content=line)
panel = Panel(display)
context_bake_8 = ContextBake(ContextDisplay=display)
panel_2 = Panel(datatofile)
