# Grasshopper definition point-attractor.gh (Grasshopper 1.0.8)
# plug-ins: Compuceraptor

# ---- group: Inputs
density_u = Slider(10, range=2..20)
density_v = Slider(10, range=2..20)
U = Slider(0.519, range=0..1)
V = Slider(0.383, range=0..1)
max_min = Slider(2, range=0..10)
max_height = Slider(8, range=0..10)
density_u_2 = GetInteger(density_u, AtLeast=1, AtMost=1, Maximum=2147483647, Minimum=-2147483648, TreeAccess=False)
density_v_2 = GetInteger(density_v, AtLeast=1, AtMost=1, Maximum=2147483647, Minimum=-2147483648, TreeAccess=False)
U_2 = GetNumber(U, AtLeast=1, AtMost=1, Maximum=1.797693135e+308, Minimum=-1.797693135e+308, TreeAccess=False)
V_2 = GetNumber(V, AtLeast=1, AtMost=1, Maximum=1.797693135e+308, Minimum=-1.797693135e+308, TreeAccess=False)
int_density_u = Integer(density_u_2)
int_density_v = Integer(density_v_2)
num_u = Number(U_2)
num_v = Number(V_2)

# ----
min_height = GetNumber(max_min, AtLeast=1, AtMost=1, Maximum=1.797693135e+308, Minimum=-1.797693135e+308, TreeAccess=False)
max_height_2 = GetNumber(max_height, AtLeast=1, AtMost=1, Maximum=1.797693135e+308, Minimum=-1.797693135e+308, TreeAccess=False)

# ---- group: Inputs (continued)
num_max_height = Number(max_height_2)
num_min_height = Number(min_height)

# ---- group: Script
size = Panel("-10 To 10")
int_density_u_2 = Integer(int_density_u)
int_density_v_2 = Integer(int_density_v)
num_u_2 = Number(num_u)
num_v_2 = Number(num_v)
num_max_height_2 = Number(num_max_height)
num_min_height_2 = Number(num_min_height)
rectangle = Rectangle(Plane=PlaneXY(0, 0, 0), XSize=size, YSize=size, Radius=0)  # -> Rectangle, Length
construct_point = ConstructPoint(XCoordinate=num_u_2, YCoordinate=num_v_2, ZCoordinate=0)
boundary_surfaces = BoundarySurfaces(Edges=rectangle.Rectangle)
divide_domain² = DivideDomain²(Domain=boundary_surfaces, UCount=int_density_u_2, VCount=int_density_v_2)
evaluate_surface = EvaluateSurface(Surface=reparameterize(boundary_surfaces), Point=construct_point)  # -> Point, Normal, UDirection, VDirection, Frame
isotrim = Isotrim(Surface=boundary_surfaces, Domain=divide_domain²)
area = Area(Geometry=isotrim)  # -> Area, Centroid
distance = Distance(PointA=area.Centroid, PointB=evaluate_surface.Point)
bounds = Bounds(Numbers=distance)
dimensions = Dimensions(Surface=isotrim)  # -> expr("x/2", UDimension), expr("x/2", VDimension)
unit_z = UnitZ(Factor=1)
subtraction = Subtraction(A=dimensions.UDimension, B="0.01")
subtraction_2 = Subtraction(A=dimensions.VDimension, B="0.01")

# ----
num_max_height_3 = Number(num_max_height_2)
num_min_height_3 = Number(num_min_height_2)

# ---- group: Script (continued)
construct_domain = ConstructDomain(DomainStart=num_min_height_3, DomainEnd=num_max_height_3)
remap_numbers = RemapNumbers(Value=distance, Source=bounds, Target=construct_domain)  # -> Mapped, Clipped
gradient = Gradient(
    LowerLimit=num_min_height_3,
    UpperLimit=num_max_height_3,
    Parameter=remap_numbers.Mapped,
    stops=[0: RGB(12, 7, 134), 0.25: RGB(126, 3, 167), 0.5: RGB(203, 71, 119), 0.75: RGB(248, 149, 64), 1: RGB(240, 249, 33)])
amplitude = Amplitude(Vector=unit_z, Amplitude=remap_numbers.Mapped)
center_box = CenterBox(Base=area.Centroid, X=subtraction, Y=subtraction_2, Z=amplitude)
colour_display = Colour(gradient)

# ----
three_material = ThreeMaterial(Color=colour_display, Metalness=0, Roughness=0.5, Opacity=1, Transparent=False)
list_length = ListLength(List=center_box)
series = Series(Start=0, Step=1, Count=list_length)
concatenate = Concatenate(FragmentA="Cube", FragmentB=series)
number = Number(center_box)
context_print = ContextPrint(Anzahl=number)
display = Display(Geo=center_box, MeshName="Main_Mesh", ThreeMaterial=three_material)
datatofile = DataToFile(Geometry=center_box, LayerNames=concatenate, FileNames="Cube", FileEnding=".stp")
context_bake = ContextBake(Content=display)
context_bake_2 = ContextBake(Content=datatofile)
