# Grasshopper definition input_deep.gh (Grasshopper 1.0.8)

# ---- group: Layer_1 / Layer_2
get_number2 = GetNumber(Slider(0, range=0..5), AtLeast=1, AtMost=1, Maximum=1.797693135e+308, Minimum=-1.797693135e+308, TreeAccess=False)

# ---- group: Layer_1 / Layer_2 / Layer_3
get_number3 = GetNumber(Slider(0, range=0..5), AtLeast=1, AtMost=1, Maximum=1.797693135e+308, Minimum=-1.797693135e+308, TreeAccess=False)

# ---- group: Layer_1
get_number1 = GetNumber(Slider(0, range=0..5), AtLeast=1, AtMost=1, Maximum=1.797693135e+308, Minimum=-1.797693135e+308, TreeAccess=False)

# ----
context_print = ContextPrint(Text=[get_number1, get_number2, get_number3])
