# Grasshopper definition value_list_test.gh (Grasshopper 1.0.8)
# plug-ins: Compuceraptor

type = ValueList({"Cube": 0, "Sphere": 1, "Cone": 2}, selected="Cube")
number_slider = Slider(9, range=0..100)
get_value_list = GetValueList(
    type,
    DefaultSelectedIndex=0,
    StoredItems="""[
  {
    "name": "Cube",
    "expression": "0"
  },
  {
    "name": "Sphere",
    "expression": "1"
  },
  {
    "name": "Cone",
    "expression": "2"
  }
]""")
cone = Cone(Base=PlaneXY(0, 0, 0), Radius=number_slider, Length=Slider(20, range=0..100))  # -> Cone, Tip
sphere = Sphere(Base=PlaneXY(0, 0, 0), Radius=number_slider)
center_box = CenterBox(Base=PlaneXY(0, 0, 0), X=number_slider, Y=number_slider, Z=number_slider)
stream_filter = StreamFilter(Gate=get_value_list, Stream0=center_box, Stream1=sphere, Stream2=cone.Cone)
data = Data(stream_filter)
three_material = ThreeMaterial(Color=ColourSwatch(SwatchColor=RGB(212, 108, 108)), Metalness=0, Roughness=0.5, Opacity=1, Transparent=False)
display = Display(Geo=stream_filter, ThreeMaterial=three_material)
context_bake = ContextBake(Content=display)
