# Grasshopper definition display_pipeline_debug.ghx (Grasshopper 1.0.8)
# plug-ins: Selva

geotree = Geometry(Tree({0}: [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], {1}: [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], {2}: [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], {3}: [Point(50, 50, 50)]))
nametree = Text(Tree({0}: ["GridMesh"], {1}: ["RandomMesh"], {2}: ["SampleCurve"], {3}: ["SamplePoint"]))
layertree = Text(Tree({0}: ["Fixtures/Meshes"], {1}: ["Fixtures/Meshes"], {2}: ["Fixtures/Curves"], {3}: ["Fixtures/Points"]))
metatree = Text(Tree({0}: ["kind=grid;cacheable=false"], {1}: ["kind=random;cacheable=true"], {2}: ["kind=curve"], {3}: ["kind=point"]))
tm = ThreeMaterial(Color=RGB(70, 130, 220), Metalness=0, Roughness=0.5, Opacity=1, Transparent=False)
display_fixture = Display(Geo=geotree, Name=nametree, Layer=layertree, Metadata=metatree, Material=tm)
