# Grasshopper definition live_solve_showcase.ghx (Grasshopper 1.0.8)
# plug-ins: Selva

# ---- group: Solve behaviour: stage delay + incidental noise
noise_options = ValueList({"none", "warning", "error", "exception"}, selected="none")
stage_delay_s = Slider(0, range=0..3)
stage_delay = GetNumber(stage_delay_s, AtLeast=1, AtMost=1, Maximum=1.797693135e+308, Minimum=-1.797693135e+308, TreeAccess=False)
noise = GetValueList(
    noise_options,
    AtLeast=1,
    AtMost=1,
    Immediate=True,
    ListAccess=False,
    StoredItems="""[
  {
    "name": "none",
    "expression": "none"
  },
  {
    "name": "warning",
    "expression": "warning"
  },
  {
    "name": "error",
    "expression": "error"
  },
  {
    "name": "exception",
    "expression": "exception"
  }
]""",
    TreeAccess=False)
noise_text = Text(noise)

# ----
radius_scale = Slider(1, range=0.2..3)
mode_options = ValueList({"Spheres", "Voronoi cells"}, selected="Spheres")
get_integer = GetInteger(Slider(10, range=10..250), AtLeast=1, AtMost=1, Maximum=2147483647, Minimum=-2147483648, TreeAccess=False)
radius_scale_2 = GetNumber(radius_scale, AtLeast=1, AtMost=1, Maximum=1.797693135e+308, Minimum=-1.797693135e+308, TreeAccess=False)
mode = GetValueList(
    mode_options,
    AtLeast=1,
    AtMost=1,
    Immediate=True,
    ListAccess=False,
    StoredItems="""[
  {
    "name": "Spheres",
    "expression": "Spheres"
  },
  {
    "name": "Voronoi cells",
    "expression": "Voronoi cells"
  }
]""",
    TreeAccess=False)
ui_bridge = UIBridge(
    Enable=Toggle(True),
    Schema="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",
    Values="{\"819cb5c6-bdd5-4580-aac8-441d410bb4ae\":\"none\",\"03398815-8e1e-40eb-9f6e-f773c9296a65\":53,\"ccd23254-11da-4761-8e69-9b892de180d8\":0}")  # -> Schema, URL
random = Random(Range="1 to 100", Number=get_integer, Seed=2)
random_2 = Random(Range="1 to 100", Number=get_integer, Seed="29")
random_3 = Random(Range="1 to 100", Number=get_integer, Seed="12")
random_4 = Random(Range="1 to 20", Number=get_integer, Seed="20")
c_bake = ContextBake(Content=ui_bridge.Schema)
integer = Integer(random_4)
construct_point = ConstructPoint(XCoordinate=random, YCoordinate=random_2, ZCoordinate=random_3)
mode_text = Text(mode)
multiplication = Multiplication(A=integer, B=radius_scale_2)
mode_2 = ContextPrint(Text=mode)
panel = Panel("""Spheres
Voronoi cells""")
sphere = Sphere(Base=construct_point, Radius=multiplication)
mode_index = MemberIndex(Set=panel, Member=mode_text)  # -> Index, Count
list_length = ListLength(List=sphere)
larger = LargerThan(FirstNumber=list_length, SecondNumber=100)  # -> LargerThan, OrEqualTo
panel_2 = Panel(""""Warm" = warm
"Cool" = cool
"Mono" = mono""")
panel_3 = Panel(""""Warm" = warm
"Cool" = cool
"Mono" = mono
"Rainbow" = rainbow""")

smaller_than = SmallerThan(FirstNumber="40", SecondNumber=list_length)  # -> SmallerThan, OrEqualTo
larger_than = LargerThan(FirstNumber="60", SecondNumber=list_length)  # -> LargerThan, OrEqualTo
smaller = SmallerThan(FirstNumber=list_length, SecondNumber=200)  # -> SmallerThan, OrEqualTo
panel_4 = Panel("More than 200 spheres is too heavy for the web viewer: refused")
message = Message(Condition=smaller_than.SmallerThan, Message="Only a few spheres", Level=1, Notify=0)
message_2 = Message(Condition=larger_than.LargerThan, Message="You got a lot of spheres", Level=0, Notify=0)
too_many = Message(Condition=smaller.SmallerThan, Message=panel_4, Level=2, Notify=0)

palette_options = StreamFilter(Gate=larger.LargerThan, Stream0=panel_2, Stream1=panel_3)

equals = Equality(FirstNumber=mode_index.Index, SecondNumber=0)  # -> Equality, Inequality
smaller_2 = SmallerThan(FirstNumber=radius_scale_2, SecondNumber=2)  # -> SmallerThan, OrEqualTo
voronoi_note = Message(Condition=equals.Equality, Message="Voronoi cells take a moment for many points", Level=0, Notify=0)
overlap = Message(Condition=smaller_2.SmallerThan, Message="Radius scale above 2 makes the spheres overlap heavily", Level=1, Notify=0)

# ---- group: Notify = Log
smaller_3 = SmallerThan(FirstNumber=stage_delay, SecondNumber=3)  # -> SmallerThan, OrEqualTo
msg = Message(Condition=smaller_3.SmallerThan, Message="Stage delay of 3 s or more: logged only, never a popup", Level=1, Notify=1)

# ----
set_palette = SetDynamicValueList(Options=palette_options)
panel_5 = Panel("""warm
cool
mono
rainbow""")
palette = GetDynamicValueList(
    palette_options,
    AtLeast=1,
    AtMost=1,
    Immediate=True,
    ListAccess=False,
    StoredItems="""[
  {
    "name": "Warm",
    "expression": "warm"
  },
  {
    "name": "Cool",
    "expression": "cool"
  },
  {
    "name": "Mono",
    "expression": "mono"
  },
  {
    "name": "Rainbow",
    "expression": "rainbow"
  }
]""",
    TreeAccess=False)
sphere_count = ContextPrint(SphereCount=list_length)
palette_options_2 = ContextBake(Content=set_palette)
palette_text = Text(palette)
palette_colours = Colour([RGB(224, 122, 95), RGB(88, 150, 214), RGB(140, 140, 140), RGB(160, 90, 220)])
palette_index = MemberIndex(Set=panel_5, Member=palette_text)  # -> Index, Count
palette_colour = ListItem(List=palette_colours, Index=palette_index.Index, Wrap=True)
voronoi_box = CenterBox(Base=PlaneXY(50.5, 50.5, 50.5), X=52, Y=52, Z=52)
voronoi³ = Voronoi3D(Points=construct_point, Box=voronoi_box)  # -> Cells, Boundary
volume = Volume(Geometry=voronoi³.Cells)  # -> Volume, Centroid
shrink_cells = Scale(Geometry=voronoi³.Cells, Center=volume.Centroid, Factor=0.8)  # -> Geometry, Transform
three_material = ThreeMaterial(Color=palette_colour, Metalness=0, Roughness=Slider(0.23, range=0..1), Opacity=1, Transparent=False)
pick_geometry = StreamFilter(Gate=mode_index.Index, Stream0=sphere, Stream1=shrink_cells.Geometry)

# ---- group: Slow stages: abort lands between them; progress hooks in here
slow_stage_1 = CSharpScript(geo=pick_geometry, delay=stage_delay)  # -> out, pass; inputs geo: list
# ---------- slow_stage_1: C# ----------
// Slow stage 1 of 4: sleeps `delay` seconds in ticks, then passes the geometry through
// unchanged. Grasshopper only aborts between components, so each tick checks for an abort
// itself, and reports progress so the viewer shows one bar across all four stages.
using System;
using System.Collections.Generic;
using System.Linq;
using System.Threading;

public class Script_Instance : GH_ScriptInstance
{
    private const int Stage = 1;
    private const int Stages = 4;
    private const int Ticks = 10;

    private void RunScript(List<object> geo, object delay, ref object pass)
    {
        var doc = Component.OnPingDocument();
        var seconds = delay == null ? 0 : Convert.ToDouble(delay);
        for (var tick = 1; seconds > 0 && tick <= Ticks; tick++)
        {
            if (doc != null && doc.AbortRequested) break;
            Thread.Sleep(TimeSpan.FromSeconds(seconds / Ticks));
            Progress(doc, ((Stage - 1) * Ticks + tick) / (double)(Stages * Ticks));
        }
        pass = geo;
    }

    // Selva isn't referenceable from a script, so reach the solve runtime by name. Outside Selva
    // (plain Grasshopper, stock Compute) the type is missing and this does nothing.
    private static void Progress(Grasshopper.Kernel.GH_Document doc, double fraction)
    {
        var runtimes = AppDomain.CurrentDomain.GetAssemblies()
            .Select(a => a.GetType("Selva.GH.Features.SolveRuntime.Services.SolveRuntimes"))
            .FirstOrDefault(t => t != null);
        var runtime = runtimes?.GetMethod("For")?.Invoke(null, new object[] { doc });
        runtime?.GetType().GetMethod("EmitProgress")?.Invoke(runtime,
            new object[] { "Slow stages", fraction, Stage, Stages, "Stage " + Stage + " of " + Stages });
    }
}
# ---------- end slow_stage_1 ----------
slow_stage_2 = CSharpScript(geo=slow_stage_1.pass, delay=stage_delay)  # -> out, pass; inputs geo: list
# ---------- slow_stage_2: C# ----------
// Slow stage 2 of 4: sleeps `delay` seconds in ticks, then passes the geometry through
// unchanged. Grasshopper only aborts between components, so each tick checks for an abort
// itself, and reports progress so the viewer shows one bar across all four stages.
using System;
using System.Collections.Generic;
using System.Linq;
using System.Threading;

public class Script_Instance : GH_ScriptInstance
{
    private const int Stage = 2;
    private const int Stages = 4;
    private const int Ticks = 10;

    private void RunScript(List<object> geo, object delay, ref object pass)
    {
        var doc = Component.OnPingDocument();
        var seconds = delay == null ? 0 : Convert.ToDouble(delay);
        for (var tick = 1; seconds > 0 && tick <= Ticks; tick++)
        {
            if (doc != null && doc.AbortRequested) break;
            Thread.Sleep(TimeSpan.FromSeconds(seconds / Ticks));
            Progress(doc, ((Stage - 1) * Ticks + tick) / (double)(Stages * Ticks));
        }
        pass = geo;
    }

    // Selva isn't referenceable from a script, so reach the solve runtime by name. Outside Selva
    // (plain Grasshopper, stock Compute) the type is missing and this does nothing.
    private static void Progress(Grasshopper.Kernel.GH_Document doc, double fraction)
    {
        var runtimes = AppDomain.CurrentDomain.GetAssemblies()
            .Select(a => a.GetType("Selva.GH.Features.SolveRuntime.Services.SolveRuntimes"))
            .FirstOrDefault(t => t != null);
        var runtime = runtimes?.GetMethod("For")?.Invoke(null, new object[] { doc });
        runtime?.GetType().GetMethod("EmitProgress")?.Invoke(runtime,
            new object[] { "Slow stages", fraction, Stage, Stages, "Stage " + Stage + " of " + Stages });
    }
}
# ---------- end slow_stage_2 ----------
noise_stage = CSharpScript(geo=slow_stage_2.pass, noise=noise_text)  # -> out, pass; inputs geo: list
# ---------- noise_stage: C# ----------
// Incidental Grasshopper noise: messages no Selva Message component wrote. They must
// reach the message log without interrupting the user or blocking the result.
using System;
using System.Collections.Generic;
using Grasshopper.Kernel;

public class Script_Instance : GH_ScriptInstance
{
    private void RunScript(List<object> geo, object noise, ref object pass)
    {
        switch (Convert.ToString(noise).Trim().ToLowerInvariant())
        {
            case "warning":
                Component.AddRuntimeMessage(GH_RuntimeMessageLevel.Warning, "Incidental warning from a script component");
                break;
            case "error":
                Component.AddRuntimeMessage(GH_RuntimeMessageLevel.Error, "Incidental error from a script component");
                break;
            case "exception":
                throw new InvalidOperationException("Script component threw on purpose");
        }
        pass = geo;
    }
}
# ---------- end noise_stage ----------
slow_stage_3 = CSharpScript(geo=noise_stage.pass, delay=stage_delay)  # -> out, pass; inputs geo: list
# ---------- slow_stage_3: C# ----------
// Slow stage 3 of 4: sleeps `delay` seconds in ticks, then passes the geometry through
// unchanged. Grasshopper only aborts between components, so each tick checks for an abort
// itself, and reports progress so the viewer shows one bar across all four stages.
using System;
using System.Collections.Generic;
using System.Linq;
using System.Threading;

public class Script_Instance : GH_ScriptInstance
{
    private const int Stage = 3;
    private const int Stages = 4;
    private const int Ticks = 10;

    private void RunScript(List<object> geo, object delay, ref object pass)
    {
        var doc = Component.OnPingDocument();
        var seconds = delay == null ? 0 : Convert.ToDouble(delay);
        for (var tick = 1; seconds > 0 && tick <= Ticks; tick++)
        {
            if (doc != null && doc.AbortRequested) break;
            Thread.Sleep(TimeSpan.FromSeconds(seconds / Ticks));
            Progress(doc, ((Stage - 1) * Ticks + tick) / (double)(Stages * Ticks));
        }
        pass = geo;
    }

    // Selva isn't referenceable from a script, so reach the solve runtime by name. Outside Selva
    // (plain Grasshopper, stock Compute) the type is missing and this does nothing.
    private static void Progress(Grasshopper.Kernel.GH_Document doc, double fraction)
    {
        var runtimes = AppDomain.CurrentDomain.GetAssemblies()
            .Select(a => a.GetType("Selva.GH.Features.SolveRuntime.Services.SolveRuntimes"))
            .FirstOrDefault(t => t != null);
        var runtime = runtimes?.GetMethod("For")?.Invoke(null, new object[] { doc });
        runtime?.GetType().GetMethod("EmitProgress")?.Invoke(runtime,
            new object[] { "Slow stages", fraction, Stage, Stages, "Stage " + Stage + " of " + Stages });
    }
}
# ---------- end slow_stage_3 ----------
slow_stage_4 = CSharpScript(geo=slow_stage_3.pass, delay=stage_delay)  # -> out, pass; inputs geo: list
# ---------- slow_stage_4: C# ----------
// Slow stage 4 of 4: sleeps `delay` seconds in ticks, then passes the geometry through
// unchanged. Grasshopper only aborts between components, so each tick checks for an abort
// itself, and reports progress so the viewer shows one bar across all four stages.
using System;
using System.Collections.Generic;
using System.Linq;
using System.Threading;

public class Script_Instance : GH_ScriptInstance
{
    private const int Stage = 4;
    private const int Stages = 4;
    private const int Ticks = 10;

    private void RunScript(List<object> geo, object delay, ref object pass)
    {
        var doc = Component.OnPingDocument();
        var seconds = delay == null ? 0 : Convert.ToDouble(delay);
        for (var tick = 1; seconds > 0 && tick <= Ticks; tick++)
        {
            if (doc != null && doc.AbortRequested) break;
            Thread.Sleep(TimeSpan.FromSeconds(seconds / Ticks));
            Progress(doc, ((Stage - 1) * Ticks + tick) / (double)(Stages * Ticks));
        }
        pass = geo;
    }

    // Selva isn't referenceable from a script, so reach the solve runtime by name. Outside Selva
    // (plain Grasshopper, stock Compute) the type is missing and this does nothing.
    private static void Progress(Grasshopper.Kernel.GH_Document doc, double fraction)
    {
        var runtimes = AppDomain.CurrentDomain.GetAssemblies()
            .Select(a => a.GetType("Selva.GH.Features.SolveRuntime.Services.SolveRuntimes"))
            .FirstOrDefault(t => t != null);
        var runtime = runtimes?.GetMethod("For")?.Invoke(null, new object[] { doc });
        runtime?.GetType().GetMethod("EmitProgress")?.Invoke(runtime,
            new object[] { "Slow stages", fraction, Stage, Stages, "Stage " + Stage + " of " + Stages });
    }
}
# ---------- end slow_stage_4 ----------

# ----
display = Display(Geo=slow_stage_4.pass, Material=three_material)
context_bake = ContextBake(Content=display)
