# Grasshopper definition sheet_metal_bracket.ghx (Grasshopper 1.0.8)
# plug-ins: SheepMetal, Selva

material = ValueList({"Steel", "Aluminium", "Stainless", "Copper"}, selected="Steel")
width = Slider(60, range=10..300)
base_flange = Slider(80, range=20..300)
upright_flange = Slider(60, range=20..300)
bend_angle = Slider(90, range=30..150)
thickness = Slider(2, range=0.5..6)
bend_radius = Slider(2, range=0.5..10)
k_factor = Slider(0.33, range=0.25..0.5)
holes_per_flange = Slider(2, range=0..6)
hole_diameter = Slider(6.5, range=3..14)
width_2 = GetNumber(width, AtLeast=1, AtMost=1, Maximum=1.797693135e+308, Minimum=-1.797693135e+308, TreeAccess=False)
base_flange_2 = GetNumber(base_flange, AtLeast=1, AtMost=1, Maximum=1.797693135e+308, Minimum=-1.797693135e+308, TreeAccess=False)
upright_flange_2 = GetNumber(upright_flange, AtLeast=1, AtMost=1, Maximum=1.797693135e+308, Minimum=-1.797693135e+308, TreeAccess=False)
bend_angle_2 = GetNumber(bend_angle, AtLeast=1, AtMost=1, Maximum=1.797693135e+308, Minimum=-1.797693135e+308, TreeAccess=False)
thickness_2 = GetNumber(thickness, AtLeast=1, AtMost=1, Maximum=1.797693135e+308, Minimum=-1.797693135e+308, TreeAccess=False)
bend_radius_2 = GetNumber(bend_radius, AtLeast=1, AtMost=1, Maximum=1.797693135e+308, Minimum=-1.797693135e+308, TreeAccess=False)
k_factor_2 = GetNumber(k_factor, AtLeast=1, AtMost=1, Maximum=1.797693135e+308, Minimum=-1.797693135e+308, TreeAccess=False)
holes_per_flange_2 = GetInteger(holes_per_flange, AtLeast=1, AtMost=1, Maximum=2147483647, Minimum=-2147483648, TreeAccess=False)
hole_diameter_2 = GetNumber(hole_diameter, AtLeast=1, AtMost=1, Maximum=1.797693135e+308, Minimum=-1.797693135e+308, TreeAccess=False)
material_2 = GetValueList(
    material,
    AtLeast=1,
    AtMost=1,
    Immediate=True,
    ListAccess=False,
    StoredItems="""[
  {
    "name": "Steel",
    "expression": "Steel"
  },
  {
    "name": "Aluminium",
    "expression": "Aluminium"
  },
  {
    "name": "Stainless",
    "expression": "Stainless"
  },
  {
    "name": "Copper",
    "expression": "Copper"
  }
]""",
    TreeAccess=False)
ui_bridge = UIBridge(Enable=Toggle(True), Schema="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")  # -> Schema, URL
stol = SetTolerances(AngleTolerance=1, AbsoluteTolerance=0.001)
profile = CSharpScript(A=base_flange_2, B=upright_flange_2, Ang=bend_angle_2)  # -> out, Profile, Plane
# ---------- profile: C# ----------
// Grasshopper Script Instance
#region Usings
using System;
using System.Linq;
using System.Collections;
using System.Collections.Generic;
using System.Drawing;

using Rhino;
using Rhino.Geometry;

using Grasshopper;
using Grasshopper.Kernel;
using Grasshopper.Kernel.Data;
using Grasshopper.Kernel.Types;
#endregion

public class Script_Instance : GH_ScriptInstance
{
    // L profile in the XZ plane: base flange along +X, upright flange turned up by the bend angle.
    private void RunScript(
		object A,
		object B,
		object Ang,
		ref object Profile,
		ref object Plane)
    {
        double a = Clamp(Num(A, 80), 5, 2000);
        double b = Clamp(Num(B, 60), 5, 2000);
        double alpha = (180 - Clamp(Num(Ang, 90), 20, 160)) * Math.PI / 180;

        Profile = new Polyline(new[] {
            new Point3d(a, 0, 0),
            Point3d.Origin,
            new Point3d(b * Math.Cos(alpha), 0, b * Math.Sin(alpha))
        }).ToNurbsCurve();
        Plane = new Rhino.Geometry.Plane(Point3d.Origin, Vector3d.XAxis, Vector3d.ZAxis);
    }

    static double Num(object o, double fallback)
    {
        if (o == null) return fallback;
        double v;
        return GH_Convert.ToDouble(o, out v, GH_Conversion.Both) ? v : fallback;
    }

    static double Clamp(double v, double lo, double hi) { return Math.Max(lo, Math.Min(hi, v)); }
}
# ---------- end profile ----------
c_bake = ContextBake(Content=ui_bridge.Schema)
pts = PolylineToSheet(
    Polyline=profile.Profile,
    Thickness=thickness_2,
    BendRadius=bend_radius_2,
    ReferencePlane=profile.Plane,
    Depth=width_2,
    OffsetType=1)  # -> Sheet, Angles
U = Unroller(Sheet=pts.Sheet, CompensationStrategy=k_factor_2, BackSideUp=False, Thicken=False, Orient=1)  # -> Unrolled, BendAxes, BendRegions, FinishUp, FinishDown, UnrollResult, OverlapPoints
holes = CSharpScript(Flat=U.Unrolled, Regions=U.BendRegions, N=holes_per_flange_2, D=hole_diameter_2)  # -> out, Cuts, Diameter; inputs Regions: list
# ---------- holes: C# ----------
// Grasshopper Script Instance
#region Usings
using System;
using System.Linq;
using System.Collections;
using System.Collections.Generic;
using System.Drawing;

using Rhino;
using Rhino.Geometry;

using Grasshopper;
using Grasshopper.Kernel;
using Grasshopper.Kernel.Data;
using Grasshopper.Kernel.Types;
#endregion

public class Script_Instance : GH_ScriptInstance
{
    // One row of holes per flange, laid out on the unrolled flat so Reroll can cut them through the part.
    private void RunScript(
		object Flat,
		List<object> Regions,
		object N,
		object D,
		ref object Cuts,
		ref object Diameter)
    {
        var cuts = new List<Curve>();
        Cuts = cuts;
        Diameter = 0.0;
        var flat = Flat as Brep ?? (Flat is GH_Brep ? ((GH_Brep)Flat).Value : null);
        int n = (int)Clamp(Math.Round(Num(N, 2)), 0, 12);
        double d = Math.Max(Num(D, 6.5), 0);
        if (flat == null || n == 0 || d <= 0) return;

        var bb = flat.GetBoundingBox(true);
        var strip = BoundingBox.Empty;
        foreach (var o in Regions ?? new List<object>())
        {
            Curve c = o as Curve ?? (o is GH_Curve ? ((GH_Curve)o).Value : null);
            if (c != null) strip.Union(c.GetBoundingBox(true));
        }
        if (!strip.IsValid) return;

        // The bend strip spans the flat in one direction; the two flanges sit either side of it.
        bool stripAlongX = strip.Max.X - strip.Min.X > 0.9 * (bb.Max.X - bb.Min.X);
        double lo0 = stripAlongX ? bb.Min.Y : bb.Min.X, lo1 = stripAlongX ? strip.Min.Y : strip.Min.X;
        double hi0 = stripAlongX ? strip.Max.Y : strip.Max.X, hi1 = stripAlongX ? bb.Max.Y : bb.Max.X;
        double run0 = stripAlongX ? bb.Min.X : bb.Min.Y, run = stripAlongX ? bb.Max.X - bb.Min.X : bb.Max.Y - bb.Min.Y;

        d = Math.Min(d, Math.Min(Math.Min(lo1 - lo0, hi1 - hi0) * 0.6, run / n * 0.7));
        Diameter = Math.Round(d, 2);
        if (d < 0.5) return;

        foreach (double across in new[] { (lo0 + lo1) / 2, (hi0 + hi1) / 2 })
            for (int i = 0; i < n; i++)
            {
                double along = run0 + run * (i + 0.5) / n;
                var centre = stripAlongX ? new Point3d(along, across, 0) : new Point3d(across, along, 0);
                cuts.Add(new Circle(new Rhino.Geometry.Plane(centre, Vector3d.ZAxis), d / 2).ToNurbsCurve());
            }
    }

    static double Num(object o, double fallback)
    {
        if (o == null) return fallback;
        double v;
        return GH_Convert.ToDouble(o, out v, GH_Conversion.Both) ? v : fallback;
    }

    static double Clamp(double v, double lo, double hi) { return Math.Max(lo, Math.Min(hi, v)); }
}
# ---------- end holes ----------
reroll = Reroll(UnrollResult=U.UnrollResult, CutCurves=holes.Cuts)  # -> Solid, Curves3D, Points3D
mts = ManifoldToSheet(Brep=reroll.Solid, RootFace=-1, MergeCoplanarFaces=False)
sprop = SheetProperties(Sheet=mts, Material=material_2, Name="L bracket")  # -> Sheet, Material, Quantity, Name, PartNumber, FinishSide0, FinishSide1, Spacing, Grain
U_2 = Unroller(Sheet=sprop.Sheet, CompensationStrategy=k_factor_2, BackSideUp=False, Thicken=False, Orient=1)  # -> Unrolled, BendAxes, BendRegions, FinishUp, FinishDown, UnrollResult, OverlapPoints
si = SheetInfo(Sheet=sprop.Sheet)  # -> Flanges, Bends, Hems, IHoles, NIHoles, CHoles, Thickness, PerBendLists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
stats = CSharpScript(Solid=reroll.Solid, Flat=U_2.Unrolled, Axes=U_2.BendAxes, Mat=material_2, Holes=si.IHoles, Bends=si.Bends)  # -> out, Weight, Colour, FlatSize, Summary, FlatMoved, FlatCurves; inputs Axes: list
# ---------- stats: C# ----------
// Grasshopper Script Instance
#region Usings
using System;
using System.Linq;
using System.Collections;
using System.Collections.Generic;
using System.Drawing;

using Rhino;
using Rhino.Geometry;

using Grasshopper;
using Grasshopper.Kernel;
using Grasshopper.Kernel.Data;
using Grasshopper.Kernel.Types;
#endregion

public class Script_Instance : GH_ScriptInstance
{
    // Weight and colour per material, plus the flat pattern moved beside the part for the viewer and the DXF.
    private void RunScript(
		object Solid,
		object Flat,
		List<object> Axes,
		object Mat,
		object Holes,
		object Bends,
		ref object Weight,
		ref object Colour,
		ref object FlatSize,
		ref object Summary,
		ref object FlatMoved,
		ref object FlatCurves)
    {
        Weight = null; Colour = null; FlatSize = null; Summary = null; FlatMoved = null; FlatCurves = null;
        var solid = Solid as Brep ?? (Solid is GH_Brep ? ((GH_Brep)Solid).Value : null);
        var flat = Flat as Brep ?? (Flat is GH_Brep ? ((GH_Brep)Flat).Value : null);
        string mat = Mat == null ? "Steel" : Mat.ToString().Trim('"');

        double density;
        Color colour;
        switch (mat.ToLowerInvariant())
        {
            case "aluminium": density = 2.70; colour = Color.FromArgb(200, 206, 214); break;
            case "stainless": density = 7.93; colour = Color.FromArgb(150, 160, 172); break;
            case "copper": density = 8.96; colour = Color.FromArgb(184, 115, 51); break;
            default: mat = "Steel"; density = 7.85; colour = Color.FromArgb(70, 78, 92); break;
        }
        Colour = colour;

        double grams = solid != null ? solid.GetVolume() / 1000.0 * density : 0;
        Weight = Math.Round(grams, 1);
        if (flat == null) return;

        var bb = flat.GetBoundingBox(true);
        // Beside the part, whichever way it was extruded.
        double clear = solid != null ? solid.GetBoundingBox(true).Max.Y + 40 : 40;
        var move = Transform.Translation(new Vector3d(-bb.Min.X, clear - bb.Min.Y, -bb.Min.Z));
        var moved = flat.DuplicateBrep();
        moved.Transform(move);
        FlatMoved = moved;

        var curves = Curve.JoinCurves(moved.DuplicateNakedEdgeCurves(true, true), 0.001).ToList();
        foreach (var o in Axes ?? new List<object>())
        {
            Curve c = o as Curve ?? (o is GH_Curve ? ((GH_Curve)o).Value : null);
            if (c == null) continue;
            c = c.DuplicateCurve();
            c.Transform(move);
            curves.Add(c);
        }
        FlatCurves = curves;

        string size = string.Format("{0:0.0} x {1:0.0} mm", bb.Max.X - bb.Min.X, bb.Max.Y - bb.Min.Y);
        FlatSize = size;
        Summary = string.Format("{0}, {1} bend(s), {2} hole(s), flat {3}, {4:0.0} g", mat, Num(Bends, 0), Num(Holes, 0), size, grams);
    }

    static double Num(object o, double fallback)
    {
        if (o == null) return fallback;
        double v;
        return GH_Convert.ToDouble(o, out v, GH_Conversion.Both) ? v : fallback;
    }

    static double Clamp(double v, double lo, double hi) { return Math.Max(lo, Math.Min(hi, v)); }
}
# ---------- end stats ----------
tm = ThreeMaterial(Color=RGB(56, 189, 248), Metalness=0.1, Roughness=0.6)
tm_2 = ThreeMaterial(Color=stats.Colour, Metalness=0.85, Roughness=0.35)
c_print = ContextPrint(WeightG=stats.Weight)
c_print_2 = ContextPrint(Summary=stats.Summary)
c_print_3 = ContextPrint(FlatSize=stats.FlatSize)
gtf = GeometryToFile(Geometry=stats.FlatCurves, FileNames="bracket_flat_pattern", FileEnding=".dxf")
D = Display(Geo=reroll.Solid, Name="Bracket", Material=tm_2)
D_2 = Display(Geo=stats.FlatMoved, Name="Flat pattern", Material=tm)
c_bake_2 = ContextBake(FlatPatternDXF=gtf)
codisplay = CombineDisplay(WebDisplay=[D, D_2])
c_bake_3 = ContextBake(Content=codisplay)
