# Grasshopper definition Sheet_Analyzer.gh (Grasshopper 1.0.8)
# plug-ins: SheepMetal, Selva

display_options = ValueList({"Sheet": 0, "Sheet Colored": 1, "Unrolled": 2}, selected="Sheet Colored")
k_factor = Slider(0.54, range=0..1)
file_path = FilePath("C:\Users\Felix\Desktop\Sheet_1.3dm")
get_file = GetFile(file_path, AtLeast=1, AtMost=1, Immediate=True, Prompt="Select a file to import", TreeAccess=False)
ui_bridge = UIBridge(Enable=Toggle(True), Schema="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")
k_factor_2 = GetString(k_factor, AtLeast=1, AtMost=1, TreeAccess=False)
get_value_list = GetValueList(
    display_options,
    AtLeast=1,
    AtMost=1,
    Immediate=True,
    StoredItems="""[
  {
    "name": "Sheet",
    "expression": "0"
  },
  {
    "name": "Sheet Colored",
    "expression": "1"
  },
  {
    "name": "Unrolled",
    "expression": "2"
  }
]""",
    TreeAccess=False)
brep = Brep(get_file)
integer = Integer(get_value_list)
k_factor_3 = Number(k_factor_2)
context_bake = ContextBake(Content=ui_bridge)

# ----
# Brep To Sheet
brep_2 = Brep(brep)
manifold_to_sheet = ManifoldToSheet(Brep=brep_2, RootFaceIndex="-1", MergeCoplanarFaces=False)
sheet = Sheet(manifold_to_sheet)

k_factor_4 = Number(k_factor_3)

# ----
# Unroll Sheet
sheet_2 = Sheet(manifold_to_sheet)
unroller = Unroller(Sheet=sheet_2, CompensationStrategy=k_factor_4, BackSideUp=False, Thicken=False)  # -> Unrolled, BendAxes, BendRegions, UnrollResult
brep_3 = Brep(unroller.Unrolled)

# ----
# Extract Sheet Data
sheet_3 = Sheet(sheet)
sheet_info = SheetInfo(Sheet=sheet_3)  # -> Flanges, Bends, Hems, IHoles, NIHoles, CHoles, Thickness, port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
mass_addition = MassAddition(Input=[sheet_info.IHoles, sheet_info.NIHoles, sheet_info.CHoles])  # -> Result, PartialResults

geometry_to_file = GeometryToFile(Geometry=unroller.Unrolled, FileNames="Sheet", FileEnding=".3dm")
context_bake_2 = ContextBake(Content=geometry_to_file)

# ----
# Display Unrolled
brep_4 = Brep(brep_3)
integer_2 = Integer(integer)
stream_gate = StreamGate(Stream=brep_4, Gate=integer_2)  # -> Target0, Target1, Target2
custom_preview = CustomPreview(Geometry=stream_gate.Target2, Material=ColourSwatch(SwatchColor=RGB(255, 255, 255)))

thickness = ContextPrint(Thickness=sheet_info.Thickness)
flanges = ContextPrint(Flanges=sheet_info.Flanges)
bends = ContextPrint(Bends=sheet_info.Bends)
hems = ContextPrint(Text=sheet_info.Hems)
thickness_2 = ContextPrint(Holes=mass_addition.Result)
cluster = Cluster()

# ----
# Display Sheet By Feature
sheet_4 = Sheet(sheet)
explode_sheet = ExplodeSheet(Sheet=sheet_4)  # -> Flanges, Bends, Hems, IHoles, NIHoles, CHoles, ThicknessFaces
entwine = Entwine(
    Branch00=explode_sheet.Flanges,
    Branch01=explode_sheet.Bends,
    Branch02=explode_sheet.Hems,
    Branch03=explode_sheet.IHoles,
    Branch04=explode_sheet.NIHoles,
    Branch05=explode_sheet.CHoles,
    Branch06=explode_sheet.ThicknessFaces,
    FlattenInputs=True)
list_length = ListLength(List=entwine)
repeat_data = RepeatData(Data=cluster, Length=list_length)  # -> simplify(Data)

integer_3 = Integer(integer)
stream_gate_2 = StreamGate(Stream=entwine, Gate=integer_3)  # -> Target0, Target1, Target2

three_material = ThreeMaterial(Color=repeat_data, Metalness="0.85", Roughness=0.5, Opacity=1, Transparent=False)
display = Display(Geo=stream_gate_2.Target1, TMaterial=three_material)
context_bake_3 = ContextBake(DisplaySheetColor=display)
custom_preview_2 = CustomPreview(Geometry=stream_gate_2.Target1, Material=repeat_data)

three_material_2 = ThreeMaterial(Color=ColourSwatch(SwatchColor=RGB(166, 162, 162)), Metalness="0.85", Roughness=0.5, Opacity=1, Transparent=False)
display_2 = Display(Geo=stream_gate.Target2, TMaterial=three_material_2)
context_bake_4 = ContextBake(DisplayUnrolled=display_2)

# ----
# Display Sheet
sheet_5 = Sheet(sheet)
integer_4 = Integer(integer)

brep_5 = Brep(sheet_5)

stream_gate_3 = StreamGate(Stream=brep_5, Gate=integer_4)  # -> Target0, Target1, Target2

colour_swatch = ColourSwatch(SwatchColor=RGB(212, 186, 186))
three_material_3 = ThreeMaterial(Color=colour_swatch, Metalness="0.85", Roughness=0.5, Opacity=1, Transparent=False)
display_3 = Display(Geo=stream_gate_3.Target0, TMaterial=three_material_3)
custom_preview_3 = CustomPreview(Geometry=stream_gate_3.Target0, Material=colour_swatch)
context_bake_5 = ContextBake(DisplaySheet=display_3)

# ==== cluster Cluster
entwine = Entwine(
    Branch00=ColourSwatch(SwatchColor=RGB(214, 214, 214)),
    Branch01=ColourSwatch(SwatchColor=RGB(224, 135, 135)),
    Branch02=ColourSwatch(SwatchColor=RGB(211, 224, 135)),
    Branch03=ColourSwatch(SwatchColor=RGB(135, 224, 162)),
    Branch04=ColourSwatch(SwatchColor=RGB(135, 224, 215)),
    Branch05=ColourSwatch(SwatchColor=RGB(135, 153, 224)),
    Branch06=ColourSwatch(SwatchColor=RGB(180, 135, 224)),
    FlattenInputs=True)
result = ClusterOutput(entwine)
