# Grasshopper definition option_test.gh (Grasshopper 1.0.8)
# plug-ins: Selva

material = ValueList({"Wood": 0, "Copper": 1, "Aluminum": 2, "Steel": 3, "Plastic": 4}, selected="Plastic")
wood = ValueList({"Oak", "Pine", "Birch", "Plywood"}, selected="Pine")
copper = ValueList({"C110 (ETP)", "C101 (Oxygen-free)", "Phosphor bronze"}, selected="Phosphor bronze")
aluminum = ValueList({"6061-T6", "5052-H32", "7075-T6"}, selected="7075-T6")
steel = ValueList({"Mild steel (A36/S235)", "Stainless 304", "Stainless 316", "Tool steel (A2)"}, selected="Mild steel (A36/S235)")
plastic = ValueList({"PLA", "ABS", "PETG", "PMMA (Acrylic)"}, selected="PETG")
example_number = GetNumber(Slider(0, range=0..20), AtLeast=1, AtMost=1, Maximum=1.797693135e+308, Minimum=-1.797693135e+308, TreeAccess=False)
ui_bridge = UIBridge(
    Enable=Toggle(True),
    Schema="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",
    SessionId="8-5V_rKg",
    Values="{\"1ea98803-e756-41af-b4ed-c1a527affd17\":\"PETG\",\"3a91923c-c5e3-4ea9-8afd-e71fe0b2dafd\":0,\"a3cce961-bfaa-4d89-89a5-29500b92d8e3\":\"4\"}")
material_2 = GetValueList(
    material,
    AtLeast=1,
    AtMost=1,
    Immediate=True,
    StoredItems="""[
  {
    "name": "Wood",
    "expression": "0"
  },
  {
    "name": "Copper",
    "expression": "1"
  },
  {
    "name": "Aluminum",
    "expression": "2"
  },
  {
    "name": "Steel",
    "expression": "3"
  },
  {
    "name": "Plastic",
    "expression": "4"
  }
]""",
    TreeAccess=False)
wood_2 = GetValueList(
    wood,
    AtLeast=1,
    AtMost=1,
    Immediate=True,
    StoredItems="""[
  {
    "name": "Oak",
    "expression": "Oak"
  },
  {
    "name": "Pine",
    "expression": "Pine"
  },
  {
    "name": "Birch",
    "expression": "Birch"
  },
  {
    "name": "Plywood",
    "expression": "Plywood"
  }
]""",
    TreeAccess=False)
copper_2 = GetValueList(
    copper,
    AtLeast=1,
    AtMost=1,
    Immediate=True,
    StoredItems="""[
  {
    "name": "C110 (ETP)",
    "expression": "C110 (ETP)"
  },
  {
    "name": "C101 (Oxygen-free)",
    "expression": "C101 (Oxygen-free)"
  },
  {
    "name": "Phosphor bronze",
    "expression": "Phosphor bronze"
  }
]""",
    TreeAccess=False)
aluminum_2 = GetValueList(
    aluminum,
    AtLeast=1,
    AtMost=1,
    Immediate=True,
    StoredItems="""[
  {
    "name": "6061-T6",
    "expression": "6061-T6"
  },
  {
    "name": "5052-H32",
    "expression": "5052-H32"
  },
  {
    "name": "7075-T6",
    "expression": "7075-T6"
  }
]""",
    TreeAccess=False)
steel_2 = GetValueList(steel, AtLeast=1, AtMost=1, Immediate=True, StoredItems="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", TreeAccess=False)
plastic_2 = GetValueList(
    plastic,
    AtLeast=1,
    AtMost=1,
    Immediate=True,
    StoredItems="""[
  {
    "name": "PLA",
    "expression": "PLA"
  },
  {
    "name": "ABS",
    "expression": "ABS"
  },
  {
    "name": "PETG",
    "expression": "PETG"
  },
  {
    "name": "PMMA (Acrylic)",
    "expression": "PMMA (Acrylic)"
  }
]""",
    TreeAccess=False)
evaluate_schema = EvaluateSchema(Schema=ui_bridge)  # -> Info, JSON, InputCount, OutputCount
stream_filter = StreamFilter(Gate=material_2, Stream0=wood_2, Stream1=copper_2, Stream2=aluminum_2, Stream3=steel_2, Stream4=plastic_2)
context_print = ContextPrint(CurrentMaterial=stream_filter)
panel = Panel(evaluate_schema.JSON)
