# Grasshopper definition table_example.gh (Grasshopper 1.0.8)
# plug-ins: Pufferfish, Selva

leg_radius = Slider(2.4, range=1.5..3)
leg_radius_2 = GetNumber(leg_radius, AtLeast=1, AtMost=1, Maximum=1.797693135e+308, Minimum=-1.797693135e+308, TreeAccess=False)
create_legs = GetBoolean(Toggle(False), AtLeast=1, AtMost=1, FalseValue="False", TreeAccess=False, TrueValue="True")
ui_bridge = UIBridge(Enable=Toggle(True), Schema="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", Values="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")
evaluate_schema = EvaluateSchema(Schema=ui_bridge)  # -> Info, JSON, InputCount, OutputCount
context_bake = ContextBake(Content=ui_bridge)
num_leg_width = Number(leg_radius_2)
boolean = Boolean(invert(create_legs))
panel = Panel(evaluate_schema.JSON)
series = Series(Start=0, Step=1, Count=Slider(20, range=0..100))
context_print = ContextPrint(PipiChanged=series)
boolean_2 = Boolean(boolean)

table_length_cm = Slider(200, range=100..500)
corner_radius = Slider(0, range=0..40)
leg_inset = Slider(6, range=0..20)
leg_width = Slider(2.4, range=1.5..3)
legstyle = ValueList({"Square": 0, "Cylindrical": 1, "NotDefined": 2}, selected="Square")
table_width_cm = Slider(200, range=100..250)
table_height = Slider(90, range=90..135)
table_length_cm_2 = Slider(2, range=1..6)

table_width = GetInteger(
    table_width_cm,
    AtLeast=1,
    AtMost=1,
    Maximum=2147483647,
    Minimum=-2147483648,
    Prompt="This is the table width",
    TreeAccess=False)
file_name = GetString("Table_Test", AtLeast=1, AtMost=1, TreeAccess=False)
table_length = GetInteger(table_length_cm, AtLeast=1, AtMost=1, Maximum=2147483647, Minimum=-2147483648, TreeAccess=False)
table_height_2 = GetInteger(table_height, AtLeast=1, AtMost=1, Maximum=2147483647, Minimum=-2147483648, TreeAccess=False)
table_thickness = GetNumber(table_length_cm_2, AtLeast=1, AtMost=1, Maximum=1.797693135e+308, Minimum=-1.797693135e+308, TreeAccess=False)
corner_radius_2 = GetNumber(corner_radius, AtLeast=1, AtMost=1, Maximum=1.797693135e+308, Minimum=-1.797693135e+308, TreeAccess=False)
leg_inset_2 = GetInteger(leg_inset, AtLeast=1, AtMost=1, Maximum=2147483647, Minimum=-2147483648, TreeAccess=False)
leg_width_2 = GetNumber(leg_width, AtLeast=1, AtMost=1, Maximum=1.797693135e+308, Minimum=-1.797693135e+308, TreeAccess=False)
leg_type = GetValueList(
    legstyle,
    AtLeast=1,
    AtMost=1,
    Immediate=True,
    StoredItems="""[
  {
    "name": "Square",
    "expression": "0"
  },
  {
    "name": "Cylindrical",
    "expression": "1"
  },
  {
    "name": "NotDefined",
    "expression": "2"
  }
]""",
    TreeAccess=False)

symetricdomain = SymetricDomain(A=table_width)
symetricdomain_2 = SymetricDomain(A=table_length)
num_tablethickness = Number(table_thickness)
num_cornerradius = Number(corner_radius_2)
num_leg_width_2 = Number(leg_width_2)
int_tableheight = Integer(table_height_2)
str_filename = Text(file_name)
dom_length = Domain(symetricdomain_2)
int_leginset = Integer(leg_inset_2)
dom_width = Domain(symetricdomain)
int_choice = Integer(leg_type)

num_tablethickness_2 = Number(num_tablethickness)
int_leginset_2 = Integer(int_leginset)

dom_length_2 = Domain(dom_length)
num_leg_width_3 = Number(num_leg_width_2)
dom_width_2 = Domain(dom_width)
rectangle = Rectangle(Plane=PlaneXY(0, 0, 0), XSize=dom_width_2, YSize=dom_length_2, Radius=0)  # -> Rectangle, Length
addition = Addition(A=int_leginset_2, B=num_leg_width_3)
negative = Negative(Value=addition)
offset_curve = OffsetCurve(Curve=rectangle.Rectangle, Distance=negative, Corners=1)
explode = Explode(Curve=offset_curve, Recursive=True)  # -> Segments, Vertices
pt_edge = Point(explode.Vertices)

num_cornerradius_2 = Number(num_cornerradius)

dom_width_3 = Domain(dom_width)
dom_length_3 = Domain(dom_length)
rectangle_2 = Rectangle(Plane=PlaneXY(0, 0, 0), XSize=dom_width_3, YSize=dom_length_3, Radius=num_cornerradius_2)  # -> Rectangle, Length
unit_z = UnitZ(Factor=num_tablethickness_2)
boundary_surfaces = BoundarySurfaces(Edges=rectangle_2.Rectangle)
extrude = Extrude(Base=boundary_surfaces, Direction=unit_z)
brep_tabletop = Brep(extrude)

duplicate_data = DuplicateData(Data=brep_tabletop, Number=Slider(10000, range=0..20000), Order=True)

num_leg_width_4 = Number(num_leg_width_2)
int_tableheight_2 = Integer(int_tableheight)
pt_edge_2 = Point(pt_edge)
symetricdomain_3 = SymetricDomain(A=num_leg_width_4)
unit_z_2 = UnitZ(Factor=int_tableheight_2)  # -> expr("x*-1", UnitVector)
rectangle_3 = Rectangle(Plane=pt_edge_2, XSize=symetricdomain_3, YSize=symetricdomain_3, Radius=0)  # -> Rectangle, Length
extrude_tapered_polysurface = ExtrudeTaperedPolysurface(Profile=rectangle_3.Rectangle, Direction=unit_z_2, Angle="-0.3", CornerType=0, FaceMerge=True)
brep_legsquare = Brep(extrude_tapered_polysurface)

num_leg_width_5 = Number(num_leg_width)
pt_edge_3 = Point(pt_edge)
int_tableheight_3 = Integer(int_tableheight)
diam_end = Slider(1.5, range=1..3)
line_sdl = LineSDL(Start=pt_edge_3, Direction=Vector(0, 0, -1), Length=int_tableheight_3)
merge = Merge(Data1=num_leg_width_5, Data2=diam_end)
pipe_variable = PipeVariable(Curve=line_sdl, Parameters=[0, 1], Radii=merge, Caps=1, FitRail=False)
brep_leground = Brep(pipe_variable)

volume = Volume(Geometry=duplicate_data, UseTasks=False)  # -> Volume, Centroid

int_choice_2 = Integer(int_choice)
brep_legsquare_2 = Brep(brep_legsquare)
brep_leground_2 = Brep(brep_leground)
stream_filter = StreamFilter(Gate=int_choice_2, Stream0=brep_legsquare_2, Stream1=brep_leground_2)

stream_filter_2 = StreamFilter(Gate=boolean_2, Stream0=stream_filter)

brep_legs = Brep(stream_filter_2)

three_material = ThreeMaterial(Color=ColourSwatch(SwatchColor=RGB(193, 154, 107)), Metalness=0, Roughness=0.5, Opacity=1, Transparent=False)
three_material_2 = ThreeMaterial(Color=ColourSwatch(SwatchColor=RGB(193, 154, 107)), Metalness=0, Roughness=0.5, Opacity=1, Transparent=False)
brep_tabletop_2 = Brep(brep_tabletop)
brep_legs_2 = Brep(brep_legs)
display = Display(Geo=brep_tabletop_2, TMaterial=three_material)
display_2 = Display(Geo=brep_legs_2, TMaterial=three_material_2)
merge_2 = Merge(Data1=display, Data2=display_2)  # -> flatten(Result)
context_bake_2 = ContextBake(Content=merge_2)

brep_tabletop_3 = Brep(brep_tabletop)  # disabled
brep_legs_3 = Brep(brep_legs)  # disabled
colour_swatch = ColourSwatch(SwatchColor=RGB(193, 154, 107))  # disabled
merge_3 = Merge(Data1=brep_tabletop_3, Data2=brep_legs_3)  # disabled
custom_preview = CustomPreview(Geometry=merge_3, Material=colour_swatch)  # disabled

brep_tabletop_4 = Brep(brep_tabletop)
str_filename_2 = Text(str_filename)
brep_legs_4 = Brep(brep_legs)
model_object = ModelObject(Geometry=brep_tabletop_4, Name="Table Top", Layer="Table Top")  # -> Object, Geometry, Name, Layer, Visibility, Display, Drafting, Render
model_object_2 = ModelObject(Geometry=brep_legs_4, Name="Legs", Layer="Legs")  # -> Object, Geometry, Name, Layer, Visibility, Display, Drafting, Render
merge_4 = Merge(Data1=model_object.Object, Data2=model_object_2.Object)
model_block_definition = ModelBlockDefinition(Objects=flatten(merge_4), Name="Table")  # -> BlockDefinition, Objects, Name
block_to_file = BlockToFile(Block=model_block_definition.BlockDefinition, FileName=str_filename_2)  # -> flatten(File)
context_bake_3 = ContextBake(Content=block_to_file)

# ==== cluster SymetricDomain
A = ClusterInput()
division = Division(A=A, B=2)
negative = Negative(Value=division)
construct_domain = ConstructDomain(DomainStart=division, DomainEnd=negative)
domain = ClusterOutput(construct_domain)
