# Grasshopper definition selva_example_0_1_0.gh (Grasshopper 1.0.8)
# plug-ins: Selva

gh_environement = GH_Environement()
enable = BooleanToggle(True)
copy_up = BooleanToggle(True)
types = ValueList({"Sphere": 0, "Cylinder": 1, "Box": 2}, selected="Box")
radius = Slider(15, range=10..20)
heigth = Slider(15, range=10..20)
width = Slider(15, range=10..20)
context_print = ContextPrint(IsCompute=gh_environement)
file_path = FilePath("C:\Users\Felix\Desktop\124520_557178_BETA-Blinkopf_BB.3dm")
ui_bridge = UIBridge(
    Enable=enable,
    Schema="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",
    SessionId="caqRCtvm",
    Values="{\"ac37cb43-0b39-43cd-a8ac-9e072342bcd0\":\"{\\\"file\\\":\\\"177452_905877_Trichter_Versteifung_RAWG.3dm\\\",\\\"type\\\":\\\"path\\\",\\\"fileEnding\\\":\\\".3dm\\\"}\"}")
evaluate_schema = EvaluateSchema(Schema=ui_bridge)  # -> Info, JSON, InputCount, OutputCount

copy_up_2 = GetBoolean(copy_up, AtLeast=1, AtMost=1, FalseValue="False", TreeAccess=False, TrueValue="True")
radius_2 = GetNumber(radius, AtLeast=1, AtMost=1, Maximum=1.797693135e+308, Minimum=-1.797693135e+308, TreeAccess=False)
heigth_2 = GetNumber(heigth, AtLeast=1, AtMost=1, Maximum=1.797693135e+308, Minimum=-1.797693135e+308, TreeAccess=False)
width_2 = GetNumber(width, AtLeast=1, AtMost=1, Maximum=1.797693135e+308, Minimum=-1.797693135e+308, TreeAccess=False)
get_file = GetFile(file_path, AtLeast=1, AtMost=1, Immediate=True, Prompt="Select a file to import", TreeAccess=False)
types_2 = GetValueList(
    types,
    AtLeast=1,
    AtMost=1,
    Immediate=True,
    StoredItems="""[
  {
    "name": "Sphere",
    "expression": "0"
  },
  {
    "name": "Cylinder",
    "expression": "1"
  },
  {
    "name": "Box",
    "expression": "2"
  }
]""",
    TreeAccess=False)

int_test = GetInteger(Slider(1, range=1..5), AtLeast=1, AtMost=1, Maximum=2147483647, Minimum=-2147483648, TreeAccess=False)
file = ContextBake(Content=ui_bridge)
brep = Brep(get_file)
panel = Panel(evaluate_schema.JSON)
cylinder = Cylinder(Base=PlaneXY(0, 0, 0), Radius=radius_2, Length=heigth_2)
sphere = Sphere(Base=PlaneXY(0, 0, 0), Radius=radius_2)
center_box = CenterBox(Base=PlaneXY(0, 0, 0), X=radius_2, Y=heigth_2, Z=width_2)
cap_holes = CapHoles(Brep=cylinder)
stream_filter = StreamFilter(Gate=types_2, Stream0=sphere, Stream1=cap_holes, Stream2=center_box)
bounding_box = BoundingBox(Content=stream_filter, Plane=PlaneXY(0, 0, 0))  # -> Box, Box_2
deconstruct_box = DeconstructBox(Box=bounding_box.Box)  # -> Plane, X, Y, Z
unit_z = UnitZ(Factor=deconstruct_box.Z)
multiplication = Multiplication(A=unit_z, B=int_test)
move = Move(Geometry=stream_filter, Motion=multiplication)  # -> Geometry, Transform
merge = Merge(Data1=stream_filter, Data2=move.Geometry)  # -> flatten(Result)
stream_filter_2 = StreamFilter(Gate=copy_up_2, Stream0=stream_filter, Stream1=merge)
three_material = ThreeMaterial(Color=RGB(255, 255, 255), Metalness=0, Roughness=0.5, Opacity=1, Transparent=False)

list_length = ListLength(List=stream_filter_2)
text = Text(types_2)
series = Series(Start=0, Step=1, Count=list_length)
concatenate = Concatenate(Fragment_A=text, A="_", Fragment_B=series)
model_object = ModelObject(Geometry=stream_filter_2, Name=concatenate, Layer=concatenate)  # -> Object, Geometry, Name, Layer, Visibility, Display, Drafting, Render
model_block_definition = ModelBlockDefinition(Objects=model_object.Object, Name="Blocky")  # -> BlockDefinition, Objects, Name
block_to_file = BlockToFile(Block=model_block_definition.BlockDefinition, Name="Boky")

display = Display(Geo=stream_filter_2, TMaterial=three_material)
area = Area(Geometry=stream_filter_2, UseTasks=True)  # -> Area, Centroid
geometry_to_file = GeometryToFile(Geometry=stream_filter_2, FileNames="Test", FileEnding=".3dm")
context_bake = ContextBake(DisplayOuput=display)
file_2 = ContextBake(FileOutput=geometry_to_file)
file_3 = ContextBake(Content=block_to_file)
area_2 = ContextPrint(Text=area.Area)
