# Grasshopper definition builder_test2.gh (Grasshopper 1.0.8)
# plug-ins: Selva

types = ValueList({"Sphere": 0, "Cylinder": 1, "Box": 2}, selected="Box")
radius = Slider(7, range=0..20)
heigth = Slider(10, range=10..20)
width = Slider(10, range=10..20)
c_script = CSharpScript()  # -> out, a
# ---------- c_script: C# ----------
// Grasshopper Script Instance
#region Usings
using System;
using System.Linq;
using System.Collections;
using System.Collections.Generic;
using System.Drawing;

using Rhino;
using Rhino.Geometry;

using Grasshopper;
using Grasshopper.Kernel;
using Grasshopper.Kernel.Data;
using Grasshopper.Kernel.Types;
#endregion

public class Script_Instance : GH_ScriptInstance
{
    #region Notes
    /* 
      Members:
        RhinoDoc RhinoDocument
        GH_Document GrasshopperDocument
        IGH_Component Component
        int Iteration

      Methods (Virtual & overridable):
        Print(string text)
        Print(string format, params object[] args)
        Reflect(object obj)
        Reflect(object obj, string method_name)
    */
    #endregion

    private void RunScript(object x, object y, ref object a)
    {
        // Write your logic here

        var ProjectFileName = this.GrasshopperDocument.Properties.ProjectFileName;
        var DocId = this.GrasshopperDocument.DocumentID;

       
        a =  this.GrasshopperDocument.DocumentID;
    }
}
# ---------- end c_script ----------

copy_up = GetBoolean("false", AtLeast=1, AtMost=1, FalseValue="False", TreeAccess=False, TrueValue="True")
radius_2 = GetNumber(radius, AtLeast=1, AtMost=1, Maximum=25, Minimum=5, TreeAccess=False)
width_2 = GetNumber(heigth, AtLeast=1, AtMost=1, Maximum=20, Minimum=5, TreeAccess=False)
heigth_2 = GetNumber(width, AtLeast=1, AtMost=1, Maximum=20, Minimum=5, TreeAccess=False)
get_value_list = GetValueList(
    types,
    AtLeast=1,
    AtMost=1,
    Immediate=True,
    StoredItems="""[
  {
    "name": "Sphere",
    "expression": "0"
  },
  {
    "name": "Cylinder",
    "expression": "1"
  },
  {
    "name": "Box",
    "expression": "2"
  }
]""",
    TreeAccess=False)

cylinder = Cylinder(Base=PlaneXY(0, 0, 0), Radius=radius_2, Length=heigth_2)
sphere = Sphere(Base=PlaneXY(0, 0, 0), Radius=radius_2)
center_box = CenterBox(Base=PlaneXY(0, 0, 0), X=radius_2, Y=width_2, Z=heigth_2)
cap_holes = CapHoles(Brep=cylinder)
stream_filter = StreamFilter(Gate=get_value_list, Stream0=sphere, Stream1=cap_holes, Stream2=center_box)
bounding_box = BoundingBox(Content=stream_filter, Plane=PlaneXY(0, 0, 0))  # -> Box, Box_2
deconstruct_box = DeconstructBox(Box=bounding_box.Box)  # -> Plane, X, Y, Z
unit_z = UnitZ(Factor=deconstruct_box.Z)
move = Move(Geometry=stream_filter, Motion=unit_z)  # -> Geometry, Transform
merge = Merge(Data1=stream_filter, Data2=move.Geometry)  # -> flatten(Result)
stream_filter_2 = StreamFilter(Gate=copy_up, Stream0=stream_filter, Stream1=merge)

geometry_to_file = GeometryToFile(Geometry=stream_filter_2, FileNames="Test", FileEnding=".3dm")

display = Display(Geo=stream_filter_2)
display_2 = ContextBake(Content=display)

area = Area(Geometry=stream_filter_2)  # -> Area, Centroid

bake = ContextBake(Content=geometry_to_file)
area_2 = ContextPrint(Print=area.Area)

ui_bridge = UIBridge(
    Enable=Toggle(True),
    Schema="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",
    SessionId="QPgZ4hYY",
    Values="{\"12e4b4b9-2767-426b-baa5-0a0e1bcd0a5b\":7,\"4a7cf1b2-03d2-4894-97b3-c2da6d9209a9\":\"Box\",\"d5efe509-6e2e-4b83-bfdb-6ad50bc31001\":10}")

schema = ContextPrint(Schema=ui_bridge)
