# Grasshopper definition bench-display.gh (Grasshopper 1.0.8)
# plug-ins: Selva

toggle = BooleanToggle(False)
panel = Panel("40")
count = GetNumber(Slider(50, range=50..100), AtLeast=1, AtMost=1, Maximum=1.797693135e+308, Minimum=-1.797693135e+308, TreeAccess=False)
ui_bridge = UIBridge(Enable=Toggle(True), Schema="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")  # -> Schema, URL
panel_3 = Panel("200")
metal = GetNumber(Slider(0.1, range=0.1..1), AtLeast=1, AtMost=1, Maximum=1.797693135e+308, Minimum=-1.797693135e+308, TreeAccess=False)
c_bake = ContextBake(Content=ui_bridge.Schema)
c_bake_2 = ContextBake(Content=ui_bridge.Schema)
random = Random(Range="0 to 200", Number=count, Seed="200")
random_2 = Random(Range="0 to 200", Number=count, Seed="232")
random_3 = Random(Range="0 to 200", Number=count, Seed="4232")
random_4 = Random(Range="5 to 20", Number=count, Seed="4232")
construct_point = ConstructPoint(XCoordinate=random, YCoordinate=random_2, ZCoordinate=random_3)
three_material = ThreeMaterial(Color=ColourSwatch(SwatchColor=RGB(255, 254, 255)), Metalness=metal, Roughness=0.5, Opacity=1, Transparent=False)
sphere = Sphere(Base=construct_point, Radius=random_4)
display = Display(Geo=sphere, TMaterial=three_material)
context_bake = ContextBake(WebDisplay=display)
